# Grasshopper definition Kangaroo_benchmark_grid.gh (Grasshopper 1.0.8)
# plug-ins: Heteroptera, Pufferfish, Human, LunchBox, Kangaroo2 Components, eleFront

pt = ConstructPoint(XCoordinate=0, YCoordinate=0, ZCoordinate=0)
X = UnitX(Factor=1)
line = LineSDL(Start=pt, Direction=X, Length=X)
len = Length(Curve=line)
end = EndPoints(Curve=line)  # -> Start, End
length_line = LengthLine(Line=line, Length=len, Strength=2)
anchor = Anchor(Point=pt, Strength=10000)
load = Load(Point=end.End, ForceVector=Vector(2, 0, 0), Weighting=1)
solver = Solver(GoalObjects=flatten([length_line, anchor, load]), Reset=Button(), Threshold=1e-15, Tolerance=0.0001, On=Toggle(False))  # -> I, V, O
len_2 = Length(Curve=solver.O)
item = ListItem(List=len_2, Index=0, Wrap=True)
panel = Panel(item)

Z = UnitZ(Factor=1)
Z_2 = UnitZ(Factor=0.5)
pt_2 = Point([<point referenced from the Rhino model> x5])
pt_3 = Point([<point referenced from the Rhino model> x4])
fonts = FontTable()
panel_2 = Panel(fonts)
item_2 = ListItem(List=panel_2, Index=131, Wrap=True)
textdot = DefineTextDot(Text="Free", Location=pt_2, Font=item_2, Size=20)
textdot_2 = DefineTextDot(Text="Fixed", Location=pt_3, Font=item_2, Size=20)

number_slider = Slider(2, range=0..10)
rectangle = Rectangle(Plane=PlaneXY(0, 0, 0), XSize=Domain(0, 2), YSize=Domain(0, 2), Radius=0)  # -> Rectangle, Length
grid = RectangleGrid(Rectangle=rectangle.Rectangle, Size=1, VSize=number_slider)  # -> Points, U, V
disc = Discontinuity(Curve=rectangle.Rectangle, Level=1)  # -> Points, Parameters
load_2 = Slider(2, range=0..10)
anchor_2 = Anchor(Point=disc.Points, Strength=10000)
Z_3 = UnitZ(Factor=load_2)

grid_2 = GridStructure(Surface=rectangle.Rectangle, UDivisions=number_slider, VDivisions=number_slider)  # -> StructureLines, StructureNodes

item_3 = ListItem(List=grid_2.StructureNodes, Index=Slider(4, range=0..10), Wrap=True)
load_3 = Load(Point=item_3, ForceVector=Z_3, Weighting=1)
len_3 = Length(Curve=grid_2.StructureLines)
length_line_2 = LengthLine(Line=grid_2.StructureLines, Length=len_3, Strength=2)
solver_2 = Solver(
    GoalObjects=flatten([length_line_2, anchor_2, load_3]),
    Reset=Button(),
    Threshold=1e-15,
    Tolerance=0.0001,
    On=Toggle(True))  # -> I, V, O
pt_4 = Point(solver_2.V)
pdecon = Deconstruct(Point=pt_4)  # -> XComponent, YComponent, ZComponent
bnd = Bounds(Numbers=pdecon.ZComponent)
panel_3 = Panel(bnd)

move = Move(Geometry=item_3, Motion=Z)  # -> Geometry, Transform
vec2pt = Vector2Pt(PointA=item_3, PointB=move.Geometry, Unitize=False)  # -> Vector, Length
move_2 = Move(Geometry=item_3, Motion=Z_2)  # -> Geometry, Transform
amp = Amplitude(Vector=vec2pt.Vector, Amplitude=0.4)
xz = XZPlane(Origin=move_2.Geometry)
xz_2 = XZPlane(Origin=move_2.Geometry)
vdisex = VectorDisplayEx(Point=item_3, Vector=amp, Colour=RGB(0, 0, 0), Width=4)
textdot_3 = DefineTextDot(Text="F = 2", Location=xz, Font=item_2, Size=20)
xz_3 = XZPlane(Origin=pt_4)
roundd = RoundToDecimalPlace(NumberX=pdecon.ZComponent, DecimalPlace=3, RoundType=0)  # -> Rounded, Difference
textdot_4 = DefineTextDot(Text=roundd.Rounded, Location=xz_3, Font=item_2, Size=20)
