# Grasshopper definition necto.gh (Grasshopper 1.0.8)
# plug-ins: Karamba3D, MeshEdit Components, Pufferfish, Weaverbird, Kiwi3d, eleFront, Sasquatch

# ----
# Parameters Formfinding (08/01/25 FINAL)
panel = Panel("""0
0.05
0.2
0.6
0.9
1""")
nonorientable_location = Panel("""0
0.5
0.7
1""")
panel_2 = Panel("""0
0.1
0.5
0.67
0.9
1""")
basecurve_a = Curve(<curve referenced from the Rhino model>)
non_orientable_support = Curve(<curve referenced from the Rhino model>)
basecurve_b = Curve(<curve referenced from the Rhino model>)
basecurve_c = Curve(<curve referenced from the Rhino model>)
basecurve_d = Curve(<curve referenced from the Rhino model>)
width = Slider(7.1, range=0..10)
length = Slider(7.1, range=0..10)
z_d = Slider(1.5, range=-10..10)
z_b = Slider(3.3, range=0..10)
number_slider = Slider(4, range=0..10)
number_slider_2 = Slider(4.1, range=0..10)
merge = Merge(Data1=basecurve_a, Data2=basecurve_b, Data3=basecurve_c, Data4=basecurve_d)
division = Division(A=length, B=-2)
division_2 = Division(A=width, B=2)

number_slider_3 = Slider(-1.632, range=-40..40)  # disabled
number_slider_4 = Slider(12.23, range=-40..40)  # disabled
pt = ConstructPoint(XCoordinate=number_slider_3, YCoordinate=number_slider_4, ZCoordinate=0)  # disabled
number_slider_5 = Slider(0, range=-180..180)  # disabled
curvepoint = PointOnCurve(parameter=0.5)
xz = XZPlane(Origin=pt)  # disabled
id = Guid(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)  # disabled
rotate = Rotate(Geometry=xz, Angle=degrees(number_slider_5), Plane=pt)  # -> Geometry, Transform; disabled
c_script = CSharpScript(id=id, pl=rotate.Geometry)  # -> out; inputs id: Guid, pl: Plane; disabled
# ---------- c_script: C# ----------
    var cp = new Rhino.DocObjects.ObjRef(id);
    var source = cp.ClippingPlaneSurface().Plane;
    RhinoDoc.ActiveDoc.Objects.Transform(id, Transform.PlaneToPlane(source, pl), true);
# ---------- end c_script ----------
crv = Curve(<curve referenced from the Rhino model>)
crv_2 = Curve(<curve referenced from the Rhino model>)
pt_2 = Point([<point referenced from the Rhino model> x69])
pt_3 = Point([<point referenced from the Rhino model> x117])
pt_4 = Point([<point referenced from the Rhino model> x81])
crv_3 = Curve(<curve referenced from the Rhino model>)
pt_5 = Point([<point referenced from the Rhino model> x21])
pt_6 = Point([<point referenced from the Rhino model> x21])
pt_7 = Point([<point referenced from the Rhino model> x37])
pt_8 = Point([<point referenced from the Rhino model> x21])
panel_3 = Panel("R")

toggle_transparent_background = BooleanToggle(True)  # disabled
# Animation Controller: This definition is to control the creation of animations from GH.
# 
# Inputs:
# 
# ToggleRun [boolean toggle] - Setting this to 'True' will automatically advanced the animation and slider until the slider reaches the maximum. Once it reaches the maximum, it will reset the slider and itself. Frames will only be saved when this is set to 'True'.
# 
# Timeline [slider] - Use the slider to scrobble through the animation when 'ToggleRun' is set to 'False'. When ToggleRun is set to 'True', this slider will auto-increment until it reaches its max. This slider's upper limit/maximum corresponds to the number of frames.
# 
# Path [panel] - The directory where the frames will be saved.
# 
# FrameName [panel] - The frame file name prefix.
# 
# Outputs: use these to drive animation elements.
# 
# TotalFrames [int] - the total number  of frames. This correspondds to the 'Timeline' slider's range. Change the 'Timeline' Minimim and Maxmimim to affect this.
# 
# CurrentFrame [int] - The current frame.
timeline = Slider(256, range=0..300)  # disabled
path = Panel("C:\Users\nicla\Desktop\University\Master DTU\Master Thesis\Principal stress rationalization\Final_model_25\animation")  # disabled
frame_height = Panel("2160")
frame_width = Panel("4096")
framename = Panel("test_1")
togglerun = BooleanToggle(False)  # disabled

# ---- group: Camera Path
crv_4 = Curve(reparameterize(<curve referenced from the Rhino model>))  # disabled

# ---- group: Camera Target
pt_9 = Point(Point(-1, 2, 0))  # disabled

# ----
c_script_2 = CSharpScript(
    run=togglerun,
    currentFrame=timeline,
    path=path,
    frameName=framename,
    frameWidth=frame_width,
    frameHeight=frame_height,
    transparentBackground=toggle_transparent_background)  # -> out, TotalFrames, CurrentFrame; inputs run: Boolean, currentFrame: Int32, path: String, frameName: String, frameWidth: Int32, frameHeight: Int32, transparentBackground: Boolean; disabled
# ---------- c_script_2: C# usings ----------
using System.IO;
using System.Linq;
using System.Data;
using System.Drawing;
using System.Reflection;
using System.Windows.Forms;
using System.Xml;
using System.Xml.Linq;
using System.Runtime.InteropServices;

using Rhino.DocObjects;
using Rhino.Collections;
using GH_IO;
using GH_IO.Serialization;
# ---------- c_script_2: C# ----------
    slider = GrasshopperDocument.Objects.Where(o => o.NickName == "Timeline").First() as Grasshopper.Kernel.Special.GH_NumberSlider;
    toggle = GrasshopperDocument.Objects.Where(o => o.NickName == "ToggleRun").First() as Grasshopper.Kernel.Special.GH_BooleanToggle;
    totalFrames = (int) slider.Slider.Maximum - (int) slider.Slider.Minimum;
    TotalFrames = totalFrames;
    CurrentFrame = currentFrame;

    if(currentFrame == (int) slider.Slider.Maximum && run )
    {
      toggle.Value = false;
      running = false;
      slider.TrySetSliderValue(frameAtStart);
      cnt = frameAtStart;
      toggle.ExpireSolution(true);
      return;
    }

    //Component.Message = (int) slider.Slider.Value + "/" + TotalFrames + " Frames";
    Component.Message = "";

    if(run)
    {

      //init
      if(!running)
      {
        frameAtStart = currentFrame;
        cnt = frameAtStart;
        running = true;
      }

      //do image saving
      var view = RhinoDocument.Views.ActiveView;
      var capture = new Rhino.Display.ViewCapture
        {
          Width = frameWidth > 0 ? frameWidth : view.ActiveViewport.Size.Width,
          Height = frameHeight > 0 ? frameHeight : view.ActiveViewport.Size.Height,
          ScaleScreenItems = false,
          DrawAxes = false,
          DrawGrid = false,
          DrawGridAxes = false,
          TransparentBackground = transparentBackground
          };


      var bitmap = capture.CaptureToBitmap(view);

      if (null != bitmap)
      {
        if(!Directory.Exists(path))
          Print("{0}", Directory.CreateDirectory(path));

        var filename = Path.Combine(path, frameName + "_" + currentFrame + ".png");
        bitmap.Save(filename, System.Drawing.Imaging.ImageFormat.Png);
      }

      //auto increment slider
      slider.TrySetSliderValue(cnt++);
      CurrentFrame = cnt;

      toggle.ExpireSolution(true);

    }
# ---------- c_script_2: C# additional code ----------
  int totalFrames = 0;
  int frameAtStart = 0;
  bool running = false;
  int cnt = 0;

  Grasshopper.Kernel.Special.GH_NumberSlider slider = new Grasshopper.Kernel.Special.GH_NumberSlider();
  Grasshopper.Kernel.Special.GH_BooleanToggle toggle = new Grasshopper.Kernel.Special.GH_BooleanToggle();
# ---------- end c_script_2 ----------

# ---- group: Step
panel_4 = Panel("1")  # disabled
division_3 = Division(A=panel_4, B=c_script_2.TotalFrames)  # disabled
multiplication = Multiplication(A=c_script_2.CurrentFrame, B=division_3)  # disabled

# ----
panel_5 = Panel([c_script_2.TotalFrames, c_script_2.CurrentFrame])  # disabled
panel_6 = Panel(c_script_2.out)  # disabled
eval = EvaluateCurve(Curve=crv_4, Parameter=multiplication)  # -> Point, Tangent, Angle; disabled

# ---- group: Position Camera
c_script_3 = CSharpScript(camPosition=eval.Point, camTarget=pt_9)  # -> out, A; inputs camPosition: Point3d, camTarget: Point3d; disabled
# ---------- c_script_3: C# ----------
    RhinoDocument.Views.ActiveView.ActiveViewport.SetCameraLocations(camTarget, camPosition);
# ---------- end c_script_3 ----------

# ----
Z = UnitZ(Factor="-1")
matselect = MaterialSelectionKaramba3D(menu=[dropdown(7), dropdown(8)])

# ----
# Loads - Karamba
panel_7 = Panel("-12")
loads = LoadsKaramba3D(Vector=Vector(0, 0, -1), LCase="LC0", mode="Gravity")
loads_2 = LoadsKaramba3D(Eps0=panel_7, LCase="LC0", mode="InitialStrain")
# KARAMBA
loads_3 = LoadKaramba3D([loads, loads_2])

pt_10 = ConstructPoint(XCoordinate="-1.5", YCoordinate="2.117", ZCoordinate="0.53")
pt_11 = Point(<point referenced from the Rhino model>)
pt_12 = Point([<point referenced from the Rhino model> x13])
pt_13 = Point(<point referenced from the Rhino model>)
pt_14 = Point([<point referenced from the Rhino model> x10])
pt_15 = Point(<point referenced from the Rhino model>)
item = ListItem(List=pt_12, Index=11, Wrap=True)
replace = ReplaceItems(List=pt_12, Item=pt_13, Indices="11", Wrap=False)
replace_2 = ReplaceItems(List=replace, Item=pt_11, Indices="2", Wrap=False)
ins = InsertItems(List=replace_2, Item=pt_15, Indices=0, Wrap=True)
cull_i = CullIndex(List=ins, Indices=Slider(11, range=0..14), Wrap=True)
sph = Sphere(Base=cull_i, Radius=0.12)
preview = CustomPreview(Geometry=sph, Material=ColourSwatch(SwatchColor=RGB(0, 0, 0)))
pt_16 = Point([<point referenced from the Rhino model> x2])
pt_17 = Point([Point(-3.639755401, -4.736860721, 0.8536745183), Point(-3.476732148, -4.748841773, 0.8469792036), Point(-3.241276324, -4.699018186, 0.8769003747), Point(-3.27046847, -4.891295696, 0.729430315), Point(-2.173510424, -1.301847198, 5.656115955), Point(-2.192531058, -1.177720837, 5.655584154)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])
crv_5 = Curve([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])
crv_6 = Curve([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])
pt_18 = Point()
index = ItemIndex(List=pt_17, Item=pt_17)
panel_8 = Panel("0.1")  # disabled
textdot = DefineTextDot(Text=index, Location=pt_17, Font="Arial", Size=14)
relay = Relay()
Z_2 = UnitZ(Factor=1)

degenrate_curves_1 = Curve([<curve referenced from the Rhino model> x30])
# PSL
# 3. Draw and import topological skeleton
degenrate_curves_2 = Curve([<curve referenced from the Rhino model> x27])

pt_19 = Point(<point referenced from the Rhino model>)
crv_7 = Curve(Tree({0;0}: [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], {0;0;0}: [], {0;1}: [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], {0;1;0}: [], {0;2}: [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], {0;2;0}: []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))
crv_8 = Curve(Tree({0;0}: [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], {0;1}: [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], {0;2}: [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], {0;3}: [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], {0;4}: [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], {0;5}: [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]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))
crv_9 = Curve()
timeline_2 = Slider(72, range=0..300)
panel_9 = Panel("0")
crv_10 = Curve([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])
crv_11 = Curve([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])
join = JoinCurves(Curves=flatten([crv_10, crv_11]), Preserve=False)
len = Length(Curve=crv_10)
panel_10 = Panel(crv_10)
panel_11 = Panel("300")
sort = SortList(Keys=len, ValuesA=crv_10)  # -> Keys, ValuesA
relay_2 = Relay([crv_6, crv_5])
list = ValueList({"AngularDimension", "Arc", "Block", "Brep", "Circle", "Curve", "Dimension", "Ellipse", "Extrusion", "Hatch", "Leader", "Line", "LinearDimension", "Mesh", "Point", "Polyline", "Polysurface", "RadialDimension", "Surface", "Text", "TextDot"}, selected="Curve")
swatch = ColourSwatch(SwatchColor=RGB(59, 175, 225))
traced_segments = Curve([<curve referenced from the Rhino model> x4])
crv_12 = Curve(reparameterize(<curve referenced from the Rhino model>))

# ---- group: Camera Target
pt_20 = Point(<point referenced from the Rhino model>)

# ----
crv_13 = Curve([<curve referenced from the Rhino model> x146])
shatter = Shatter(Curve=crv_12, Parameters=0.99)
preview_2 = CustomPreview(Geometry=traced_segments, Material=ColourSwatch(SwatchColor=RGB(172, 18, 223)))
swatch_2 = ColourSwatch(SwatchColor=RGB(136, 154, 0))
item_2 = ListItem(List=shatter, Index=1, Wrap=True)

# ---- group: Camera Path
crv_14 = Curve(reparameterize(<curve referenced from the Rhino model>))

# ----
crv_15 = Curve([<curve referenced from the Rhino model> x146])
crv_16 = Curve(reparameterize([<curve referenced from the Rhino model> x17]))
join_2 = JoinCurves(Curves=crv_16, Preserve=False)  # -> reparameterize(Curves)
swatch_3 = ColourSwatch(SwatchColor=RGB(131, 222, 20))
panel_12 = Panel("2")
crv_17 = Curve([<curve referenced from the Rhino model> x461])

toggle_transparent_background_2 = BooleanToggle(True)
togglerun_2 = BooleanToggle(False)
timeline_3 = Slider(255, range=0..255)
path_2 = Panel("C:\Users\nicla\Desktop\University\Master DTU\Master Thesis\Principal stress rationalization\Test_041224\Methodology\Paper\images")
frame_height_2 = Panel("2160")
frame_width_2 = Panel("4096")
framename_2 = Panel("topo_1_psl_2")

remap = RemapNumbers(Value=timeline_3, Source=Domain(0, 255), Target=Domain(0, 1))  # -> Mapped, Clipped
eval_2 = EvaluateCurve(Curve=reparameterize(join_2), Parameter=remap.Mapped)  # -> Point, Tangent, Angle
crv_cp = CurveClosestPoint(Point=eval_2.Point, Curve=reparameterize(join_2))  # -> Point, Parameter, Distance
pframe = PerpFrame(Curve=reparameterize(join_2), Parameter=crv_cp.Parameter)
cir = Circle(Plane=pframe, Radius=0.3)
shatter_2 = Shatter(Curve=reparameterize(join_2), Parameters=crv_cp.Parameter)
boundary = BoundarySurfaces(Edges=cir)
split = SplitWithBrep(Curve=reparameterize(join_2), Brep=boundary)  # -> Curve, Points
subtraction = Subtraction(A="255", B=timeline_3)
item_3 = ListItem(List=split.Curve, Index=0, Wrap=True)
rgb = ColourRGB(Alpha=subtraction, Red="255", Green="36", Blue="36")
item_4 = ListItem(List=item_3, Index=0, Wrap=True)
rgb_2 = ColourRGB(Alpha="255", Red="136", Green="154", Blue="0")
curve_display = CSharpScript(Curve=item_4, Width="4", Colour=rgb_2)  # inputs Curve: Curve, Width: Int32, Colour: Color, Dash: String
# ---------- curve_display: C# ----------
    if (Curve == null) return;
    if (Width <= 0) return;

    double[] pattern = ParseDashPattern(Dash);
    IEnumerable<Curve> segments = ApplyDashPattern(Curve, pattern);

    _clip = BoundingBox.Union(_clip, Curve.GetBoundingBox(false));
    foreach (Curve segment in segments)
    {
      _curves.Add(segment);
      _colors.Add(Colour);
      _widths.Add(Width);
    }
# ---------- curve_display: C# additional code ----------
  /// <summary>
  /// Parse a dash pattern.
  /// </summary>
  /// <param name="pattern">Pattern to parse.</param>
  /// <returns>Array of dashes and gaps.</returns>
  private double[] ParseDashPattern(string pattern)
  {
    if (string.IsNullOrWhiteSpace(pattern))
      return null;

    string[] fragments = pattern.Split(new char[] {' '});
    if (fragments == null || fragments.Length == 0)
      return null;

    double[] values = new double[fragments.Length];
    for (int i = 0; i < fragments.Length; i++)
    {
      double v;
      if (!double.TryParse(fragments[i], out v))
        throw new Exception(fragments[i] + " is a not a valid number.");

      if (v <= 0.0)
        throw new Exception("Dashes or gaps must have a strictly positive length.");

      values[i] = v;
    }

    return values;
  }
  /// <summary>
  /// Apply a dash+gap pattern to a curve.
  /// </summary>
  private IEnumerable<Curve> ApplyDashPattern(Curve curve, double[] pattern)
  {
    if (pattern == null || pattern.Length == 0)
      return new Curve[] { curve };

    double curveLength = curve.GetLength();
    List<Curve> dashes = new List<Curve>();

    double offset0 = 0.0;
    int index = 0;
    while(true)
    {
      // Get the current dash length.
      double dashLength = pattern[index++];
      if (index >= pattern.Length)
        index = 0;

      // Compute the offset of the current dash from the curve start.
      double offset1 = offset0 + dashLength;
      if (offset1 > curveLength)
        offset1 = curveLength;

      // Solve the curve parameters at the current dash start and end.
      double t0, t1;
      curve.LengthParameter(offset0, out t0);
      curve.LengthParameter(offset1, out t1);

      Curve dash = curve.Trim(t0, t1);
      if (dash != null)
        dashes.Add(dash);

      // Get the current gap length.
      double gapLength = pattern[index++];
      if (index >= pattern.Length)
        index = 0;

      // Set the start of the next dash to be the end of the current
      // dash + the length of the adjacent gap.
      offset0 = offset1 + gapLength;

      // Abort when we've reached the end of the curve.
      if (offset0 >= curveLength)
        break;
    }

    return dashes;
  }

  private BoundingBox _clip;
  private readonly List<Curve> _curves = new List<Curve>();
  private readonly List<Color> _colors = new List<Color>();
  private readonly List<int> _widths = new List<int>();

  /// <summary>
  /// This method will be called once every solution, before any calls to RunScript.
  /// </summary>
  public override void BeforeRunScript()
  {
    _clip = BoundingBox.Empty;
    _curves.Clear();
    _colors.Clear();
    _widths.Clear();
  }

  /// <summary>
  /// Return a BoundingBox that contains all the geometry you are about to draw.
  /// </summary>
  public override BoundingBox ClippingBox
  {
    get { return _clip; }
  }
  /// <summary>
  /// Draw all wires and points in this method.
  /// </summary>
  public override void DrawViewportWires(IGH_PreviewArgs args)
  {
    for (int i = 0; i < _curves.Count; i++)
      args.Display.DrawCurve(_curves[i], _colors[i], _widths[i]);
  }
# ---------- end curve_display ----------
rgb_3 = ColourRGB(Alpha="255", Red="255", Green="36", Blue="36")
crv_18 = Curve(<curve referenced from the Rhino model>)
panel_13 = Panel("0.05")
crv_19 = Curve([<curve referenced from the Rhino model> x4])
crv_20 = Curve(<curve referenced from the Rhino model>)
swatch_4 = ColourSwatch(SwatchColor=RGBA(255, 36, 36, 198))
preview_3 = CustomPreview(Geometry=crv_13, Material=swatch_4)
crv_21 = Curve(<curve referenced from the Rhino model>)
crv_22 = Curve(<curve referenced from the Rhino model>)
crv_23 = Curve([<curve referenced from the Rhino model> x38])
crv_24 = Curve(<curve referenced from the Rhino model>)
psl2 = Curve([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])
crv_25 = Curve(<curve referenced from the Rhino model>)
mp = MultiPipe(Curves=crv_16, NodeSize=0.035, EndOffset=1, StrutSize=1, Segment=0, KinkAngle=0.1, CubeFit=0, Caps=0)
crv_26 = Curve(<curve referenced from the Rhino model>)
crv_27 = Curve(<curve referenced from the Rhino model>)
crv_28 = Curve(<curve referenced from the Rhino model>)
curve_display_2 = CSharpScript(Curve=psl2, Width="2", Colour=swatch_4)  # inputs Curve: Curve, Width: Int32, Colour: Color, Dash: String
# ---------- curve_display_2: C# ----------
    if (Curve == null) return;
    if (Width <= 0) return;

    double[] pattern = ParseDashPattern(Dash);
    IEnumerable<Curve> segments = ApplyDashPattern(Curve, pattern);

    _clip = BoundingBox.Union(_clip, Curve.GetBoundingBox(false));
    foreach (Curve segment in segments)
    {
      _curves.Add(segment);
      _colors.Add(Colour);
      _widths.Add(Width);
    }
# ---------- curve_display_2: C# additional code ----------
  /// <summary>
  /// Parse a dash pattern.
  /// </summary>
  /// <param name="pattern">Pattern to parse.</param>
  /// <returns>Array of dashes and gaps.</returns>
  private double[] ParseDashPattern(string pattern)
  {
    if (string.IsNullOrWhiteSpace(pattern))
      return null;

    string[] fragments = pattern.Split(new char[] {' '});
    if (fragments == null || fragments.Length == 0)
      return null;

    double[] values = new double[fragments.Length];
    for (int i = 0; i < fragments.Length; i++)
    {
      double v;
      if (!double.TryParse(fragments[i], out v))
        throw new Exception(fragments[i] + " is a not a valid number.");

      if (v <= 0.0)
        throw new Exception("Dashes or gaps must have a strictly positive length.");

      values[i] = v;
    }

    return values;
  }
  /// <summary>
  /// Apply a dash+gap pattern to a curve.
  /// </summary>
  private IEnumerable<Curve> ApplyDashPattern(Curve curve, double[] pattern)
  {
    if (pattern == null || pattern.Length == 0)
      return new Curve[] { curve };

    double curveLength = curve.GetLength();
    List<Curve> dashes = new List<Curve>();

    double offset0 = 0.0;
    int index = 0;
    while(true)
    {
      // Get the current dash length.
      double dashLength = pattern[index++];
      if (index >= pattern.Length)
        index = 0;

      // Compute the offset of the current dash from the curve start.
      double offset1 = offset0 + dashLength;
      if (offset1 > curveLength)
        offset1 = curveLength;

      // Solve the curve parameters at the current dash start and end.
      double t0, t1;
      curve.LengthParameter(offset0, out t0);
      curve.LengthParameter(offset1, out t1);

      Curve dash = curve.Trim(t0, t1);
      if (dash != null)
        dashes.Add(dash);

      // Get the current gap length.
      double gapLength = pattern[index++];
      if (index >= pattern.Length)
        index = 0;

      // Set the start of the next dash to be the end of the current
      // dash + the length of the adjacent gap.
      offset0 = offset1 + gapLength;

      // Abort when we've reached the end of the curve.
      if (offset0 >= curveLength)
        break;
    }

    return dashes;
  }

  private BoundingBox _clip;
  private readonly List<Curve> _curves = new List<Curve>();
  private readonly List<Color> _colors = new List<Color>();
  private readonly List<int> _widths = new List<int>();

  /// <summary>
  /// This method will be called once every solution, before any calls to RunScript.
  /// </summary>
  public override void BeforeRunScript()
  {
    _clip = BoundingBox.Empty;
    _curves.Clear();
    _colors.Clear();
    _widths.Clear();
  }

  /// <summary>
  /// Return a BoundingBox that contains all the geometry you are about to draw.
  /// </summary>
  public override BoundingBox ClippingBox
  {
    get { return _clip; }
  }
  /// <summary>
  /// Draw all wires and points in this method.
  /// </summary>
  public override void DrawViewportWires(IGH_PreviewArgs args)
  {
    for (int i = 0; i < _curves.Count; i++)
      args.Display.DrawCurve(_curves[i], _colors[i], _widths[i]);
  }
# ---------- end curve_display_2 ----------
crv_29 = Curve(<curve referenced from the Rhino model>)
crv_30 = Curve(<curve referenced from the Rhino model>)
crv_31 = Curve(<curve referenced from the Rhino model>)
crv_32 = Curve(<curve referenced from the Rhino model>)
curve_display_3 = CSharpScript(
    Curve=[crv_19, crv_18, crv_20, crv_26, crv_22, crv_30, crv_31, crv_32, crv_29, crv_27, crv_28, crv_24, crv_21, crv_25],
    Width="4",
    Colour=rgb_2)  # inputs Curve: Curve, Width: Int32, Colour: Color, Dash: String; same code as curve_display
c_script_4 = CSharpScript(
    run=togglerun_2,
    currentFrame=timeline_3,
    path=path_2,
    frameName=framename_2,
    frameWidth=frame_width_2,
    frameHeight=frame_height_2,
    transparentBackground=toggle_transparent_background_2)  # -> out, TotalFrames, CurrentFrame; inputs run: Boolean, currentFrame: Int32, path: String, frameName: String, frameWidth: Int32, frameHeight: Int32, transparentBackground: Boolean; same code as c_script_2
preview_4 = CustomPreview(Geometry=mp, Material=swatch)

# ---- group: Camera Path
crv_33 = Curve(reparameterize(crv_14))

# ---- group: Camera Target
pt_21 = Point(Point(2.542722123, 0, -1.465989405))

# ---- group: Step
division_4 = Division(A="1", B=c_script_4.TotalFrames)
multiplication_2 = Multiplication(A=c_script_4.CurrentFrame, B=division_4)

# ----
panel_14 = Panel([c_script_4.TotalFrames, c_script_4.CurrentFrame])
end = EndPoints(Curve=crv_33)  # -> Start, End
panel_15 = Panel(c_script_4.out)
eval_3 = EvaluateCurve(Curve=crv_33, Parameter=multiplication_2)  # -> Point, Tangent, Angle

# ---- group: Position Camera
c_script_5 = CSharpScript(camPosition=end.End, camTarget=pt_21)  # -> out, A; inputs camPosition: Point3d, camTarget: Point3d; same code as c_script_3

# ----
panel_16 = Panel("""-1
1""")
panel_17 = Panel("""1.6
0.5""")
Z_3 = UnitZ(Factor=panel_16)
psl_1 = Curve(graft([<curve referenced from the Rhino model> x972]))
segmentation_lines = Curve(reparameterize([<curve referenced from the Rhino model> x23]))
midpt = CurveMiddle(Curve=segmentation_lines)
md_slider = MDSlider(SliderMode=0, slider_value=Point(0.5, 0.5, 0.5), x_domain=Domain(0, 1), y_domain=Domain(0, 1), z_domain=Domain(0, 1))
psl_1_2 = Curve(simplify(psl_1))
merge_2 = Merge()
Z_4 = UnitZ(Factor="-1")
srf = Surface(<surface referenced from the Rhino model>)
xy = XYPlane(Origin=Point(0, 0, 0))
xy_2 = XYPlane(Origin=Point(0, 0, 0))
project = Project(Curve=segmentation_lines, Brep=srf, Direction=Z_4)
srf_cp = SurfaceClosestPoint()  # -> Point, UVPoint, Distance

# ----
# Initial mesh construction
cluster = Cluster(
    data_12=Slider(0.76, range=0..1),
    data_13=Slider(0.25, range=0..1),
    data=division,
    Z_3=number_slider,
    data_2=division_2,
    B=width,
    Z=z_b,
    data_9=Slider(0.33, range=0..1),
    data_10=Slider(0.71, range=0..1),
    B_2=length,
    Z_2=z_d,
    data_5=panel_2,
    Z_4=number_slider_2,
    data_6=Slider(40, range=0..100),
    base_curves_outriggers=merge,
    data_7=Slider(28, range=0..100),
    big_funnel=panel,
    B_5=nonorientable_location,
    support_down=non_orientable_support)  # -> bc_pt, R, ad_2, ad_pt, cd_2, bc_2, ab_pts, ab_2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
# Weld meshes and unify
mjoin = MeshJoin(Meshes=flatten(cluster.R))

wbjoin = WeaverbirdsJoinMeshesAndWeld(Mesh=mjoin, Weld=True)

unifynormals = MeshUnifyNormals(Mesh=wbjoin)
initial_mesh = Mesh(unifynormals)

refine = Refine(Mesh=initial_mesh, Level=1)
demesh = DeconstructMesh(Mesh=refine)  # -> Vertices, Faces, Colours, Normals
crv_cp_2 = CurveClosestPoint(Point=demesh.Vertices, Curve=crv)  # -> Point, Parameter, Distance
crv_cp_3 = CurveClosestPoint(Point=demesh.Vertices, Curve=crv_2)  # -> Point, Parameter, Distance
pt_22 = Point(demesh.Vertices)
smaller = SmallerThan(FirstNumber=crv_cp_2.Distance, SecondNumber=0.001)  # -> SmallerThan, OrEqualTo
smaller_2 = SmallerThan(FirstNumber=crv_cp_3.Distance, SecondNumber=0.001)  # -> SmallerThan, OrEqualTo
cull = CullPattern(List=crv_cp_2.Point, CullPattern=smaller.SmallerThan)
cull_2 = CullPattern(List=crv_cp_3.Point, CullPattern=smaller_2.SmallerThan)

# ----
# Anchor definition - Kangaroo
anchor_points_outrigger = Point(flatten([cluster.basepoint_outriggers, pt_4, pt_2, pt_3]))
anchor_points_column = Point(flatten([pt_6, pt_5, pt_8, pt_7]))
extra_points = Point(cluster.extra_points_2)  # disabled
target_curve_top_funnel = Curve(reparameterize(<curve referenced from the Rhino model>))
hanging_funnel_points = Point(cull_2)
points_top_funnel = Point(cull)
target_curve_hanging_funnel = Curve(reparameterize(<curve referenced from the Rhino model>))
explode_tree = ExplodeTree(Data=anchor_points_column)  # -> Branch0, Branch1, Branch2, Branch3, Branch4
merge_3 = Merge(Data1=anchor_points_outrigger, Data2=extra_points)  # -> flatten(Result)
avr = Average(Input=points_top_funnel)
avr_2 = Average(Input=hanging_funnel_points)
sortptpolar = SortPointsPolar(Points=points_top_funnel, ReferncePlane=avr)  # -> SortedPoints, SortedValues
sortptpolar_2 = SortPointsPolar(Points=hanging_funnel_points, ReferncePlane=avr_2)  # -> SortedPoints, SortedValues
pt_23 = Point([explode_tree.Branch1, explode_tree.Branch3, explode_tree.Branch0, explode_tree.Branch4])
# KANGAROO
cullpt = CullDuplicates(Points=flatten(merge_3), Tolerance=0.0001, CullMode=3)  # -> Points, Indices, Valence
cullpt_2 = CullDuplicates(Points=sortptpolar.SortedPoints, Tolerance=0.001, CullMode=3)  # -> Points, Indices, Valence
cullpt_3 = CullDuplicates(Points=sortptpolar_2.SortedPoints, Tolerance=0.001, CullMode=3)  # -> Points, Indices, Valence
lng = ListLength(List=cullpt_3.Points)
lng_2 = ListLength(List=cullpt_2.Points)
cullpt_4 = CullDuplicates(Points=flatten(pt_23), Tolerance=0.0001, CullMode=3)  # -> Points, Indices, Valence
divide = DivideCurve(Curve=target_curve_hanging_funnel, Count=lng, Kinks=False)  # -> Points, Tangents, Parameters
divide_2 = DivideCurve(Curve=target_curve_top_funnel, Count=lng_2, Kinks=False)  # -> Points, Tangents, Parameters
anchor_strength = Slider(1000000, range=0..1000000)
shift = ShiftList(List=divide.Points, Shift=Slider(26, range=0..30), Wrap=True)
shift_2 = ShiftList(List=divide_2.Points, Shift=Slider(21, range=0..30), Wrap=True)
anchor_points_hanging_funnel = Point(shift)
anchor_points_top_funnel = Point(shift_2)
anchor = Anchor(Point=flatten(cullpt_4.Points), Strength=1000000000)
anchor_2 = Anchor(Point=cullpt.Points, Strength=anchor_strength)
anchor_3 = Anchor(Point=cullpt_2.Points, Target=anchor_points_top_funnel, Strength=anchor_strength)
anchor_4 = Anchor(Point=cullpt_3.Points, Target=anchor_points_hanging_funnel, Strength=anchor_strength)
anchor_points_columns = Point(pt_23)
anchor_points_outriggers = Point(merge_3)
anchor_points_top_funnel_2 = Point(anchor_points_top_funnel)
anchor_points_hanging_funnel_2 = Point(anchor_points_hanging_funnel)
all_target_anchor_points = Entwine(
    Branch00=anchor_points_hanging_funnel_2,
    Branch01=anchor_points_top_funnel_2,
    Branch02=anchor_points_columns,
    Branch03=anchor_points_outriggers,
    FlattenInputs=True)  # -> flatten(Result)
cullpt_5 = CullDuplicates(Points=flatten(all_target_anchor_points), Tolerance=0.0001, CullMode=3)  # -> Points, Indices, Valence
anchor_points_kangaroo = Data(flatten([anchor_3, anchor_2, anchor_4, anchor]))

pline = PolyLine(Vertices=anchor_points_outrigger, Closed=False)

# ----
# Vertex loads - kangaroo
initial_mesh_2 = Mesh(refine)
vertexloads = VertexLoads(Mesh=initial_mesh_2, Strength=expr("-x", Slider(0.01, range=0.01..1)))

initial_mesh_3 = Mesh(refine)
show = Show(G=initial_mesh_3)

ln = Line(StartPoint=anchor_points_hanging_funnel, EndPoint=cullpt_3.Points)
pt_24 = Point(hanging_funnel_points)
all_initial_anchor_points = Entwine(
    Branch00=cullpt_3.Points,
    Branch01=cullpt_2.Points,
    Branch02=anchor_points_columns,
    Branch03=anchor_points_outriggers,
    FlattenInputs=True)  # -> flatten(Result)
cullpt_6 = CullDuplicates(Points=flatten(all_initial_anchor_points), Tolerance=0.0001, CullMode=3)  # -> Points, Indices, Valence

# ----
# Target Anchor pts
all_target_anchor_points_2 = Point(cullpt_5.Points)

# ----
# Initial Anchor pts
all_initial_anchor_points_2 = Point(cullpt_6.Points)

# ----
# Kangaroo - set line lengths
# inner egdes
# Slid - cable
# outer edges
initial_mesh_4 = Mesh(refine)
medges = MeshEdges(Mesh=initial_mesh_4)  # -> NakedEdges, InteriorEdges, NonManifoldEdges
range = Range(Domain=Domain(500, 700), Steps=1100)
item_5 = ListItem(List=medges.NakedEdges, Index=range, Wrap=True)
factor = Slider(0.2, range=0..1)
number_slider_6 = Slider(50, range=1..50)
factor_2 = Slider(0, range=0..1)
factor_3 = Slider(0.19, range=0..0.5)
len_2 = Length(Curve=medges.InteriorEdges)
multiplication_3 = Multiplication(A=len_2, B=factor_3)
length_line = LengthLine(Line=medges.InteriorEdges, Length=multiplication_3, Strength=Slider(30, range=1..50))

midpt_2 = CurveMiddle(Curve=medges.NakedEdges)
crv_cp_4 = CurveClosestPoint(Point=midpt_2, Curve=crv_3)  # -> Point, Parameter, Distance
smaller_3 = SmallerThan(FirstNumber=crv_cp_4.Distance, SecondNumber="0.001")  # -> SmallerThan, OrEqualTo
item_6 = ListItem(List=medges.NakedEdges, Index=550, Wrap=True)
join_3 = JoinCurves(Curves=medges.NakedEdges, Preserve=False)
cull_i_2 = CullIndex(List=join_3, Indices="4", Wrap=True)
item_7 = ListItem(List=join_3, Index="4", Wrap=True)
explode = Explode(Curve=cull_i_2, Recursive=True)  # -> flatten(Segments), Vertices
cull_i_3 = CullIndex(List=medges.NakedEdges, Indices=range, Wrap=True)
explode_2 = Explode(Curve=item_7, Recursive=True)  # -> Segments, Vertices
cull_3 = CullPattern(List=medges.NakedEdges, CullPattern=smaller_3.SmallerThan)

len_3 = Length(Curve=cull_i_3)
multiplication_4 = Multiplication(A=len_3, B=factor)
len_4 = Length(Curve=cull_3)
multiplication_5 = Multiplication(A=len_4, B=factor_2)
length_line_2 = LengthLine(Line=flatten(cull_i_3), Length=multiplication_4, Strength=Slider(50, range=1..50))
length_line_3 = LengthLine(Line=cull_3, Length=multiplication_5, Strength=Slider(500, range=0..500))
merge_4 = Merge(Data1=length_line, Data2=length_line_3, Data3=length_line_2)  # -> flatten(Result)

# ----
# Assemble kangaroo
assemble_kangaroo_model = Entwine(Branch00=show, Branch01=vertexloads, Branch02=anchor_points_kangaroo, Branch03=merge_4, FlattenInputs=True)  # -> simplify(Result)

# ---- group: Simulation
# FORMFINDING!
toggle = BooleanToggle(False)
solver = Solver(GoalObjects=assemble_kangaroo_model, Reset=Button(), Threshold=1e-15, Tolerance=0.0001, On=toggle)  # -> I, V, O

# ---- group: Outputs
# Formfinding output
branch = TreeBranch(Tree=solver.O, Path="{0}", MaintainPaths=True)
unifynormals_2 = MeshUnifyNormals(Mesh=branch)
formfound_mesh = Mesh(unifynormals_2)

# ----
# DATA PASS
# Anchor points an mesh for karamba
# (Let data through manually)
all_target_anchor_points_3 = Point(all_target_anchor_points_2)
formfound_mesh_2 = Mesh(formfound_mesh)
dam = DataDam(DataFORMFOUNDMESH=formfound_mesh_2, BufferDelay=2500000, BufferMode=0)
dam_2 = DataDam(DataANCHORPOINTS=all_target_anchor_points_3, BufferDelay=2500000, BufferMode=0)
formfound_mesh_3 = Mesh(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)
all_target_anchor_points_4 = Point(dam_2)

medges_2 = MeshEdges(Mesh=formfound_mesh_3)  # -> NakedEdges, InteriorEdges, NonManifoldEdges
curve_display_4 = CSharpScript(Curve=flatten(medges_2.NakedEdges), Width="4", Colour=ColourSwatch(SwatchColor=RGB(0, 0, 0)))  # inputs Curve: Curve, Width: Int32, Colour: Color, Dash: String; disabled; same code as curve_display
curve_display_5 = CSharpScript(Curve=flatten(medges_2.InteriorEdges), Width="2", Colour=ColourSwatch(SwatchColor=RGBA(21, 8, 0, 60)))  # inputs Curve: Curve, Width: Int32, Colour: Color, Dash: String; same code as curve_display
preview_5 = CustomPreview(Geometry=formfound_mesh_3, Material=ColourSwatch(SwatchColor=RGB(173, 194, 116)))
msh2psrf = MeshToPolysurface(Mesh=formfound_mesh_3, Triangles=False, FaceMerge=False)  # disabled
suppt = SupportPoint(
    Point=all_target_anchor_points_4,
    DispX=True,
    DispY=True,
    DispZ=True,
    Rotation=False,
    Torsion=False,
    TryStrongSupport=True)  # disabled

# ----
# Membrane - Karamba
formfound_mesh_4 = Mesh(formfound_mesh_3)
matprops = MaterialPropertiesKaramba3D(
    FamilyOfMaterial="Steel",
    Name="S235",
    YoungsModulus_kN_cm²="3.5",
    InPlaneShearModulus_kN_cm²="1.5",
    TransverseShearModulus_kN_cm²="1.5",
    SpecificWeight_kN_m³="0.5",
    CoefficientOfThermalExpansion_1=1.2e-05,
    TensileStrength_kN_cm²="1",
    CompressiveStrength_kN_cm²="1",
    StrengthHypothesis="MISES",
    mode="Isotrop")
crosec = CrossSectionKaramba3D(FamilyNameOfCrossSection="DefaultCroSec", Material=matprops, Height_cm="0.3", mode="Shell - Const")
surfelem = CreateSurfaceElementKaramba3D(Mesh=formfound_mesh_4, CrossSection=crosec, LimitDistance_m=1e-05, Bending="0", mode="MeshToMembrane")  # -> Element, Points, Info

# ----
# Membrane - Karamba
formfound_mesh_5 = Mesh(formfound_mesh_3)
crosec_2 = CrossSectionKaramba3D(FamilyNameOfCrossSection="DefaultCroSec", Material=matselect, Height_cm="2", mode="Shell - Const")
surfelem_2 = CreateSurfaceElementKaramba3D(Mesh=formfound_mesh_5, CrossSection=crosec_2, LimitDistance_m=0.005, Bending="1", mode="MeshToShell")  # -> Element, Points, Info

loads_4 = LoadsKaramba3D(Vector=Z, Mesh=formfound_mesh_5, LCase="G", mode="MeshLoad -Const.", menu=[buttons(off, on, off), buttons(on, on)])

# ----
# Supports - Karamba
all_anchor_points = Point(all_target_anchor_points_4)
supp = SupportKaramba3D(PosInd=all_anchor_points, menu=[buttons(on, on, on, off, off, on)])
support = SupportKaramba3D(supp)

# ----
# Loads - Karamba
panel_18 = Panel("-10")
loads_5 = LoadsKaramba3D(Vector=Vector(0, 0, -1), LCase="G", mode="Gravity")
loads_6 = LoadsKaramba3D(Eps0=panel_18, LCase="LC0", mode="InitialStrain")
loads_7 = LoadKaramba3D([loads_5, loads_4])

# ----
# Assmble and Analyze
support_2 = SupportKaramba3D(support)
element = ElementKaramba3D(surfelem.Element)
loads_8 = LoadKaramba3D(loads_3)
assemble = AssembleModelKaramba3D(Elem=flatten(element), Support=flatten(support_2), Load=flatten(loads_8), LimitDistance_m=0.0001)  # -> Model, Info, Mass_kg, CentreOfGravity, LoadCaseNames

analysethii = AnalyseThIIKaramba3D(
    Model=assemble.Model,
    UseInitialNII=True,
    NIIFromCombination=True,
    NoTensionalNII=False,
    RTolerance=1e-07,
    MaxIterations=50)  # -> AnalysedModel, MaximumDisplacement_cm, ResultingForce_kN, ChangeOfElasticEnergy_kNm
analysethii_2 = AnalyseThIIKaramba3D(
    Model=assemble.Model,
    UseInitialNII=True,
    NIIFromCombination=True,
    NoTensionalNII=False,
    RTolerance=1e-07,
    MaxIterations=50)  # -> AnalysedModel, MaximumDisplacement_cm, ResultingForce_kN, ChangeOfElasticEnergy_kNm
popgeo = PopulateGeometry(Geometry=formfound_mesh_4, Count=250, Seed=1)
modelview = ModelViewKaramba3D(Model=analysethii_2.AnalysedModel)  # -> Model, DeformedMesh, DeformedAxes, DeformedModel, MaximumDeformation
shellview = ShellViewKaramba3D(Model=modelview.Model, IndexOfLayer=0)  # -> Model, MeshesOfRenderedShells, LegendColours, LegendTags
shelllineresults = LineResultsOnShellsKaramba3D(
    AnalysedModel=modelview.Model,
    LayerPosition=0,
    ListOfSourcesOfPrincipalStressLinesLinesPoints=popgeo,
    SegmentLength_m=0.5,
    DA_deg=5,
    mode="PrincStress")  # -> Model, Lines1, Lines2
legend = Legend(Colour=shellview.LegendColours, Tags=shellview.LegendTags, LegendType=1)
crv_34 = Curve(shelllineresults.Lines1)

shellvecresults = ResultVectorsOnShellsKaramba3D(Model=modelview.Model, LayerPosition=0, mode="PrincStress")  # -> Model, Points, FirstPrincipalStressVector_kN_cm², SecondPrincipalStressVector_kN_cm², FirstPrincipalStressValue_kN_cm², SecondPrincipalStressValue_kN_cm²
# 1. Find and bake vector singularities
equalst = EqualityWithinTolerance(
    FirstNumber=shellvecresults.FirstPrincipalStressValue_kN_cm²,
    SecondNumber=shellvecresults.SecondPrincipalStressValue_kN_cm²,
    Tolerance=0.001)  # -> Equality, Inequality
cull_4 = CullPattern(List=shellvecresults.Points, CullPattern=equalst.Equality)

amp = Amplitude(Vector=shellvecresults.SecondPrincipalStressVector_kN_cm², Amplitude=0.2)
item_8 = ListItem(List=shellvecresults.Points, Index="300", Wrap=True)
item_9 = ListItem(List=shellvecresults.SecondPrincipalStressVector_kN_cm², Index="300", Wrap=True)
item_10 = ListItem(List=shellvecresults.Points, Index="300", Wrap=True)
amp_2 = Amplitude(Vector=shellvecresults.SecondPrincipalStressVector_kN_cm², Amplitude=0.2)
item_11 = ListItem(List=shellvecresults.SecondPrincipalStressVector_kN_cm², Index="300", Wrap=True)
dprod = DotProduct(VectorA=item_9, VectorB=graft(shellvecresults.SecondPrincipalStressVector_kN_cm²), Unitize=False)  # -> flatten(DotProduct)
item_12 = ListItem(List=shellvecresults.Points, Index=0, Wrap=True)
dprod_2 = DotProduct(VectorA=item_11, VectorB=graft(shellvecresults.SecondPrincipalStressVector_kN_cm²), Unitize=False)  # -> flatten(DotProduct)
smaller_4 = SmallerThan(FirstNumber=dprod, SecondNumber=0)  # -> SmallerThan, OrEqualTo
vdisex = VectorDisplayEx(Point=item_10, Vector=item_11, Colour=RGB(0, 0, 0), Width=2)
smaller_5 = SmallerThan(FirstNumber=dprod_2, SecondNumber=0)  # -> SmallerThan, OrEqualTo
py3 = Python3Script(x=shellvecresults.SecondPrincipalStressVector_kN_cm², y=smaller_4.SmallerThan)  # -> out, a; inputs x: list of Vector3d, y: list of Boolean
# ---------- py3: Python ----------
final = []
import rhinoscriptsyntax as rg

for v,b in zip(x,y):
    if b == True:
        final.append(v*-1)
    if b == False:
        final.append(v)
a = final
# ---------- end py3 ----------
py3_2 = Python3Script(x=shellvecresults.SecondPrincipalStressVector_kN_cm², y=smaller_5.SmallerThan)  # -> out, a; inputs x: list of Vector3d, y: list of Boolean; same code as py3
vec = Vector(py3_2.a)
vec_2 = Vector(py3.a)
pt_25 = Point(shellvecresults.Points)
multiplication_6 = Multiplication(A=shellvecresults.SecondPrincipalStressValue_kN_cm², B="1000")
bnd = Bounds(Numbers=multiplication_6)
bnd_2 = Bounds(Numbers=shellvecresults.FirstPrincipalStressValue_kN_cm²)
cp = ClosestPoint(Point=ins, Cloud=shellvecresults.Points)  # -> ClosestPoint, CPIndex, Distance
bar_graph = BarGraph(multiplication_6, BarColor=RGB(255, 0, 90))

# ----
# 2. Make inital random seeding
mesh_vertices = Point(surfelem.Points)  # disabled
cull_5 = CullPattern(List=mesh_vertices, CullPattern=[False, False, True, True])  # disabled
shelllineresults_2 = LineResultsOnShellsKaramba3D(
    AnalysedModel=modelview.Model,
    LayerPosition=0,
    ListOfSourcesOfPrincipalStressLinesLinesPoints=cull_5,
    SegmentLength_m=panel_8,
    DA_deg=5,
    mode="PrincStress")  # -> Model, Lines1, Lines2; disabled

py3_3 = Python3Script(
    points=shellvecresults.Points,
    p1_list=shellvecresults.FirstPrincipalStressVector_kN_cm²,
    p2_list=shellvecresults.SecondPrincipalStressVector_kN_cm²,
    sigma1_list=shellvecresults.FirstPrincipalStressValue_kN_cm²,
    sigma2_list=shellvecresults.SecondPrincipalStressValue_kN_cm²,
    x=ins,
    y=cp.CPIndex)  # -> a, simplify(b), simplify(c), simplify(d), Type, e; inputs points: list of Point3d, p1_list: list of Vector3d, p2_list: list of Vector3d, sigma1_list: list of Double, sigma2_list: list of Double, x: list of Point3d, y: list
# ---------- py3_3: Python ----------
import numpy as np
from scipy.spatial import KDTree
import Rhino.Geometry as rg
import math

from ghpythonlib import treehelpers as tr


# --------------------------------------------------------
# 1) Stress Tensor in 2D
# --------------------------------------------------------
def stress_tensor_2D(sigma1, p1, sigma2, p2):
    """
    2D stress tensor: T = sigma1*(p1 p1^T) + sigma2*(p2 p2^T).
    p1, p2: (px, py, pz) as tuples/arrays (we use only x and y).
    """
    p1x, p1y, _ = p1
    p2x, p2y, _ = p2

    T1 = np.array([[p1x*p1x, p1x*p1y],
                   [p1y*p1x, p1y*p1y]])
    T2 = np.array([[p2x*p2x, p2x*p2y],
                   [p2y*p2x, p2y*p2y]])
    return sigma1 * T1 + sigma2 * T2

# --------------------------------------------------------
# 2) Degeneracy Check
# --------------------------------------------------------
# def is_degenerate_2D(T, tol=0.15):
#     """
#     Check if T11 ~ T22 and T12 ~ 0 within tolerance tol.
#     """
#     T11, T22, T12 = T[0,0], T[1,1], T[0,1]
#     return (abs(T11 - T22) < tol) and (abs(T12) < tol)

# --------------------------------------------------------
# 3) Cubic Slopes for Separatrices
# --------------------------------------------------------
def separatrix_slopes(a, b, c, d, imag_tol=1e-7):
    """
    Solve Delmarcelle–Hesselink's cubic for real slopes x_k:
      d*x^3 + (c + 2*b)*x^2 + (2*a - d)*x - c = 0.
    Returns a list of real solutions (scalar slopes).
    """
    c3 = d
    c2 = c + 2*b
    c1 = 2*a - d
    c0 = -c

    roots = np.roots([c3, c2, c1, c0])
    real_slopes = [r.real for r in roots if abs(r.imag) < imag_tol]
    return real_slopes


# --------------------------------------------------------
# 4) Classification via delta = a*d - b*c
# --------------------------------------------------------
def classify_degenerate(a, b, c, d, tol=0.0001):
    """
    Returns:
      'wedge' if delta > 0 (index +1/2),
      'trisector' if delta < 0 (index -1/2),
      'merged-index=±1' if delta is near 0.
    """
    delta = a*d - b*c
    print(f"delta: {delta}")
    if abs(delta) < 1e-18:
        return "merged-index"
    elif delta > 0:
        return "wedge"
    else:
        return "trisector"

# --------------------------------------------------------
# NEW: Approximate Partial Derivatives via Regression
# --------------------------------------------------------
def approximate_partials_regression(idx_center, pts, Tlist, kdtree, n_neighbors=1):
    """
    For the degenerate point at idx_center, take the n_neighbors closest points
    (excluding the center itself) and perform a linear regression to approximate
    the partial derivatives of:
         f(x,y) = T11 - T22   and   g(x,y) = T12.
    We solve for:
         f(x,y) ≈ A0 + A1*x + A2*y   =>  ∂f/∂x ≈ A1, ∂f/∂y ≈ A2,
         g(x,y) ≈ B0 + B1*x + B2*y   =>  ∂g/∂x ≈ B1, ∂g/∂y ≈ B2.
    Then define:
         a = 0.5 * A1, b = 0.5 * A2, c = B1, d = B2.
    """
    x0, y0, _ = pts[idx_center]
    # Query n_neighbors+1 (including the center itself)
    distances, indices = kdtree.query([x0, y0], k=n_neighbors+1)
    # Remove the center:
    neighbor_indices = [j for j in indices if j != idx_center]
    if len(neighbor_indices) < n_neighbors:
        # If fewer than expected, use what is available
        n_used = len(neighbor_indices)
    else:
        n_used = n_neighbors

    # Build the design matrix X = [1, x, y] for the neighbors
    X = []
    f_vals = []
    g_vals = []
    for j in neighbor_indices[:n_used]:
        xj, yj, _ = pts[j]
        X.append([1.0, xj, yj])
        T = Tlist[j]
        f_vals.append(T[0,0] - T[1,1])
        g_vals.append(T[0,1])
    X = np.array(X)
    f_vals = np.array(f_vals)
    g_vals = np.array(g_vals)

    # Solve the least squares problem for f and g:
    sol_f, _, _, _ = np.linalg.lstsq(X, f_vals, rcond=None)
    sol_g, _, _, _ = np.linalg.lstsq(X, g_vals, rcond=None)
    # Partial derivatives:
    df_dx, df_dy = sol_f[1], sol_f[2]
    dg_dx, dg_dy = sol_g[1], sol_g[2]
    a = 0.5 * df_dx
    b = 0.5 * df_dy
    c = dg_dx
    d = dg_dy
    return (a, b, c, d)

# --------------------------------------------------------
# 6a) Helper: Get Local Eigenvectors from Nearest Neighbor
# --------------------------------------------------------
def get_local_eigenvectors(x, y, pts, Tlist, kdtree, tol):
    """
    From the KDTree, find the nearest nondegenerate point to (x,y)
    and return its eigenvectors (ordered by descending eigenvalue) as 2D numpy arrays.
    """
    distance, idx = kdtree.query([x, y], k=5)
    for d, j in zip(np.atleast_1d(distance), np.atleast_1d(idx)):
        T = Tlist[j]
        sigma_1 = sigma1_list[j]
        sigma_2 = sigma2_list[j]
        if not is_degenerate_by_values(sigma_1, sigma_2, tol=0.00017):
            eigvals, eigvecs = np.linalg.eig(T)
            order = np.argsort(eigvals)[::-1]
            p1 = eigvecs[:, order[0]]
            p2 = eigvecs[:, order[1]]
            return p1, p2
    return None, None

# --------------------------------------------------------
# 6b) Helper: Determine Which Eigenfield Owns a Given Slope
# --------------------------------------------------------
def sample_directions_around_merged_point(
    x0, y0,
    pts,
    Tlist,
    kdtree,
    n_samples,
    offset_eps,
    deg_tol=0.01):
    """
    1) Sample n_samples directions around the circle, in steps of 2π/n_samples.
    2) For each direction, call measure_unoriented_angles(...) => (label, angle1, angle2).
    3) Group them by label='1' or label='2', but store how close we are to p1 or p2.
       We'll use the angle to the chosen field as our "fit measure."
    4) Sort each group by ascending angle (so smaller angle = better fit).
    5) Keep only the best 4 directions from each group, i.e., those with the smallest angle to their chosen field.
    6) Return those final directions in (p1_vectors, p2_vectors).
    """
    n_samples = 20
    deg_tol=0.1
    offset_eps = 1.5
    angles = np.linspace(0, 2*np.pi, n_samples, endpoint=False)
    print(f"offset = {offset_eps}")
    p1_candidates = []  # will store (direction_2D, best_angle)
    p2_candidates = []

    for theta in angles:
        dx = np.cos(theta)
        dy = np.sin(theta)
        dir_vec = np.array([dx, dy], dtype=float)

        print(f"dx:{dx}")
        print(f"dy:{dy}")
        # slope => (dy/dx) if dx != 0
        if abs(dx) > 1e-14:
            slope = dy/dx
        else:
            slope = np.sign(dy)*1e14  # near-vertical fallback

        label, angle1, angle2 = measure_unoriented_angles(
            x0, y0, dir_vec, offset_eps, pts, Tlist, kdtree, tol=deg_tol
        )
        print(f"label:{label}")
        print(angle1)
        if label is None:
            continue

        # Build the direction vector (normalized)
        vec = np.array([dx, dy], dtype=float)
        length = np.linalg.norm(vec)
        if length < 1e-14:
            continue
        vec /= length

        # The "fit measure" is the angle to whichever field it belongs to
        # label='1' => we use angle1, label='2' => use angle2
        fit_angle = angle1 if label == '1' else angle2

        if label == '1':
            p1_candidates.append((vec, fit_angle))
        else:
            p2_candidates.append((vec, fit_angle))

    # Now pick the best 4 by ascending angle
    p1_candidates.sort(key=lambda tup: tup[1])  # sort by fit_angle
    p2_candidates.sort(key=lambda tup: tup[1])

    p1_top4 = p1_candidates[:5]
    p2_top4 = p2_candidates[:5]

    # Return just the directions
    p1_vecs = [x[0] for x in p1_top4]
    p2_vecs = [x[0] for x in p2_top4]

    return p1_vecs, p2_vecs, p1_candidates

def measure_unoriented_angles(
    x0, y0,
    dir_vec,
    eps,
    pts,
    Tlist,
    kdtree,
    tol):
    """
    1) Offsets from (x0,y0) by eps in direction (1, slope).
    2) Gets local p1, p2 from nearest non-degenerate neighbor.
    3) Computes the *unoriented* angles angle1, angle2 of (1,slope)
       vs. p1 and p2, respectively.

    Returns (label, angle1, angle2):
      label: '1' if angle1 <= angle2, '2' otherwise
      angle1, angle2: the actual angles in [0, π/2].
    
    If something fails (degenerate region, zero dir, etc.), returns (None, None, None).
    """

    print(f"epsilon={eps}")
    norm = np.linalg.norm(dir_vec)
    if norm < 1e-14:
        return (None, None, None)
    dir_vec_n = dir_vec / norm

    x_eps = x0 + eps * dir_vec_n[0]
    y_eps = y0 + eps * dir_vec_n[1]

    p1, p2 = get_local_eigenvectors(x_eps, y_eps, pts, Tlist, kdtree, tol=tol)
    if p1 is None or p2 is None:
        return (None, None, None)

    p1_n = p1 / np.linalg.norm(p1)
    p2_n = p2 / np.linalg.norm(p2)

    dot1 = abs(np.dot(dir_vec_n, p1_n))
    dot2 = abs(np.dot(dir_vec_n, p2_n))
    angle1 = math.acos(np.clip(dot1, 0, 1))
    angle2 = math.acos(np.clip(dot2, 0, 1))

    if angle1 <= angle2:
        return ('1', angle1, angle2)
    else:
        return ('2', angle1, angle2)

def which_eigenfield_owns_slope(x0, y0, slope, eps, pts, Tlist, kdtree, tol=0.15):
    """
    Given a degenerate point (x0,y0) and a separatrix slope (scalar),
    offset by a small step eps along the direction (1, slope) to get (x_eps, y_eps).
    Then, get the local eigenvectors from the nearest nondegenerate point and
    determine which eigenvector the offset direction aligns with, using the unoriented angle.
    Returns 'p1' if the offset direction is closer (in angle) to p1, else 'p2'.
    """
    # Construct the unit direction vector from the slope.
    dir_vec = np.array([1.0, slope])
    norm = np.linalg.norm(dir_vec)
    if norm < 1e-14:
        return None
    dir_vec_n = dir_vec / norm

    # Offset the degenerate point.
    x_eps = x0 + eps * dir_vec_n[0]
    y_eps = y0 + eps * dir_vec_n[1]

    # Get the local eigenvectors from the nearest nondegenerate point.
    p1, p2 = get_local_eigenvectors(x_eps, y_eps, pts, Tlist, kdtree, tol=tol)
    if p1 is None or p2 is None:
        return None

    # Normalize the eigenvectors.
    p1_n = p1 / np.linalg.norm(p1)
    p2_n = p2 / np.linalg.norm(p2)

    # Compute unoriented angles using the absolute dot product.
    # That is, for two unit vectors v and w, the unoriented angle is:
    # angle = arccos(|v · w|).
    angle1 = np.arccos(np.clip(abs(np.dot(dir_vec_n, p1_n)), 0, 1))
    angle2 = np.arccos(np.clip(abs(np.dot(dir_vec_n, p2_n)), 0, 1))

    return '1' if angle1 <= angle2 else '2'


def compute_index_delmarcelle(
    x0, y0,
    pts,
    Tlist,
    kdtree,
    radius,
    n_samples=50,
    which_field='major'):
    """
    Computes the Delmarcelle–Hesselink index of a suspected 2D degenerate point
    by sampling around a small circle (radius) and summing the net rotation
    of the chosen eigenvector field (major or minor) along that circle.
    
    Uses single-pass angle unwrapping to avoid accidental cancellation at the end.
    
    Returns:
      index_value : float
      points_circle : list of (x,y) for each circle sample
    """
    alpha = np.zeros(n_samples, dtype=float)
    points_circle = []

    thetas = np.linspace(0, 2*np.pi, n_samples, endpoint=False)

    # Keep track of the previous vector to ensure consistent orientation.
    v_prev = None

    lam_eps = 1e-10  # tolerance for near-degenerate eigenvalues
    nominal_idx = 0 if which_field.lower() == 'major' else 1

    for i, th in enumerate(thetas):
        x_samp = x0 + radius * math.cos(th)
        y_samp = y0 + radius * math.sin(th)
        points_circle.append((x_samp, y_samp))

        # Nearest neighbor
        dist, idx = kdtree.query([x_samp, y_samp], k=1)
        T = Tlist[idx]

        # Eigen-decomposition
        vals, vecs = np.linalg.eig(T)
        vals = np.real(vals)
        vecs = np.real(vecs)

        order = np.argsort(vals)[::-1]
        vals = vals[order]
        vecs = vecs[:, order]

        # Branch tracking near a degeneracy
        if abs(vals[0] - vals[1]) < lam_eps and v_prev is not None:
            dot0 = abs(np.dot(v_prev, vecs[:,0]))
            dot1 = abs(np.dot(v_prev, vecs[:,1]))
            chosen_idx = 1 if dot1 > dot0 else 0
        else:
            chosen_idx = nominal_idx

        v = vecs[:, chosen_idx]

        # Sign flip if needed
        if v_prev is not None and np.dot(v, v_prev) < 0:
            v = -v
        v_prev = v

        alpha[i] = math.atan2(v[1], v[0])

    # -----------------------------------------------------
    # Single-pass unwrapping to get a continuous angle array
    # -----------------------------------------------------
    alpha_unwrapped = np.zeros_like(alpha)
    alpha_unwrapped[0] = alpha[0]
    for i in range(1, n_samples):
        delta = alpha[i] - alpha_unwrapped[i-1]
        # If jump > π or < -π, shift by 2π
        if delta > math.pi:
            delta -= 2*math.pi
        elif delta < -math.pi:
            delta += 2*math.pi
        alpha_unwrapped[i] = alpha_unwrapped[i-1] + delta

    # Net rotation is difference between last and first unwrapped angle
    total_rot = alpha_unwrapped[-1] - alpha_unwrapped[0]
    index_value = total_rot / (2.0 * math.pi)

    return index_value, points_circle

# --------------------------------------------------------
# 7) Putting it all together with Slope Labeling and List Outputs
# --------------------------------------------------------

def is_degenerate_by_values(sigma1, sigma2, tol):
    return abs(sigma1 - sigma2) < tol

def find_deg_points_kdtree_classify_with_slopes(
    points,
    sigma1_list,
    p1_list,
    sigma2_list,
    p2_list,
    tol_deg=0.0023,
    band_tol=0.2,
    search_radius=0.2,
    slope_imag_tol=1e-7,
    offset_eps=0.5,
    n_neighbors=10):
    n = len(points)
    if not (
        len(sigma1_list) == n and len(sigma2_list) == n
        and len(p1_list) == n and len(p2_list) == n
    ):
        raise ValueError("Mismatch in list lengths vs. points length.")

    # ----------------------------------------------------
    # Build Tlist (stress tensors):
    # ----------------------------------------------------
    Tlist = []
    for i in range(n):
        s1 = sigma1_list[i]
        s2 = sigma2_list[i]
        p1_val = p1_list[i]
        p2_val = p2_list[i]
        T = stress_tensor_2D(s1, p1_val, s2, p2_val)
        Tlist.append(T)

    arr_2d = np.array([(pt.X, pt.Y) for pt in points], dtype=float)
    kdtree = KDTree(arr_2d)

    # We keep deg_points_list and degenerate_types_list as before:
    deg_points_list = []
    degenerate_types_list = []

    # But now, instead of one big fields_list/directions_list,
    # we store a sublist for each degenerate point:
    fields_sublists = []
    directions_sublists = []
#if is_degenerate_by_values(sigma1_list[i], sigma2_list[i], tol=0.005):
    for i, (x0, y0, z0) in enumerate(x): #change here
        if is_degenerate_by_values(sigma1_list[y[i]], sigma2_list[y[i]], tol=0.005):
            print("is dege")
            
            idx_val, points_circle = compute_index_delmarcelle(
            x0, y0,
            points, Tlist, kdtree,
            radius=0.3,  # pick something small enough to be 'local'
            n_samples=20,
            which_field='major')


            if abs(idx_val)<0.07:
                continue



        
            # For THIS degenerate point, we collect local fields/directions:
            local_fields = []
            local_dirs = []

            abcd = approximate_partials_regression(
                y[i], points, Tlist, kdtree, n_neighbors=n_neighbors
            )

            print(f"abcd = {abcd}")
            if abcd is None:
                deg_points_list.append(rg.Point2d(x0, y0))
                degenerate_types_list.append("degenerate-uncertain")
                # This point has no directions, so store empty sublists:
                fields_sublists.append(local_fields)   # []
                directions_sublists.append(local_dirs) # []
                continue

            a, b, c, d = abcd
            deg_type = classify_degenerate(a, b, c, d, tol=0.001)




            if abs(idx_val - 0.5) < 0.1:
                deg_type = "wedge"
            elif abs(idx_val - 1) < 0.1 or abs(idx_val + 1) < 0.1:
                deg_type = "merged-index"
            elif abs(idx_val + 0.5) < 0.1:
                deg_type = "trisector"





















            # ----------------------------------------------------
            # 1) Wedge / Trisector => normal slopes from D-H cubic
            # ----------------------------------------------------
            if deg_type in ["wedge","trisector"]:
                slopes = separatrix_slopes(a, b, c, d, imag_tol=slope_imag_tol)
                print(f"slopes = {slopes}")

            # ----------------------------------------------------
            # 2) Merged => sample fallback
            # ----------------------------------------------------
            elif deg_type == "merged-index":
                print(11111111111111111111111111)
                # Instead of second-order approach, do the sampling approach right away
                p1_vecs, p2_vecs,p1_candidates = sample_directions_around_merged_point(
                    x0, y0,
                    points, Tlist, kdtree,
                    n_samples=20,
                    offset_eps = 0.1,
                    deg_tol=tol_deg
                )
                print(p1_vecs)


                # Store these in our *local* lists for this point
                for v in p1_vecs:
                    local_fields.append('1')
                    local_dirs.append((v[0], v[1]))
                for v in p2_vecs:
                    local_fields.append('2')
                    local_dirs.append((v[0], v[1]))

                # And skip the normal slope-based approach
                slopes = []
            else:
                slopes = []

            print(f"hi:{slopes}")

            # ----------------------------------------------------
            # 3) If slopes found, offset + labeling
            # ----------------------------------------------------
            # We treat each slope as p1, and also handle the perpendicular slope as p2.
            # Then we see which eigenfield "owns" each slope by offset test.
            for slope in slopes:
                L = math.sqrt(1.0 + slope*slope)
                pos_dir = (1.0/L, slope/L)
                neg_dir = (-1.0/L, -slope/L)

                label = which_eigenfield_owns_slope(
                    x0, y0, slope, offset_eps,
                    points, Tlist, kdtree, tol=tol_deg
                )
                if label == '1':
                    local_fields.append('1')
                    local_dirs.append(pos_dir)
                    local_fields.append('2')
                    local_dirs.append(neg_dir)
                elif label == '2':
                    local_fields.append('1')
                    local_dirs.append(neg_dir)
                    local_fields.append('2')
                    local_dirs.append(pos_dir)
                else:
                    # uncertain => we skip
                    pass

            # ----------------------------------------------------
            # 4) Append final results for this degenerate point
            # ----------------------------------------------------
            deg_points_list.append(rg.Point2d(x0, y0))
            degenerate_types_list.append(deg_type)
            fields_sublists.append(local_fields)
            directions_sublists.append(local_dirs)

    # ---------------------------------------------------------
    # Final return: sublists instead of a single flat list
    # ---------------------------------------------------------
    return deg_points_list, degenerate_types_list, fields_sublists, directions_sublists, Tlist, kdtree


# --------------------------------------------------------
# Example usage snippet (assuming your variables are defined)
# --------------------------------------------------------

# Suppose you have:
#   points: list of Rhino.Geometry.Point3d (with z=0)
#   sigma1_list, sigma2_list: lists of floats
#   p1_list, p2_list: lists of 3D direction tuples (e.g., (p1.x, p1.y, p1.z))
deg_pts, deg_types, fields_sub, dirs_sub, Tlist, kdtree= find_deg_points_kdtree_classify_with_slopes(
    points,
    sigma1_list,
    p1_list,
    sigma2_list,
    p2_list,
    tol_deg=0.3,
    band_tol=0.1,         # not used in regression but kept for compatibility
    search_radius=0.1,      # not used in regression version either
    slope_imag_tol=1e-7,
    offset_eps=0.3,
    n_neighbors=30
)

import numpy as np
import Rhino.Geometry as rg










#Example usage (inside some loop or analysis code):
singul_indices = []
for i, deg_pt in enumerate(deg_pts):
    x0, y0 = deg_pt.X, deg_pt.Y
    idx_val, points_circle = compute_index_delmarcelle(
        x0, y0,
        points, Tlist, kdtree,
        radius=0.3,  # pick something small enough to be 'local'
        n_samples=20,
        which_field='major'
    )
    singul_indices.append(round(idx_val,2))
    print("Degenerate Pt #{} at ({:.3f},{:.3f}), index = {:.3f}"
        .format(i, x0, y0, idx_val))

#If the index is ~+0.5, likely a wedge (I=+1/2), if ~-0.5, likely a trisector (I=-1/2), etc.





print(deg_pts)

dirx = []
diry = []

for i in range(0,len(deg_pts)):
    print("Degenerate point:", deg_pts[i], "Type:", deg_types[i])
    print("Directions/fields:")
    local_dirx = []
    local_diry = []
    for f, d in zip(fields_sub[i], dirs_sub[i]):
        print("   Field:", f, " Direction:", d)

    for d in dirs_sub[i]:
        local_dirx.append(d[0])
        local_diry.append(d[1])
    dirx.append(local_dirx)
    diry.append(local_diry)


singul_indices = [f"{i} I = {d}" for i,d in zip(deg_types,singul_indices)]


deg_pts = [rg.Point3d(p[0],p[1],0) for p in deg_pts]


a = deg_pts
b = tr.list_to_tree(fields_sub)
c = tr.list_to_tree(dirx)
d = tr.list_to_tree(diry)
Type = singul_indices
# ---------- end py3_3 ----------
equals = Equality(FirstNumber=py3_3.b, SecondNumber="1")  # -> Equality, Inequality
cull_6 = CullPattern(List=py3_3.c, CullPattern=equals.Equality)
cull_7 = CullPattern(List=py3_3.d, CullPattern=equals.Equality)
vec_3 = VectorXYZ(XComponent=cull_6, YComponent=cull_7, ZComponent=0)  # -> Vector, Length

# ---- group: Construct degenrate curves manually
mesh = Mesh(shellview.MeshesOfRenderedShells)
msh2psrf_2 = MeshToPolysurface(Mesh=mesh, Triangles=False, FaceMerge=False)
# 4. Seed curves and get PSL_1
model = ModelKaramba3D(modelview.Model)
degenrate_curves_1_2 = Curve(degenrate_curves_1)
project_2 = Project(Curve=degenrate_curves_1_2, Brep=msh2psrf_2, Direction=Vector(0, 0, 1))
divdist = DivideDistance(Curve=project_2, Distance=0.05)  # -> flatten(Points), Tangents, Parameters
shelllineresults_3 = LineResultsOnShellsKaramba3D(
    AnalysedModel=model,
    LayerPosition=0,
    ListOfSourcesOfPrincipalStressLinesLinesPoints=divdist.Points,
    SegmentLength_m="0.1",
    DA_deg=5,
    mode="PrincStress")  # -> Model, Lines1, Lines2

# ----
mshnakededgs = MeshNakedEdges(Mesh=formfound_mesh_4)  # -> Naked, R
mshnakededgs_2 = MeshNakedEdges(Mesh=formfound_mesh_4)  # -> Naked, R
mesh_2 = Mesh(formfound_mesh_3)
wbfacepolys = WeaverbirdsFacePolylines(Mesh=mesh_2)
disc = Discontinuity(Curve=wbfacepolys, Level=1)  # -> Points, Parameters
avr_3 = Average(Input=disc.Points)
cp_2 = ClosestPoint(Point=midpt, Cloud=flatten(avr_3))  # -> ClosestPoint, CPIndex, Distance
item_13 = ListItem(List=wbfacepolys, Index=cp_2.CPIndex, Wrap=True)
disc_2 = Discontinuity(Curve=item_13, Level=1)  # -> Points, Parameters
flip = FlipMatrix(Data=disc_2.Points)
bang = ExplodeTree(Data=flip)  # -> Branch0, Branch1, Branch2, Branch3
srf4pt = _4PointSurface(CornerA=bang.Branch0, CornerB=bang.Branch1, CornerC=bang.Branch2, CornerD=bang.Branch3)  # -> reparameterize(Surface)
evalsrf = EvaluateSurface(Surface=srf4pt, Point=md_slider)  # -> Point, Normal, UDirection, VDirection, Frame
amp_3 = Amplitude(Vector=evalsrf.Normal, Amplitude="0.2")
amp_4 = Amplitude(Vector=evalsrf.Normal, Amplitude="-0.2")
vdisex_2 = VectorDisplayEx(Point=evalsrf.Point, Vector=evalsrf.Normal, Colour=RGB(0, 0, 0), Width=2)
extr = Extrude(Base=segmentation_lines, Direction=amp_3)
extr_2 = Extrude(Base=segmentation_lines, Direction=amp_4)
join_4 = BrepJoin(Breps=[extr, extr_2])  # -> Breps, Closed
bcx = BrepCurve(Brep=join_4.Breps, Curve=psl_1_2)  # -> Curves, Points
trim = TrimTree(Tree=simplify(bcx.Points), Depth=1)
crv_cp_5 = CurveClosestPoint(Point=trim, Curve=psl_1_2)  # -> Point, Parameter, Distance
py3_4 = Python3Script(x=crv_cp_5.Parameter)  # -> out, flatten(a); inputs x: list
# ---------- py3_4: Python ----------
booleans = []

if len(x) == 0:
    booleans.append(True)
else:
    booleans.append(False)

a = booleans
# ---------- end py3_4 ----------
shatter_3 = Shatter(Curve=psl_1_2, Parameters=crv_cp_5.Parameter)  # -> flatten(Segments)
cull_8 = CullPattern(List=flatten(psl_1_2), CullPattern=py3_4.a)
len_5 = Length(Curve=shatter_3)
smaller_6 = SmallerThan(FirstNumber=len_5, SecondNumber="0.1")  # -> SmallerThan, OrEqualTo
not = GateNot(A=smaller_6.SmallerThan)
cull_9 = CullPattern(List=shatter_3, CullPattern=not)
midpt_3 = CurveMiddle(Curve=reparameterize(cull_9))
pgroups = PointGroups(Points=midpt_3, Distance="0.3")  # -> Groups, Indices
midpt_4 = CurveMiddle(Curve=cull_8)
mshnakededgs_3 = MeshNakedEdges(Mesh=mesh_2)  # -> Naked, R
bang_2 = ExplodeTree(Data=pgroups.Groups)  # -> Branch0, Branch1
project_3 = Project(Geometry=mshnakededgs_3.Naked, Plane=xy)  # -> Geometry, Transform
project_4 = ProjectPoint(Point=midpt_3, Direction=Vector(0, 0, -1), Geometry=xy_2)  # -> Point, Index

# ----
# Kiwi membrane PSL verification
list_2 = ValueList({"STEEL": 1, "WOOD": 2, "GFRP": 3, "ETFE (Membrane)": 4, "CONCRETE": 5, "ALUMINIUM": 6}, selected="ETFE (Membrane)")  # disabled
matdef = MaterialDefaults(Type=list_2, IsNmm2=False, IskNcm2=False, IskNm2=True, mUnit=1)  # -> Material, YoungsModulus, AlphaT, Nue, Density, Strength; disabled
panel_19 = Panel("0.8")  # disabled
srfref = SurfaceRefinement(PDeg=3, QDeg=3, ElementRefU=5, ElementRefV=5, IsKnotApproxElementSize=False, IsKnotSubdivision=True)  # disabled
list_3 = ValueList({"Displacements": 1, "Stresses": 2, "SupportForces": 3}, selected=["Displacements", "Stresses", "SupportForces"])  # disabled
membrane = MembraneElement(
    Brep=msh2psrf,
    Material=matdef.Material,
    Thickness=0.001,
    Prestress1=panel_19,
    Prestress2=panel_19,
    Refinement=srfref,
    Formfinding=True,
    ShowPrestressDirections=False)  # disabled
nonlina = NonLinearAnalysis(
    Name="MyAnalysis",
    Iterations=100,
    EquilibriumAccurancy=0.001,
    OutputSetting=list_3,
    AdaptiveForceControl=0,
    OutputFrequency=1)  # disabled
toggle_2 = BooleanToggle(False)  # disabled
list_4 = ValueList({"X Displacement": 1, "Y Displacement": 2, "Z Displacement": 3, "Displacement Length": 4, "P_N1": 5, "P_N2": 6, "N1": 7, "N2": 8, "N12": 9, "P_M1 (Shell)": 10, "P_M2 (Shell)": 11, "M1 (Shell)": 12, "M2 (Shell)": 13, "M12 (Shell)": 14, "von_Mises (Shell)": 15}, selected="P_N1")  # disabled

lina = LinearAnalysis(Name="MyAnalysis", OutputSetting=list_3)  # disabled

amodel = AnalysisModel(
    Analysis=lina,
    StructuralElements=membrane,
    Supports=suppt,
    IntersectionTolerance=0.001,
    IsCarat=True,
    IsKratos=False,
    PenaltyFac=10000000,
    ShowCouplingIDs=False,
    ShowEdgeIDs=False,
    ShowGeo=True,
    ShowPatchIDs=True,
    ShowPrePro=True,
    ShowRef=False,
    mUsedVersion="BETA 0.6.0")  # disabled
analysis_completed = IGASolver(AnalysisModel=amodel, Run=toggle_2, antiFreeze=False, showWindow=True)  # -> ResultModel, ErrorReport; disabled
defmod = DeformedModel(Model=analysis_completed.ResultModel, ScaleFactor=1, FlyingNodeLimit=100000)  # -> Model, Geo, DeformedStructuralElements; disabled
_2dresults = _2DElementResults(Model=analysis_completed.ResultModel, Type=list_4, Scaling=1)  # -> IDGP, V, R, LocationGP, ParameterLocationGP; disabled
end_2 = EndPoints(Curve=_2dresults.R)  # -> Start, End; disabled
vec2pt = Vector2Pt(PointA=end_2.Start, PointB=end_2.End, Unitize=False)  # -> Vector, Length; disabled
vdisex_3 = VectorDisplayEx(Point=end_2.Start, Vector=vec2pt.Vector, Colour=RGB(0, 0, 0), Width=2)  # disabled

# ----
# Supports - Karamba
all_anchor_points_2 = Point(all_target_anchor_points_4)

pdecon = Deconstruct(Point=all_anchor_points_2)  # -> XComponent, YComponent, ZComponent
equalst_2 = EqualityWithinTolerance(FirstNumber=pdecon.ZComponent, SecondNumber="0", Tolerance=0.001)  # -> Equality, Inequality
cull_10 = CullPattern(List=all_anchor_points_2, CullPattern=equalst_2.Equality)

supp_2 = SupportKaramba3D(PosInd=cull_10, menu=[buttons(on, on, on, off, off, off)])
support_3 = SupportKaramba3D(supp_2)

medges_3 = MeshEdges(Mesh=formfound_mesh_3)  # -> NakedEdges, InteriorEdges, NonManifoldEdges
medges_4 = MeshEdges(Mesh=formfound_mesh_3)  # -> NakedEdges, InteriorEdges, NonManifoldEdges
crv_35 = Curve(medges_3.NakedEdges)
crv_36 = Curve(medges_4.NakedEdges)
join_5 = JoinCurves(Curves=crv_35, Preserve=False)
crv_37 = Curve([<curve referenced from the Rhino model> x31])
join_6 = JoinCurves(Curves=crv_36, Preserve=False)
cull_i_4 = CullIndex(List=join_6, Indices=[1, 5], Wrap=True)
cull_i_5 = CullIndex(List=join_5, Indices=[1, 5], Wrap=True)
divdist_2 = DivideDistance(Curve=cull_i_4, Distance="0.1")  # -> Points, Tangents, Parameters
divdist_3 = DivideDistance(Curve=crv_37, Distance="0.1")  # -> Points, Tangents, Parameters
cullpt_7 = CullDuplicates(Points=flatten(divdist_3.Points), Tolerance=0.001, CullMode=3)  # -> Points, Indices, Valence
shelllineresults_4 = LineResultsOnShellsKaramba3D(
    AnalysedModel=modelview.Model,
    LayerPosition=0,
    ListOfSourcesOfPrincipalStressLinesLinesPoints=cullpt_7.Points,
    SegmentLength_m=0.5,
    DA_deg=5,
    mode="PrincStress")  # -> Model, Lines1, Lines2
crv_38 = Curve(shelllineresults_4.Lines1)
len_6 = Length()

item_14 = ListItem(List=cullpt_7.Points, Index=0, Wrap=True)
crv_39 = Curve(crv_38)
join_7 = JoinCurves(Curves=crv_39, Preserve=False)  # -> flatten(Curves)
join_8 = JoinCurves(Curves=join_7, Preserve=False)
mp_2 = MultiPipe(Curves=join_6, NodeSize=0.03, EndOffset=1, StrutSize=1, Segment=0, KinkAngle=0.6, CubeFit=0, Caps=0)
len_7 = Length(Curve=join_8)
smaller_7 = SmallerThan(FirstNumber=len_7, SecondNumber="0.4")  # -> SmallerThan, OrEqualTo
not_2 = GateNot(A=smaller_7.SmallerThan)
preview_6 = CustomPreview(Geometry=mp_2, Material=ColourSwatch(SwatchColor=RGB(0, 0, 0)))
cull_11 = CullPattern(List=join_8, CullPattern=not_2)
end_3 = EndPoints(Curve=cull_11)  # -> Start, End
dist = Distance(PointA=end_3.Start, PointB=end_3.End)
smaller_8 = SmallerThan(FirstNumber=dist, SecondNumber="0.01")  # -> SmallerThan, OrEqualTo
not_3 = GateNot(A=smaller_8.SmallerThan)
cull_12 = CullPattern(List=cull_11, CullPattern=smaller_8.SmallerThan)
cull_13 = CullPattern(List=cull_11, CullPattern=not_3)
item_15 = ListItem(List=flatten(cull_12), Index=Slider(99, range=0..142), Wrap=True)
ccx = CurveCurve(CurveA=graft(cull_12), CurveB=mshnakededgs.Naked)  # -> Points, ParamsA, ParamsB
trim_2 = TrimTree(Tree=ccx.Points, Depth=1)  # -> simplify(Tree)
lng_3 = ListLength(List=trim_2)  # -> flatten(Length)
int = Integer(lng_3)
py3_5 = Python3Script(x=int)  # -> out, a; inputs x: list of Int32
# ---------- py3_5: Python ----------
list1 = []
for i in x:

    if i == 0:
        a = list1.append(False)
    if i > 0:
        a = list1.append(True)

a = list1
# ---------- end py3_5 ----------
not_4 = GateNot(A=py3_5.a)
cull_14 = CullPattern(List=cull_12, CullPattern=py3_5.a)
crv_40 = Curve(reparameterize(cull_14))
ccx_2 = CurveCurve(CurveA=graft(crv_40), CurveB=mshnakededgs_2.Naked)  # -> Points, ParamsA, ParamsB
trim_3 = TrimTree(Tree=ccx_2.ParamsA, Depth=1)  # -> simplify(Tree)
shatter_4 = Shatter(Curve=graft(crv_40), Parameters=trim_3)  # -> flatten(Segments)
len_8 = Length(Curve=shatter_4)
sort_2 = SortList(Keys=shatter_4, ValuesA=len_8)  # -> Keys, ValuesA
item_16 = ListItem(List=reverse(sort_2.ValuesA), Index=0, Wrap=True)
larger = LargerThan(FirstNumber=item_16, SecondNumber=len_8)  # -> LargerThan, OrEqualTo
cull_15 = CullPattern(List=shatter_4, CullPattern=larger.OrEqualTo)
merge_5 = Merge(Data1=cull_15, Data2=cull_13)  # -> flatten(Result)
len_9 = Length(Curve=merge_5)
larger_2 = LargerThan(FirstNumber=len_9, SecondNumber="30")  # -> LargerThan, OrEqualTo
not_5 = GateNot(A=larger_2.LargerThan)
cull_16 = CullPattern(List=merge_5, CullPattern=not_5)
before = Curve(cull_16)
py3_6 = Python3Script(curve_ids=cull_16, min_dist="0.05")  # -> a, b; inputs curve_ids: list of Curve, min_dist: Double
# ---------- py3_6: Python ----------
import Rhino

def curve_min_distance(crvA, crvB):
    # This overload returns bool, pointOnA, pointOnB
    success, pointOnA, pointOnB = crvA.ClosestPoints(crvB)
    if success:
        print(pointOnA.DistanceTo(pointOnB))
        return pointOnA.DistanceTo(pointOnB)
    else:
        return float('inf')

def remove_curves_too_close(curves, min_dist):
    """
    curves: a list of Rhino.Geometry.Curve objects
    min_dist: float
    returns (kept_list, removed_list),
             each is a subset of `curves` (the actual geometry objects)
    """
    n = len(curves)
    conflicts = {i: [] for i in range(n)}

    # 1. Build conflict adjacency
    for i in range(n):
        for j in range(i+1, n):
            dist_ij = curve_min_distance(curves[i], curves[j])
            if dist_ij < min_dist:
                conflicts[i].append(j)
                conflicts[j].append(i)

    keep_indices = set(range(n))

    # 2. Greedy removal
    while True:
        conflict_found = False
        for i in keep_indices:
            for j in conflicts[i]:
                if j in keep_indices and i < j:
                    conflict_found = True
                    break
            if conflict_found:
                break

        if not conflict_found:
            break

        # find worst offender
        worst_index = None
        max_conf = -1
        for i in keep_indices:
            ccount = sum(1 for x in conflicts[i] if x in keep_indices)
            if ccount > max_conf:
                max_conf = ccount
                worst_index = i

        if worst_index is not None:
            keep_indices.remove(worst_index)

    removed_indices = set(range(n)) - keep_indices
    kept_curves = [curves[i] for i in keep_indices]
    removed_curves = [curves[i] for i in removed_indices]
    return kept_curves, removed_curves

# --------------------------------------------------
# GHPython component "run" code:
# Inputs:
#    x  -> list of Rhino.Geometry.Curve
#    y  -> float (min_dist)
# Outputs:
#    a  -> kept curves (geometry)
#    b  -> removed curves (geometry)
# --------------------------------------------------


kept, removed = remove_curves_too_close(curve_ids, min_dist)
a = kept
b = removed
# ---------- end py3_6 ----------
crv_41 = Curve(py3_6.a)
after = Curve(crv_41)

# ---- group: Construct degenrate curves manually
mesh_3 = Mesh(shellview.MeshesOfRenderedShells)
msh2psrf_3 = MeshToPolysurface(Mesh=mesh_3, Triangles=False, FaceMerge=False)
# 4. Seed curves and get PSL_2
model_2 = ModelKaramba3D(modelview.Model)
degenrate_curves_2_2 = Curve(degenrate_curves_2)
# ----
tracer_automatic_3d_self_single_loop_for = Python3Script(
    seed_points=item_12,
    principal_vectors=vec_2,
    points=shellvecresults.Points,
    domain_surface=msh2psrf_3,
    boundary_curves=join_6,
    stress_values=multiplication_6)  # -> out, a, b, w, Error_message, c, warning; "Tracer_automatic_3d_self_single_loop_force"; inputs seed_points: list of Point3d, principal_vectors: list of Vector3d, points: list of Point3d, domain_surface: Brep, collision_threshold: Double, boundary_curves: list of Curve, stress_values: list of Double; disabled
# ---------- tracer_automatic_3d_self_single_loop_for: Python ----------
import math
import numpy as np
import rhinoscriptsyntax as rs
import Rhino.Geometry as rg
import scriptcontext as sc
from scipy.spatial import KDTree
import heapq
from ghpythonlib import treehelpers as tr


# ------------------------------------------------------------------------
# Variables
# ------------------------------------------------------------------------

#BASIC
h = 0.1
num_steps = 4000
k = 15
boundary_tolerance = h
collision_threshold = 0.05
offset_distance = 0.2
steps_back = 5



#ADVANCED
sample_count = 1000
min_seed_distance = 0.09 #collision_threshold * 1.5
seed_boundary_dist = min_seed_distance
sample_interval = 2
closing_threshold=0.1

# ------------------------------------------------------------------------
# Helper functions
# ------------------------------------------------------------------------
def to_xyz(pt_or_vec):
    """Converts Rhino.Geometry.Point3d or Vector3d (or numeric [x,y,z]) to a Python list [x, y, z]."""
    if hasattr(pt_or_vec, "X"):
        return [pt_or_vec.X, pt_or_vec.Y, pt_or_vec.Z]
    else:
        # Already [x,y,z]
        return [pt_or_vec[0], pt_or_vec[1], pt_or_vec[2]]

def distance_3d(a, b):
    return math.sqrt((a[0]-b[0])**2 + (a[1]-b[1])**2 + (a[2]-b[2])**2)

def normalize(vector):
    """Normalize a vector (2D) to unit length."""
    magnitude = math.sqrt(vector[0]**2 + vector[1]**2+vector[2]**2)
    return [vector[0] / magnitude, vector[1] / magnitude,vector[2] / magnitude] if magnitude != 0 else [0, 0, 0]

def to_numeric(vec):
    """Convert a Rhino object to a numeric [x,y,z] list; otherwise return vec as-is."""
    try:
        return [vec.X, vec.Y, vec.Z]
    except AttributeError:
        return vec

def find_closest_neighbors_kd(point, kd_tree, k):
    """
    Given a 2D point (as [x,y]) and a pre-built KDTree,
    return a list of indices of the k closest points.
    """

    distances, indices = kd_tree.query(point,k=k)
    if isinstance(indices, int):
        return [indices]
    return list(indices)

def build_polyline_curve_3d(poly_pts):
    pts3d = [rg.Point3d(pt[0], pt[1], pt[2]) for pt in poly_pts]
    poly = rg.Polyline(pts3d)
    return rg.PolylineCurve(poly)

def project_onto_surface(surface, pt3d, tolerance=200):
    pt_rh = rg.Point3d(pt3d[0], pt3d[1], pt3d[2])
    
    if isinstance(surface, rg.Brep):
        # Note the 6 returned values:
        rc, closest_pt, cindex, u, v, normal = surface.ClosestPoint(pt_rh, tolerance)
        if rc:
            # Check if cindex is a face
            if cindex.ComponentIndexType == rg.ComponentIndexType.BrepFace:
                face_id = cindex.Index
                face = surface.Faces[face_id]
                
                # 'closest_pt' is the 3D point on that face
                # Optionally confirm it's within the face domain or do face.IsPointOnFace(u,v)
                
                return [closest_pt.X, closest_pt.Y, closest_pt.Z]
            else:
                # The closest component might be an edge or vertex
                return None
        else:
            return None
    
    elif isinstance(surface, rg.Surface):
        rc, u, v = surface.ClosestPoint(pt_rh)
        if rc:
            pt_srf = surface.PointAt(u, v)
            return [pt_srf.X, pt_srf.Y, pt_srf.Z]
        else:
            return None
    else:
        return None

def distance_to_brep_edges(pt3d, boundary_curves):
    test_pt = rg.Point3d(pt3d[0], pt3d[1], pt3d[2])
    min_dist = float('inf')
    best_cp = None  # keep track of the closest point so far
    
    for crv in boundary_curves:
        rc, t = crv.ClosestPoint(test_pt)
        if rc:
            cp = crv.PointAt(t)
            dist = cp.DistanceTo(test_pt)
            if dist < min_dist:
                min_dist = dist
                best_cp = cp
    
    return min_dist, best_cp



def is_on_surface(surface, pt3d, tol=0.01):
    """
    Returns True if pt3d is within 'tol' of the surface. 
    """
    if not surface: 
        return True  # no surface provided
    pproj = project_onto_surface(surface, pt3d)
    if pproj is None:
        return False
    dx = pt3d[0] - pproj[0]
    dy = pt3d[1] - pproj[1]
    dz = pt3d[2] - pproj[2]
    dist = math.sqrt(dx*dx + dy*dy + dz*dz)
    return (dist < tol)



# ------------------------------------------------------------------------
# Tracing functions
# ------------------------------------------------------------------------

def runge_kutta_step_3d(
    current_point, 
    current_dir,
    h, 
    k, 
    principal_vectors, 
    points_3d, 
    step_sign, 
    kd_tree, 
    boundary_curves=None, 
    boundary_tolerance=1, prev_dir=None):
    """
    Perform one RK4 step in 3D. Stop if next point is within 'boundary_tolerance'
    of any boundary curve (edges).
    Returns the next 3D point or None if out-of-bound / near boundary.
    """
    
    # 1) Neighbors & dynamic step size
    neighbors = find_closest_neighbors_kd(current_point, kd_tree, k)
    h = h * step_sign#adjust_step_size_3d(current_point, neighbors, points_3d, step_sign)
    
    # k1
    k1_dir = interpolate_vector(current_point, points_3d, principal_vectors, neighbors, current_dir)
    mid1 = [
        current_point[0] + 0.5*h*k1_dir[0],
        current_point[1] + 0.5*h*k1_dir[1],
        current_point[2] + 0.5*h*k1_dir[2]
    ]
    
    # k2
    neigh_mid1 = find_closest_neighbors_kd(mid1, kd_tree, k)
    k2_dir = interpolate_vector(mid1, points_3d, principal_vectors, neigh_mid1, k1_dir)
    mid2 = [
        current_point[0] + 0.5*h*k2_dir[0],
        current_point[1] + 0.5*h*k2_dir[1],
        current_point[2] + 0.5*h*k2_dir[2]
    ]
    
    # k3
    neigh_mid2 = find_closest_neighbors_kd(mid2, kd_tree, k)
    k3_dir = interpolate_vector(mid2, points_3d, principal_vectors, neigh_mid2, k2_dir)
    end_pt = [
        current_point[0] + h*k3_dir[0],
        current_point[1] + h*k3_dir[1],
        current_point[2] + h*k3_dir[2]
    ]
    
    # k4
    neigh_end = find_closest_neighbors_kd(end_pt, kd_tree, k)
    k4_dir = interpolate_vector(end_pt, points_3d, principal_vectors, neigh_end, k3_dir)
    
    # Summation
    dx = h*(k1_dir[0] + 2*k2_dir[0] + 2*k3_dir[0] + k4_dir[0]) / 6.0
    dy = h*(k1_dir[1] + 2*k2_dir[1] + 2*k3_dir[1] + k4_dir[1]) / 6.0
    dz = h*(k1_dir[2] + 2*k2_dir[2] + 2*k3_dir[2] + k4_dir[2]) / 6.0
    
    next_point = [
        current_point[0] + dx,
        current_point[1] + dy,
        current_point[2] + dz
    ]
    next_dir = k4_dir

    if domain_surface is not None:
        projected = project_onto_surface(domain_surface, next_point)
        #print(projected)
        if projected is None:
            # Means we're off domain or near an open edge you consider invalid
            return None
        next_point = projected  # accept the projected coordinate

    # 2) Check distance to boundary edges, if we have them
    # if boundary_curves:
    #     dist_to_edge = distance_to_brep_edges(next_point, boundary_curves)
    #     if dist_to_edge < boundary_tolerance:
    #         # We consider that "off" or "too close" => stop
    #         return None

    # Otherwise return the next valid point
    return next_point, next_dir

def interpolate_vector(point, points, vectors, neighbors, ref_dir):
    """
    Distance-weighted interpolation of neighbor vectors in 3D,
    flipping each neighbor's vector if dot < 0 with respect to 'ref_dir'.

    - pt: [x, y, z], the point where we want the interpolated vector
    - points_3d: Nx3 array of point coords
    - vectors_3d: Nx3 array of principal vectors
    - neighbors: list of indices from the KDTree
    - ref_dir: [dx, dy, dz], the direction from the previous step (or None if first step)
    """
    weights = []
    weighted_vec = [0.0, 0.0, 0.0]

    for i in neighbors:
        vx, vy, vz = vectors[i]  # copy so we can flip locally
        if ref_dir is not None:
            dotp = vx*ref_dir[0] + vy*ref_dir[1] + vz*ref_dir[2]
            if dotp < 0:
                vx, vy, vz = -vx, -vy, -vz
        
        npt = points[i]
        dx = point[0] - npt[0]
        dy = point[1] - npt[1]
        dz = point[2] - npt[2]
        dist = (dx*dx + dy*dy + dz*dz)**0.5
        
        w = 1.0 / (dist + 1e-6)
        weights.append(w)
        
        weighted_vec[0] += vx*w
        weighted_vec[1] += vy*w
        weighted_vec[2] += vz*w

    total_w = sum(weights)
    if total_w > 1e-12:
        weighted_vec[0] /= total_w
        weighted_vec[1] /= total_w
        weighted_vec[2] /= total_w

    mag = (weighted_vec[0]**2 + weighted_vec[1]**2 + weighted_vec[2]**2)**0.5
    if mag < 1e-12:
        return [0.0, 0.0, 0.0]
    
    return [weighted_vec[0]/mag, weighted_vec[1]/mag, weighted_vec[2]/mag]

# ------------------------------------------------------------------------
# Collision checks
# ------------------------------------------------------------------------


def closest_point_on_polyline_3d(pt3d, poly_curve):
    """
    Return (closest_point, distance) from a 3D point to a polyline curve.
    """
    test_pt = rg.Point3d(pt3d[0], pt3d[1], pt3d[2])
    rc, t = poly_curve.ClosestPoint(test_pt)
    if rc:
        cp = poly_curve.PointAt(t)
        dist = cp.DistanceTo(test_pt)
        #print(dist)
        return [cp.X, cp.Y, cp.Z], dist
    else:
        return None, float('inf')

def find_closest_existing_line_3d(next_point, existing_trajectories, threshold):
    """
    Among all previously traced lines (in 3D), find if 'next_point' is within 'threshold' of any line.
    Returns (closest_line_index, closest_point_on_line, distance).
    """
    min_dist = float('inf')
    closest_line_idx = None
    closest_pt = None
    
    for i, (polyline_pts, poly_curve) in enumerate(existing_trajectories):
        cp, dist = closest_point_on_polyline_3d(next_point, poly_curve)
        if dist < min_dist:
            min_dist = dist
            closest_line_idx = i
            closest_pt = cp
    
    if min_dist < threshold:
        return (closest_line_idx, closest_pt, min_dist)
    else:
        return (None, None, float('inf'))

def find_most_parallel_boundary_point(
    current_pt,
    last_step_vec,
    boundary_points,
    k=10):
    """
    Given a KD-tree of boundary sample points (boundary_kdtree)
    and the original array (boundary_points),
    find the boundary sample whose direction from current_pt 
    is most opposite (or "most parallel" – depends on how you measure) 
    to last_step_vec. Return (best_point, min_dist).

    boundary_points should be a Nx3 np.array or a list of [x,y,z].
    """
    
    if boundary_kdtree is None:
        return None, float('inf')
    
    cur_np = np.array(current_pt, dtype=float)
    step_np = np.array(last_step_vec, dtype=float)
    
    # if zero length, can't define direction
    step_len = np.linalg.norm(step_np)
    if step_len < 1e-12:
        return None, float('inf')
    step_np /= step_len
    
    # 1) Quickly find the 'k' closest boundary samples to current_pt
    #    using the KD-tree:
    #    If k=1, you'll get a single distance & index as floats
    #    If k>1, arrays
    distances, indices = boundary_kdtree.query(cur_np, k=k)

    # If k=1, make them arrays for consistency
    if k == 1:
        distances = [distances]
        indices = [indices]

    # 2) Among these k points, pick the direction which has 
    #    the smallest dot or largest negative dot, etc.
    best_dot = 9999
    best_pt = None
    min_dist = float('inf')

    # boundary_points is Nx3

    for dist, idx in zip(distances, indices):
        cand_np = boundary_points_array[idx]  # shape (3,)
        dir_vec = cand_np - cur_np
        dir_len = np.linalg.norm(dir_vec)
        if dir_len < 1e-12:
            continue
        dir_unit = dir_vec / dir_len
        dot_val = np.dot(dir_unit, step_np)
        
        # Suppose you want the direction that is "most parallel but reversed"
        # => you'd pick the smallest dot_val. If you want "most parallel, same direction,"
        # => you'd pick largest dot_val. 
        if dot_val < best_dot:
            best_dot = dot_val
            best_pt = cand_np
            # optional: track the boundary distance as well
            if dist < min_dist:
                min_dist = dist

    # Convert best_pt to Rhino point
    if best_pt is not None:
        return rg.Point3d(best_pt[0], best_pt[1], best_pt[2]), min_dist
    else:
        return None, float('inf')

# ------------------------------------------------------------------------
# Sampling and offset functions
# ------------------------------------------------------------------------


def surface_normal_at_point(surface, pt3d, tolerance=2):
    """
    Returns the surface normal [nx, ny, nz] at a 3D point on a multi-face Brep or rg.Surface.
    If near an open edge or invalid, returns None.
    """
    pt_rh = rg.Point3d(pt3d[0], pt3d[1], pt3d[2])

    if isinstance(surface, rg.Brep):
        stuff = surface.ClosestPoint(pt_rh, tolerance)
        if not stuff or len(stuff) < 6:
            return None
        b = stuff[0]
        rc = stuff[1]
        #print(rc)
        comp_index = stuff[2]
        u = stuff[3]
        v = stuff[4]
        # stuff[4] => cpt
        # stuff[5] => guess_normal
        if not rc:
            return None
        
        # If it's a face, we evaluate the face normal at (u, v)
        if comp_index.ComponentIndexType == rg.ComponentIndexType.BrepFace:
            face_id = comp_index.Index
            face = surface.Faces[face_id]
            exact_normal = face.NormalAt(u, v)
            if exact_normal:
                return [exact_normal.X, exact_normal.Y, exact_normal.Z]
            else:
                return None
        else:
            # edge/vertex
            return None
    
    elif isinstance(surface, rg.Surface):
        rc, u, v = surface.ClosestPoint(pt_rh)
        if rc:
            exact_normal = surface.NormalAt(u, v)
            return [exact_normal.X, exact_normal.Y, exact_normal.Z]
        else:
            return None

    # Not a Brep or Surface
    return None

def offset_seed(psl_pts_3d, index, offset_distance, surface):
    """
    Offsets the PSL at psl_pts_3d[index] in the local tangent plane of 'surface'.
    Steps:
      1) Compute PSL tangent at index
      2) Get surface normal at that point
      3) binormal = cross(surface_normal, psl_tangent)
      4) candidate1 = point + offset_distance*binormal
         candidate2 = point - offset_distance*binormal
      5) (optional) project candidates back onto the surface
    Returns: (candidate1, candidate2) as [x, y, z], or (None, None) on error.
    """
    n = len(psl_pts_3d)
    if n < 2:
        return None, None
    
    # 0) Current point
    px, py, pz = psl_pts_3d[index]
    
    # 1) PSL TANGENT
    if index == 0:
        # Use next point - current point
        nx, ny, nz = psl_pts_3d[1]
        tx = nx - px
        ty = ny - py
        tz = nz - pz
    elif index == n - 1:
        # Use current point - prev point
        px_prev, py_prev, pz_prev = psl_pts_3d[n - 2]
        tx = px - px_prev
        ty = py - py_prev
        tz = pz - pz_prev
    else:
        # Middle: use psl_pts_3d[index+1] - psl_pts_3d[index-1]
        px_prev, py_prev, pz_prev = psl_pts_3d[index - 1]
        px_next, py_next, pz_next = psl_pts_3d[index + 1]
        tx = px_next - px_prev
        ty = py_next - py_prev
        tz = pz_next - pz_prev

    # Normalize tangent
    t_len = math.sqrt(tx*tx + ty*ty + tz*tz)
    if t_len < 1e-12:
        return None, None
    tx /= t_len
    ty /= t_len
    tz /= t_len
    
    # 2) SURFACE NORMAL
    normal = surface_normal_at_point(surface, [px, py, pz])
    if not normal:
        print("no normal")
        return None, None
    nx, ny, nz = normal
    n_len = math.sqrt(nx*nx + ny*ny + nz*nz)
    if n_len < 1e-12:
        return None, None
    nx /= n_len
    ny /= n_len
    nz /= n_len
    
    # 3) BINORMAL = cross(normal, tangent)
    # This is guaranteed to be in the tangent plane if PSL is truly tangent to the surface
    # If the PSL isn't exactly tangent, you'll get some tilt. 
    bx = ny*tz - nz*ty
    by = nz*tx - nx*tz
    bz = nx*ty - ny*tx
    b_len = math.sqrt(bx*bx + by*by + bz*bz)
    if b_len < 1e-12:
        # Means normal and tangent are parallel or something degenerate
        return None, None
    bx /= b_len
    by /= b_len
    bz /= b_len
    
    # 4) OFFSET POINTS
    candidate1 = [px + offset_distance*bx,
                  py + offset_distance*by,
                  pz + offset_distance*bz]
    candidate2 = [px - offset_distance*bx,
                  py - offset_distance*by,
                  pz - offset_distance*bz]
    
    # 5) (OPTIONAL) Project them onto the surface if you want them exactly on the domain
    candidate1_proj = project_onto_surface(surface, candidate1)
    #print(f"this point is seed {candidate1_proj}")
    candidate2_proj = project_onto_surface(surface, candidate2)
    # if not candidate1_proj or not candidate2_proj:
    #     return None, None
    # return candidate1_proj, candidate2_proj

    # If you don't need the final projection, just return them:
    return candidate1_proj, candidate2_proj

def sample_psl_3d(psl_pts, sample_interval):
    """
    Given a PSL (list of Rhino Point3d or numeric [x,y,z] points),
    sample it every 'sample_interval' points.
    Returns a list of tuples: ( [x,y,z], original_index )
    """
    samples = []
    for i in range(0, len(psl_pts), sample_interval):
        pt3d = psl_pts[i]
        # Convert to numeric [x,y,z] if it's a Point3d
        if hasattr(pt3d, "X"):
            samples.append(([pt3d.X, pt3d.Y, pt3d.Z], i))
        else:
            samples.append((pt3d, i))
    return samples

def is_valid_seed(candidate, existing_trajectories, min_distance, boundary_curves):
    """
    Check if candidate seed is valid:
      - It is not too close to any existing PSL (using min_distance).
      - It is not too close to any boundary curves (if boundary_curves is provided and
        candidate's distance < boundary_tolerance).
    """
    # Check candidate against existing PSLs
    idx, cp, dist = find_closest_existing_line_3d(candidate, existing_trajectories, min_distance)
    if idx is not None:
        return False

    # Check candidate against boundary curves if provided
    if boundary_curves:
        dist_edge, cp_edge = distance_to_brep_edges(candidate, boundary_curves)
        if dist_edge < seed_boundary_dist:
            return False

    return True

def get_stress_value(sample_pt, kd_tree, stress_values):
    """
    Query the stress_kdtree to find the nearest stress sample.
    Return the corresponding stress value from stress_values.
    """
    # sample_pt is [x, y] in 2D
    dist, idx = kd_tree.query(sample_pt)  # single neighbor
    # stress_values[idx] is the stress at the nearest stress point
    return stress_values[idx]

# ------------------------------------------------------------------------
# Tracing logic
# ------------------------------------------------------------------------

def trace_psl_both_directions(
    seed_point_3d, 
    h, 
    num_steps, 
    k, 
    principal_vectors, 
    points_3d,
    boundary_curves=None,
    boundary_tolerance=boundary_tolerance,
    existing_trajectories=None,
    collision_threshold=collision_threshold,
    closing_threshold=closing_threshold, 
    kd_tree=None):
    """
    Single-loop approach where forward/backward can stop independently.
    If forward hits a collision/boundary, it stops, but backward can continue, and vice versa.
    We only stop the entire PSL when BOTH directions are inactive, or when tips meet.
    """
    if existing_trajectories is None:
        existing_trajectories = []
    
    import Rhino.Geometry as rg
    bridging_lines = []
    edge_lines = []

    # We'll keep two lines: forward and backward
    forward_line = [rg.Point3d(*seed_point_3d)]
    backward_line = [rg.Point3d(*seed_point_3d)]
    
    # Current forward/backward points + directions
    f_current_pt = list(seed_point_3d)
    f_current_dir = None
    b_current_pt = list(seed_point_3d)
    b_current_dir = None

    # NEW: Boolean flags to track if forward/backward are still active
    forward_active = True
    backward_active = True

    for step_i in range(num_steps):
        
        # ---------------------------
        # FORWARD STEP (if still active)
        # ---------------------------
        if forward_active:
            f_next = runge_kutta_step_3d(
                f_current_pt,
                f_current_dir,
                h,
                k,
                principal_vectors,
                points_3d,
                step_sign=+1,
                kd_tree=kd_tree,
                boundary_curves=boundary_curves,
                boundary_tolerance=boundary_tolerance
            )
            if not f_next or f_next[0] is None:
                print(f"PSL forward direction stopped at iteration {step_i}.")
                forward_active = False
            else:
                f_next_pt, f_next_dir = f_next
                # Collision check with existing PSLs
                if existing_trajectories:
                    line_idx, close_pt, dist_cl = find_closest_existing_line_3d(
                        f_next_pt, existing_trajectories, collision_threshold
                    )
                    if line_idx is not None and close_pt is not None:
                        # Instead of break, we do bridging & disable forward
  
                        if len(forward_line) > steps_back:
                            bridging_line = rg.Line(
                                forward_line[-steps_back],
                                rg.Point3d(*close_pt)
                            )
                            bridging_lines.append(bridging_line)
                            del forward_line[-(steps_back-1):]

                        if len(forward_line)==0 or len(backward_line)==1:
                            print("too short for bridge")
                        else:
                            bridging_line = rg.Line(
                                forward_line[-1],
                                rg.Point3d(*close_pt)
                            )
                            bridging_lines.append(bridging_line)
                        
                        print(f"PSL forward collided with line {line_idx} at dist {dist_cl:.3f}.")
                        forward_active = False

                    # 2) Check distance to boundary edges, if we have them
                if boundary_curves:
                    dir_vec = [-1*x for x in f_next_dir]
                    cp,dist_to_edge = find_most_parallel_boundary_point(f_next_pt,dir_vec,boundary_curves,k=10)
                    if dist_to_edge < boundary_tolerance:
                        # We consider that "off" or "too close" => stop
                        print(f"PSL forward reached boundary.")
                        forward_active = False
                        bridging_line = rg.Line(
                                forward_line[-1],
                                rg.Point3d(cp)
                        )
                        bridging_lines.append(bridging_line)

                # If still active, accept the new forward step
                if forward_active:
                    forward_line.append(rg.Point3d(*f_next_pt))
                    f_current_pt = f_next_pt
                    f_current_dir = f_next_dir

        # ---------------------------
        # BACKWARD STEP (if still active)
        # ---------------------------
        if backward_active:
            b_next = runge_kutta_step_3d(
                b_current_pt,
                b_current_dir,
                h,
                k,
                principal_vectors,
                points_3d,
                step_sign=-1,
                kd_tree=kd_tree,
                boundary_curves=boundary_curves,
                boundary_tolerance=boundary_tolerance
            )
            if not b_next or b_next[0] is None:
                print(f"PSL backward direction stopped at iteration {step_i}.")
                backward_active = False
            else:
                b_next_pt, b_next_dir = b_next
                # Collision check with existing PSLs
                if existing_trajectories:
                    line_idx, close_pt, dist_cl = find_closest_existing_line_3d(
                        b_next_pt, existing_trajectories, collision_threshold
                    )
                    if line_idx is not None and close_pt is not None:
                       
                        if len(backward_line) > steps_back:
                            bridging_line = rg.Line(
                                backward_line[-steps_back],
                                rg.Point3d(*close_pt)
                            )
                            bridging_lines.append(bridging_line)
                            del backward_line[-(steps_back-1):]

                        if len(backward_line)==0 or len(backward_line)==1:
                            print("too short for bridge")
                        else:
                            bridging_line = rg.Line(
                                backward_line[-1],
                                rg.Point3d(*close_pt)
                            )
                            bridging_lines.append(bridging_line)

                        print(f"PSL backward collided with line {line_idx} at dist {dist_cl:.3f}.")
                        backward_active = False


                if boundary_curves:
                    cp,dist_to_edge = find_most_parallel_boundary_point(b_next_pt,b_next_dir,boundary_curves,k=10)
                    if dist_to_edge < boundary_tolerance:
                        # We consider that "off" or "too close" => stop
                        print(f"PSL forward reached boundary.")
                        backward_active = False
                        bridging_line = rg.Line(
                                backward_line[-1],
                                rg.Point3d(cp)
                        )
                        bridging_lines.append(bridging_line)

                # If still active, accept the new backward step
                if backward_active:
                    backward_line.append(rg.Point3d(*b_next_pt))
                    b_current_pt = b_next_pt
                    b_current_dir = b_next_dir
        
        # ---------------------------
        # Check if BOTH directions are done
        # ---------------------------
        if not forward_active and not backward_active:
            print("Both forward & backward directions inactive => stopping PSL.")
            break

        # ---------------------------
        # TIP DISTANCE CHECK
        # ---------------------------
        # Only if both are still active
        if forward_active and backward_active and step_i >= 10:
            f_xyz = [forward_line[-1].X, forward_line[-1].Y, forward_line[-1].Z]
            b_xyz = [backward_line[-1].X, backward_line[-1].Y, backward_line[-1].Z]
            dist_fb = distance_3d(f_xyz, b_xyz)
            if dist_fb < closing_threshold:
                bridging_line = rg.Line(
                    forward_line[-1],
                    backward_line[-1]
                )
                bridging_lines.append(bridging_line)

                print(
                    f"PSL tips meet at iteration {step_i}, dist= {dist_fb:.3f} < {closing_threshold}."
                )
                # Here we might disable both directions or just break:
                forward_active = False
                backward_active = False
                break
    
    # Merge lines
    backward_line.reverse()
    if len(backward_line) > 1:
        backward_line.pop()
    merged_pts = backward_line + forward_line
    
    return merged_pts, bridging_lines, edge_lines

def generate_all_psls_3d(
    initial_seed_3d,
    h, 
    num_steps, 
    k, 
    principal_vectors, 
    points_3d,
    kd_tree,
    boundary_curves,
    collision_threshold,
    sample_interval,
    min_seed_distance,
    # NEW: for stress-based offset
    stress_values):
    """
    Generate PSLs using an iterative seeding strategy (3D version)
    with a GLOBAL PRIORITY QUEUE for candidate seeds based on stress.

    1) Trace an initial PSL from initial_seed_3d.
    2) Sample it, pushing candidate seeds into a priority queue (max stress first).
    3) Pop the highest-stress seed, validate it, trace a PSL, sample it, push new seeds...
    4) Stop when the priority queue is empty.

    Returns:
      - all_psls: list of (psl_points_3d, polyline_curve_3d)
      - bridging_lines: bridging segments
      - positive_candidates: seeds that were actually used
    """
    # 1) Trace the initial PSL
    initial_psl, initial_bridges, initial_edges = trace_psl_both_directions(
        seed_point_3d=initial_seed_3d,
        h=h,
        num_steps=num_steps,
        k=k,
        principal_vectors=principal_vectors,
        points_3d=points_3d,
        boundary_curves=boundary_curves,
        boundary_tolerance=boundary_tolerance,
        existing_trajectories=None,
        collision_threshold=collision_threshold,
        kd_tree=kd_tree
    )
    # Convert to curve for collision checks
    initial_curve = build_polyline_curve_3d(initial_psl)

    all_psls = [(initial_psl, initial_curve)]
    bridging_lines = []
    positive_candidates = []
    edges = []
    offsets = []


    if initial_bridges:
        bridging_lines.extend(initial_bridges)

    if initial_edges:
        edges.extend(initial_edges)

    # Helper: sample a PSL, push seeds to a global priority queue
    def add_candidates_from_psl(psl_points, sample_interval):
        samples = sample_psl_3d(psl_points, sample_interval)  # => [ ([x,y,z], index), ... ]
        print(len(samples))
        psl_numeric = [[pt.X, pt.Y, pt.Z] for pt in psl_points]

        for (sample_pt_3d, orig_index) in samples:
            # 1) Query stress
            stress_val = get_stress_value(sample_pt_3d,kd_tree, stress_values)
            # 2) Compute dynamic offset e.g. offset = bar_capacity / stress_val, clamped
            if stress_val < 1e-6:
                continue
            raw_offset = 10 / stress_val
            #print(raw_offset)
            

            dyn_offset = min(raw_offset, 0.5) 
            #print(f"dyn_offset: {dyn_offset}")
            offsets.append(dyn_offset)
            if dyn_offset < collision_threshold:
                from Grasshopper.Kernel import GH_RuntimeMessageLevel as RML
                ghenv.Component.AddRuntimeMessage(RML.Warning, "Warning: Needed offset is smaller than collision_threshold -> Choose higher rebar diameter")
                print("Warning: Needed offset is smaller than collision_threshold -> Choose higher rebar diameter")
                warning = "Warning: Needed offset is smaller than collision_threshold -> Choose higher rebar diameter"

            # 3) Generate offset candidates
            cand1, cand2 = offset_seed(psl_numeric, orig_index, dyn_offset, domain_surface)
            for c in [cand1, cand2]:
                if c is not None:
                    # Use negative stress as priority => max stress first
                    heapq.heappush(candidate_queue, (-stress_val, c))
                    
    # 2) Initialize a global priority queue for seeds
    candidate_queue = []
    # Sample the initial PSL, push seeds
    add_candidates_from_psl(initial_psl, sample_interval)

    # 3) Process the global priority queue
    while candidate_queue:
        neg_stress, candidate_3d = heapq.heappop(candidate_queue)
        s_val = -neg_stress
        
        # Check if candidate is valid: 
        #   1) not too close to existing PSLs
        #   2) not too close to domain boundary if you do so in is_valid_seed
        #   3) optionally: on surface, etc.
        if not is_valid_seed(candidate_3d, all_psls, min_seed_distance, boundary_curves):
            continue
        positive_candidates.append(candidate_3d)
        # Now trace a PSL from this candidate
        new_psl, new_bridges, new_edges = trace_psl_both_directions(
            seed_point_3d=candidate_3d,
            h=h,
            num_steps=num_steps,
            k=k,
            principal_vectors=principal_vectors,
            points_3d=points_3d,
            boundary_curves=boundary_curves,
            boundary_tolerance=boundary_tolerance,
            existing_trajectories=all_psls,
            collision_threshold=collision_threshold,
            kd_tree=kd_tree
        )
        new_curve = build_polyline_curve_3d(new_psl)
        all_psls.append((new_psl, new_curve))
        if new_bridges:
            bridging_lines.extend(new_bridges)

        if new_edges:
            edges.extend(new_edges)

        # Immediately sample the new PSL => add new seeds
        add_candidates_from_psl(new_psl, sample_interval)

    return all_psls, bridging_lines, positive_candidates, edges, offsets


# ------------------------------------------------------------------------
# Build KD Trees
# ------------------------------------------------------------------------

#1) mesh points kdtree
points_array_3d = [to_xyz(pt) for pt in points]
points_np = np.array(points_array_3d)  # shape (N, 3)
kd_tree = KDTree(points_np)

#2) boundary sample points kdtree
sampled_boundary_pts = []
for crv in boundary_curves:
    params = crv.DivideByCount(sample_count, True)
    for t in params:
        p = crv.PointAt(t)
        sampled_boundary_pts.append([p.X, p.Y, p.Z])

# Build KDTree for boundary points
if sampled_boundary_pts:
    boundary_points_array = np.array(sampled_boundary_pts, dtype=float)
    boundary_kdtree = KDTree(boundary_points_array)
else:
    boundary_kdtree = None







initial_seed_3d = to_xyz(seed_points[0])
principal_vectors_3d = [to_xyz(vec) for vec in principal_vectors]








# ----------------------------------------------------------------------
# CALL YOUR 3D PSL GENERATION FUNCTION
# ----------------------------------------------------------------------




all_psls, bridging_lines, positive_candidates,edges,offsets = generate_all_psls_3d(
    initial_seed_3d,
    h,
    num_steps,
    k,
    principal_vectors_3d,   # 3D vectors
    points_array_3d,        # 3D points
    kd_tree,
    boundary_curves,
    collision_threshold,
    sample_interval,
    min_seed_distance,
    stress_values

)


# ----------------------------------------------------------------------
# PREPARE OUTPUTS FOR GH
# ----------------------------------------------------------------------
# 1) PSL polylines as GH curves
psl_curves = [psl_curve for (psl_points, psl_curve) in all_psls]



# 3) Convert positive_candidates to Point3d
generated_seed_points = [rg.Point3d(pc[0], pc[1], pc[2]) for pc in positive_candidates]
from ghpythonlib import treehelpers as tr
# 4) Finally set GH outputs (A, B, C, e.g.)
a = tr.list_to_tree(psl_curves)
b = tr.list_to_tree(bridging_lines)
w = tr.list_to_tree(generated_seed_points)
#c = tr.list_to_tree(edges)
c = tr.list_to_tree(offsets)
# ---------- end tracer_automatic_3d_self_single_loop_for ----------
crv_42 = Curve([tracer_automatic_3d_self_single_loop_for.a, tracer_automatic_3d_self_single_loop_for.b])
project_5 = ProjectPoint(Point=py3_3.a, Direction=Z_2, Geometry=msh2psrf_3)  # -> Point, Index
textdot_2 = DefineTextDot(Text=py3_3.Type, Location=project_5.Point, Font="Arial", Size=14)
pt_26 = Point(project_5.Point)
line = LineSDL(Start=graft(pt_26), Direction=vec_3.Vector, Length=0.1)
crv_43 = Curve(line)
cull_i_6 = CullIndex(List=degenrate_curves_2_2, Indices=[4, 5], Wrap=True)

# ---- group: Construct degenrate curves manually (continued)
project_6 = Project(Curve=cull_i_6, Brep=msh2psrf_3, Direction=Vector(0, 0, 1))
divdist_4 = DivideDistance(Curve=project_6, Distance=0.05)  # -> flatten(Points), Tangents, Parameters
shelllineresults_5 = LineResultsOnShellsKaramba3D(
    AnalysedModel=model_2,
    LayerPosition=0,
    ListOfSourcesOfPrincipalStressLinesLinesPoints=divdist_4.Points,
    SegmentLength_m="0.1",
    DA_deg=5,
    mode="PrincStress")  # -> Model, Lines1, Lines2

# ----
item_17 = ListItem(List=divdist_4.Points, Index=[1510, 1520, 1530, 1540, 1550], Wrap=True)

cullpt_8 = CullDuplicates(Points=flatten([divdist_2.Points, item_17]), Tolerance=0.001, CullMode=3)  # -> Points, Indices, Valence
shelllineresults_6 = LineResultsOnShellsKaramba3D(
    AnalysedModel=modelview.Model,
    LayerPosition=0,
    ListOfSourcesOfPrincipalStressLinesLinesPoints=cullpt_8.Points,
    SegmentLength_m=0.5,
    DA_deg=5,
    mode="PrincStress")  # -> Model, Lines1, Lines2
tracer_automatic_3d_self_single_loop = Python3Script(
    seed_points=pt_19,
    principal_vectors=shellvecresults.SecondPrincipalStressVector_kN_cm²,
    points=shellvecresults.Points,
    domain_surface=msh2psrf_3,
    collision_threshold="0.05",
    boundary_curves=join_5)  # -> out, a, b, w, Error_message; inputs seed_points: list of Point3d, principal_vectors: list of Vector3d, points: list of Point3d, domain_surface: Brep, collision_threshold: Double, boundary_curves: list of Curve; disabled
# ---------- tracer_automatic_3d_self_single_loop: Python ----------
import math
import numpy as np
import rhinoscriptsyntax as rs
import Rhino.Geometry as rg
import scriptcontext as sc
from scipy.spatial import KDTree

# --- Your existing functions (with minor adaptations) ---

def distance_3d(a, b):
    return math.sqrt((a[0]-b[0])**2 + (a[1]-b[1])**2 + (a[2]-b[2])**2)

def normalize(vector):
    """Normalize a vector (2D) to unit length."""
    magnitude = math.sqrt(vector[0]**2 + vector[1]**2+vector[2]**2)
    return [vector[0] / magnitude, vector[1] / magnitude,vector[2] / magnitude] if magnitude != 0 else [0, 0, 0]

def to_numeric(vec):
    """Convert a Rhino object to a numeric [x,y,z] list; otherwise return vec as-is."""
    try:
        return [vec.X, vec.Y, vec.Z]
    except AttributeError:
        return vec

def find_closest_neighbors_kd(point, kd_tree, k):
    """
    Given a 2D point (as [x,y]) and a pre-built KDTree,
    return a list of indices of the k closest points.
    """

    distances, indices = kd_tree.query(point,k=k)
    if isinstance(indices, int):
        return [indices]
    return list(indices)

def interpolate_vector(point, points, vectors, neighbors, ref_dir):
    """
    Distance-weighted interpolation of neighbor vectors in 3D,
    flipping each neighbor's vector if dot < 0 with respect to 'ref_dir'.

    - pt: [x, y, z], the point where we want the interpolated vector
    - points_3d: Nx3 array of point coords
    - vectors_3d: Nx3 array of principal vectors
    - neighbors: list of indices from the KDTree
    - ref_dir: [dx, dy, dz], the direction from the previous step (or None if first step)
    """
    weights = []
    weighted_vec = [0.0, 0.0, 0.0]

    for i in neighbors:
        vx, vy, vz = vectors[i]  # copy so we can flip locally
        if ref_dir is not None:
            dotp = vx*ref_dir[0] + vy*ref_dir[1] + vz*ref_dir[2]
            if dotp < 0:
                vx, vy, vz = -vx, -vy, -vz
        
        npt = points[i]
        dx = point[0] - npt[0]
        dy = point[1] - npt[1]
        dz = point[2] - npt[2]
        dist = (dx*dx + dy*dy + dz*dz)**0.5
        
        w = 1.0 / (dist + 1e-6)
        weights.append(w)
        
        weighted_vec[0] += vx*w
        weighted_vec[1] += vy*w
        weighted_vec[2] += vz*w

    total_w = sum(weights)
    if total_w > 1e-12:
        weighted_vec[0] /= total_w
        weighted_vec[1] /= total_w
        weighted_vec[2] /= total_w

    mag = (weighted_vec[0]**2 + weighted_vec[1]**2 + weighted_vec[2]**2)**0.5
    if mag < 1e-12:
        return [0.0, 0.0, 0.0]
    
    return [weighted_vec[0]/mag, weighted_vec[1]/mag, weighted_vec[2]/mag]

def adjust_step_size_3d(current_point, neighbors, points, step_sign):

    if not neighbors:
        return 0.1 * step_sign
    
    distances = []
    for i in neighbors:
        npt = points[i]
        dx = current_point[0] - npt[0]
        dy = current_point[1] - npt[1]
        dz = current_point[2] - npt[2]
        dist = math.sqrt(dx*dx + dy*dy + dz*dz)
        distances.append(dist)
    
    avg_dist = sum(distances) / len(distances) if len(distances) else 0.1
    base_step = min(0.1, avg_dist / 2.0)
    return base_step * step_sign

def project_onto_surface(surface, pt3d, tolerance=2):
    pt_rh = rg.Point3d(pt3d[0], pt3d[1], pt3d[2])
    
    if isinstance(surface, rg.Brep):
        # Note the 6 returned values:
        rc, closest_pt, cindex, u, v, normal = surface.ClosestPoint(pt_rh, tolerance)
        if rc:
            # Check if cindex is a face
            if cindex.ComponentIndexType == rg.ComponentIndexType.BrepFace:
                face_id = cindex.Index
                face = surface.Faces[face_id]
                
                # 'closest_pt' is the 3D point on that face
                # Optionally confirm it's within the face domain or do face.IsPointOnFace(u,v)
                
                return [closest_pt.X, closest_pt.Y, closest_pt.Z]
            else:
                # The closest component might be an edge or vertex
                return None
        else:
            return None
    
    elif isinstance(surface, rg.Surface):
        rc, u, v = surface.ClosestPoint(pt_rh)
        if rc:
            pt_srf = surface.PointAt(u, v)
            return [pt_srf.X, pt_srf.Y, pt_srf.Z]
        else:
            return None
    else:
        return None

    


def get_brep_edge_curves(domain_surface):
    """
    Returns a list of Rhino.Geometry.Curve objects, one for each edge of the Brep.
    If 'domain_surface' is a plain NURBS surface, we convert it to a Brep first.
    """

    # If 'domain_surface' is actually a Surface, convert it to a Brep
    if isinstance(domain_surface, rg.Surface):
        domain_surface = rg.Brep.CreateFromSurface(domain_surface)
        if not domain_surface:
            # In case conversion fails
            return []

    edge_curves = []
    # Now 'domain_surface' should be a Brep
    for edge in domain_surface.Edges:
        crv = edge.ToNurbsCurve()  # or edge.EdgeCurve if you prefer
        edge_curves.append(crv)
    return edge_curves

def distance_to_brep_edges(pt3d, boundary_curves):
    test_pt = rg.Point3d(pt3d[0], pt3d[1], pt3d[2])
    min_dist = float('inf')
    best_cp = None  # keep track of the closest point so far
    
    for crv in boundary_curves:
        rc, t = crv.ClosestPoint(test_pt)
        if rc:
            cp = crv.PointAt(t)
            dist = cp.DistanceTo(test_pt)
            if dist < min_dist:
                min_dist = dist
                best_cp = cp
    
    return min_dist, best_cp

def is_on_surface(surface, pt3d, tol=0.01):
    """
    Returns True if pt3d is within 'tol' of the surface. 
    """
    if not surface: 
        return True  # no surface provided
    pproj = project_onto_surface(surface, pt3d)
    if pproj is None:
        return False
    dx = pt3d[0] - pproj[0]
    dy = pt3d[1] - pproj[1]
    dz = pt3d[2] - pproj[2]
    dist = math.sqrt(dx*dx + dy*dy + dz*dz)
    return (dist < tol)

def runge_kutta_step_3d(
    current_point, 
    current_dir,
    h, 
    k, 
    principal_vectors, 
    points_3d, 
    step_sign, 
    kd_tree, 
    boundary_curves=None, 
    boundary_tolerance=0.1, prev_dir=None):
    """
    Perform one RK4 step in 3D. Stop if next point is within 'boundary_tolerance'
    of any boundary curve (edges).
    Returns the next 3D point or None if out-of-bound / near boundary.
    """
    
    # 1) Neighbors & dynamic step size
    neighbors = find_closest_neighbors_kd(current_point, kd_tree, k)
    h = adjust_step_size_3d(current_point, neighbors, points_3d, step_sign)
    
    # k1
    k1_dir = interpolate_vector(current_point, points_3d, principal_vectors, neighbors, current_dir)
    mid1 = [
        current_point[0] + 0.5*h*k1_dir[0],
        current_point[1] + 0.5*h*k1_dir[1],
        current_point[2] + 0.5*h*k1_dir[2]
    ]
    
    # k2
    neigh_mid1 = find_closest_neighbors_kd(mid1, kd_tree, k)
    k2_dir = interpolate_vector(mid1, points_3d, principal_vectors, neigh_mid1, k1_dir)
    mid2 = [
        current_point[0] + 0.5*h*k2_dir[0],
        current_point[1] + 0.5*h*k2_dir[1],
        current_point[2] + 0.5*h*k2_dir[2]
    ]
    
    # k3
    neigh_mid2 = find_closest_neighbors_kd(mid2, kd_tree, k)
    k3_dir = interpolate_vector(mid2, points_3d, principal_vectors, neigh_mid2, k2_dir)
    end_pt = [
        current_point[0] + h*k3_dir[0],
        current_point[1] + h*k3_dir[1],
        current_point[2] + h*k3_dir[2]
    ]
    
    # k4
    neigh_end = find_closest_neighbors_kd(end_pt, kd_tree, k)
    k4_dir = interpolate_vector(end_pt, points_3d, principal_vectors, neigh_end, k3_dir)
    
    # Summation
    dx = h*(k1_dir[0] + 2*k2_dir[0] + 2*k3_dir[0] + k4_dir[0]) / 6.0
    dy = h*(k1_dir[1] + 2*k2_dir[1] + 2*k3_dir[1] + k4_dir[1]) / 6.0
    dz = h*(k1_dir[2] + 2*k2_dir[2] + 2*k3_dir[2] + k4_dir[2]) / 6.0
    
    next_point = [
        current_point[0] + dx,
        current_point[1] + dy,
        current_point[2] + dz
    ]
    next_dir = k4_dir

    if domain_surface is not None:
        projected = project_onto_surface(domain_surface, next_point)
        print(projected)
        if projected is None:
            # Means we're off domain or near an open edge you consider invalid
            return None
        next_point = projected  # accept the projected coordinate

    # 2) Check distance to boundary edges, if we have them
    # if boundary_curves:
    #     dist_to_edge = distance_to_brep_edges(next_point, boundary_curves)
    #     if dist_to_edge < boundary_tolerance:
    #         # We consider that "off" or "too close" => stop
    #         return None

    # Otherwise return the next valid point
    return next_point, next_dir
# --- Collision Checking using Cached PSL Curves ---

def closest_point_on_polyline_3d(pt3d, poly_curve):
    """
    Return (closest_point, distance) from a 3D point to a polyline curve.
    """
    test_pt = rg.Point3d(pt3d[0], pt3d[1], pt3d[2])
    rc, t = poly_curve.ClosestPoint(test_pt)
    if rc:
        cp = poly_curve.PointAt(t)
        dist = cp.DistanceTo(test_pt)
        return [cp.X, cp.Y, cp.Z], dist
    else:
        return None, float('inf')

def find_closest_existing_line_3d(next_point, existing_trajectories, threshold):
    """
    Among all previously traced lines (in 3D), find if 'next_point' is within 'threshold' of any line.
    Returns (closest_line_index, closest_point_on_line, distance).
    """
    min_dist = float('inf')
    closest_line_idx = None
    closest_pt = None
    
    for i, (polyline_pts, poly_curve) in enumerate(existing_trajectories):
        cp, dist = closest_point_on_polyline_3d(next_point, poly_curve)
        if dist < min_dist:
            min_dist = dist
            closest_line_idx = i
            closest_pt = cp
    
    if min_dist < threshold:
        return (closest_line_idx, closest_pt, min_dist)
    else:
        return (None, None, float('inf'))

def build_polyline_curve_3d(poly_pts):
    pts3d = [rg.Point3d(pt[0], pt[1], pt[2]) for pt in poly_pts]
    poly = rg.Polyline(pts3d)
    return rg.PolylineCurve(poly)

# --- New Functions for Sampling and Seeding ---

import Rhino.Geometry as rg
def surface_normal_at_point(surface, pt3d, tolerance=2):
    """
    Returns the surface normal [nx, ny, nz] at a 3D point on a multi-face Brep or rg.Surface.
    If near an open edge or invalid, returns None.
    """
    pt_rh = rg.Point3d(pt3d[0], pt3d[1], pt3d[2])

    if isinstance(surface, rg.Brep):
        stuff = surface.ClosestPoint(pt_rh, tolerance)
        if not stuff or len(stuff) < 6:
            return None
        b = stuff[0]
        rc = stuff[1]
        print(rc)
        comp_index = stuff[2]
        u = stuff[3]
        v = stuff[4]
        # stuff[4] => cpt
        # stuff[5] => guess_normal
        if not rc:
            return None
        
        # If it's a face, we evaluate the face normal at (u, v)
        if comp_index.ComponentIndexType == rg.ComponentIndexType.BrepFace:
            face_id = comp_index.Index
            face = surface.Faces[face_id]
            exact_normal = face.NormalAt(u, v)
            if exact_normal:
                return [exact_normal.X, exact_normal.Y, exact_normal.Z]
            else:
                return None
        else:
            # edge/vertex
            return None
    
    elif isinstance(surface, rg.Surface):
        rc, u, v = surface.ClosestPoint(pt_rh)
        if rc:
            exact_normal = surface.NormalAt(u, v)
            return [exact_normal.X, exact_normal.Y, exact_normal.Z]
        else:
            return None

    # Not a Brep or Surface
    return None


def sample_psl(psl_pts, sample_interval):
    """
    Given a PSL (list of Rhino Point3d), sample it at every sample_interval (by index).
    Returns a list of numeric [x,y] points.
    """
    samples = []
    #print(sample_interval)
    for i in range(0, len(psl_pts), sample_interval):
        pt = psl_pts[i]
        
        if isinstance(pt, rg.Point3d):
            samples.append([pt.X, pt.Y, pt.Z])
        else:
            samples.append(pt)
        #print(samples)
    return samples

import math

def offset_seed(psl_pts_3d, index, offset_distance, surface):
    """
    Offsets the PSL at psl_pts_3d[index] in the local tangent plane of 'surface'.
    Steps:
      1) Compute PSL tangent at index
      2) Get surface normal at that point
      3) binormal = cross(surface_normal, psl_tangent)
      4) candidate1 = point + offset_distance*binormal
         candidate2 = point - offset_distance*binormal
      5) (optional) project candidates back onto the surface
    Returns: (candidate1, candidate2) as [x, y, z], or (None, None) on error.
    """
    n = len(psl_pts_3d)
    if n < 2:
        return None, None
    
    # 0) Current point
    px, py, pz = psl_pts_3d[index]
    
    # 1) PSL TANGENT
    if index == 0:
        # Use next point - current point
        nx, ny, nz = psl_pts_3d[1]
        tx = nx - px
        ty = ny - py
        tz = nz - pz
    elif index == n - 1:
        # Use current point - prev point
        px_prev, py_prev, pz_prev = psl_pts_3d[n - 2]
        tx = px - px_prev
        ty = py - py_prev
        tz = pz - pz_prev
    else:
        # Middle: use psl_pts_3d[index+1] - psl_pts_3d[index-1]
        px_prev, py_prev, pz_prev = psl_pts_3d[index - 1]
        px_next, py_next, pz_next = psl_pts_3d[index + 1]
        tx = px_next - px_prev
        ty = py_next - py_prev
        tz = pz_next - pz_prev

    # Normalize tangent
    t_len = math.sqrt(tx*tx + ty*ty + tz*tz)
    if t_len < 1e-12:
        return None, None
    tx /= t_len
    ty /= t_len
    tz /= t_len
    
    # 2) SURFACE NORMAL
    normal = surface_normal_at_point(surface, [px, py, pz])
    if not normal:
        print("no normal")
        return None, None
    nx, ny, nz = normal
    n_len = math.sqrt(nx*nx + ny*ny + nz*nz)
    if n_len < 1e-12:
        return None, None
    nx /= n_len
    ny /= n_len
    nz /= n_len
    
    # 3) BINORMAL = cross(normal, tangent)
    # This is guaranteed to be in the tangent plane if PSL is truly tangent to the surface
    # If the PSL isn't exactly tangent, you'll get some tilt. 
    bx = ny*tz - nz*ty
    by = nz*tx - nx*tz
    bz = nx*ty - ny*tx
    b_len = math.sqrt(bx*bx + by*by + bz*bz)
    if b_len < 1e-12:
        # Means normal and tangent are parallel or something degenerate
        return None, None
    bx /= b_len
    by /= b_len
    bz /= b_len
    
    # 4) OFFSET POINTS
    candidate1 = [px + offset_distance*bx,
                  py + offset_distance*by,
                  pz + offset_distance*bz]
    candidate2 = [px - offset_distance*bx,
                  py - offset_distance*by,
                  pz - offset_distance*bz]
    
    # 5) (OPTIONAL) Project them onto the surface if you want them exactly on the domain
    candidate1_proj = project_onto_surface(surface, candidate1)
    print(f"this point is seed {candidate1_proj}")
    candidate2_proj = project_onto_surface(surface, candidate2)
    # if not candidate1_proj or not candidate2_proj:
    #     return None, None
    # return candidate1_proj, candidate2_proj

    # If you don't need the final projection, just return them:
    return candidate1_proj, candidate2_proj


def sample_psl_3d(psl_pts, sample_interval):
    """
    Given a PSL (list of Rhino Point3d or numeric [x,y,z] points),
    sample it every 'sample_interval' points.
    Returns a list of tuples: ( [x,y,z], original_index )
    """
    samples = []
    for i in range(0, len(psl_pts), sample_interval):
        pt3d = psl_pts[i]
        # Convert to numeric [x,y,z] if it's a Point3d
        if hasattr(pt3d, "X"):
            samples.append(([pt3d.X, pt3d.Y, pt3d.Z], i))
        else:
            samples.append((pt3d, i))
    return samples


def is_valid_seed(candidate, existing_trajectories, min_distance, boundary_curves, boundary_tolerance=0.1):
    """
    Check if candidate seed is valid:
      - It is not too close to any existing PSL (using min_distance).
      - It is not too close to any boundary curves (if boundary_curves is provided and
        candidate's distance < boundary_tolerance).
    """
    # Check candidate against existing PSLs
    idx, cp, dist = find_closest_existing_line_3d(candidate, existing_trajectories, min_distance)
    if idx is not None:
        return False

    # Check candidate against boundary curves if provided
    if boundary_curves:
        dist_edge, cp_edge = distance_to_brep_edges(candidate, boundary_curves)
        if dist_edge < 0.1:
            return False

    return True


# --- Main Loop: Iterative Seeding with a Queue ---
def trace_principal_stress_line(
    p_start, 
    h, 
    num_steps, 
    k, 
    principal_vectors,  # Nx3
    points_3d,          # Nx3
    boundary_curves = None,      # list of curve edges
    boundary_tolerance=0.1,
    existing_trajectories=None,
    collision_threshold=0.05,
    step_sign=1):
    """
    Trace a principal stress line starting from p_start (3D) using RK4 in 3D.
    - p_start: [x, y, z]
    - principal_vectors, points_3d: lists or arrays of same length
    - surface: optional Rhino surface or Brep to constrain PSL
    - boundary_tolerance: distance threshold to consider 'off the surface'
    - existing_trajectories: list of ( [pts], polyline_curve ) to detect collisions
    - collision_threshold: distance threshold for merging lines
    - step_sign: +1 forward or -1 backward
    Returns: (trajectory_pts, bridging_line)
    """
    if existing_trajectories is None:
        existing_trajectories = []
    
    trajectory = [rg.Point3d(p_start[0], p_start[1], p_start[2])]
    bridging_line = None
    
    current_point_3d = p_start[:]
    current_dir = None 
    
    for _ in range(num_steps):
        # 1) Get next point
        next_result = runge_kutta_step_3d(
            current_point_3d, 
            current_dir,
            h, 
            k, 
            principal_vectors,
            points_3d,
            step_sign,
            kd_tree,
            boundary_curves,
            boundary_tolerance,
        )
        
        if not next_result or next_result[0] is None:
            print("PSL stopped: near or off boundary.")
            break
        next_pt, next_dir = next_result
        
        # # 2a) Check alignment with principal vectors (optional)
        # #     For example, compare direction of (next_point - current_point)
        # #     with the local principal vector at next_point
        # move_vec = normalize_3d([
        #     next_point_3d[0] - current_point_3d[0],
        #     next_point_3d[1] - current_point_3d[1],
        #     next_point_3d[2] - current_point_3d[2]
        # ])
        # neigh2 = find_closest_neighbors_kd_3d(next_point_3d, kd_tree, k)
        # local_vec = interpolate_vector_3d(next_point_3d, points_3d, principal_vectors, neigh2)
        # dotp = abs(move_vec[0]*local_vec[0] + move_vec[1]*local_vec[1] + move_vec[2]*local_vec[2])
        # if dotp < 0.7:
        #     print("PSL stopped: direction misaligned with principal vectors.")
        #     break
        
        # 3) Collision check with existing lines
        if existing_trajectories:
            line_idx, close_pt, dist = find_closest_existing_line_3d(next_pt, existing_trajectories, collision_threshold)
            if line_idx is not None and close_pt is not None:
                # Attempt bridging
                steps_back = 5
                if len(trajectory) > steps_back:
                    bridging_line = [
                        trajectory[-steps_back],
                        rg.Point3d(close_pt[0], close_pt[1], close_pt[2])
                    ]
                    # remove last steps so it merges more smoothly
                    del trajectory[-(steps_back-1):]
                else:
                    bridging_line = [
                        trajectory[-1],
                        rg.Point3d(close_pt[0], close_pt[1], close_pt[2])
                    ]
                print("PSL stopped: close to line %d at distance %.3f - merging initiated" % (line_idx, dist))
                break
        
        if len(trajectory) > 20:
            if trajectory[0].DistanceTo(rg.Point3d(next_pt[0], next_pt[1], next_pt[2])) < 0.1:
                trajectory.append(trajectory[0])
                print("Loop detected and closed")
                break

        
        trajectory.append(rg.Point3d(next_pt[0], next_pt[1], next_pt[2]))
        current_point_3d = next_pt
        current_dir = next_dir
    
    return trajectory, bridging_line

def trace_psl_backwards_with_closing_check(
    p_start_3d,
    h,
    num_steps,
    k,
    principal_vectors,
    points_3d,
    boundary_curves,
    boundary_tolerance,
    existing_trajectories,
    collision_threshold,
    forward_line,
    closing_threshold,
    kd_tree,
    step_sign=-1):
    """
    Similar to trace_principal_stress_line, but:
      - We move one step at a time
      - After each step, we check distance to forward_line[-1]. 
      - If it's < closing_threshold, we stop.
    """
    import math
    
    def distance_3d(a, b):
        return math.sqrt((a[0]-b[0])**2 + (a[1]-b[1])**2 + (a[2]-b[2])**2)
    
    trajectory = [rg.Point3d(*p_start_3d)]
    bridging_line = None
    current_point_3d = list(p_start_3d)
    current_dir = None
    
    # Convert the far end of forward_line (the last point) to a numeric [x,y,z]
    forward_end = forward_line[-1]
    if hasattr(forward_end, "X"):
        forward_end_xyz = [forward_end.X, forward_end.Y, forward_end.Z]
    else:
        forward_end_xyz = forward_end
    
    for _ in range(num_steps):
        # 1) Attempt a single RK4 step
        next_result = runge_kutta_step_3d(
            current_point_3d, 
            current_dir,
            h, 
            k, 
            principal_vectors, 
            points_3d, 
            step_sign,
            kd_tree,
            boundary_curves,
            boundary_tolerance
        )
        if not next_result or not next_result[0]:
            # boundary/collision check
            print("PSL backward: off boundary or step failed.")
            break
        
        next_pt, next_dir = next_result
        nxt_xyz = [next_pt[0], next_pt[1], next_pt[2]]
        
        # 2) Collision check w. existing PSLs (same as your code)
        if existing_trajectories:
            line_idx, close_pt, dist_cl = find_closest_existing_line_3d(
                nxt_xyz, existing_trajectories, collision_threshold
            )
            if line_idx is not None and close_pt is not None:
                # bridging, etc.
                bridging_line = [
                    trajectory[-1],
                    rg.Point3d(close_pt[0], close_pt[1], close_pt[2])
                ]
                print("PSL backward: bridging or collision => stop.")
                break
        
        # 3) **Closing check**: compare distance to forward_line[-1]
        dist_ff = distance_3d(nxt_xyz, forward_end_xyz)
        if dist_ff < closing_threshold:
            print(
                "PSL backward: tips near forward line end (dist=%.3f < %.3f), stopping." 
                % (dist_ff, closing_threshold)
            )
            break
        
        # Accept the step
        trajectory.append(rg.Point3d(*nxt_xyz))
        current_point_3d = nxt_xyz
        current_dir = next_dir
    
    return trajectory, bridging_line

def trace_psl_both_directions(
    seed_point_3d, 
    h, 
    num_steps, 
    k, 
    principal_vectors, 
    points_3d,
    boundary_curves=None,
    boundary_tolerance=0.1,
    existing_trajectories=None,
    collision_threshold=0.05,
    closing_threshold=0.1, 
    kd_tree=None
):
    """
    Single-loop approach where forward/backward can stop independently.
    If forward hits a collision/boundary, it stops, but backward can continue, and vice versa.
    We only stop the entire PSL when BOTH directions are inactive, or when tips meet.
    """
    if existing_trajectories is None:
        existing_trajectories = []
    
    import Rhino.Geometry as rg
    bridging_lines = []

    # We'll keep two lines: forward and backward
    forward_line = [rg.Point3d(*seed_point_3d)]
    backward_line = [rg.Point3d(*seed_point_3d)]
    
    # Current forward/backward points + directions
    f_current_pt = list(seed_point_3d)
    f_current_dir = None
    b_current_pt = list(seed_point_3d)
    b_current_dir = None

    # NEW: Boolean flags to track if forward/backward are still active
    forward_active = True
    backward_active = True

    for step_i in range(num_steps):
        
        # ---------------------------
        # FORWARD STEP (if still active)
        # ---------------------------
        if forward_active:
            f_next = runge_kutta_step_3d(
                f_current_pt,
                f_current_dir,
                h,
                k,
                principal_vectors,
                points_3d,
                step_sign=+1,
                kd_tree=kd_tree,
                boundary_curves=boundary_curves,
                boundary_tolerance=boundary_tolerance
            )
            if not f_next or f_next[0] is None:
                print(f"PSL forward direction stopped at iteration {step_i}.")
                forward_active = False
            else:
                f_next_pt, f_next_dir = f_next
                # Collision check with existing PSLs
                if existing_trajectories:
                    line_idx, close_pt, dist_cl = find_closest_existing_line_3d(
                        f_next_pt, existing_trajectories, collision_threshold
                    )
                    if line_idx is not None and close_pt is not None:
                        # Instead of break, we do bridging & disable forward
                        steps_back = 5
                        if len(forward_line) > steps_back:
                            bridging_line = [
                                forward_line[-steps_back],
                                rg.Point3d(*close_pt)
                            ]
                            bridging_lines.append(bridging_line)
                            del forward_line[-(steps_back-1):]

                        if len(forward_line)==0 or len(backward_line)==1:
                            print("too short for bridge")
                        else:
                            bridging_line = [
                                forward_line[-1],
                                rg.Point3d(*close_pt)
                            ]
                            bridging_lines.append(bridging_line)
                        
                        print(f"PSL forward collided with line {line_idx} at dist {dist_cl:.3f}.")
                        forward_active = False

                    # 2) Check distance to boundary edges, if we have them
                if boundary_curves:
                    dist_to_edge,cp = distance_to_brep_edges(f_next_pt, boundary_curves)
                    if dist_to_edge < boundary_tolerance:
                        # We consider that "off" or "too close" => stop
                        print(f"PSL forward reached boundary.")
                        forward_active = False
                        bridging_line = [
                                forward_line[-1],
                                rg.Point3d(cp)
                            ]
                        bridging_lines.append(bridging_line)


                # If still active, accept the new forward step
                if forward_active:
                    forward_line.append(rg.Point3d(*f_next_pt))
                    f_current_pt = f_next_pt
                    f_current_dir = f_next_dir

        # ---------------------------
        # BACKWARD STEP (if still active)
        # ---------------------------
        if backward_active:
            b_next = runge_kutta_step_3d(
                b_current_pt,
                b_current_dir,
                h,
                k,
                principal_vectors,
                points_3d,
                step_sign=-1,
                kd_tree=kd_tree,
                boundary_curves=boundary_curves,
                boundary_tolerance=boundary_tolerance
            )
            if not b_next or b_next[0] is None:
                print(f"PSL backward direction stopped at iteration {step_i}.")
                backward_active = False
            else:
                b_next_pt, b_next_dir = b_next
                # Collision check with existing PSLs
                if existing_trajectories:
                    line_idx, close_pt, dist_cl = find_closest_existing_line_3d(
                        b_next_pt, existing_trajectories, collision_threshold
                    )
                    if line_idx is not None and close_pt is not None:
                        steps_back = 5
                        if len(backward_line) > steps_back:
                            bridging_line = [
                                backward_line[-steps_back],
                                rg.Point3d(*close_pt)
                            ]
                            bridging_lines.append(bridging_line)
                            del backward_line[-(steps_back-1):]

                        if len(backward_line)==0 or len(backward_line)==1:
                            print("too short for bridge")
                        else:
                            bridging_line = [
                                backward_line[-1],
                                rg.Point3d(*close_pt)
                            ]
                            bridging_lines.append(bridging_line)

                        print(f"PSL backward collided with line {line_idx} at dist {dist_cl:.3f}.")
                        backward_active = False


                if boundary_curves:
                    dist_to_edge,cp = distance_to_brep_edges(b_next_pt, boundary_curves)
                    if dist_to_edge < boundary_tolerance:
                        # We consider that "off" or "too close" => stop
                        print(f"PSL backward reached boundary.")
                        backward_active = False
                        bridging_line = [
                                backward_line[-1],
                                rg.Point3d(cp)
                            ]
                        bridging_lines.append(bridging_line)

                # If still active, accept the new backward step
                if backward_active:
                    backward_line.append(rg.Point3d(*b_next_pt))
                    b_current_pt = b_next_pt
                    b_current_dir = b_next_dir
        
        # ---------------------------
        # Check if BOTH directions are done
        # ---------------------------
        if not forward_active and not backward_active:
            print("Both forward & backward directions inactive => stopping PSL.")
            break

        # ---------------------------
        # TIP DISTANCE CHECK
        # ---------------------------
        # Only if both are still active
        if forward_active and backward_active and step_i >= 10:
            f_xyz = [forward_line[-1].X, forward_line[-1].Y, forward_line[-1].Z]
            b_xyz = [backward_line[-1].X, backward_line[-1].Y, backward_line[-1].Z]
            dist_fb = distance_3d(f_xyz, b_xyz)
            if dist_fb < closing_threshold:
                bridging_line = [
                    forward_line[-1],
                    backward_line[-1]
                ]
                bridging_lines.append(bridging_line)

                print(
                    f"PSL tips meet at iteration {step_i}, dist= {dist_fb:.3f} < {closing_threshold}."
                )
                # Here we might disable both directions or just break:
                forward_active = False
                backward_active = False
                break
    
    # Merge lines
    backward_line.reverse()
    if len(backward_line) > 1:
        backward_line.pop()
    merged_pts = backward_line + forward_line
    
    return merged_pts, bridging_lines


def generate_all_psls_3d(
    initial_seed_3d,
    h, 
    num_steps, 
    k, 
    principal_vectors, 
    points_3d,
    kd_tree,
    boundary_curves,
    collision_threshold,
    sample_interval,
    offset_distance,
    min_seed_distance):
    """
    Generate PSLs using an iterative seeding strategy (3D version).

    1) Trace the initial PSL from initial_seed_3d.
    2) Put that PSL in a queue.
    3) For each PSL in the queue, sample it, offset each sample to find new seeds.
    4) If a new seed is valid, trace a new PSL & add it to the queue.
    
    Returns:
      - all_psls: list of (psl_points, polyline_curve)
      - bridging_lines: short lines merging PSLs
      - positive_candidates: list of seeds that were actually used
    """
    initial_psl, initial_bridges = trace_psl_both_directions(
        seed_point_3d=initial_seed_3d,
        h=h,
        num_steps=num_steps,
        k=k,
        principal_vectors=principal_vectors,
        points_3d=points_3d,
        boundary_curves=boundary_curves,
        boundary_tolerance=0.1,
        existing_trajectories=None,
        collision_threshold=collision_threshold,
        closing_threshold=0.25,  # or some distance
        kd_tree=kd_tree
    )


    # Build polyline curve (3D) for collision checking
    initial_curve = build_polyline_curve_3d(initial_psl)
    all_psls = [(initial_psl, initial_curve)]
    bridging_lines = []
    positive_candidates = []
    if initial_bridges:
        bridging_lines.extend(initial_bridges)
    
    # 2) PSL queue
    psl_queue = [(initial_psl, initial_curve)]
    
    # 3) BFS-like expansion
    while psl_queue:
        
        current_psl, current_curve = psl_queue.pop(0)
        # numeric version
        psl_numeric_3d = [[pt.X, pt.Y, pt.Z] for pt in current_psl]
        
        # Sample
        samples = sample_psl_3d(current_psl, sample_interval)  # returns ( [x,y,z], index )
        
        # For each sample, offset in 3D
        for sample_pt_3d, orig_index in samples:
            cand1, cand2 = offset_seed(psl_numeric_3d, orig_index, offset_distance, domain_surface)
            if not cand1 or not cand2:
                continue  # offset failed or degenerate tangent
            
            # We'll try both
            candidates_3d = [cand1, cand2]
            
            traced_this_sample = False
            for candidate_3d in candidates_3d:
                # Check if candidate is valid:
                #   1) at least min_seed_distance from existing PSL
                if not is_valid_seed(candidate_3d, all_psls, min_seed_distance,boundary_curves, boundary_tolerance=0.1):
                    continue
                # #   2) on or within boundary surface (if you want)
                # if not rs.IsPointOnSurface(domain_surface, candidate_3d):
                #     continue
                
                # We have a new seed
                print("Candidate seed found:", candidate_3d)
                positive_candidates.append(candidate_3d)
                
                # Trace a new PSL
                new_psl, new_bridges = trace_psl_both_directions(
                    seed_point_3d=candidate_3d,
                    h=h,
                    num_steps=num_steps,
                    k=k,
                    principal_vectors=principal_vectors,
                    points_3d=points_3d,
                    boundary_curves=boundary_curves,
                    boundary_tolerance=0.1,
                    existing_trajectories=all_psls,
                    collision_threshold=collision_threshold,
                    closing_threshold=0.2,  # or some distance
                    kd_tree=kd_tree
                )
                new_curve = build_polyline_curve_3d(new_psl)
                
                # Add to collection
                all_psls.append((new_psl, new_curve))
                psl_queue.append((new_psl, new_curve))
                if new_bridges:
                    bridging_lines.extend(new_bridges)
                
                traced_this_sample = True
                # If you only want one PSL from this sample, break here
                break
    
    return all_psls, bridging_lines, positive_candidates


# --- Example Main Routine in Grasshopper ---
def to_xyz(pt_or_vec):
    """Converts Rhino.Geometry.Point3d or Vector3d (or numeric [x,y,z]) to a Python list [x, y, z]."""
    if hasattr(pt_or_vec, "X"):
        return [pt_or_vec.X, pt_or_vec.Y, pt_or_vec.Z]
    else:
        # Already [x,y,z]
        return [pt_or_vec[0], pt_or_vec[1], pt_or_vec[2]]

# Suppose 'points' is a list of 3D points from Grasshopper input,
# and 'principal_vectors' is a matching list of 3D vectors.
# We'll build a KDTree in 3D:
points_array_3d = [to_xyz(pt) for pt in points]
points_np = np.array(points_array_3d)  # shape (N, 3)
kd_tree = KDTree(points_np)

# If your 'seed_points' input is also 3D, pick the first as initial:
initial_seed_3d = to_xyz(seed_points[0])

# Convert principal_vectors to [vx,vy,vz]
principal_vectors_3d = [to_xyz(vec) for vec in principal_vectors]

# We'll store the domain surface or Brep for offset + boundary checks
# If you are passing a Rhino surface or a single-face Brep from GH, you can just keep it:
domain_srf_or_brep = domain_surface

boundary_curves = boundary_curves

# Parameters (exposed as GH inputs or hard-coded here)
h = 0.1
num_steps = 1500
k = 25
collision_threshold = 0.05
sample_interval = 3
offset_distance = 0.1
min_seed_distance = 0.08

# ----------------------------------------------------------------------
# CALL YOUR 3D PSL GENERATION FUNCTION
# ----------------------------------------------------------------------
all_psls, bridging_lines, positive_candidates = generate_all_psls_3d(
    initial_seed_3d,
    h,
    num_steps,
    k,
    principal_vectors_3d,   # 3D vectors
    points_array_3d,        # 3D points
    kd_tree,
    boundary_curves,
    collision_threshold,
    sample_interval,
    offset_distance,
    min_seed_distance
)

# `all_psls` is a list of (psl_points_3d, polyline_curve_3d)
# bridging_lines is a list of short bridging segments
# positive_candidates is a list of 3D seed coords that were actually used

# ----------------------------------------------------------------------
# PREPARE OUTPUTS FOR GH
# ----------------------------------------------------------------------
# 1) PSL polylines as GH curves
psl_curves = [psl_curve for (psl_points, psl_curve) in all_psls]

# 2) Bridging lines. If each bridging_line is [ptA, ptB], you might convert to GH lines or polylines
# For simplicity we just pass them out as is, or build lines:
# bridging_line_curves = []
# for bl in bridging_lines:
#     ptA, ptB = bl
#     bridging_line_curves.append(rg.Line(rg.Point3d(*ptA), rg.Point3d(*ptB)))

# 3) Convert positive_candidates to Point3d
generated_seed_points = [rg.Point3d(pc[0], pc[1], pc[2]) for pc in positive_candidates]
from ghpythonlib import treehelpers as tr
# 4) Finally set GH outputs (A, B, C, e.g.)
a = tr.list_to_tree(psl_curves)
b = tr.list_to_tree(bridging_lines)
w = tr.list_to_tree(generated_seed_points)
# ---------- end tracer_automatic_3d_self_single_loop ----------
tracer_manual_3d_self = Python3Script(
    seed_points=cullpt_7.Points,
    principal_vectors=shellvecresults.FirstPrincipalStressVector_kN_cm²,
    points=shellvecresults.Points,
    domain_surface=msh2psrf_3,
    collision_threshold="0.05",
    boundary_curves=join_5)  # -> out, a, b, w, Error_message; inputs seed_points: list of Point3d, principal_vectors: list of Vector3d, points: list of Point3d, domain_surface: Brep, collision_threshold: Double, boundary_curves: list of Curve; disabled
# ---------- tracer_manual_3d_self: Python ----------
import math
import rhinoscriptsyntax as rs
import Rhino
import Rhino.Geometry as rg
import scriptcontext as sc
import numpy as np
from scipy.spatial import KDTree
from ghpythonlib import treehelpers as tr


# ------------------------------------------------------------------------
# 3D UTILITY FUNCTIONS
# ------------------------------------------------------------------------
def distance_3d(a, b):
    return math.sqrt((a[0]-b[0])**2 + (a[1]-b[1])**2 + (a[2]-b[2])**2)

def to_xyz(pt_or_vec):
    """Converts Rhino.Geometry.Point3d or Vector3d (or numeric [x,y,z]) to a Python list [x, y, z]."""
    if hasattr(pt_or_vec, "X"):
        return [pt_or_vec.X, pt_or_vec.Y, pt_or_vec.Z]
    else:
        return [pt_or_vec[0], pt_or_vec[1], pt_or_vec[2]]

def normalize_3d(vec):
    """Normalize a 3D vector [x, y, z] to unit length. Returns [0,0,0] if near zero length."""
    mag = math.sqrt(vec[0]**2 + vec[1]**2 + vec[2]**2)
    if mag < 1e-12:
        return [0.0, 0.0, 0.0]
    return [vec[0]/mag, vec[1]/mag, vec[2]/mag]

def find_closest_neighbors_kd_3d(point, kd_tree, k):
    """
    Given a 3D point [x, y, z] and a KDTree, returns a list of indices of the k closest points.
    """
    distances, indices = kd_tree.query(point, k=k)
    if isinstance(indices, int):
        return [indices]
    return list(indices)

def interpolate_vector_3d_consistent(pt, points_3d, vectors_3d, neighbors, ref_dir):
    """
    Distance-weighted interpolation of neighbor vectors in 3D,
    flipping each neighbor's vector if dot < 0 with respect to 'ref_dir'.

    - pt: [x, y, z], the point where we want the interpolated vector
    - points_3d: Nx3 array of point coords
    - vectors_3d: Nx3 array of principal vectors
    - neighbors: list of indices from the KDTree
    - ref_dir: [dx, dy, dz], the direction from the previous step (or None if first step)
    """
    weights = []
    weighted_vec = [0.0, 0.0, 0.0]

    for i in neighbors:
        vx, vy, vz = vectors_3d[i]  # copy so we can flip locally
        if ref_dir is not None:
            dotp = vx*ref_dir[0] + vy*ref_dir[1] + vz*ref_dir[2]
            if dotp < 0:
                vx, vy, vz = -vx, -vy, -vz
        
        npt = points_3d[i]
        dx = pt[0] - npt[0]
        dy = pt[1] - npt[1]
        dz = pt[2] - npt[2]
        dist = (dx*dx + dy*dy + dz*dz)**0.5
        
        w = 1.0 / (dist + 1e-6)
        weights.append(w)
        
        weighted_vec[0] += vx*w
        weighted_vec[1] += vy*w
        weighted_vec[2] += vz*w

    total_w = sum(weights)
    if total_w > 1e-12:
        weighted_vec[0] /= total_w
        weighted_vec[1] /= total_w
        weighted_vec[2] /= total_w

    mag = (weighted_vec[0]**2 + weighted_vec[1]**2 + weighted_vec[2]**2)**0.5
    if mag < 1e-12:
        return [0.0, 0.0, 0.0]
    
    return [weighted_vec[0]/mag, weighted_vec[1]/mag, weighted_vec[2]/mag]

def adjust_step_size_3d(current_pt, neighbors, points_3d, step_sign):

    if not neighbors:
        return 0.1 * step_sign
    
    distances = []
    for i in neighbors:
        npt = points_3d[i]
        dx = current_pt[0] - npt[0]
        dy = current_pt[1] - npt[1]
        dz = current_pt[2] - npt[2]
        dist = math.sqrt(dx*dx + dy*dy + dz*dz)
        distances.append(dist)
    
    avg_dist = sum(distances) / len(distances) if len(distances) else 0.1
    base_step = min(0.1, avg_dist / 2.0)
    return base_step * step_sign

# ------------------------------------------------------------------------#
# SURFACE / BREP PROJECTION UTILS
# ------------------------------------------------------------------------#

def project_onto_surface(surface, pt3d, tolerance=2):
    pt_rh = rg.Point3d(pt3d[0], pt3d[1], pt3d[2])
    
    if isinstance(surface, rg.Brep):
        # Note the 6 returned values:
        rc, closest_pt, cindex, u, v, normal = surface.ClosestPoint(pt_rh, tolerance)
        if rc:
            # Check if cindex is a face
            if cindex.ComponentIndexType == rg.ComponentIndexType.BrepFace:
                face_id = cindex.Index
                face = surface.Faces[face_id]
                
                # 'closest_pt' is the 3D point on that face
                # Optionally confirm it's within the face domain or do face.IsPointOnFace(u,v)
                
                return [closest_pt.X, closest_pt.Y, closest_pt.Z]
            else:
                # The closest component might be an edge or vertex
                return None
        else:
            return None
    
    elif isinstance(surface, rg.Surface):
        rc, u, v = surface.ClosestPoint(pt_rh)
        if rc:
            pt_srf = surface.PointAt(u, v)
            return [pt_srf.X, pt_srf.Y, pt_srf.Z]
        else:
            return None
    else:
        return None

    

def is_on_surface(surface, pt3d, tol=0.01):
    """
    Returns True if pt3d is within 'tol' of the surface. 
    """
    if not surface: 
        return True  # no surface provided
    pproj = project_onto_surface(surface, pt3d)
    if pproj is None:
        return False
    dx = pt3d[0] - pproj[0]
    dy = pt3d[1] - pproj[1]
    dz = pt3d[2] - pproj[2]
    dist = math.sqrt(dx*dx + dy*dy + dz*dz)
    return (dist < tol)

def get_brep_edge_curves(domain_surface):
    """
    Returns a list of Rhino.Geometry.Curve objects, one for each edge of the Brep.
    If 'domain_surface' is a plain NURBS surface, we convert it to a Brep first.
    """

    # If 'domain_surface' is actually a Surface, convert it to a Brep
    if isinstance(domain_surface, rg.Surface):
        domain_surface = rg.Brep.CreateFromSurface(domain_surface)
        if not domain_surface:
            # In case conversion fails
            return []

    edge_curves = []
    # Now 'domain_surface' should be a Brep
    for edge in domain_surface.Edges:
        crv = edge.ToNurbsCurve()  # or edge.EdgeCurve if you prefer
        edge_curves.append(crv)
    return edge_curves

def distance_to_brep_edges(pt3d, boundary_curves):
    test_pt = rg.Point3d(pt3d[0], pt3d[1], pt3d[2])
    min_dist = float('inf')
    best_cp = None  # keep track of the closest point so far
    
    for crv in boundary_curves:
        rc, t = crv.ClosestPoint(test_pt)
        if rc:
            cp = crv.PointAt(t)
            dist = cp.DistanceTo(test_pt)
            if dist < min_dist:
                min_dist = dist
                best_cp = cp
    
    return min_dist, best_cp

def runge_kutta_step_3d(
    current_point, 
    current_dir,
    h, 
    k, 
    principal_vectors, 
    points_3d, 
    step_sign, 
    kd_tree, 
    boundary_curves=None, 
    boundary_tolerance=0.01,prev_dir=None):
    """
    Perform one RK4 step in 3D. Stop if next point is within 'boundary_tolerance'
    of any boundary curve (edges).
    Returns the next 3D point or None if out-of-bound / near boundary.
    """
    
    # 1) Neighbors & dynamic step size
    neighbors = find_closest_neighbors_kd_3d(current_point, kd_tree, k)
    h = adjust_step_size_3d(current_point, neighbors, points_3d, step_sign)
    
    # k1
    k1_dir = interpolate_vector_3d_consistent(current_point, points_3d, principal_vectors, neighbors, current_dir)
    mid1 = [
        current_point[0] + 0.5*h*k1_dir[0],
        current_point[1] + 0.5*h*k1_dir[1],
        current_point[2] + 0.5*h*k1_dir[2]
    ]
    
    # k2
    neigh_mid1 = find_closest_neighbors_kd_3d(mid1, kd_tree, k)
    k2_dir = interpolate_vector_3d_consistent(mid1, points_3d, principal_vectors, neigh_mid1, k1_dir)
    mid2 = [
        current_point[0] + 0.5*h*k2_dir[0],
        current_point[1] + 0.5*h*k2_dir[1],
        current_point[2] + 0.5*h*k2_dir[2]
    ]
    
    # k3
    neigh_mid2 = find_closest_neighbors_kd_3d(mid2, kd_tree, k)
    k3_dir = interpolate_vector_3d_consistent(mid2, points_3d, principal_vectors, neigh_mid2, k2_dir)
    end_pt = [
        current_point[0] + h*k3_dir[0],
        current_point[1] + h*k3_dir[1],
        current_point[2] + h*k3_dir[2]
    ]
    
    # k4
    neigh_end = find_closest_neighbors_kd_3d(end_pt, kd_tree, k)
    k4_dir = interpolate_vector_3d_consistent(end_pt, points_3d, principal_vectors, neigh_end, k3_dir)
    
    # Summation
    dx = h*(k1_dir[0] + 2*k2_dir[0] + 2*k3_dir[0] + k4_dir[0]) / 6.0
    dy = h*(k1_dir[1] + 2*k2_dir[1] + 2*k3_dir[1] + k4_dir[1]) / 6.0
    dz = h*(k1_dir[2] + 2*k2_dir[2] + 2*k3_dir[2] + k4_dir[2]) / 6.0
    
    next_point = [
        current_point[0] + dx,
        current_point[1] + dy,
        current_point[2] + dz
    ]
    next_dir = k4_dir

    if domain_surface is not None:
        projected = project_onto_surface(domain_surface, next_point)
        print(projected)
        if projected is None:
            # Means we're off domain or near an open edge you consider invalid
            return None
        next_point = projected  # accept the projected coordinate
    # 2) Check distance to boundary edges, if we have them
    # if boundary_curves:
    #     dist_to_edge,cp = distance_to_brep_edges(next_point, boundary_curves)
    #     if dist_to_edge < boundary_tolerance:
    #         # We consider that "off" or "too close" => stop
    #         return None

    # Otherwise return the next valid point
    return next_point, next_dir


# ------------------------------------------------------------------------
# COLLISION / MERGING CHECKS IN 3D
# ------------------------------------------------------------------------

def build_polyline_curve_3d(poly_pts):
    pts3d = [rg.Point3d(pt[0], pt[1], pt[2]) for pt in poly_pts]
    poly = rg.Polyline(pts3d)
    return rg.PolylineCurve(poly)

def closest_point_on_polyline_3d(pt3d, poly_curve):
    """
    Return (closest_point, distance) from a 3D point to a polyline curve.
    """
    test_pt = rg.Point3d(pt3d[0], pt3d[1], pt3d[2])
    rc, t = poly_curve.ClosestPoint(test_pt)
    if rc:
        cp = poly_curve.PointAt(t)
        dist = cp.DistanceTo(test_pt)
        return [cp.X, cp.Y, cp.Z], dist
    else:
        return None, float('inf')

def find_closest_existing_line_3d(next_point, existing_trajectories, threshold):
    """
    Among all previously traced lines (in 3D), find if 'next_point' is within 'threshold' of any line.
    Returns (closest_line_index, closest_point_on_line, distance).
    """
    min_dist = float('inf')
    closest_line_idx = None
    closest_pt = None
    
    for i, (polyline_pts, poly_curve) in enumerate(existing_trajectories):
        cp, dist = closest_point_on_polyline_3d(next_point, poly_curve)
        if dist < min_dist:
            min_dist = dist
            closest_line_idx = i
            closest_pt = cp
    
    if min_dist < threshold:
        return (closest_line_idx, closest_pt, min_dist)
    else:
        return (None, None, float('inf'))

# ------------------------------------------------------------------------
# MAIN PSL TRACING FUNCTION (3D)
# ------------------------------------------------------------------------

def trace_principal_stress_line_3d(
    p_start, 
    h, 
    num_steps, 
    k, 
    principal_vectors,  # Nx3
    points_3d,          # Nx3
    boundary_curves=None,      # list of curve edges
    boundary_tolerance=0.1,
    existing_trajectories=None,
    collision_threshold=0.05,
    step_sign=1,
    closing_threshold=0.1  # <-- NEW parameter
):
    """
    Trace a principal stress line starting from p_start (3D) using RK4 in 3D.
    Now also stops if the PSL loops back on itself within 'closing_threshold'.
    """
    if existing_trajectories is None:
        existing_trajectories = []
    
    trajectory = [rg.Point3d(p_start[0], p_start[1], p_start[2])]
    bridging_line = None
    
    current_point_3d = p_start[:]
    current_dir = None 
    
    for _ in range(num_steps):
        # 1) Get next point
        next_result = runge_kutta_step_3d(
            current_point_3d, 
            current_dir,
            h, 
            k, 
            principal_vectors,
            points_3d,
            step_sign,
            kd_tree,
            boundary_curves,
            boundary_tolerance,
        )
        
        if (not next_result) or (next_result[0] is None):
            print("PSL stopped: near or off boundary.")
            break

        next_pt, next_dir = next_result
        
        # -------------------------------------------------------
        # NEW: SELF-CLOSING CHECK
        # Check if 'next_pt' is within 'closing_threshold' of ANY earlier point
        # in 'trajectory'. If yes, stop to avoid a spiral/loop.
        next_xyz = [next_pt[0], next_pt[1], next_pt[2]]
        if len(trajectory) >= 20:
            for old_pt in trajectory[:-10]:
                old_xyz = [old_pt.X, old_pt.Y, old_pt.Z]
                dist = distance_3d(next_xyz, old_xyz)
                if dist < closing_threshold:
                    print("PSL stopped: self-closing detected (dist=%.3f < %.3f)." 
                        % (dist, closing_threshold))
                    bridging_line = None  # optional
                    # break out of the for-loop
                    break
            else:
                # The "else" of a for-loop executes if we *didn't* break, so if we didn't find a close point
                pass
            # But we need to know if we broke from the loop
            # We can check that by adding an "if" after the for/else:
            if dist < closing_threshold:
                # we definitely broke for a self-collision
                break
        # -------------------------------------------------------

        # 3) Collision check with existing lines (unchanged)
        if existing_trajectories:
            line_idx, close_pt, dist_cl = find_closest_existing_line_3d(next_xyz, existing_trajectories, collision_threshold)
            if line_idx is not None and close_pt is not None:
                # Attempt bridging
                steps_back = 15
                if len(trajectory) > steps_back:
                    bridging_line = [
                        trajectory[-steps_back],
                        rg.Point3d(close_pt[0], close_pt[1], close_pt[2])
                    ]
                    # remove last steps so it merges more smoothly
                    del trajectory[-(steps_back-1):]
                else:
                    bridging_line = [
                        trajectory[-1],
                        rg.Point3d(close_pt[0], close_pt[1], close_pt[2])
                    ]
                print("PSL stopped: close to line %d at distance %.3f - merging initiated" % (line_idx, dist_cl))
                break
        
        # If we reach here, we accept next_pt
        trajectory.append(rg.Point3d(next_pt[0], next_pt[1], next_pt[2]))
        current_point_3d = next_pt
        current_dir = next_dir
    
    return trajectory, bridging_line

# ------------------------------------------------------------------------
# TRACE PSL IN BOTH DIRECTIONS (3D)
# ------------------------------------------------------------------------



def trace_psl_both_directions_in_one_loop_3d(
    seed_point_3d,
    h, 
    num_steps,
    k,
    principal_vectors, 
    points_3d,
    kd_tree,
    boundary_curves=None,
    boundary_tolerance=0.01,
    existing_trajectories=None,
    collision_threshold=0.05,
    closing_threshold=0.1
):
    """
    Traces a PSL forward (+1) and backward (-1) in ONE loop, letting each direction
    stop or collide independently. If forward is done, backward can keep going (and vice versa).
    If both are done, or tips meet, we stop entirely.
    """
    if existing_trajectories is None:
        existing_trajectories = []
    
    import Rhino.Geometry as rg
    from math import sqrt

    # Initialize lines
    forward_line = [rg.Point3d(*seed_point_3d)]
    backward_line = [rg.Point3d(*seed_point_3d)]

    # Current states
    f_current_pt = list(seed_point_3d)
    f_current_dir = None
    b_current_pt = list(seed_point_3d)
    b_current_dir = None

    bridging_lines = []

    # NEW: Flags for forward/backward
    forward_active = True
    backward_active = True

    for step_i in range(num_steps):
        # --------------------------------------------------
        # FORWARD STEP (if still active)
        # --------------------------------------------------
        if forward_active:
            f_next = runge_kutta_step_3d(
                f_current_pt,
                f_current_dir,
                h,
                k,
                principal_vectors,
                points_3d,
                step_sign=+1,
                kd_tree=kd_tree,
                boundary_curves=boundary_curves,
                boundary_tolerance=boundary_tolerance
            )
            if not f_next or (f_next[0] is None):
                print(f"PSL forward direction stopped at iteration {step_i}.")
                # Do NOT break from the entire loop
                forward_active = False
            else:
                # Accept the new point
                f_next_pt, f_next_dir = f_next
                
                # Optional collision check
                if existing_trajectories:
                    line_idx, close_pt, dist_cl = find_closest_existing_line_3d(
                        f_next_pt, existing_trajectories, collision_threshold
                    )
                    if line_idx is not None and close_pt is not None:
                        # Instead of break, we do bridging & disable forward
                        steps_back = 5
                        if len(forward_line) > steps_back:
                            bridging_line = [
                                forward_line[-steps_back],
                                rg.Point3d(*close_pt)
                            ]
                            bridging_lines.append(bridging_line)
                            del forward_line[-(steps_back-1):]
                        if len(forward_line)==0:
                            print("too short for bridge")
                        else:
                            bridging_line = [
                                forward_line[-1],
                                rg.Point3d(*close_pt)
                            ]
                            bridging_lines.append(bridging_line)
                        
                        print(f"PSL forward collided with line {line_idx} at dist {dist_cl:.3f}.")
                        forward_active = False

                    # 2) Check distance to boundary edges, if we have them
                if boundary_curves:
                    dist_to_edge,cp = distance_to_brep_edges(f_next_pt, boundary_curves)
                    if dist_to_edge < boundary_tolerance:
                        # We consider that "off" or "too close" => stop
                        print(f"PSL backward reached boundary.")
                        forward_active = False
                        bridging_line = [
                                forward_line[-1],
                                rg.Point3d(cp)
                            ]
                        bridging_lines.append(bridging_line)
                        
                # If still active after collision checks, append the step
                if forward_active:
                    forward_line.append(rg.Point3d(*f_next_pt))
                    f_current_pt = f_next_pt
                    f_current_dir = f_next_dir

        # --------------------------------------------------
        # BACKWARD STEP (if still active)
        # --------------------------------------------------
        if backward_active:
            b_next = runge_kutta_step_3d(
                b_current_pt,
                b_current_dir,
                h,
                k,
                principal_vectors,
                points_3d,
                step_sign=-1,
                kd_tree=kd_tree,
                boundary_curves=boundary_curves,
                boundary_tolerance=boundary_tolerance
            )
            if not b_next or (b_next[0] is None):
                print(f"PSL backward direction stopped at iteration {step_i}.")
                backward_active = False
            else:
                b_next_pt, b_next_dir = b_next
                
                if existing_trajectories:
                    line_idx, close_pt, dist_cl = find_closest_existing_line_3d(
                        b_next_pt, existing_trajectories, collision_threshold
                    )
                    if line_idx is not None and close_pt is not None:
                        steps_back = 5
                        if len(backward_line) > steps_back:
                            bridging_line = [
                                backward_line[-steps_back],
                                rg.Point3d(*close_pt)
                            ]
                            del backward_line[-(steps_back-1):]
                            bridging_lines.append(bridging_line)

                        if len(backward_line)==0:
                            print("too short for bridge")
                        else:
                            bridging_line = [
                                backward_line[-1],
                                rg.Point3d(*close_pt)
                            ]
                            bridging_lines.append(bridging_line)
                        print(f"PSL backward collided with line {line_idx} at dist {dist_cl:.3f}.")
                        backward_active = False

                if boundary_curves:
                    dist_to_edge,cp = distance_to_brep_edges(b_next_pt, boundary_curves)
                    if dist_to_edge < boundary_tolerance:
                        # We consider that "off" or "too close" => stop
                        print(f"PSL forward reached boundary.")
                        backward_active = False
                        bridging_line = [
                                backward_line[-1],
                                rg.Point3d(cp)
                            ]
                        bridging_lines.append(bridging_line)



                if backward_active:
                    backward_line.append(rg.Point3d(*b_next_pt))
                    b_current_pt = b_next_pt
                    b_current_dir = b_next_dir

        # --------------------------------------------------
        # If BOTH directions are inactive => stop
        # --------------------------------------------------
        if not forward_active and not backward_active:
            print("Both directions inactive => done.")
            break

        # --------------------------------------------------
        # TIP DISTANCE CHECK
        # (only if both are active, or up to you)
        # --------------------------------------------------
        if forward_active and backward_active and step_i >= 10:
            f_tip = [forward_line[-1].X, forward_line[-1].Y, forward_line[-1].Z]
            b_tip = [backward_line[-1].X, backward_line[-1].Y, backward_line[-1].Z]
            dist_fb = sqrt(
                (f_tip[0] - b_tip[0])**2 +
                (f_tip[1] - b_tip[1])**2 +
                (f_tip[2] - b_tip[2])**2
            )
            if dist_fb < closing_threshold:
                # bridging line if you like
                bridging_line = [forward_line[-1], backward_line[-1]]
                bridging_lines.append(bridging_line)

                print(
                    f"PSL tips meet at iteration {step_i}, dist= {dist_fb:.3f} < {closing_threshold}."
                )
                forward_active = False
                backward_active = False
                break

    # MERGE
    backward_line.reverse()
    if len(backward_line) > 1:
        backward_line.pop()
    merged_pts = backward_line + forward_line

    return merged_pts, bridging_lines


# ------------------------------------------------------------------------
# "MAIN" LOGIC IN GRASSHOPPER
# ------------------------------------------------------------------------
# Below is just an example of how you'd use these functions in GH:
#   1) Build the 3D KDTree from your data.
#   2) Loop over seed points.
#   3) Keep a global 'existing_trajectories' for collisions.
# ------------------------------------------------------------------------

# Example usage in a GH Python component:

# 1) Convert your input points/vectors to lists of [x,y,z].
points_array_3d = [to_xyz(pt) for pt in points]

boundary_curves = boundary_curves #get_brep_edge_curves(domain_surface)





# 1.1) Make vector field globally consistent (local consistency is handled on the go)
def get_knn_adjacency(points_3d, k=6):
    """
    Build adjacency by connecting each point to its 'k' nearest neighbors.
    points_3d: Nx3 array (or list) of 3D coords
    Returns: adjacency (list of lists),
             where adjacency[i] is the list of neighbor indices for point i.
    """
    points_np = np.array(points_3d)
    tree = KDTree(points_np)
    adjacency = []

    n = len(points_3d)
    for i in range(n):
        # Query K+1 because the nearest neighbor list includes the point itself at distance 0
        dists, indices = tree.query(points_np[i], k=k+1)
        # Drop 'i' itself
        neighbors = [idx for idx in indices if idx != i]
        adjacency.append(neighbors)
    
    return adjacency

def unify_vector_field(points_3d, vectors_3d, adjacency):
    """
    points_3d: Nx3 array of point positions
    vectors_3d: Nx3 array of directions
    adjacency: a list of lists, adjacency[i] = indices of neighbors of i
    """
    visited = [False]*len(points_3d)
    queue = [0]  # start BFS from index 0, or any random index
    visited[0] = True
    
    while queue:
        i = queue.pop(0)
        v_i = vectors_3d[i]
        
        for nbr in adjacency[i]:
            if not visited[nbr]:
                # Compare dot product
                dotp = (v_i[0]*vectors_3d[nbr][0] + 
                        v_i[1]*vectors_3d[nbr][1] + 
                        v_i[2]*vectors_3d[nbr][2])
                if dotp < 0:
                    # Flip neighbor's vector
                    vectors_3d[nbr][0] = -vectors_3d[nbr][0]
                    vectors_3d[nbr][1] = -vectors_3d[nbr][1]
                    vectors_3d[nbr][2] = -vectors_3d[nbr][2]
                visited[nbr] = True
                queue.append(nbr)
    
    # Now vectors_3d should be locally consistent
    return vectors_3d

adjacency = get_knn_adjacency(points_array_3d,k=1)
constant_vectors = unify_vector_field(points,principal_vectors,adjacency)
vectors_array_3d = [to_xyz(vec) for vec in constant_vectors]



w = tr.list_to_tree(vectors_array_3d)





# 2) Build a 3D KD-tree
points_np = np.array(points_array_3d)  # shape (N, 3)
kd_tree = KDTree(points_np)

# 3) We'll store PSL results in 'existing_trajectories' as: ( [pt3d_list], polyline_curve )
existing_trajectories = []
bridging_lines_out = []

# If 'domain_surface' is a Rhino Surface or a single-face Brep, you can store it here:
surface_id = None
if domain_surface:
    # If it's a Brep or Surface, no need to do 'sc.doc.Objects.AddSurface' necessarily,
    # but store it in a variable for the above projection checks
    surface_id = domain_surface  # rename for clarity

# 4) Loop over seed points (3D)
for seed in seed_points:
    seed_xyz = to_xyz(seed)
    
    merged_psl,  new_bridges = trace_psl_both_directions_in_one_loop_3d(
        seed_point_3d=seed_xyz,
        h=0.1,
        num_steps=1500,
        k=25,
        principal_vectors=vectors_array_3d,
        points_3d=points_array_3d,
        kd_tree=kd_tree,
        boundary_curves=boundary_curves,
        boundary_tolerance=0.1,
        existing_trajectories=existing_trajectories,
        collision_threshold=0.05,
        closing_threshold=0.1  # or whatever
    )
    
    # Build the cached polyline for collisions
    psl_curve_3d = build_polyline_curve_3d([[pt.X, pt.Y, pt.Z] for pt in merged_psl])
    existing_trajectories.append((merged_psl, psl_curve_3d))
    bridging_lines_out.extend(new_bridges)

# 5) Output
a = tr.list_to_tree(existing_trajectories)  # Each branch: (pts, polylineCurve)
b = tr.list_to_tree(bridging_lines_out)



# import cProfile, pstats, io

# # Create a profiler object and enable it.
# profiler = cProfile.Profile()
# profiler.enable()

# # Run your main function
# main()  # or capture its output if needed

# # Disable the profiler
# profiler.disable()

# # Create a stream to capture the profiler output
# s = io.StringIO()
# ps = pstats.Stats(profiler, stream=s).sort_stats('cumtime')
# ps.print_stats()  # You can also use 'time' or 'ncalls' as the sort key

# # Print the profiling results
# print(s.getvalue())
# ---------- end tracer_manual_3d_self ----------
pline_2 = PolyLine(Vertices=tracer_manual_3d_self.b, Closed=False)
pline_3 = PolyLine(Vertices=tracer_automatic_3d_self_single_loop.b, Closed=False)  # -> flatten(Polyline)
generated_seeds = Point(tracer_automatic_3d_self_single_loop.w)
crv_44 = Curve(tracer_manual_3d_self.a)
psl = Curve(tracer_automatic_3d_self_single_loop.a)
len_10 = Length(Curve=crv_44)
len_11 = Length(Curve=pline_2)
smaller_9 = SmallerThan(FirstNumber=len_10, SecondNumber="0.3")  # -> SmallerThan, OrEqualTo
cull_17 = CullPattern(List=crv_44, CullPattern=invert(smaller_9.SmallerThan))

explode_3 = Explode(Curve=psl, Recursive=True)  # -> Segments, Vertices
end_4 = EndPoints(Curve=crv_43)  # -> Start, End
join_9 = JoinCurves(Curves=explode_3.Segments, Preserve=False)  # -> flatten(Curves)
pull = PullPoint(Point=end_4.End, Geometry=formfound_mesh_3, ClosestOnly=True)  # -> ClosestPoint, Distance, Index
vec2pt_2 = Vector2Pt(PointA=end_4.Start, PointB=pull.ClosestPoint, Unitize=False)  # -> flatten(Vector), Length
pt_27 = Point(flatten(end_4.Start))
vec2pt_3 = Vector2Pt(PointA=end_4.Start, PointB=pull.ClosestPoint, Unitize=False)  # -> Vector, Length
item_18 = ListItem(List=vec2pt_2.Vector, Index="0", Wrap=True)
multiplication_7 = Multiplication(A=item_18, B=-1)
replace_3 = ReplaceItems(List=vec2pt_2.Vector, Item=multiplication_7, Indices="0", Wrap=False)
partition = PartitionList(List=replace_3, Size=3)
line_2 = LineSDL(Start=end_4.Start, Direction=partition, Length=0.1)
end_5 = EndPoints(Curve=line_2)  # -> Start, End
pull_2 = PullPoint(Point=end_5.End, Geometry=formfound_mesh_3, ClosestOnly=True)  # -> ClosestPoint, Distance, Index
vdisex_4 = VectorDisplayEx(Point=end_4.Start, Vector=partition, Colour=RGB(0, 0, 0), Width=2)
tracer_manual_3d = Python3Script(
    seed_points=flatten(pull_2.ClosestPoint),
    principal_vectors=shellvecresults.FirstPrincipalStressVector_kN_cm²,
    points=shellvecresults.Points,
    domain_surface=msh2psrf_3,
    collision_threshold="0.05",
    boundary_curves=join_6,
    seed_vectors=flatten(partition))  # -> out, a, b, w, Error_message; inputs seed_points: list of Point3d, principal_vectors: list of Vector3d, points: list of Point3d, domain_surface: Brep, collision_threshold: Double, boundary_curves: list of Curve, seed_vectors: list of Vector3d
# ---------- tracer_manual_3d: Python ----------
import math
import rhinoscriptsyntax as rs
import Rhino
import Rhino.Geometry as rg
import scriptcontext as sc
import numpy as np
from scipy.spatial import KDTree
from ghpythonlib import treehelpers as tr


# ------------------------------------------------------------------------
# 3D UTILITY FUNCTIONS
# ------------------------------------------------------------------------

def to_xyz(pt_or_vec):
    """Converts Rhino.Geometry.Point3d or Vector3d (or numeric [x,y,z]) to a Python list [x, y, z]."""
    if hasattr(pt_or_vec, "X"):
        return [pt_or_vec.X, pt_or_vec.Y, pt_or_vec.Z]
    else:
        return [pt_or_vec[0], pt_or_vec[1], pt_or_vec[2]]

def normalize_3d(vec):
    """Normalize a 3D vector [x, y, z] to unit length. Returns [0,0,0] if near zero length."""
    mag = math.sqrt(vec[0]**2 + vec[1]**2 + vec[2]**2)
    if mag < 1e-12:
        return [0.0, 0.0, 0.0]
    return [vec[0]/mag, vec[1]/mag, vec[2]/mag]

def find_closest_neighbors_kd_3d(point, kd_tree, k):
    """
    Given a 3D point [x, y, z] and a KDTree, returns a list of indices of the k closest points.
    """
    distances, indices = kd_tree.query(point, k=k)
    if isinstance(indices, int):
        return [indices]
    return list(indices)

def interpolate_vector_3d_consistent(pt, points_3d, vectors_3d, neighbors, ref_dir):
    """
    Distance-weighted interpolation of neighbor vectors in 3D,
    flipping each neighbor's vector if dot < 0 with respect to 'ref_dir'.

    - pt: [x, y, z], the point where we want the interpolated vector
    - points_3d: Nx3 array of point coords
    - vectors_3d: Nx3 array of principal vectors
    - neighbors: list of indices from the KDTree
    - ref_dir: [dx, dy, dz], the direction from the previous step (or None if first step)
    """
    weights = []
    weighted_vec = [0.0, 0.0, 0.0]

    for i in neighbors:
        vx, vy, vz = vectors_3d[i]  # copy so we can flip locally
        if ref_dir is not None:
            dotp = vx*ref_dir[0] + vy*ref_dir[1] + vz*ref_dir[2]
            if dotp < 0:
                vx, vy, vz = -vx, -vy, -vz
        
        npt = points_3d[i]
        dx = pt[0] - npt[0]
        dy = pt[1] - npt[1]
        dz = pt[2] - npt[2]
        dist = (dx*dx + dy*dy + dz*dz)**0.5
        
        w = 1.0 / (dist + 1e-6)
        weights.append(w)
        
        weighted_vec[0] += vx*w
        weighted_vec[1] += vy*w
        weighted_vec[2] += vz*w

    total_w = sum(weights)
    if total_w > 1e-12:
        weighted_vec[0] /= total_w
        weighted_vec[1] /= total_w
        weighted_vec[2] /= total_w

    mag = (weighted_vec[0]**2 + weighted_vec[1]**2 + weighted_vec[2]**2)**0.5
    if mag < 1e-12:
        return [0.0, 0.0, 0.0]
    
    return [weighted_vec[0]/mag, weighted_vec[1]/mag, weighted_vec[2]/mag]

def adjust_step_size_3d(current_pt, neighbors, points_3d, step_sign):

    if not neighbors:
        return 0.1 * step_sign
    
    distances = []
    for i in neighbors:
        npt = points_3d[i]
        dx = current_pt[0] - npt[0]
        dy = current_pt[1] - npt[1]
        dz = current_pt[2] - npt[2]
        dist = math.sqrt(dx*dx + dy*dy + dz*dz)
        distances.append(dist)
    
    avg_dist = sum(distances) / len(distances) if len(distances) else 0.1
    base_step = min(0.1, avg_dist / 2.0)
    return base_step * step_sign

# ------------------------------------------------------------------------#
# SURFACE / BREP PROJECTION UTILS
# ------------------------------------------------------------------------#

def project_onto_surface(surface, pt3d):
    """
    Project a 3D point onto a Rhino surface or the first face of a Brep.
    Returns [x, y, z] on the surface, or None if projection fails.
    """
    pt_rh = rg.Point3d(pt3d[0], pt3d[1], pt3d[2])
    
    # If 'surface' is actually a Brep, get the face or use ClosestPoint on the brep
    if isinstance(surface, rg.Brep):
        # For a single-face brep (like an untrimmed surface), we can do:
        #   face = surface.Faces[0]
        #   rc, u, v = face.ClosestPoint(pt_rh)
        #   ...
        # Otherwise, you can do surface.ClosestPoint(pt_rh) to get a face index, etc.
        face = surface.Faces[0] # <--- if you know it has only one face
        rc, u, v = face.ClosestPoint(pt_rh)
        if rc:
            new_pt = face.PointAt(u, v)
            return [new_pt.X, new_pt.Y, new_pt.Z]
        else:
            return None
    
    elif isinstance(surface, rg.Surface):
        rc, u, v = surface.ClosestPoint(pt_rh)
        if rc:
            new_pt = surface.PointAt(u, v)
            return [new_pt.X, new_pt.Y, new_pt.Z]
        else:
            return None
    
    else:
        # If it's something else, or None
        return None

def is_on_surface(surface, pt3d, tol=0.01):
    """
    Returns True if pt3d is within 'tol' of the surface. 
    """
    if not surface: 
        return True  # no surface provided
    pproj = project_onto_surface(surface, pt3d)
    if pproj is None:
        return False
    dx = pt3d[0] - pproj[0]
    dy = pt3d[1] - pproj[1]
    dz = pt3d[2] - pproj[2]
    dist = math.sqrt(dx*dx + dy*dy + dz*dz)
    return (dist < tol)

def get_brep_edge_curves(domain_surface):
    """
    Returns a list of Rhino.Geometry.Curve objects, one for each edge of the Brep.
    If 'domain_surface' is a plain NURBS surface, we convert it to a Brep first.
    """

    # If 'domain_surface' is actually a Surface, convert it to a Brep
    if isinstance(domain_surface, rg.Surface):
        domain_surface = rg.Brep.CreateFromSurface(domain_surface)
        if not domain_surface:
            # In case conversion fails
            return []

    edge_curves = []
    # Now 'domain_surface' should be a Brep
    for edge in domain_surface.Edges:
        crv = edge.ToNurbsCurve()  # or edge.EdgeCurve if you prefer
        edge_curves.append(crv)
    return edge_curves

def distance_to_brep_edges(pt3d, boundary_curves):
    """
    Given a 3D point (x,y,z) and a list of boundary curves,
    returns the minimum distance from the point to any of those curves.
    """
    test_pt = rg.Point3d(pt3d[0], pt3d[1], pt3d[2])
    min_dist = float('inf')
    for crv in boundary_curves:
        
        # ClosestPoint returns (bool, parameter)
        rc, t = crv.ClosestPoint(test_pt)
        if rc:
            cp = crv.PointAt(t)
            dist = cp.DistanceTo(test_pt)
            if dist < min_dist:
                min_dist = dist
                close_pt = cp
    return min_dist, close_pt

def runge_kutta_step_3d(
    current_point, 
    current_dir,
    h, 
    k, 
    principal_vectors, 
    points_3d, 
    step_sign, 
    kd_tree, 
    boundary_curves=None, 
    boundary_tolerance=0.01,prev_dir=None):
    """
    Perform one RK4 step in 3D. Stop if next point is within 'boundary_tolerance'
    of any boundary curve (edges).
    Returns the next 3D point or None if out-of-bound / near boundary.
    """
    
    # 1) Neighbors & dynamic step size
    neighbors = find_closest_neighbors_kd_3d(current_point, kd_tree, k)
    h = h * step_sign#adjust_step_size_3d(current_point, neighbors, points_3d, step_sign)
    
    # k1
    k1_dir = interpolate_vector_3d_consistent(current_point, points_3d, principal_vectors, neighbors, current_dir)
    mid1 = [
        current_point[0] + 0.5*h*k1_dir[0],
        current_point[1] + 0.5*h*k1_dir[1],
        current_point[2] + 0.5*h*k1_dir[2]
    ]
    
    # k2
    neigh_mid1 = find_closest_neighbors_kd_3d(mid1, kd_tree, k)
    k2_dir = interpolate_vector_3d_consistent(mid1, points_3d, principal_vectors, neigh_mid1, k1_dir)
    mid2 = [
        current_point[0] + 0.5*h*k2_dir[0],
        current_point[1] + 0.5*h*k2_dir[1],
        current_point[2] + 0.5*h*k2_dir[2]
    ]
    
    # k3
    neigh_mid2 = find_closest_neighbors_kd_3d(mid2, kd_tree, k)
    k3_dir = interpolate_vector_3d_consistent(mid2, points_3d, principal_vectors, neigh_mid2, k2_dir)
    end_pt = [
        current_point[0] + h*k3_dir[0],
        current_point[1] + h*k3_dir[1],
        current_point[2] + h*k3_dir[2]
    ]
    
    # k4
    neigh_end = find_closest_neighbors_kd_3d(end_pt, kd_tree, k)
    k4_dir = interpolate_vector_3d_consistent(end_pt, points_3d, principal_vectors, neigh_end, k3_dir)
    
    # Summation
    dx = h*(k1_dir[0] + 2*k2_dir[0] + 2*k3_dir[0] + k4_dir[0]) / 6.0
    dy = h*(k1_dir[1] + 2*k2_dir[1] + 2*k3_dir[1] + k4_dir[1]) / 6.0
    dz = h*(k1_dir[2] + 2*k2_dir[2] + 2*k3_dir[2] + k4_dir[2]) / 6.0
    
    next_point = [
        current_point[0] + dx,
        current_point[1] + dy,
        current_point[2] + dz
    ]
    next_dir = k4_dir
    # 2) Check distance to boundary edges, if we have them
    # if boundary_curves:
    #     dist_to_edge = distance_to_brep_edges(next_point, boundary_curves)
    #     if dist_to_edge < boundary_tolerance:
    #         # We consider that "off" or "too close" => stop
    #         return None

    # Otherwise return the next valid point
    return next_point, next_dir


# ------------------------------------------------------------------------
# COLLISION / MERGING CHECKS IN 3D
# ------------------------------------------------------------------------

def build_polyline_curve_3d(poly_pts):
    pts3d = [rg.Point3d(pt[0], pt[1], pt[2]) for pt in poly_pts]
    poly = rg.Polyline(pts3d)
    return rg.PolylineCurve(poly)

def closest_point_on_polyline_3d(pt3d, poly_curve):
    """
    Return (closest_point, distance) from a 3D point to a polyline curve.
    """
    test_pt = rg.Point3d(pt3d[0], pt3d[1], pt3d[2])
    rc, t = poly_curve.ClosestPoint(test_pt)
    if rc:
        cp = poly_curve.PointAt(t)
        dist = cp.DistanceTo(test_pt)
        return [cp.X, cp.Y, cp.Z], dist
    else:
        return None, float('inf')

def find_closest_existing_line_3d(next_point, existing_trajectories, threshold):
    """
    Among all previously traced lines (in 3D), find if 'next_point' is within 'threshold' of any line.
    Returns (closest_line_index, closest_point_on_line, distance).
    """
    min_dist = float('inf')
    closest_line_idx = None
    closest_pt = None
    
    for i, (polyline_pts, poly_curve) in enumerate(existing_trajectories):
        cp, dist = closest_point_on_polyline_3d(next_point, poly_curve)
        if dist < min_dist:
            min_dist = dist
            closest_line_idx = i
            closest_pt = cp
    
    if min_dist < threshold:
        return (closest_line_idx, closest_pt, min_dist)
    else:
        return (None, None, float('inf'))


def distance_to_seedpt(pt):
    min_dist = float('inf')
    closest_seed = None
    for seed in seed_points:
        dist_to_s = seed.DistanceTo(pt)
        if dist_to_s < min_dist:
            min_dist = dist_to_s
            closest_seed = seed
    return min_dist, closest_seed

# ------------------------------------------------------------------------
# MAIN PSL TRACING FUNCTION (3D)
# ------------------------------------------------------------------------

def trace_principal_stress_line_3d(
    p_start, 
    h, 
    num_steps, 
    k, 
    principal_vectors, 
    points_3d, 
    boundary_curves=None, 
    boundary_tolerance=0.05,
    existing_trajectories=None,
    collision_threshold=0.05,
    step_sign=1,
    start_dir=None):
    """
    Trace a principal stress line starting from p_start (3D) using RK4 in 3D,
    following the provided starting direction 'start_dir'.
    """
    if existing_trajectories is None:
        existing_trajectories = []
    
    trajectory = [rg.Point3d(p_start[0], p_start[1], p_start[2])]
    bridging_line = None
    
    current_point_3d = p_start[:]
    # Use the provided starting direction
    current_dir = start_dir
    nn = 0
    for _ in range(num_steps):
        next_result = runge_kutta_step_3d(
            current_point_3d, 
            current_dir,
            h, 
            k, 
            principal_vectors,
            points_3d,
            step_sign,
            kd_tree,
            boundary_curves,
            boundary_tolerance,
        )
        nn = nn+1
        if not next_result or next_result[0] is None:
            print("PSL stopped: near or off boundary.")
            break
        next_pt, next_dir = next_result
        
        # Collision check with existing lines
        if existing_trajectories:
            line_idx, close_pt, dist = find_closest_existing_line_3d(next_pt, existing_trajectories, collision_threshold)
            if line_idx is not None and close_pt is not None:
                steps_back = 5
                if len(trajectory) > steps_back:
                    bridging_line = [
                        trajectory[-steps_back],
                        rg.Point3d(close_pt[0], close_pt[1], close_pt[2])
                    ]
                    del trajectory[-(steps_back-1):]
                else:
                    bridging_line = [
                        trajectory[-1],
                        rg.Point3d(close_pt[0], close_pt[1], close_pt[2])
                    ]
                print("PSL stopped: close to line %d at distance %.3f - merging initiated" % (line_idx, dist))
                break
    
        if seed_points:
            if nn>20:
                print(1)
                dist_to_seed, seed_pt = distance_to_seedpt(rg.Point3d(next_pt[0],next_pt[1],next_pt[2]))
                print(dist_to_seed)
                if dist_to_seed < 0.1:
                    print("smaller")
                    # create connection to close seed_point
                    bridging_line = [
                    trajectory[-1],
                    rg.Point3d(seed_pt[0], seed_pt[1], seed_pt[2])
                    ]
                    break

        if boundary_curves:
            dist_to_edge,cp = distance_to_brep_edges(next_pt, boundary_curves)
            
            if dist_to_edge < boundary_tolerance:
                # We consider that "off" or "too close" => stop
               
                bridging_line = [cp,trajectory[-1]]
                
                break
 
        trajectory.append(rg.Point3d(next_pt[0], next_pt[1], next_pt[2]))
        current_point_3d = next_pt
        current_dir = next_dir
    
    return trajectory, bridging_line

# ------------------------------------------------------------------------
# "MAIN" LOGIC IN GRASSHOPPER
# ------------------------------------------------------------------------
# Below is just an example of how you'd use these functions in GH:
#   1) Build the 3D KDTree from your data.
#   2) Loop over seed points.
#   3) Keep a global 'existing_trajectories' for collisions.
# ------------------------------------------------------------------------

# Example usage in a GH Python component:

# 1) Convert your input points/vectors to lists of [x,y,z].
points_array_3d = [to_xyz(pt) for pt in points]

boundary_curves = boundary_curves #get_brep_edge_curves(domain_surface)


# 1.1) Make vector field globally consistent (local consistency is handled on the go)
def get_knn_adjacency(points_3d, k=6):
    """
    Build adjacency by connecting each point to its 'k' nearest neighbors.
    points_3d: Nx3 array (or list) of 3D coords
    Returns: adjacency (list of lists),
             where adjacency[i] is the list of neighbor indices for point i.
    """
    points_np = np.array(points_3d)
    tree = KDTree(points_np)
    adjacency = []

    n = len(points_3d)
    for i in range(n):
        # Query K+1 because the nearest neighbor list includes the point itself at distance 0
        dists, indices = tree.query(points_np[i], k=k+1)
        # Drop 'i' itself
        neighbors = [idx for idx in indices if idx != i]
        adjacency.append(neighbors)
    
    return adjacency

def unify_vector_field(points_3d, vectors_3d, adjacency):
    """
    points_3d: Nx3 array of point positions
    vectors_3d: Nx3 array of directions
    adjacency: a list of lists, adjacency[i] = indices of neighbors of i
    """
    visited = [False]*len(points_3d)
    queue = [0]  # start BFS from index 0, or any random index
    visited[0] = True
    
    while queue:
        i = queue.pop(0)
        v_i = vectors_3d[i]
        
        for nbr in adjacency[i]:
            if not visited[nbr]:
                # Compare dot product
                dotp = (v_i[0]*vectors_3d[nbr][0] + 
                        v_i[1]*vectors_3d[nbr][1] + 
                        v_i[2]*vectors_3d[nbr][2])
                if dotp < 0:
                    # Flip neighbor's vector
                    vectors_3d[nbr][0] = -vectors_3d[nbr][0]
                    vectors_3d[nbr][1] = -vectors_3d[nbr][1]
                    vectors_3d[nbr][2] = -vectors_3d[nbr][2]
                visited[nbr] = True
                queue.append(nbr)
    
    # Now vectors_3d should be locally consistent
    return vectors_3d

adjacency = get_knn_adjacency(points_array_3d,k=1)
constant_vectors = unify_vector_field(points,principal_vectors,adjacency)
vectors_array_3d = [to_xyz(vec) for vec in constant_vectors]



w = tr.list_to_tree(vectors_array_3d)





# 2) Build a 3D KD-tree
points_np = np.array(points_array_3d)  # shape (N, 3)
kd_tree = KDTree(points_np)

# 3) We'll store PSL results in 'existing_trajectories' as: ( [pt3d_list], polyline_curve )
existing_trajectories = []
bridging_lines_out = []

# If 'domain_surface' is a Rhino Surface or a single-face Brep, you can store it here:
surface_id = None
if domain_surface:
    # If it's a Brep or Surface, no need to do 'sc.doc.Objects.AddSurface' necessarily,
    # but store it in a variable for the above projection checks
    surface_id = domain_surface  # rename for clarity

# 4) Loop over seed points (3D)
# Assume seed_points and seed_vectors are lists of seed points and their associated starting vectors
for seed, svec in zip(seed_points, seed_vectors):
    seed_xyz = to_xyz(seed)
    start_direction = to_xyz(svec)  # convert starting vector if necessary
    
    psl, bridge = trace_principal_stress_line_3d(
        seed_xyz,
        h=0.05,
        num_steps=3000,
        k=25,
        principal_vectors=vectors_array_3d,
        points_3d=points_array_3d,
        boundary_curves=boundary_curves,
        boundary_tolerance=0.05,
        existing_trajectories=existing_trajectories,
        collision_threshold=0.05,
        start_dir=start_direction  # use the provided starting vector
    )
    
    # Build the cached polyline for collisions
    psl_curve_3d = build_polyline_curve_3d([[pt.X, pt.Y, pt.Z] for pt in psl])
    existing_trajectories.append((psl, psl_curve_3d))
    if bridge:
        bridging_lines_out.append(bridge)


# 5) Output
a = tr.list_to_tree(existing_trajectories)  # Each branch: (pts, polylineCurve)
b = tr.list_to_tree(bridging_lines_out)



# import cProfile, pstats, io

# # Create a profiler object and enable it.
# profiler = cProfile.Profile()
# profiler.enable()

# # Run your main function
# main()  # or capture its output if needed

# # Disable the profiler
# profiler.disable()

# # Create a stream to capture the profiler output
# s = io.StringIO()
# ps = pstats.Stats(profiler, stream=s).sort_stats('cumtime')
# ps.print_stats()  # You can also use 'time' or 'ncalls' as the sort key

# # Print the profiling results
# print(s.getvalue())
# ---------- end tracer_manual_3d ----------
# PSL - Postprocessing
crv_45 = Curve(shelllineresults_6.Lines2)
crv_46 = Curve(tracer_manual_3d.a)
pline_4 = PolyLine(Vertices=tracer_manual_3d.b, Closed=False)  # -> flatten(Polyline)
filtertype = FilterByType(ObjectType=list, Geometry=flatten(crv_46), invertFilter=False, returnNulls=False)  # -> ExcludedGeometry, IncludedGeometry
karamba3d_output = Curve(crv_45)
len_12 = Length(Curve=filtertype.IncludedGeometry)
smaller_10 = SmallerThan(FirstNumber=len_12, SecondNumber="0.3")  # -> SmallerThan, OrEqualTo
join_10 = JoinCurves(Curves=karamba3d_output, Preserve=False)  # -> flatten(Curves)
ln_2 = Line(StartPoint=pull_2.ClosestPoint, EndPoint=end_5.Start)
cull_18 = CullPattern(List=filtertype.IncludedGeometry, CullPattern=invert(smaller_10.SmallerThan))
join_11 = JoinCurves(Curves=flatten([cull_18, pline_4]), Preserve=False)
len_13 = Length(Curve=join_11)
smaller_11 = SmallerThan(FirstNumber=len_13, SecondNumber="0.3")  # -> SmallerThan, OrEqualTo
join_12 = JoinCurves(Curves=join_10, Preserve=False)
cull_19 = CullPattern(List=join_11, CullPattern=invert(smaller_11.SmallerThan))
mp_3 = MultiPipe(Curves=flatten([cull_19, ln_2]), NodeSize=0.05, EndOffset=1, StrutSize=1, Segment=0, KinkAngle=0.1, CubeFit=0, Caps=0)
item_19 = ListItem(List=join_12, Index=Slider(277, range=0..400), Wrap=True)
len_14 = Length(Curve=join_12)
curve_display_6 = CSharpScript(Curve=flatten(cull_19), Width="4", Colour=swatch)  # inputs Curve: Curve, Width: Int32, Colour: Color, Dash: String; same code as curve_display
preview_7 = CustomPreview(Geometry=mp_3, Material=swatch)
larger_3 = LargerThan(FirstNumber=len_14, SecondNumber="25")  # -> LargerThan, OrEqualTo
not_6 = GateNot(A=larger_3.LargerThan)
cull_20 = CullPattern(List=join_12, CullPattern=not_6)
cull_21 = CullPattern(List=join_12, CullPattern=larger_3.LargerThan)
len_15 = Length(Curve=cull_20)
smaller_12 = SmallerThan(FirstNumber=len_15, SecondNumber="0.2")  # -> SmallerThan, OrEqualTo
not_7 = GateNot(A=smaller_12.SmallerThan)
cull_22 = CullPattern(List=cull_20, CullPattern=not_7)
crv_47 = Curve(reparameterize(cull_22))
end_6 = EndPoints(Curve=crv_47)  # -> Start, End
pdecon_2 = Deconstruct(Point=end_6.End)  # -> XComponent, YComponent, ZComponent
larger_4 = LargerThan(FirstNumber=pdecon_2.ZComponent, SecondNumber="5")  # -> LargerThan, OrEqualTo
not_8 = GateNot(A=larger_4.LargerThan)
cull_23 = CullPattern(List=crv_47, CullPattern=larger_4.LargerThan)
divide_3 = DivideCurve(Curve=cull_23, Count=10, Kinks=False)  # -> flatten(Points), Tangents, Parameters
cull_24 = CullPattern(List=crv_47, CullPattern=not_8)
avr_4 = Average(Input=divide_3.Points)
end_7 = EndPoints(Curve=cull_24)  # -> Start, End
dist_2 = Distance(PointA=end_7.Start, PointB=end_7.End)
line_3 = LineSDL(Start=avr_4, Direction=Z_3, Length=panel_17)
join_13 = JoinCurves(Curves=line_3, Preserve=False)
smaller_13 = SmallerThan(FirstNumber=dist_2, SecondNumber="0.1")  # -> SmallerThan, OrEqualTo
not_9 = GateNot(A=smaller_13.SmallerThan)
divide_4 = DivideCurve(Curve=join_13, Count=Slider(30, range=0..30), Kinks=False)  # -> Points, Tangents, Parameters
cull_25 = CullPattern(List=cull_24, CullPattern=smaller_13.SmallerThan)
cull_26 = CullPattern(List=cull_25, CullPattern=not_4)
cull_27 = CullPattern(List=cull_24, CullPattern=not_9)
cir_2 = Circle(Plane=divide_4.Points, Radius=2)
boundary_2 = BoundarySurfaces(Edges=cir_2)
item_20 = ListItem(List=flatten(cull_25), Index=Slider(142, range=0..142), Wrap=True)
bbx = BrepBrep(BrepA=msh2psrf_3, BrepB=boundary_2)  # -> Curves, Points; disabled
ccx_3 = CurveCurve(CurveA=graft(cull_25), CurveB=mshnakededgs_2.Naked)  # -> Points, ParamsA, ParamsB
trim_4 = TrimTree(Tree=ccx_3.Points, Depth=1)  # -> simplify(Tree)
lng_4 = ListLength(List=trim_4)  # -> flatten(Length)
int_2 = Integer(lng_4)
py3_7 = Python3Script(x=int_2)  # -> out, a; inputs x: list of Int32; same code as py3_5
not_10 = GateNot(A=py3_7.a)
cull_28 = CullPattern(List=cull_25, CullPattern=py3_7.a)
item_21 = ListItem(List=cull_28, Index=Slider(12, range=0..16), Wrap=True)
cull_29 = CullPattern(List=cull_25, CullPattern=not_10)
end_8 = EndPoints(Curve=item_21)  # -> Start, End
crv_48 = Curve(reparameterize(cull_28))
ccx_4 = CurveCurve(CurveA=graft(crv_48), CurveB=mshnakededgs_2.Naked)  # -> Points, ParamsA, ParamsB
sph_2 = Sphere(Base=end_8.End, Radius=0.005)
sph_3 = Sphere(Base=end_8.Start, Radius=0.005)
trim_5 = TrimTree(Tree=ccx_4.ParamsA, Depth=1)  # -> simplify(Tree)
preview_8 = CustomPreview(Geometry=sph_2, Material=ColourSwatch(SwatchColor=RGB(240, 19, 19)))
preview_9 = CustomPreview(Geometry=sph_3, Material=ColourSwatch(SwatchColor=RGB(64, 227, 27)))
shatter_5 = Shatter(Curve=graft(crv_48), Parameters=trim_5)  # -> flatten(Segments)
len_16 = Length(Curve=shatter_5)
sort_3 = SortList(Keys=shatter_5, ValuesA=len_16)  # -> Keys, ValuesA
item_22 = ListItem(List=reverse(sort_3.ValuesA), Index=0, Wrap=True)
larger_5 = LargerThan(FirstNumber=item_22, SecondNumber=len_16)  # -> LargerThan, OrEqualTo
cull_30 = CullPattern(List=shatter_5, CullPattern=larger_5.OrEqualTo)
cull_31 = CullPattern(List=cull_30, CullPattern=[False, True])
entwine = Entwine(Branch00=cull_27, Branch01=cull_30, Branch02=bbx.Curves, FlattenInputs=True)  # -> flatten(Result)
end_9 = EndPoints(Curve=cull_31)  # -> Start, End
py3_8 = Python3Script(curve_ids=entwine, min_dist="0.05")  # -> a, b; inputs curve_ids: list of Curve, min_dist: Double; same code as py3_6
sph_4 = Sphere(Base=end_9.End, Radius=0.005)
sph_5 = Sphere(Base=end_9.Start, Radius=0.005)
preview_10 = CustomPreview(Geometry=sph_4, Material=ColourSwatch(SwatchColor=RGB(240, 19, 19)))
preview_11 = CustomPreview(Geometry=sph_5, Material=ColourSwatch(SwatchColor=RGB(64, 227, 27)))
crv_49 = Curve(py3_8.a)

# ==== cluster Cluster
data = ClusterInput()
data_2 = ClusterInput()
data_3 = Data(data_2)
data_4 = Data(data)
B = ClusterInput()
B_2 = ClusterInput()
Z = ClusterInput()
Z_2 = ClusterInput()
Z_3 = ClusterInput()
Z_4 = ClusterInput()

addition = Addition(A=data_4, B=B)
subtraction = Subtraction(A=data_3, B=B_2)
D = ConstructPoint(XCoordinate=data_4, YCoordinate=subtraction, ZCoordinate=Z_2)
A = ConstructPoint(XCoordinate=data_4, YCoordinate=data_3, ZCoordinate=Z_3)
B_3 = ConstructPoint(XCoordinate=addition, YCoordinate=data_3, ZCoordinate=Z)
C = ConstructPoint(XCoordinate=addition, YCoordinate=subtraction, ZCoordinate=Z_4)
ln = Line(StartPoint=A, EndPoint=B_3)
ln_2 = Line(StartPoint=A, EndPoint=D)
ln_3 = Line(StartPoint=C, EndPoint=B_3)
ln_4 = Line(StartPoint=D, EndPoint=C)

support_a = SupportA(P=A, D_2=Slider(-41, range=-180..100), R=Slider(0.6, range=0..10), D=Slider(221, range=-360..360))
arc_support_c = ArcSupportD(P=C, D_2=Slider(124, range=-180..180), R=Slider(0.6, range=0..10), D=Slider(219, range=-360..360))
arc_support_d = ArcSupportD(P=D, D_2=Slider(45, range=-180..100), R=Slider(0.6, range=0..10), D=Slider(235, range=-360..360))
arc_support_b = ArcSupportD(P=B_3, D_2=Slider(-131, range=-180..180), R=Slider(0.6, range=0..10), D=Slider(241, range=-360..360))

panel = Panel("264")
panel_2 = Panel("245")
panel_3 = Panel("263")
end = EndPoints(Curve=support_a)  # -> Start, End
end_2 = EndPoints(Curve=arc_support_d)  # -> Start, End
end_3 = EndPoints(Curve=arc_support_b)  # -> Start, End
end_4 = EndPoints(Curve=arc_support_c)  # -> Start, End
cd = Line(StartPoint=end_2.End, EndPoint=end_4.Start)
ad = Line(StartPoint=end.End, EndPoint=end_2.Start)
bc = Line(StartPoint=end_4.End, EndPoint=end_3.Start)
ab = Line(StartPoint=end.Start, EndPoint=end_3.End)
ad_2 = ClusterOutput(ad)
cd_2 = ClusterOutput(cd)
ab_2 = ClusterOutput(ab)
bc_2 = ClusterOutput(bc)
data_5 = ClusterInput()
data_6 = ClusterInput()
data_7 = ClusterInput()
data_8 = Data(data_5)
data_9 = ClusterInput()
data_10 = ClusterInput()
data_11 = Data(data_6)
data_12 = ClusterInput()
data_13 = ClusterInput()
data_14 = Data(data_7)
data_15 = Data(data_9)
data_16 = Data(data_10)
data_17 = Data(data_12)
data_18 = Data(data_13)

multiplication = Multiplication(A=data_11, B=data_8)
divide = DivideCurve(Curve=ab, Count=data_11, Kinks=False)  # -> Points, Tangents, Parameters
shift = ShiftList(List=multiplication, Shift=1, Wrap=invert(True))
short = ShortestList(ListA=multiplication, ListB=shift, TrimMode=2)  # -> ListA, ListB
dom = ConstructDomain(DomainStart=short.ListA, DomainEnd=short.ListB)
ab_pts = ClusterOutput(divide.Points)
subset = SubList(List=divide.Points, Domain=dom, Wrap=True)  # -> List, Index
bang = ExplodeTree(Data=subset.List)  # -> Branch0, Branch1, Branch2, Branch3, Branch4

multiplication_2 = Multiplication(A=data_11, B=data_8)
divide_2 = DivideCurve(Curve=cd, Count=data_11, Kinks=False)  # -> Points, Tangents, Parameters
shift_2 = ShiftList(List=multiplication_2, Shift=1, Wrap=invert(True))
short_2 = ShortestList(ListA=multiplication_2, ListB=shift_2, TrimMode=2)  # -> ListA, ListB
cd_pts = ClusterOutput(divide_2.Points)
dom_2 = ConstructDomain(DomainStart=short_2.ListA, DomainEnd=short_2.ListB)
subset_2 = SubList(List=divide_2.Points, Domain=dom_2, Wrap=True)  # -> List, Index
bang_2 = ExplodeTree(Data=subset_2.List)  # -> Branch0, Branch1, Branch2, Branch3, Branch4

subtraction_2 = Subtraction(A=data_16, B=data_15)
subtraction_3 = Subtraction(A=data_17, B=data_18)
number_slider = Slider(10, range=0..100)
division = Division(A=subtraction_2, B="3")
division_2 = Division(A=subtraction_3, B="3")
addition_2 = Addition(A=data_15, B=division)
subtraction_4 = Subtraction(A=data_16, B=division)
addition_3 = Addition(A=data_18, B=division_2)
subtraction_5 = Subtraction(A=data_17, B=division_2)
division_3 = Division(A=1, B=number_slider)

lng = ListLength(List=bang_2.Branch4)  # -> expr("x-1", Length)
division_4 = Division(A="1", B=lng)
series = Series(Start=0, Step=division_4, Count=expr("x+1", lng))
item = ListItem(List=reverse(bang_2.Branch3), Index=0, Wrap=True)
eval = EvaluateCurve(Curve=bc, Parameter=data_18)  # -> Point, Tangent, Angle
ln_5 = Line(StartPoint=item, EndPoint=eval.Point)
tweencrv = TweenCurve(CurveA=ln_5, CurveB=arc_support_c, Factor=series, BlendType=0)
make_mesh = MakeMesh(C=tweencrv, N=number_slider)  # -> M, P
end_5 = EndPoints(Curve=tweencrv)  # -> Start, End

lng_2 = ListLength(List=bang.Branch4)  # -> expr("x-1", Length)
division_5 = Division(A="1", B=lng_2)
series_2 = Series(Start=0, Step=division_5, Count=expr("x+1", lng_2))
eval_2 = EvaluateCurve(Curve=bc, Parameter=data_17)  # -> Point, Tangent, Angle
item_2 = ListItem(List=reverse(bang.Branch3), Index=0, Wrap=True)
ln_6 = Line(StartPoint=eval_2.Point, EndPoint=item_2)
tweencrv_2 = TweenCurve(CurveA=ln_6, CurveB=arc_support_b, Factor=series_2, BlendType=0)
end_6 = EndPoints(Curve=tweencrv_2)  # -> Start, End
make_mesh_2 = MakeMesh(C=tweencrv_2, N=number_slider)  # -> M, P

lng_3 = ListLength(List=bang.Branch0)  # -> expr("x-1", Length)
division_6 = Division(A="1", B=lng_3)
series_3 = Series(Start=0, Step=division_6, Count=expr("x+1", lng_3))
eval_3 = EvaluateCurve(Curve=ad, Parameter=data_15)  # -> Point, Tangent, Angle
item_3 = ListItem(List=bang.Branch1, Index=0, Wrap=True)
ln_7 = Line(StartPoint=item_3, EndPoint=eval_3.Point)
tweencrv_3 = TweenCurve(CurveA=ln_7, CurveB=support_a, Factor=series_3, BlendType=0)
make_mesh_3 = MakeMesh(C=tweencrv_3, N=number_slider)  # -> M, P
end_7 = EndPoints(Curve=tweencrv_3)  # -> Start, End

lng_4 = ListLength(List=bang_2.Branch0)  # -> expr("x-1", Length)
eval_4 = EvaluateCurve(Curve=ad, Parameter="0.8")  # -> Point, Tangent, Angle
item_4 = ListItem(List=bang_2.Branch1, Index=0, Wrap=True)
division_7 = Division(A="1", B=lng_4)
ln_8 = Line(StartPoint=eval_4.Point, EndPoint=item_4)
series_4 = Series(Start=0, Step=division_7, Count=expr("x+1", lng_4))
tweencrv_4 = TweenCurve(CurveA=ln_8, CurveB=arc_support_d, Factor=series_4, BlendType=0)
end_8 = EndPoints(Curve=tweencrv_4)  # -> Start, End
make_mesh_4 = MakeMesh(C=tweencrv_4, N=number_slider)  # -> M, P

number_slider_2 = Slider(13, range=0..15)
number_slider_3 = Slider(8, range=0..15)

pt = Point(bang.Branch2)
pt_2 = Point(bang_2.Branch2)
ln_9 = Line(StartPoint=pt, EndPoint=pt_2)
make_mesh_5 = MakeMesh(C=ln_9, N=data_14)  # -> M, P

flip = FlipCurve(Curve=ln_5)  # -> Curve, Flag

division_8 = Division(A="1", B=data_14)
series_5 = Series(Start=0, Step=division_8, Count=expr("x+1", data_14))
tweencrv_5 = TweenCurve(CurveA=flip.Curve, CurveB=ln_6, Factor=series_5, BlendType=0)
end_9 = EndPoints(Curve=tweencrv_5)  # -> Start, End
make_mesh_6 = MakeMesh(C=tweencrv_5, N=number_slider)  # -> M, P

division_9 = Division(A="1", B=data_14)
flip_2 = FlipCurve(Curve=ln_8)  # -> Curve, Flag
series_6 = Series(Start=0, Step=division_9, Count=expr("x+1", data_14))
tweencrv_6 = TweenCurve(CurveA=flip_2.Curve, CurveB=ln_7, Factor=series_6, BlendType=0)
make_mesh_7 = MakeMesh(C=tweencrv_6, N=number_slider)  # -> M, P
end_10 = EndPoints(Curve=tweencrv_6)  # -> Start, End

cull_i = CullIndex(List=tweencrv_6, Indices=[0, 1], Wrap=True)
base_curves_outriggers = ClusterInput()
crv = Curve(<curve referenced from the Rhino model>)
merge = Merge(Data1=reverse(flatten(end_7.End)), Data2=reverse(flatten(end_10.End)), Data3=flatten(end_8.Start))
pt_3 = Point(end_8.Start)
base_curves_outriggers_2 = Curve(graft(base_curves_outriggers))
midpt = CurveMiddle(Curve=crv)
crv_cp = CurveClosestPoint(Point=midpt, Curve=crv)  # -> Point, Parameter, Distance
item_5 = ListItem(List=end_10.End, Index=[0, 1, 2, 3, 4], Wrap=True)
item_6 = ListItem(List=bang_2.Branch1, Index=[0, 1, 2, 3, 4, 5, 6, 7, 8, 9], Wrap=True)
shatter = Shatter(Curve=crv, Parameters=crv_cp.Parameter)
pt_4 = Point(flatten(merge))
pt_5 = Point(flatten(subset.List))
entwine = Entwine(Branch00=bang_2.Branch1, Branch01=bang_2.Branch2, Branch02=bang_2.Branch3, Branch03=bang_2.Branch4, FlattenInputs=True)  # -> flatten(Result)
pline = PolyLine(Vertices=item_5, Closed=False)  # -> reparameterize(Polyline)
bang_3 = ExplodeTree(Data=base_curves_outriggers_2)  # -> Branch0, Branch1, Branch2, Branch3
merge_2 = Merge(Data1=reverse(flatten(end_6.Start)), Data2=reverse(flatten(end_9.Start)), Data3=flatten(end_5.End))
cullpt = CullDuplicates(Points=pt_4, Tolerance=0.01, CullMode=3)  # -> reverse(Points), Indices, Valence
item_7 = ListItem(List=end_10.End, Index=5, Wrap=True)
item_8 = ListItem(List=bang_2.Branch1, Index=10, Wrap=True)
pt_6 = Point(merge_2)
pline_2 = PolyLine(Vertices=item_6, Closed=False)  # -> reparameterize(Polyline)
dispatch = Dispatch(List=shatter, DispatchPattern=[True, False])  # -> ListA, ListB
crv_2 = Curve(dispatch.ListA)
cullpt_2 = CullDuplicates(Points=pt_5, Tolerance=0.1, CullMode=3)  # -> reverse(Points), Indices, Valence
seq = Sequence(Notation="[N-1] + 5", Length=10, Initial=3)
pt_7 = Point(flatten(entwine))
lng_5 = ListLength(List=cullpt_2.Points)  # -> expr("x-1", Length)
cull_i_2 = CullIndex(List=cullpt.Points, Indices=[0, 1, 2, 3, 4], Wrap=True)
pt_8 = Point(flatten(pt_6))
cullpt_3 = CullDuplicates(Points=pt_7, Tolerance=0.1, CullMode=3)  # -> Points, Indices, Valence
lng_6 = ListLength(List=cull_i_2)  # -> expr("x-1", Length)
divide_3 = DivideCurve(Curve=bang_3.Branch2, Count=lng_5, Kinks=False)  # -> Base_points_Outriggers, Tangents, Parameters
cullpt_4 = CullDuplicates(Points=pt_8, Tolerance=0.1, CullMode=3)  # -> Points, Indices, Valence
cull_i_3 = CullIndex(List=cullpt_3.Points, Indices=[0, 1, 2, 3, 4, 5, 6, 7, 8, 9], Wrap=True)
lng_7 = ListLength(List=cull_i_3)
divide_4 = DivideCurve(Curve=dispatch.ListB, Count=lng_7, Kinks=False)  # -> Base_points_Outriggers, Tangents, Parameters
cull_i_4 = CullIndex(List=divide_4.Base_points_Outriggers, Indices=0, Wrap=True)
divide_5 = DivideCurve(Curve=crv_2, Count=lng_6, Kinks=False)  # -> Base_points_A, Tangents, Parameters
ln_10 = Line(StartPoint=cull_i_2, EndPoint=reverse(divide_5.Base_points_A))
cull_i_5 = CullIndex(List=cullpt_4.Points, Indices=[0, -1], Wrap=True)
lng_8 = ListLength(List=cull_i_5)  # -> expr("x-1", Length)
divide_6 = DivideCurve(Curve=bang_3.Branch3, Count=lng_8, Kinks=False)  # -> Base_points_A, Tangents, Parameters
ln_11 = Line(StartPoint=cull_i_3, EndPoint=cull_i_4)
ln_12 = Line(StartPoint=cullpt_2.Points, EndPoint=divide_3.Base_points_Outriggers)
base_points_outriggers = ClusterOutput(divide_3.Base_points_Outriggers)
ln_13 = Line(StartPoint=cull_i_5, EndPoint=divide_6.Base_points_A)
seq_2 = Sequence(Notation="[N-1] + 5", Length=8, Initial=3)

# ---- group: D3
make_mesh_8 = MakeMesh(C=ln_12, N=Slider(18, range=10..30))  # -> M, P

# ---- group: D4
make_mesh_9 = MakeMesh(C=ln_13, N=Slider(18, range=10..30))  # -> M, P

# ----
make_mesh_10 = MakeMesh(C=ln_10, N=Slider(18, range=10..30))  # -> M, P
end_11 = EndPoints(Curve=ln_12)  # -> Start, End

# ---- group: D1
make_mesh_11 = MakeMesh(C=ln_11, N=Slider(26, range=10..30))  # -> M, P

# ----
number_slider_4 = Slider(8, range=0..10)
flip_3 = FlipMatrix(Data=make_mesh_11.P)
flip_4 = FlipMatrix(Data=make_mesh_10.P)
panel_4 = Panel("1")
cull_i_6 = CullIndex(List=end_11.Start, Indices=[23, 24], Wrap=True)
cull_i_7 = CullIndex(List=end_11.End, Indices=[23, 24], Wrap=True)
flip_5 = FlipMatrix(Data=make_mesh_8.P)
flip_6 = FlipMatrix()
item_9 = ListItem(List=flip_3, Index=0, Wrap=True)  # -> flatten(Item)
item_10 = ListItem(List=item_9, Index=[1, 2, 3, 4, 5, 6, 7, 8, 9, 10], Wrap=True)
pline_3 = PolyLine(Vertices=item_10, Closed=False)  # -> reparameterize(Polyline)
flip_7 = FlipCurve(Curve=pline_3)  # -> Curve, Flag
merge_3 = Merge(Data1=pline_2, Data2=flip_7.Curve)  # -> flatten(Result)
lng_9 = ListLength(List=item_10)  # -> expr("x-1", Length)
tweencrv_7 = TweenCurve(CurveA=pline_2, CurveB=flip_7.Curve, Factor=[0, 0.33, 0.66, 1], BlendType=0)
end_12 = EndPoints(Curve=tweencrv_7)  # -> Start, End
pt_9 = Point(flatten(end_12.End))
make_mesh_12 = MakeMesh(C=tweencrv_7, N=lng_9)  # -> M, P
shift_3 = ShiftList(List=pt_9, Shift=1, Wrap=True)  # -> simplify(graft(List))
lng_10 = ListLength(List=pt_9)
merge_4 = Merge(Data1=shift_3, Data2=simplify(graft(pt_9)))
mesh = Mesh(make_mesh_12.M)
repeat = RepeatData(Data=item_8, Length=lng_10)
merge_5 = Merge(Data1=simplify(graft(repeat)), Data2=simplify(merge_4))
conmesh = ConstructMesh(Vertices=merge_5, Faces={A=0, B=1, C=2, D=2})
panel_6 = Panel("8")
item_11 = ListItem(List=flip_4, Index=0, Wrap=True)  # -> flatten(Item)
item_12 = ListItem(List=item_11, Index=[1, 2, 3, 4, 5], Wrap=True)
pline_4 = PolyLine(Vertices=item_12, Closed=False)  # -> reparameterize(Polyline)
lng_11 = ListLength(List=item_12)  # -> expr("x-1", Length)
flip_8 = FlipCurve(Curve=pline_4)  # -> Curve, Flag
merge_6 = Merge(Data1=pline, Data2=flip_8.Curve)  # -> flatten(Result)
tweencrv_8 = TweenCurve(CurveA=pline, CurveB=flip_8.Curve, Factor=[0, 0.33, 0.66, 1], BlendType=0)
end_13 = EndPoints(Curve=tweencrv_8)  # -> Start, End
pt_10 = Point(flatten(end_13.End))
make_mesh_13 = MakeMesh(C=tweencrv_8, N=lng_11)  # -> M, P
shift_4 = ShiftList(List=pt_10, Shift=1, Wrap=True)  # -> simplify(graft(List))
lng_12 = ListLength(List=pt_10)
merge_7 = Merge(Data1=shift_4, Data2=simplify(graft(pt_10)))
repeat_2 = RepeatData(Data=item_7, Length=lng_12)
mesh_2 = Mesh(make_mesh_13.M)
merge_8 = Merge(Data1=simplify(graft(repeat_2)), Data2=simplify(merge_7))
merge_9 = Merge(Data1=mesh, Data2=mesh_2)
conmesh_2 = ConstructMesh(Vertices=merge_8, Faces={A=0, B=1, C=2, D=2})
mesh_3 = Mesh(conmesh_2)
mesh_4 = Mesh(conmesh)
branch = TreeBranch(Tree=simplify(flip_5), Path="{10}", MaintainPaths=True)
branch_2 = TreeBranch(Tree=simplify(flip_6), Path="{10}", MaintainPaths=True)
ln_14 = Line(StartPoint=cull_i_6, EndPoint=cull_i_7)
bang_4 = ExplodeTree(Data=mesh_3)  # -> Branch0, Branch1, Branch2
item_13 = ListItem(List=reverse(item_9), Index=number_slider_4, Wrap=True)
bang_5 = ExplodeTree(Data=mesh_4)  # -> Branch0, Branch1, Branch2
item_14 = ListItem(List=reverse(item_11), Index=number_slider_4, Wrap=True)
item_15 = ListItem(List=item_9, Index=-1, Wrap=True)
split = SplitList(List=ln_14, Index=23)  # -> ListA, ListB
crv_3 = Curve(split.ListA)
crv_4 = Curve(split.ListB)
merge_10 = Merge(
    Data1=divide_4.Base_points_Outriggers,
    Data2=divide_5.Base_points_A,
    Data3=divide_3.Base_points_Outriggers,
    Data4=divide_6.Base_points_A)
item_16 = ListItem(List=item_11, Index=-1, Wrap=True)
mesh_5 = Mesh([bang_4.Branch2, bang_4.Branch1, bang_4.Branch0])
mesh_6 = Mesh(flatten([bang_5.Branch2, bang_5.Branch1, bang_5.Branch0]))
ln_15 = Line(StartPoint=item_13, EndPoint=item_15)
ln_16 = Line(StartPoint=item_14, EndPoint=item_16)
range = Range(Domain=Domain(0, 1), Steps=5)
item_17 = ListItem(List=reverse(branch), Index=0, Wrap=True)
item_18 = ListItem(List=reverse(split.ListA), Index=0, Wrap=True)
item_19 = ListItem(List=split.ListB, Index=0, Wrap=True)
item_20 = ListItem(List=reverse(split.ListA), Index=0, Wrap=True)
item_21 = ListItem(List=branch_2, Index=0, Wrap=True)
tweencrv_9 = TweenCurve(CurveA=ln_16, CurveB=ln_15, Factor=range, BlendType=0)
basepoint_outriggers = ClusterOutput(merge_10)
crv_cp_2 = CurveClosestPoint(Point=item_17, Curve=item_18)  # -> Point, Parameter, Distance
crv_cp_3 = CurveClosestPoint(Point=item_21, Curve=item_19)  # -> Point, Parameter, Distance
make_mesh_14 = MakeMesh(C=tweencrv_9, N=number_slider_4)  # -> M, P
shatter_2 = Shatter(Curve=item_18, Parameters=crv_cp_2.Parameter)
shatter_3 = Shatter(Curve=item_19, Parameters=crv_cp_3.Parameter)

# ----
# this i disconnected (top m to D1 and bottom m to D4)
outriggers = Merge(
    Data2=make_mesh_10.M,
    Data3=make_mesh_8.M,
    Data4=make_mesh_9.M,
    Data7=make_mesh_11.M,
    Data8=make_mesh_14.M,
    Data9=merge_9)

dispatch_2 = Dispatch(List=shatter_2, DispatchPattern=[True, False])  # -> ListA, ListB
dispatch_3 = Dispatch(List=shatter_3, DispatchPattern=[True, False])  # -> ListA, ListB
crv_5 = Curve(dispatch_2.ListB)
crv_6 = Curve(dispatch_3.ListB)
crv_7 = Curve([crv_6, crv_5])
merge_bun = Merge(Data3=end_9.Start, Data4=end_6.Start, Data5=end_5.End)
merge_11 = Merge(Data2=end_10.End, Data4=end_8.Start, Data5=end_7.End)
merge_12 = Merge(Data1=support_a, Data2=arc_support_d, Data3=arc_support_c, Data4=arc_support_b)
item_22 = ListItem(List=reverse(make_mesh_14.P), Index=reverse(0), Wrap=True)  # -> flatten(Item)
ad_pt = ClusterOutput(merge_11)
bc_pt = ClusterOutput(merge_bun)
divide_7 = DivideCurve(Curve=merge_12, Count=10, Kinks=False)  # -> Points, Tangents, Parameters
extra_points = Point(item_22)
extra_points_2 = ClusterOutput(extra_points)

big_funnel = ClusterInput()
ln_17 = Line(StartPoint=bang.Branch1, EndPoint=bang_2.Branch1)

multiplication_3 = Multiplication(A=data_14, BigFunnel=big_funnel)
pt_11 = Point(bang.Branch3)
pt_12 = Point(bang_2.Branch3)
shift_5 = ShiftList(List=multiplication_3, Shift=1, Wrap=invert(True))
short_3 = ShortestList(ListA=multiplication_3, ListB=shift_5, TrimMode=2)  # -> ListA, ListB
divide_8 = DivideCurve(Curve=ln_17, Count=data_14, Kinks=False)  # -> Points, Tangents, Parameters
dom_3 = ConstructDomain(DomainStart=short_3.ListA, DomainEnd=short_3.ListB)
lng_13 = ListLength(List=ln_17)  # -> expr("x-1", Length)
flip_9 = FlipMatrix(Data=divide_8.Points)
pline_5 = PolyLine(Vertices=flip_9, Closed=False)  # -> flatten(Polyline)
subset_3 = SubList(List=pline_5, Domain=dom_3, Wrap=True)  # -> List, Index
B_4 = ClusterInput()
divide_9 = DivideCurve(Curve=ln_17, Count=data_14, Kinks=False)  # -> Points, Tangents, Parameters
multiplication_4 = Multiplication(A=data_14, B=B_4)
lng_14 = ListLength(List=ln_17)  # -> expr("x-1", Length)
shift_6 = ShiftList(List=multiplication_4, Shift=1, Wrap=invert(True))
flip_10 = FlipMatrix(Data=divide_9.Points)
short_4 = ShortestList(ListA=multiplication_4, ListB=shift_6, TrimMode=2)  # -> ListA, ListB
pline_6 = PolyLine(Vertices=flip_10, Closed=False)  # -> flatten(Polyline)
dom_4 = ConstructDomain(DomainStart=short_4.ListA, DomainEnd=short_4.ListB)
bang_6 = ExplodeTree(Data=subset_3.List)  # -> Branch0, Branch1, Branch2, Branch3, Branch4
make_mesh_15 = MakeMesh(C=bang_6.Branch4, N=lng_14)  # -> M, P

make_mesh_16 = MakeMesh(C=bang_6.Branch2, N=lng_14)  # -> M, P

make_mesh_17 = MakeMesh(C=bang_6.Branch0, N=lng_14)  # -> M, P
demesh = DeconstructMesh(Mesh=make_mesh_17.M)  # -> Vertices, Faces, Colours, Normals
cull_i_8 = CullIndex(List=demesh.Faces, Indices=[11, 12, 13], Wrap=True)

B_5 = ClusterInput()
multiplication_5 = Multiplication(A=data_14, B=B_5)
pt_13 = Point(bang.Branch3)
pt_14 = Point(bang_2.Branch3)
shift_7 = ShiftList(List=multiplication_5, Shift=1, Wrap=invert(True))
ln_18 = Line(StartPoint=pt_13, EndPoint=pt_14)
short_5 = ShortestList(ListA=multiplication_5, ListB=shift_7, TrimMode=2)  # -> ListA, ListB
divide_10 = DivideCurve(Curve=ln_18, Count=data_14, Kinks=False)  # -> Points, Tangents, Parameters
dom_5 = ConstructDomain(DomainStart=short_5.ListA, DomainEnd=short_5.ListB)
lng_15 = ListLength(List=ln_18)  # -> expr("x-1", Length)
flip_11 = FlipMatrix(Data=divide_10.Points)
pline_7 = PolyLine(Vertices=flip_11, Closed=False)  # -> flatten(Polyline)
subset_4 = SubList(List=pline_7, Domain=dom_5, Wrap=True)  # -> List, Index
B_6 = ClusterInput()
divide_11 = DivideCurve(Curve=ln_18, Count=data_14, Kinks=False)  # -> Points, Tangents, Parameters
multiplication_6 = Multiplication(A=data_14, B=B_6)
lng_16 = ListLength(List=ln_18)  # -> expr("x-1", Length)
shift_8 = ShiftList(List=multiplication_6, Shift=1, Wrap=invert(True))
flip_12 = FlipMatrix(Data=divide_11.Points)
short_6 = ShortestList(ListA=multiplication_6, ListB=shift_8, TrimMode=2)  # -> ListA, ListB
pline_8 = PolyLine(Vertices=flip_12, Closed=False)  # -> flatten(Polyline)
dom_6 = ConstructDomain(DomainStart=short_6.ListA, DomainEnd=short_6.ListB)
subset_5 = SubList(List=pline_8, Domain=dom_6, Wrap=True)  # -> List, Index
bang_7 = ExplodeTree(Data=subset_4.List)  # -> Branch0, Branch1, Branch2
bang_8 = ExplodeTree(Data=subset_5.List)  # -> Branch0, Branch1, Branch2
crv_8 = Curve(bang_7.Branch1)
item_23 = ListItem(List=bang_7.Branch2, Index=0, Wrap=True)
item_24 = ListItem(List=reverse(bang_7.Branch0), Index=0, Wrap=True)
support_down = ClusterInput()
number_slider_5 = Slider(10, range=0..10)
division_10 = Division(A="1", B=number_slider_5)
series_7 = Series(Start=0, Step=division_10, Count=expr("x+1", number_slider_5))
make_mesh_18 = MakeMesh(C=bang_7.Branch0, N=lng_16)  # -> M, P
crv_9 = Curve(bang_7.Branch1)
number_slider_6 = Slider(4, range=0..10)

lng_17 = ListLength(List=bang_7.Branch1)  # -> expr("x-1", Length)
range_2 = Range(Domain=Domain(0, 1), Steps=lng_15)
crv_10 = Curve(bang_7.Branch1)
tweencrv_10 = TweenCurve(CurveA=item_24, CurveB=item_23, Factor=range_2, BlendType=0)
lng_18 = ListLength(List=tweencrv_10)  # -> expr("x-1", Length)
end_14 = EndPoints(Curve=item_23)  # -> Start, End
end_15 = EndPoints(Curve=item_24)  # -> Start, End
ln_19 = Line(StartPoint=end_15.End, EndPoint=end_14.End)
ln_20 = Line(StartPoint=end_15.Start, EndPoint=end_14.Start)
flip_13 = FlipCurve(Curve=ln_19)  # -> Curve, Flag

support_down_2 = Curve(support_down)
divide_12 = DivideCurve(Curve=support_down_2, Count=2, Kinks=False)  # -> Points, Tangents, Parameters
shatter_4 = Shatter(Curve=support_down_2, Parameters=divide_12.Parameters)
item_25 = ListItem(List=reverse(shatter_4), Index=0, Wrap=True)
item_26 = ListItem(List=shatter_4, Index=0, Wrap=True)

Z_5 = UnitZ(Factor=expr("-x", 1))
move = Move(Geometry=item_24, Motion=Z_5)  # -> Geometry, Transform
end_16 = EndPoints(Curve=item_23)  # -> Start, End
end_17 = EndPoints(Curve=move.Geometry)  # -> Start, End
vec2pt = Vector2Pt(PointA=end_16.End, PointB=end_17.Start, Unitize=False)  # -> Vector, Length
move_2 = Move(Geometry=item_23, Motion=vec2pt.Vector)  # -> Geometry, Transform

flip_14 = FlipCurve(Curve=ln_20)  # -> Curve, Flag
vdis = VectorDisplay(Anchor=end_17.End, Vector=vec2pt.Vector)

tweencrv_11 = TweenCurve(CurveA=item_23, CurveB=move_2.Geometry, Factor=series_7, BlendType=0)
tweencrv_12 = TweenCurve(CurveA=item_26, CurveB=move_2.Geometry, Factor=series_7, BlendType=0)
make_mesh_19 = MakeMesh(C=tweencrv_11, N=lng_18)  # -> M, P
make_mesh_20 = MakeMesh(C=tweencrv_12, N=lng_18)  # -> M, P

tweencrv_13 = TweenCurve(CurveA=item_24, CurveB=move.Geometry, Factor=series_7, BlendType=0)
tweencrv_14 = TweenCurve(CurveA=item_25, CurveB=move.Geometry, Factor=series_7, BlendType=0)
make_mesh_21 = MakeMesh(C=tweencrv_14, N=lng_18)  # -> M, P
make_mesh_22 = MakeMesh(C=tweencrv_13, N=lng_18)  # -> M, P

make_mesh_23 = MakeMesh(C=bang_7.Branch2, N=lng_18)  # -> M, P
flip_15 = FlipMatrix(Data=make_mesh_20.P)
flip_16 = FlipMatrix(Data=make_mesh_21.P)
end_18 = EndPoints(Curve=tweencrv_11)  # -> Start, End
end_19 = EndPoints(Curve=tweencrv_13)  # -> Start, End
item_27 = ListItem(List=flip_15, Index=0, Wrap=True)
item_28 = ListItem(List=flip_16, Index=0, Wrap=True)
split_2 = SplitList(List=crv_9, Index=expr("x-2", lng_17))  # -> ListA, ListB
ln_21 = Line(StartPoint=end_18.End, EndPoint=end_19.Start)
end_20 = EndPoints(Curve=split_2.ListA)  # -> Start, End
end_21 = EndPoints(Curve=split_2.ListB)  # -> reverse(Start), reverse(End)
cull_i_9 = CullIndex(List=reverse(ln_21), Indices=0, Wrap=True)
short_7 = ShortestList(ListA=end_18.Start, ListB=end_21.Start, TrimMode=2)  # -> ListA, ListB
short_8 = ShortestList(ListA=end_19.End, ListB=end_20.End, TrimMode=2)  # -> ListA, ListB
short_9 = ShortestList(ListA=end_20.Start, ListB=end_19.Start, TrimMode=2)  # -> ListA, ListB
short_10 = ShortestList(ListA=end_18.End, ListB=end_21.End, TrimMode=2)  # -> ListA, ListB
ln_22 = Line(StartPoint=short_7.ListA, EndPoint=short_7.ListB)
split_3 = SplitList(List=cull_i_9, Index=Slider(4, range=0..10))  # -> ListA, ListB
ln_23 = Line(StartPoint=short_9.ListA, EndPoint=short_9.ListB)
ln_24 = Line(StartPoint=short_10.ListA, EndPoint=short_10.ListB)
ln_25 = Line(StartPoint=short_8.ListA, EndPoint=short_8.ListB)
clean = CleanTree(RemoveNulls=True, RemoveInvalid=True, RemoveEmpty=False, Tree=ln_22)
clean_2 = CleanTree(RemoveNulls=True, RemoveInvalid=True, RemoveEmpty=False, Tree=ln_24)
clean_3 = CleanTree(RemoveNulls=True, RemoveInvalid=True, RemoveEmpty=False, Tree=ln_25)
clean_4 = CleanTree(RemoveNulls=True, RemoveInvalid=True, RemoveEmpty=False, Tree=ln_23)
make_mesh_web = MakeMesh(C=split_3.ListA, N=number_slider_6)  # -> M, P
make_mesh_web_2 = MakeMesh(C=clean, N=number_slider_6)  # -> M, P
make_mesh_web_3 = MakeMesh(C=clean_2, N=number_slider_6)  # -> M, P
make_mesh_web_4 = MakeMesh(C=clean_3, N=number_slider_6)  # -> M, P
make_mesh_web_5 = MakeMesh(C=clean_4, N=number_slider_6)  # -> M, P
webs = Merge(Data1=make_mesh_web_2.M, Data2=make_mesh_web_3.M, Data3=make_mesh_web_4.M, Data4=make_mesh_web_5.M)  # -> flatten(Result)

bottom_anchor_points = Merge(Data1=item_27, Data2=item_28)  # -> flatten(Result)
non_orientable_strip = Merge(
    Data1=make_mesh_18.M,
    Data2=make_mesh_23.M,
    Data3=make_mesh_22.M,
    Data4=make_mesh_19.M,
    Data5=make_mesh_20.M,
    Data6=make_mesh_21.M,
    Data7=webs,
    Data8=make_mesh_web.M)

flip_17 = FlipMatrix(Data=make_mesh_web_4.P)
flip_18 = FlipMatrix(Data=make_mesh_web_5.P)
flip_19 = FlipMatrix(Data=make_mesh_web_3.P)
flip_20 = FlipMatrix(Data=make_mesh_web_2.P)
pt_15 = Point(flip_17)
pt_16 = Point(flip_18)
item_29 = ListItem(List=end_20.Start, Index=0, Wrap=True)
pt_17 = Point(flip_19)
pt_18 = Point(flip_20)
item_30 = ListItem(List=pt_15, Index=0, Wrap=True)
item_31 = ListItem(List=pt_16, Index=0, Wrap=True)
item_32 = ListItem(List=end_20.End, Index=0, Wrap=True)
item_33 = ListItem(List=pt_17, Index=0, Wrap=True)
item_34 = ListItem(List=end_21.End, Index=0, Wrap=True)
item_35 = ListItem(List=end_21.Start, Index=0, Wrap=True)
item_36 = ListItem(List=pt_18, Index=0, Wrap=True)
pt_19 = Point(flatten(item_30))
pt_20 = Point(flatten(item_31))
pt_21 = Point(flatten(item_33))
pt_22 = Point(flatten(item_36))
shift_9 = ShiftList(List=pt_19, Shift=1, Wrap=True)  # -> simplify(graft(List))
shift_10 = ShiftList(List=pt_20, Shift=1, Wrap=True)  # -> simplify(graft(List))
shift_11 = ShiftList(List=pt_21, Shift=1, Wrap=True)  # -> simplify(graft(List))
shift_12 = ShiftList(List=pt_22, Shift=1, Wrap=True)  # -> simplify(graft(List))
lng_19 = ListLength(List=pt_19)
lng_20 = ListLength(List=pt_20)
lng_21 = ListLength(List=pt_21)
lng_22 = ListLength(List=pt_22)
merge_13 = Merge(Data1=shift_9, Data2=simplify(graft(pt_19)))
merge_14 = Merge(Data1=shift_10, Data2=simplify(graft(pt_20)))
merge_15 = Merge(Data1=shift_11, Data2=simplify(graft(pt_21)))
merge_16 = Merge(Data1=shift_12, Data2=simplify(graft(pt_22)))
repeat_3 = RepeatData(Data=item_32, Length=lng_19)
repeat_4 = RepeatData(Data=item_29, Length=lng_20)
repeat_5 = RepeatData(Data=item_34, Length=lng_21)
repeat_6 = RepeatData(Data=item_35, Length=lng_22)
merge_17 = Merge(Data1=simplify(graft(repeat_3)), Data2=simplify(merge_13))
merge_18 = Merge(Data1=simplify(graft(repeat_4)), Data2=simplify(merge_14))
merge_19 = Merge(Data1=simplify(graft(repeat_5)), Data2=simplify(merge_15))
merge_20 = Merge(Data1=simplify(graft(repeat_6)), Data2=simplify(merge_16))
conmesh_3 = ConstructMesh(Vertices=merge_17, Faces={A=0, B=1, C=2, D=2})
conmesh_4 = ConstructMesh(Vertices=merge_18, Faces={A=0, B=1, C=2, D=2})
conmesh_5 = ConstructMesh(Vertices=merge_19, Faces={A=0, B=1, C=2, D=2})
conmesh_6 = ConstructMesh(Vertices=merge_20, Faces={A=0, B=1, C=2, D=2})
mesh_7 = Mesh(conmesh_3)
mesh_8 = Mesh(conmesh_4)
mesh_9 = Mesh(conmesh_5)
mesh_10 = Mesh(conmesh_6)
bang_9 = ExplodeTree(Data=mesh_7)  # -> Branch0, Branch1, Branch2, Branch3
bang_10 = ExplodeTree(Data=mesh_8)  # -> Branch0, Branch1, Branch2, Branch3
bang_11 = ExplodeTree(Data=mesh_9)  # -> Branch0, Branch1, Branch2, Branch3
bang_12 = ExplodeTree(Data=mesh_10)  # -> Branch0, Branch1, Branch2, Branch3
mesh_11 = Mesh([bang_10.Branch0, bang_10.Branch1, bang_10.Branch2, bang_10.Branch3])
mesh_12 = Mesh([bang_9.Branch2, bang_9.Branch1, bang_9.Branch0, bang_9.Branch3])
mesh_13 = Mesh([bang_11.Branch0, bang_11.Branch1, bang_11.Branch2, bang_11.Branch3])
merge_21 = Merge(Data1=divide_7.Points, Data2=bottom_anchor_points)
mesh_14 = Mesh([bang_12.Branch2, bang_12.Branch1, bang_12.Branch0, bang_12.Branch3])
columns_pts = ClusterOutput(merge_21)
merge_22 = Merge(Data1=mesh_13, Data2=mesh_11, Data3=mesh_12, Data4=mesh_14)  # -> flatten(Result)
small_meshes = Merge(Data1=mesh_6, Data2=mesh_5, Data3=merge_22)  # -> flatten(Result)
merge_23 = Merge(
    Data1=make_mesh_2.M,
    Data2=make_mesh.M,
    Data3=make_mesh_3.M,
    Data4=make_mesh_4.M,
    Data5=make_mesh_6.M,
    Data7=make_mesh_7.M,
    Data8=small_meshes)

item_37 = ListItem(List=bang_6.Branch4, Index=0, Wrap=True)
series_8 = Series(Start=0, Step=division_3, Count=expr("x+1", number_slider))
item_38 = ListItem(List=reverse(bang_6.Branch2), Index=0, Wrap=True)
Z_6 = UnitZ(Factor=1)

divide_13 = DivideCurve(Curve=item_37, Count=lng_13, Kinks=False)  # -> Points, Tangents, Parameters
divide_14 = DivideCurve(Curve=item_38, Count=lng_13, Kinks=False)  # -> Points, Tangents, Parameters
split_4 = SplitList(List=divide_13.Points, Index=number_slider_2)  # -> ListA, ListB
split_5 = SplitList(List=divide_14.Points, Index=number_slider_2)  # -> ListA, ListB
item_39 = ListItem(List=reverse(split_4.ListA), Index=reverse(0), Wrap=True)
pt_23 = Point(split_4.ListA)
pt_24 = Point(split_5.ListA)
pline_9 = PolyLine(Vertices=pt_23, Closed=False)
pline_10 = PolyLine(Vertices=pt_24, Closed=False)

move_3 = Move(Geometry=pline_9, Motion=Z_6)  # -> Geometry, Transform
move_4 = Move(Geometry=pline_10, Motion=Z_6)  # -> Geometry, Transform

merge_24 = Merge(Data1=item_39, Data2=split_4.ListB)
item_40 = ListItem(List=reverse(split_5.ListA), Index=reverse(0), Wrap=True)
pline_11 = PolyLine(Vertices=merge_24, Closed=False)
merge_25 = Merge(Data1=item_40, Data2=split_5.ListB)
lng_23 = ListLength(List=split_4.ListA)  # -> expr("x-1", Length)
ln_26 = Line(StartPoint=merge_24, EndPoint=merge_25)
pline_12 = PolyLine(Vertices=merge_25, Closed=False)

tweencrv_15 = TweenCurve(CurveA=pline_10, CurveB=move_4.Geometry, Factor=series_8, BlendType=0)
tweencrv_16 = TweenCurve(CurveA=pline_9, CurveB=move_3.Geometry, Factor=series_8, BlendType=0)
end_22 = EndPoints(Curve=tweencrv_15)  # -> Start, End
end_23 = EndPoints(Curve=tweencrv_16)  # -> Start, End
ln_27 = Line(StartPoint=end_23.Start, EndPoint=end_22.Start)
ln_28 = Line(StartPoint=end_23.End, EndPoint=end_22.End)
lng_24 = ListLength(List=bang_6.Branch3)  # -> expr("x-1", Length)
clean_5 = CleanTree(RemoveNulls=True, RemoveInvalid=True, RemoveEmpty=False, Tree=ln_27)
clean_6 = CleanTree(RemoveNulls=True, RemoveInvalid=True, RemoveEmpty=False, Tree=ln_28)

division_11 = Division(A=1, B=lng_24)

make_mesh_24 = MakeMesh(C=clean_6, N=lng_24)  # -> M, P
make_mesh_25 = MakeMesh(C=tweencrv_16, N=lng_23)  # -> M, P
make_mesh_26 = MakeMesh(C=clean_5, N=lng_24)  # -> M, P
make_mesh_27 = MakeMesh(C=tweencrv_15, N=lng_23)  # -> M, P

series_9 = Series(Start=0, Step=division_11, Count=expr("x+1", lng_24))

flip_21 = FlipMatrix(Data=make_mesh_24.P)
flip_22 = FlipMatrix(Data=make_mesh_27.P)
flip_23 = FlipMatrix(Data=make_mesh_26.P)
flip_24 = FlipMatrix(Data=make_mesh_25.P)
item_41 = ListItem(List=reverse(flip_21), Index=0, Wrap=True)  # -> flatten(Item)
item_42 = ListItem(List=reverse(flip_24), Index=0, Wrap=True)  # -> flatten(Item)
item_43 = ListItem(List=reverse(flip_22), Index=0, Wrap=True)  # -> flatten(Item)
item_44 = ListItem(List=reverse(flip_23), Index=0, Wrap=True)  # -> flatten(Item)

make_mesh_28 = MakeMesh(C=ln_26, N=lng_24)  # -> M, P
funnel_1_mesh = Merge(Data1=make_mesh_26.M, Data2=make_mesh_24.M, Data3=make_mesh_25.M, Data4=make_mesh_27.M, Data5=make_mesh_28.M)
merge_26 = Merge(Data1=item_44, Data2=item_41, Data3=item_42, Data4=item_43)
top_funnel_pts = ClusterOutput(merge_26)

item_45 = ListItem(List=reverse(bang_6.Branch1), Index=0, Wrap=True)
item_46 = ListItem(List=bang_6.Branch1, Index=0, Wrap=True)
series_10 = Series(Start=0, Step=division_3, Count=expr("x+1", number_slider))
Z_7 = UnitZ(Factor=expr("x*-1", 1))

divide_15 = DivideCurve(Curve=item_46, Count=lng_13, Kinks=False)  # -> reverse(Points), Tangents, Parameters
divide_16 = DivideCurve(Curve=item_45, Count=lng_13, Kinks=False)  # -> reverse(Points), Tangents, Parameters
split_6 = SplitList(List=divide_15.Points, Index=number_slider_3)  # -> ListA, ListB
split_7 = SplitList(List=divide_16.Points, Index=number_slider_3)  # -> ListA, ListB
item_47 = ListItem(List=reverse(split_6.ListA), Index=reverse(0), Wrap=True)
pt_25 = Point(split_6.ListA)
pt_26 = Point(split_7.ListA)
pline_13 = PolyLine(Vertices=pt_25, Closed=False)
pline_14 = PolyLine(Vertices=pt_26, Closed=False)

move_5 = Move(Geometry=pline_13, Motion=Z_7)  # -> Geometry, Transform
move_6 = Move(Geometry=pline_14, Motion=Z_7)  # -> Geometry, Transform

merge_27 = Merge(Data1=split_6.ListB, Data2=item_47)
item_48 = ListItem(List=reverse(split_7.ListA), Index=reverse(0), Wrap=True)
pline_15 = PolyLine(Vertices=merge_27, Closed=False)
merge_28 = Merge(Data1=split_7.ListB, Data2=item_48)
lng_25 = ListLength(List=split_6.ListA)  # -> expr("x-1", Length)
pline_16 = PolyLine(Vertices=merge_28, Closed=False)
lng_26 = ListLength(List=split_6.ListB)  # -> expr("x+1", Length)

tweencrv_17 = TweenCurve(CurveA=pline_14, CurveB=move_6.Geometry, Factor=series_10, BlendType=0)
tweencrv_18 = TweenCurve(CurveA=pline_13, CurveB=move_5.Geometry, Factor=series_10, BlendType=0)
end_24 = EndPoints(Curve=tweencrv_17)  # -> Start, End
end_25 = EndPoints(Curve=tweencrv_18)  # -> Start, End
ln_29 = Line(StartPoint=end_25.Start, EndPoint=end_24.Start)
ln_30 = Line(StartPoint=end_25.End, EndPoint=end_24.End)
lng_27 = ListLength(List=bang_6.Branch1)  # -> expr("x-1", Length)
clean_7 = CleanTree(RemoveNulls=True, RemoveInvalid=True, RemoveEmpty=False, Tree=ln_29)
clean_8 = CleanTree(RemoveNulls=True, RemoveInvalid=True, RemoveEmpty=False, Tree=ln_30)

division_12 = Division(A=1, B=lng_27)

make_mesh_29 = MakeMesh(C=clean_8, N=lng_27)  # -> M, P
make_mesh_30 = MakeMesh(C=tweencrv_18, N=lng_25)  # -> M, P
make_mesh_31 = MakeMesh(C=tweencrv_17, N=lng_25)  # -> M, P
make_mesh_32 = MakeMesh(C=clean_7, N=lng_27)  # -> M, P

series_11 = Series(Start=0, Step=division_12, Count=expr("x+1", lng_27))
demesh_2 = DeconstructMesh(Mesh=make_mesh_29.M)  # -> Vertices, Faces, Colours, Normals

flip_25 = FlipMatrix(Data=make_mesh_29.P)
flip_26 = FlipMatrix(Data=make_mesh_31.P)
flip_27 = FlipMatrix(Data=make_mesh_32.P)
flip_28 = FlipMatrix(Data=make_mesh_30.P)
item_49 = ListItem(List=reverse(flip_25), Index=0, Wrap=True)  # -> flatten(Item)
item_50 = ListItem(List=reverse(flip_28), Index=0, Wrap=True)  # -> flatten(Item)
item_51 = ListItem(List=reverse(flip_26), Index=0, Wrap=True)  # -> flatten(Item)
item_52 = ListItem(List=reverse(flip_27), Index=0, Wrap=True)  # -> flatten(Item)

cull_i_10 = CullIndex(List=demesh_2.Faces, Indices=seq, Wrap=True)
conmesh_7 = ConstructMesh(Vertices=demesh_2.Vertices, Faces=cull_i_10)
merge_29 = Merge(Data1=item_52, Data2=item_49, Data3=item_50, Data4=item_51)
low_funnel_pts = ClusterOutput(merge_29)

# ---- group: disconnected L from C
ln_31 = Line(StartPoint=merge_27, EndPoint=merge_28)

# ---- group: new
shift_list = ShiftList(List=ln_31, Shift=Slider(-1, range=-1..0), Wrap=True)

# ---- group: disconnected L from C (continued)
make_mesh_33 = MakeMesh(C=shift_list, N=lng_27)  # -> M, P

# ----
demesh_3 = DeconstructMesh(Mesh=make_mesh_33.M)  # -> Vertices, Faces, Colours, Normals
cull_i_11 = CullIndex(List=demesh_3.Faces, Indices=seq_2, Wrap=True)
conmesh_8 = ConstructMesh(Vertices=demesh_3.Vertices, Faces=cull_i_11)
funnel_2_mesh = Merge(Data1=make_mesh_32.M, Data2=conmesh_7, Data3=make_mesh_30.M, Data4=make_mesh_31.M, Data5=conmesh_8, Data6=make_mesh_17.M)
strip_top_funnel = Merge(Data1=make_mesh_15.M, Data2=make_mesh_16.M, Data3=funnel_1_mesh, Data4=funnel_2_mesh)
merge_30 = Merge(Data2=strip_top_funnel, Data3=make_mesh_5.M, Data4=non_orientable_strip)
merge_31 = Merge(Data1=merge_23, Data2=merge_30, Data3=outriggers)
medges = MeshEdges(Mesh=merge_31)  # -> NakedEdges, InteriorEdges, NonManifoldEdges
R = ClusterOutput(merge_31)

# ==== cluster ArcSupportD
D = ClusterInput()
D_2 = ClusterInput()
P = ClusterInput()
rad = Radians(Degrees=expr("-x/2", D))
rad_2 = Radians(Degrees=expr("x/2", D))
rad_3 = Radians(Degrees=D_2)
dom = ConstructDomain(DomainStart=rad_2, DomainEnd=rad)
prot = RotatePlane(Plane=P, Angle=rad_3)
R = ClusterInput()
arc = Arc(Plane=prot, Radius=R, Angle=dom)  # -> Arc, Length
A = ClusterOutput(arc.Arc)

# ==== cluster SupportA
D = ClusterInput()
D_2 = ClusterInput()
rad = Radians(Degrees=expr("-x/2", D))
rad_2 = Radians(Degrees=expr("x/2", D))
rad_3 = Radians(Degrees=D_2)
P = ClusterInput()
dom = ConstructDomain(DomainStart=rad_2, DomainEnd=rad)
prot = RotatePlane(Plane=P, Angle=rad_3)
R = ClusterInput()
arc = Arc(Plane=prot, Radius=R, Angle=dom)  # -> Arc, Length
A = ClusterOutput(arc.Arc)

# ==== cluster MakeMesh
C = ClusterInput()
N = ClusterInput()
divide = DivideCurve(Curve=C, Count=N, Kinks=False)  # -> Points, Tangents, Parameters
lng = ListLength(List=C)
lng_2 = ListLength(List=divide.Points)
item = ListItem(List=flatten(lng_2), Index=0, Wrap=True)
middle_mesh = MeshFromPoints(Points=flatten(divide.Points), UDirection=lng, VDirection=item)
P = ClusterOutput(divide.Points)
M = ClusterOutput(middle_mesh)
