# Grasshopper definition ribbed_floor.gh (Grasshopper 1.0.8)
# plug-ins: Karamba3D, RhinoCodePluginGH, GrasshopperRfem6WsPlugin, Kangaroo2 Components, eleFront

rectangle = Rectangle(Plane=PlaneXY(0, 0, 0), XSize="-1.5 to 1.5", YSize="-1 to 1", Radius=0)  # -> Rectangle, Length
matselect = MaterialSelectionKaramba3D(menu=[dropdown(1), dropdown(4)])
boundary = BoundarySurfaces(Edges=rectangle.Rectangle)
mesh_uv = MeshSurface(Surface=boundary, UCount="60", VCount="60", Overhang=True, Equalize=False)
matselect_2 = MaterialSelectionKaramba3D(menu=[dropdown(7), dropdown(5)])
disassemble = DisassembleMaterialKaramba3D(Material=matselect)  # -> Material, TypeOfMaterial, FamilyNameOfMaterial, NameOfMaterial, ElemIdentifiers, Colour, YoungsModulusKNCm²Dir12, InPlaneShearModulus_kN_cm²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
panel = Panel("-1.5 to 1")  # disabled
panel_2 = Panel("-1 to 1")  # disabled
disc = Discontinuity(Curve=boundary, Level=1)  # -> Points, Parameters
pt = Point(<point referenced from the Rhino model>)  # disabled
rectangle_2 = Rectangle(Plane=pt, XSize=panel, YSize=panel_2, Radius=0)  # -> Rectangle, Length; disabled
pt_2 = Point(<point referenced from the Rhino model>)
matselect_3 = MaterialSelectionKaramba3D(menu=[dropdown(1), dropdown(4)])  # disabled
matprops = MaterialPropertiesKaramba3D(
    FamilyOfMaterial=disassemble.FamilyNameOfMaterial,
    Name=disassemble.NameOfMaterial,
    Colour=disassemble.Colour,
    YoungsModulus_kN_cm²=disassemble.YoungsModulusKNCm²Dir12,
    InPlaneShearModulus_kN_cm²=disassemble.InPlaneShearModulus_kN_cm²,
    TransverseShearModulus_kN_cm²=disassemble.TransverseShearModulusKNCm²Dir12,
    SpecificWeight_kN_m³="2",
    CoefficientOfThermalExpansion_1=disassemble.CoefficientOfThermalExpansion1Dir12,
    TensileStrength_kN_cm²=disassemble.TensileStrengthKNCm²Dir12,
    CompressiveStrength_kN_cm²=disassemble.CompressiveStrengthKNCm²Dir12,
    StrengthHypothesis=disassemble.StrengthHypothesis,
    mode="Isotrop")
boundary_2 = BoundarySurfaces(Edges=rectangle_2.Rectangle)  # disabled
rectangle_3 = Rectangle(Plane=pt_2, XSize="-1.5 to 1.5", YSize="-1 to 1", Radius=0)  # -> Rectangle, Length
panel_3 = Panel("60")  # disabled
matselect_4 = MaterialSelectionKaramba3D(menu=[dropdown(1), dropdown(4)])
matselect_5 = MaterialSelectionKaramba3D(menu=[dropdown(7), dropdown(5)])  # disabled
crosec = CrossSectionKaramba3D(FamilyNameOfCrossSection="DefaultCroSec", Material=matselect_2, Height_cm="10", mode="Shell - Const")
mesh_uv_2 = MeshSurface(Surface=boundary_2, UCount=panel_3, VCount=panel_3, Overhang=True, Equalize=False)  # disabled
explode = Explode(Curve=boundary_2, Recursive=True)  # -> Segments, Vertices; disabled
boundary_3 = BoundarySurfaces(Edges=rectangle_3.Rectangle)
matselect_6 = MaterialSelectionKaramba3D(menu=[dropdown(7), dropdown(5)])
mesh_uv_3 = MeshSurface(Surface=boundary_3, UCount="60", VCount="60", Overhang=True, Equalize=False)
disassemble_2 = DisassembleMaterialKaramba3D(Material=matselect_3)  # -> Material, TypeOfMaterial, FamilyNameOfMaterial, NameOfMaterial, ElemIdentifiers, Colour, YoungsModulusKNCm²Dir12, InPlaneShearModulus_kN_cm²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; disabled
demesh = DeconstructMesh(Mesh=mesh_uv_2)  # -> Vertices, Faces, Colours, Normals; disabled
Z = UnitZ(Factor=-10)
disc_2 = Discontinuity(Curve=boundary_2, Level=1)  # -> Points, Parameters; disabled
Z_2 = UnitZ(Factor=-1)
item = ListItem(List=explode.Segments, Index=0, Wrap=True)  # disabled
surfelem = CreateSurfaceElementKaramba3D(Mesh=mesh_uv, CrossSection=crosec, LimitDistance_m=0.005, Bending=True, mode="MeshToShell")  # -> Element, Points, Info
supp = SupportKaramba3D(PosInd=disc.Points, Ct_kN_m=Vector(0, 0, 0), Cr_kNm_rad=Vector(0, 0, 0), menu=[buttons(on, on, on, off, off, off)])
loads = LoadsKaramba3D(Vector=Z_2, LCase="LC0", mode="Gravity")
loads_2 = LoadsKaramba3D(Vector=Z, Mesh=mesh_uv, LCase="LC0", mode="MeshLoad -Const.", menu=[buttons(off, on, off), buttons(on, on)])
disassemble_3 = DisassembleMaterialKaramba3D(Material=matselect_4)  # -> Material, TypeOfMaterial, FamilyNameOfMaterial, NameOfMaterial, ElemIdentifiers, Colour, YoungsModulusKNCm²Dir12, InPlaneShearModulus_kN_cm²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
crv_cp = CurveClosestPoint(Point=demesh.Vertices, Curve=item)  # -> Point, Parameter, Distance; disabled
disc_3 = Discontinuity(Curve=boundary_3, Level=1)  # -> Points, Parameters
panel_4 = Panel("0.01")  # disabled
panel_5 = Panel("2")  # disabled
smaller = SmallerThan(FirstNumber=crv_cp.Distance, SecondNumber=panel_4)  # -> SmallerThan, OrEqualTo; disabled
cull = CullPattern(List=demesh.Vertices, CullPattern=smaller.SmallerThan)  # disabled
matprops_2 = MaterialPropertiesKaramba3D(
    FamilyOfMaterial=disassemble_2.FamilyNameOfMaterial,
    Name=disassemble_2.NameOfMaterial,
    Colour=disassemble_2.Colour,
    YoungsModulus_kN_cm²=disassemble_2.YoungsModulusKNCm²Dir12,
    InPlaneShearModulus_kN_cm²=disassemble_2.InPlaneShearModulus_kN_cm²,
    TransverseShearModulus_kN_cm²=disassemble_2.TransverseShearModulusKNCm²Dir12,
    SpecificWeight_kN_m³=panel_5,
    CoefficientOfThermalExpansion_1=disassemble_2.CoefficientOfThermalExpansion1Dir12,
    TensileStrength_kN_cm²=disassemble_2.TensileStrengthKNCm²Dir12,
    CompressiveStrength_kN_cm²=disassemble_2.CompressiveStrengthKNCm²Dir12,
    StrengthHypothesis=disassemble_2.StrengthHypothesis,
    mode="Isotrop")  # disabled
panel_6 = Panel("10")  # disabled
crosec_2 = CrossSectionKaramba3D(FamilyNameOfCrossSection="DefaultCroSec", Material=matselect_5, Height_cm=panel_6, mode="Shell - Const")  # disabled
matprops_3 = MaterialPropertiesKaramba3D(
    FamilyOfMaterial=disassemble_3.FamilyNameOfMaterial,
    Name=disassemble_3.NameOfMaterial,
    Colour=disassemble_3.Colour,
    YoungsModulus_kN_cm²=disassemble_3.YoungsModulusKNCm²Dir12,
    InPlaneShearModulus_kN_cm²=disassemble_3.InPlaneShearModulus_kN_cm²,
    TransverseShearModulus_kN_cm²=disassemble_3.TransverseShearModulusKNCm²Dir12,
    SpecificWeight_kN_m³="2",
    CoefficientOfThermalExpansion_1=disassemble_3.CoefficientOfThermalExpansion1Dir12,
    TensileStrength_kN_cm²=disassemble_3.TensileStrengthKNCm²Dir12,
    CompressiveStrength_kN_cm²=disassemble_3.CompressiveStrengthKNCm²Dir12,
    StrengthHypothesis=disassemble_3.StrengthHypothesis,
    mode="Isotrop")
load = LoadKaramba3D(flatten([loads, loads_2]))
nv = NakedVertices(Mesh=mesh_uv_3)  # -> ClothedIndex, NakedIndex, ClothedPts, NakedPts
crosec_3 = CrossSectionKaramba3D(FamilyNameOfCrossSection="DefaultCroSec", Material=matselect_6, Height_cm="10", mode="Shell - Const")
Z_3 = UnitZ(Factor=-10)  # disabled
Z_4 = UnitZ(Factor=-1)  # disabled
surfelem_2 = CreateSurfaceElementKaramba3D(Mesh=mesh_uv_2, CrossSection=crosec_2, LimitDistance_m=0.005, Bending=True, mode="MeshToShell")  # -> Element, Points, Info; disabled
supp_2 = SupportKaramba3D(PosInd=cull, Ct_kN_m=Vector(0, 0, 0), Cr_kNm_rad=Vector(0, 0, 0), menu=[buttons(on, on, on, on, on, on)])  # disabled
loads_3 = LoadsKaramba3D(Vector=Z_4, LCase="LC0", mode="Gravity")  # disabled
loads_4 = LoadsKaramba3D(Vector=Z_3, Mesh=mesh_uv_2, LCase="LC0", mode="MeshLoad -Const.", menu=[buttons(off, on, off), buttons(on, on)])  # disabled
Z_5 = UnitZ(Factor=-10)
Z_6 = UnitZ(Factor=-1)
assemble = AssembleModelKaramba3D(Elem=flatten(surfelem.Element), Support=flatten(supp), Load=flatten(load), LimitDistance_m=0.005)  # -> Model, Info, Mass_kg, CentreOfGravity, LoadCaseNames
surfelem_3 = CreateSurfaceElementKaramba3D(Mesh=mesh_uv_3, CrossSection=crosec_3, LimitDistance_m=0.005, Bending=True, mode="MeshToShell")  # -> Element, Points, Info
supp_3 = SupportKaramba3D(PosInd=nv.NakedPts, Ct_kN_m=Vector(0, 0, 0), Cr_kNm_rad=Vector(0, 0, 0), menu=[buttons(on, on, on, off, off, off)])
loads_5 = LoadsKaramba3D(Vector=Z_6, LCase="LC0", mode="Gravity")
loads_6 = LoadsKaramba3D(Vector=Z_5, Mesh=mesh_uv_3, LCase="LC0", mode="MeshLoad -Const.", menu=[buttons(off, on, off), buttons(on, on)])
analyse = AnalyseKaramba3D(Model=assemble.Model)  # -> AnalysedModel, MaximumDisplacement_cm, ResultingForce_kN, ChangeOfElasticEnergy_kNm
ladeform = LargeDeformationAnalysisKaramba3D(Model=assemble.Model, Increments=5, MaximumDisplacement_m=-1)  # -> CalculatedModel, MaximumDisplacement_cm
load_2 = LoadKaramba3D(flatten([loads_3, loads_4]))  # disabled
crv = Curve([<curve referenced from the Rhino model> x2])
popgeo = PopulateGeometry(Geometry=mesh_uv, Count=100, Seed=1)
crv_2 = Curve([<curve referenced from the Rhino model> x2])
load_3 = LoadKaramba3D(flatten([loads_5, loads_6]))
modelview = ModelViewKaramba3D(Model=analyse.AnalysedModel)  # -> Model, DeformedMesh, DeformedAxes, DeformedModel, MaximumDeformation
divdist = DivideDistance(Curve=crv, Distance="0.1")  # -> Points, Tangents, Parameters
divdist_2 = DivideDistance(Curve=crv_2, Distance="0.1")  # -> Points, Tangents, Parameters
assemble_2 = AssembleModelKaramba3D(Elem=flatten(surfelem_2.Element), Support=flatten(supp_2), Load=flatten(load_2), LimitDistance_m=0.005)  # -> Model, Info, Mass_kg, CentreOfGravity, LoadCaseNames; disabled
cull_i = CullIndex(List=reverse(divdist.Points), Indices=0, Wrap=True)
cull_i_2 = CullIndex(List=divdist_2.Points, Indices=0, Wrap=True)
assemble_3 = AssembleModelKaramba3D(Elem=flatten(surfelem_3.Element), Support=flatten(supp_3), Load=flatten(load_3), LimitDistance_m=0.005)  # -> Model, Info, Mass_kg, CentreOfGravity, LoadCaseNames
shellview = ShellViewKaramba3D(Model=modelview.Model, IndexOfLayer=0)  # -> Model, MeshesOfRenderedShells, LegendColours, LegendTags
ladeform_2 = LargeDeformationAnalysisKaramba3D(Model=assemble_2.Model, Increments=5, MaximumDisplacement_m=-1)  # -> CalculatedModel, MaximumDisplacement_cm; disabled
analyse_2 = AnalyseKaramba3D(Model=assemble_2.Model)  # -> AnalysedModel, MaximumDisplacement_cm, ResultingForce_kN, ChangeOfElasticEnergy_kNm; disabled
merge = Merge(Data1=cull_i, Data2=cull_i_2)  # -> flatten(Result)
shelllineresults = LineResultsOnShellsKaramba3D(
    AnalysedModel=shellview.Model,
    ListOfSourcesOfForceFlowLinesLinesPoints=popgeo,
    SegmentLength_m=0.5,
    DA_deg=5,
    mode="PrincMoment")  # -> Model, Lines1, Lines2
analyse_3 = AnalyseKaramba3D(Model=assemble_3.Model)  # -> AnalysedModel, MaximumDisplacement_cm, ResultingForce_kN, ChangeOfElasticEnergy_kNm
crv_3 = Curve(<curve referenced from the Rhino model>)  # disabled
panel_7 = Panel("0.1")  # disabled
ladeform_3 = LargeDeformationAnalysisKaramba3D(Model=assemble_3.Model, Increments=5, MaximumDisplacement_m=-1)  # -> CalculatedModel, MaximumDisplacement_cm
popgeo_2 = PopulateGeometry(Geometry=mesh_uv_2, Count=100, Seed=1)  # disabled
legend = Legend(Colour=shellview.LegendColours, Tags=shellview.LegendTags, LegendType=1)
crv_4 = Curve(<curve referenced from the Rhino model>)
crv_5 = Curve([<curve referenced from the Rhino model> x2])  # disabled
panel_8 = Panel("0.1")  # disabled
modelview_2 = ModelViewKaramba3D(Model=analyse_2.AnalysedModel)  # -> Model, DeformedMesh, DeformedAxes, DeformedModel, MaximumDeformation; disabled
divdist_3 = DivideDistance(Curve=crv_3, Distance=panel_7)  # -> Points, Tangents, Parameters; disabled
s_forces = ShellSectionKaramba3D(
    Model=shellview.Model,
    IntersectionGeometry=crv_4,
    ProjectionDirection=Vector(0, 0, -1),
    mode="Forces",
    menu=[checkbox(on), checkbox(off), checkbox(on), slider(15), slider(0.65), slider(0.13), checkbox(off), checkbox(off), checkbox(off), checkbox(off), checkbox(on), checkbox(off), checkbox(off), checkbox(off), checkbox(off), slider(1)])  # -> Model, CuttingCurves, FaceIndices, MeshesOfRenderedResults, CurvesOfRenderedResults, Ntt_kN_m, Nnn_kN_m, Ntn_kN_m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
divdist_4 = DivideDistance(Curve=crv_5, Distance=panel_8)  # -> Points, Tangents, Parameters; disabled
crv_6 = Curve([<curve referenced from the Rhino model> x4])
popgeo_3 = PopulateGeometry(Geometry=mesh_uv_3, Count=100, Seed=1)
crv_7 = Curve(<curve referenced from the Rhino model>)
line = Line(shelllineresults.Lines1)
modelview_3 = ModelViewKaramba3D(Model=analyse_3.AnalysedModel)  # -> Model, DeformedMesh, DeformedAxes, DeformedModel, MaximumDeformation
cull_i_3 = CullIndex(List=reverse(divdist_3.Points), Indices=0, Wrap=True)  # disabled
cull_i_4 = CullIndex(List=divdist_4.Points, Indices=0, Wrap=True)  # disabled
divdist_5 = DivideDistance(Curve=crv_6, Distance="0.12")  # -> Points, Tangents, Parameters
divdist_6 = DivideDistance(Curve=crv_7, Distance="0.12")  # -> Points, Tangents, Parameters
pt_3 = Point(<point referenced from the Rhino model>)
shellview_2 = ShellViewKaramba3D(Model=modelview_2.Model, IndexOfLayer=0)  # -> Model, MeshesOfRenderedShells, LegendColours, LegendTags; disabled
shellvecresults = ResultVectorsOnShellsKaramba3D(Model=shellview.Model, LayerPosition="-1", mode="PrincStress")  # -> Model, Points, FirstPrincipalStressVector_kN_cm², SecondPrincipalStressVector_kN_cm², FirstPrincipalStressValue_kN_cm², SecondPrincipalStressValue_kN_cm²
shelllineresults_2 = LineResultsOnShellsKaramba3D(
    AnalysedModel=shellview_2.Model,
    ListOfSourcesOfForceFlowLinesLinesPoints=popgeo_2,
    SegmentLength_m=0.5,
    DA_deg=5,
    mode="PrincMoment")  # -> Model, Lines1, Lines2; disabled
shellvecresults_2 = ResultVectorsOnShellsKaramba3D(Model=modelview.Model, LoadCase="LC0", mode="PrincForce")  # -> Model, Points, FirstPrincipalNormalForceVector_kN_m, SecondPrincipalNormalForceVector_kN_m, FirstPrincipalMomentVector_kN, SecondPrincipalMomentVector_kN, FirstPrincipalNormalForceValue_kN_m, SecondPrincipalNormalForceValue_kN_m, FirstPrincipalMomentValue_kN, SecondPrincipalMomentValue_kN
py3 = Python3Script(x=shellvecresults_2.SecondPrincipalMomentValue_kN)  # -> out, a; inputs x: list
# ---------- py3: Python ----------
a = [i*-1 if i<0 else i for i in x]
# ---------- end py3 ----------
cull_i_5 = CullIndex(List=reverse(divdist_5.Points), Indices=0, Wrap=True)
vlen = VectorLength(Vector=shellvecresults.FirstPrincipalStressVector_kN_cm²)
cull_i_6 = CullIndex(List=divdist_6.Points, Indices=0, Wrap=True)
s_forces_2 = ShellForcesKaramba3D(AnalysedModel=shellview.Model, mode="Local")  # -> Model, Nxx_kN_m, Nyy_kN_m, Nxy_kN_m, flatten(Mxx_kNm_m), flatten(Myy_kNm_m), flatten(Mxy_kNm_m), Vx_kN_m, Vy_kN_m, LoadCaseIndex
merge_2 = Merge(Data1=cull_i_3, Data2=cull_i_4)  # -> flatten(Result); disabled
crv_8 = Curve(boundary)
shellview_3 = ShellViewKaramba3D(Model=modelview_3.Model, IndexOfLayer=0)  # -> Model, MeshesOfRenderedShells, LegendColours, LegendTags
bnd = Bounds(Numbers=vlen)
bnd_2 = Bounds(Numbers=shellvecresults.FirstPrincipalStressValue_kN_cm²)
legend_2 = Legend(Colour=shellview_2.LegendColours, Tags=shellview_2.LegendTags, LegendType=1)  # disabled
crv_9 = Curve(<curve referenced from the Rhino model>)  # disabled
merge_3 = Merge(Data1=cull_i_5, Data2=cull_i_6)  # -> flatten(Result)
shelllineresults_3 = LineResultsOnShellsKaramba3D(
    AnalysedModel=shellview_3.Model,
    ListOfSourcesOfForceFlowLinesLinesPoints=popgeo_3,
    SegmentLength_m=0.5,
    DA_deg=5,
    mode="PrincMoment")  # -> Model, Lines1, Lines2
item_2 = ListItem(List=shellvecresults_2.Points, Index="1860", Wrap=True)
crv_10 = Curve(boundary)
line_2 = Line(shelllineresults_2.Lines2)  # disabled
python_3_script = Python3Script(mxx_values=s_forces_2.Mxx_kNm_m, myy_values=s_forces_2.Myy_kNm_m, mxy_values=s_forces_2.Mxy_kNm_m)  # -> M1, M2; "M1/M2"; inputs mxx_values: list, myy_values: list, mxy_values: list
# ---------- python_3_script: Python ----------
import numpy as np

def principal_moments(mxx, myy, mxy):
    """
    Calculates the principal bending moments M1 and M2.
    
    Parameters:
    - mxx: numpy array or list of bending moments about the x-axis.
    - myy: numpy array or list of bending moments about the y-axis.
    - mxy: numpy array or list of twisting moments.
    
    Returns:
    - M1: numpy array of maximum principal moments.
    - M2: numpy array of minimum principal moments.
    """
    mxx = np.array(mxx)
    myy = np.array(myy)
    mxy = np.array(mxy)
    
    # Calculate average and half-difference of mxx and myy
    avg = (mxx + myy) / 2.0
    diff = (mxx - myy) / 2.0
    # Calculate the square root term
    sqrt_term = np.sqrt(diff**2 + mxy**2)
    
    # Principal bending moments
    M1 = avg + sqrt_term  # maximum principal moment
    M2 = avg - sqrt_term  # minimum principal moment
    return M1, M2

if __name__ == "__main__":
    # Example list inputs
    # mxx_values = [10, 20, 30]  # Replace with your mxx values
    # myy_values = [5, 25, 35]   # Replace with your myy values
    # mxy_values = [2, 4, 6]     # Replace with your mxy values
    
    # Calculate principal moments
    M1, M2 = principal_moments(mxx_values, myy_values, mxy_values)
    


    # Output the results
    print("Principal bending moment M1 values:", M1)
    print("Principal bending moment M2 values:", M2)

    from ghpythonlib import treehelpers as tr

    M1 = tr.list_to_tree(M1)
    M2 = tr.list_to_tree(M2)
# ---------- end python_3_script ----------
dedomain = DeconstructDomain(Domain=bnd)  # -> Start, End
item_3 = ListItem(List=shellvecresults_2.FirstPrincipalMomentValue_kN, Index="1860", Wrap=True)
legend_3 = Legend(Colour=shellview_3.LegendColours, Tags=shellview_3.LegendTags, LegendType=1)
crv_11 = Curve(<curve referenced from the Rhino model>)
explode_2 = Explode(Curve=crv_10, Recursive=True)  # -> Segments, Vertices

tracer_automatic_3d_self_single_loop_for = Python3Script(
    seed_points=pt_3,
    principal_vectors=shellvecresults.FirstPrincipalStressVector_kN_cm²,
    points=shellvecresults.Points,
    domain_surface=boundary,
    collision_threshold="0.2",
    boundary_curves=explode_2.Segments,
    stress_values=py3.a)  # -> out, a, b, w, Error_message, c, warning; "Tracer_automatic_3d_self_single_loop_force"; inputs seed_points: list of Point3d, principal_vectors: list of Vector3d, points: list of Point3d, domain_surface: Brep, collision_threshold: Double, boundary_curves: list of Curve, stress_values: list of Double
# ---------- tracer_automatic_3d_self_single_loop_for: Python ----------
import math
import numpy as np
import rhinoscriptsyntax as rs
import Rhino.Geometry as rg
import scriptcontext as sc
from scipy.spatial import KDTree
import heapq

# --- Your existing functions (with minor adaptations) ---

def distance_3d(a, b):
    return math.sqrt((a[0]-b[0])**2 + (a[1]-b[1])**2 + (a[2]-b[2])**2)

def normalize(vector):
    """Normalize a vector (2D) to unit length."""
    magnitude = math.sqrt(vector[0]**2 + vector[1]**2+vector[2]**2)
    return [vector[0] / magnitude, vector[1] / magnitude,vector[2] / magnitude] if magnitude != 0 else [0, 0, 0]

def to_numeric(vec):
    """Convert a Rhino object to a numeric [x,y,z] list; otherwise return vec as-is."""
    try:
        return [vec.X, vec.Y, vec.Z]
    except AttributeError:
        return vec

def find_closest_neighbors_kd(point, kd_tree, k):
    """
    Given a 2D point (as [x,y]) and a pre-built KDTree,
    return a list of indices of the k closest points.
    """

    distances, indices = kd_tree.query(point,k=k)
    if isinstance(indices, int):
        return [indices]
    return list(indices)

def interpolate_vector(point, points, vectors, neighbors, ref_dir):
    """
    Distance-weighted interpolation of neighbor vectors in 3D,
    flipping each neighbor's vector if dot < 0 with respect to 'ref_dir'.

    - pt: [x, y, z], the point where we want the interpolated vector
    - points_3d: Nx3 array of point coords
    - vectors_3d: Nx3 array of principal vectors
    - neighbors: list of indices from the KDTree
    - ref_dir: [dx, dy, dz], the direction from the previous step (or None if first step)
    """
    weights = []
    weighted_vec = [0.0, 0.0, 0.0]

    for i in neighbors:
        vx, vy, vz = vectors[i]  # copy so we can flip locally
        if ref_dir is not None:
            dotp = vx*ref_dir[0] + vy*ref_dir[1] + vz*ref_dir[2]
            if dotp < 0:
                vx, vy, vz = -vx, -vy, -vz
        
        npt = points[i]
        dx = point[0] - npt[0]
        dy = point[1] - npt[1]
        dz = point[2] - npt[2]
        dist = (dx*dx + dy*dy + dz*dz)**0.5
        
        w = 1.0 / (dist + 1e-6)
        weights.append(w)
        
        weighted_vec[0] += vx*w
        weighted_vec[1] += vy*w
        weighted_vec[2] += vz*w

    total_w = sum(weights)
    if total_w > 1e-12:
        weighted_vec[0] /= total_w
        weighted_vec[1] /= total_w
        weighted_vec[2] /= total_w

    mag = (weighted_vec[0]**2 + weighted_vec[1]**2 + weighted_vec[2]**2)**0.5
    if mag < 1e-12:
        return [0.0, 0.0, 0.0]
    
    return [weighted_vec[0]/mag, weighted_vec[1]/mag, weighted_vec[2]/mag]

def adjust_step_size_3d(current_point, neighbors, points, step_sign):

    if not neighbors:
        return 0.1 * step_sign
    
    distances = []
    for i in neighbors:
        npt = points[i]
        dx = current_point[0] - npt[0]
        dy = current_point[1] - npt[1]
        dz = current_point[2] - npt[2]
        dist = math.sqrt(dx*dx + dy*dy + dz*dz)
        distances.append(dist)
    
    avg_dist = sum(distances) / len(distances) if len(distances) else 0.1
    base_step = min(0.1, avg_dist / 2.0)
    return base_step * step_sign

def project_onto_surface(surface, pt3d, tolerance=2):
    pt_rh = rg.Point3d(pt3d[0], pt3d[1], pt3d[2])
    
    if isinstance(surface, rg.Brep):
        # Note the 6 returned values:
        rc, closest_pt, cindex, u, v, normal = surface.ClosestPoint(pt_rh, tolerance)
        if rc:
            # Check if cindex is a face
            if cindex.ComponentIndexType == rg.ComponentIndexType.BrepFace:
                face_id = cindex.Index
                face = surface.Faces[face_id]
                
                # 'closest_pt' is the 3D point on that face
                # Optionally confirm it's within the face domain or do face.IsPointOnFace(u,v)
                
                return [closest_pt.X, closest_pt.Y, closest_pt.Z]
            else:
                # The closest component might be an edge or vertex
                return None
        else:
            return None
    
    elif isinstance(surface, rg.Surface):
        rc, u, v = surface.ClosestPoint(pt_rh)
        if rc:
            pt_srf = surface.PointAt(u, v)
            return [pt_srf.X, pt_srf.Y, pt_srf.Z]
        else:
            return None
    else:
        return None

def get_brep_edge_curves(domain_surface):
    """
    Returns a list of Rhino.Geometry.Curve objects, one for each edge of the Brep.
    If 'domain_surface' is a plain NURBS surface, we convert it to a Brep first.
    """

    # If 'domain_surface' is actually a Surface, convert it to a Brep
    if isinstance(domain_surface, rg.Surface):
        domain_surface = rg.Brep.CreateFromSurface(domain_surface)
        if not domain_surface:
            # In case conversion fails
            return []

    edge_curves = []
    # Now 'domain_surface' should be a Brep
    for edge in domain_surface.Edges:
        crv = edge.ToNurbsCurve()  # or edge.EdgeCurve if you prefer
        edge_curves.append(crv)
    return edge_curves

def distance_to_brep_edges(pt3d, boundary_curves):
    test_pt = rg.Point3d(pt3d[0], pt3d[1], pt3d[2])
    min_dist = float('inf')
    best_cp = None  # keep track of the closest point so far
    
    for crv in boundary_curves:
        rc, t = crv.ClosestPoint(test_pt)
        if rc:
            cp = crv.PointAt(t)
            dist = cp.DistanceTo(test_pt)
            if dist < min_dist:
                min_dist = dist
                best_cp = cp
    
    return min_dist, best_cp

def is_on_surface(surface, pt3d, tol=0.01):
    """
    Returns True if pt3d is within 'tol' of the surface. 
    """
    if not surface: 
        return True  # no surface provided
    pproj = project_onto_surface(surface, pt3d)
    if pproj is None:
        return False
    dx = pt3d[0] - pproj[0]
    dy = pt3d[1] - pproj[1]
    dz = pt3d[2] - pproj[2]
    dist = math.sqrt(dx*dx + dy*dy + dz*dz)
    return (dist < tol)

def runge_kutta_step_3d(
    current_point, 
    current_dir,
    h, 
    k, 
    principal_vectors, 
    points_3d, 
    step_sign, 
    kd_tree, 
    boundary_curves=None, 
    boundary_tolerance=0.1, prev_dir=None):
    """
    Perform one RK4 step in 3D. Stop if next point is within 'boundary_tolerance'
    of any boundary curve (edges).
    Returns the next 3D point or None if out-of-bound / near boundary.
    """
    
    # 1) Neighbors & dynamic step size
    neighbors = find_closest_neighbors_kd(current_point, kd_tree, k)
    h = adjust_step_size_3d(current_point, neighbors, points_3d, step_sign)
    
    # k1
    k1_dir = interpolate_vector(current_point, points_3d, principal_vectors, neighbors, current_dir)
    mid1 = [
        current_point[0] + 0.5*h*k1_dir[0],
        current_point[1] + 0.5*h*k1_dir[1],
        current_point[2] + 0.5*h*k1_dir[2]
    ]
    
    # k2
    neigh_mid1 = find_closest_neighbors_kd(mid1, kd_tree, k)
    k2_dir = interpolate_vector(mid1, points_3d, principal_vectors, neigh_mid1, k1_dir)
    mid2 = [
        current_point[0] + 0.5*h*k2_dir[0],
        current_point[1] + 0.5*h*k2_dir[1],
        current_point[2] + 0.5*h*k2_dir[2]
    ]
    
    # k3
    neigh_mid2 = find_closest_neighbors_kd(mid2, kd_tree, k)
    k3_dir = interpolate_vector(mid2, points_3d, principal_vectors, neigh_mid2, k2_dir)
    end_pt = [
        current_point[0] + h*k3_dir[0],
        current_point[1] + h*k3_dir[1],
        current_point[2] + h*k3_dir[2]
    ]
    
    # k4
    neigh_end = find_closest_neighbors_kd(end_pt, kd_tree, k)
    k4_dir = interpolate_vector(end_pt, points_3d, principal_vectors, neigh_end, k3_dir)
    
    # Summation
    dx = h*(k1_dir[0] + 2*k2_dir[0] + 2*k3_dir[0] + k4_dir[0]) / 6.0
    dy = h*(k1_dir[1] + 2*k2_dir[1] + 2*k3_dir[1] + k4_dir[1]) / 6.0
    dz = h*(k1_dir[2] + 2*k2_dir[2] + 2*k3_dir[2] + k4_dir[2]) / 6.0
    
    next_point = [
        current_point[0] + dx,
        current_point[1] + dy,
        current_point[2] + dz
    ]
    next_dir = k4_dir

    if domain_surface is not None:
        projected = project_onto_surface(domain_surface, next_point)
        #print(projected)
        if projected is None:
            # Means we're off domain or near an open edge you consider invalid
            return None
        next_point = projected  # accept the projected coordinate

    # 2) Check distance to boundary edges, if we have them
    # if boundary_curves:
    #     dist_to_edge = distance_to_brep_edges(next_point, boundary_curves)
    #     if dist_to_edge < boundary_tolerance:
    #         # We consider that "off" or "too close" => stop
    #         return None

    # Otherwise return the next valid point
    return next_point, next_dir
# --- Collision Checking using Cached PSL Curves ---

def closest_point_on_polyline_3d(pt3d, poly_curve):
    """
    Return (closest_point, distance) from a 3D point to a polyline curve.
    """
    test_pt = rg.Point3d(pt3d[0], pt3d[1], pt3d[2])
    rc, t = poly_curve.ClosestPoint(test_pt)
    if rc:
        cp = poly_curve.PointAt(t)
        dist = cp.DistanceTo(test_pt)
        print(dist)
        return [cp.X, cp.Y, cp.Z], dist
    else:
        return None, float('inf')

def find_closest_existing_line_3d(next_point, existing_trajectories, threshold):
    """
    Among all previously traced lines (in 3D), find if 'next_point' is within 'threshold' of any line.
    Returns (closest_line_index, closest_point_on_line, distance).
    """
    min_dist = float('inf')
    closest_line_idx = None
    closest_pt = None
    
    for i, (polyline_pts, poly_curve) in enumerate(existing_trajectories):
        cp, dist = closest_point_on_polyline_3d(next_point, poly_curve)
        if dist < min_dist:
            min_dist = dist
            closest_line_idx = i
            closest_pt = cp
    
    if min_dist < threshold:
        return (closest_line_idx, closest_pt, min_dist)
    else:
        return (None, None, float('inf'))

def build_polyline_curve_3d(poly_pts):
    pts3d = [rg.Point3d(pt[0], pt[1], pt[2]) for pt in poly_pts]
    poly = rg.Polyline(pts3d)
    return rg.PolylineCurve(poly)

# --- New Functions for Sampling and Seeding ---

import Rhino.Geometry as rg
def surface_normal_at_point(surface, pt3d, tolerance=2):
    """
    Returns the surface normal [nx, ny, nz] at a 3D point on a multi-face Brep or rg.Surface.
    If near an open edge or invalid, returns None.
    """
    pt_rh = rg.Point3d(pt3d[0], pt3d[1], pt3d[2])

    if isinstance(surface, rg.Brep):
        stuff = surface.ClosestPoint(pt_rh, tolerance)
        if not stuff or len(stuff) < 6:
            return None
        b = stuff[0]
        rc = stuff[1]
        #print(rc)
        comp_index = stuff[2]
        u = stuff[3]
        v = stuff[4]
        # stuff[4] => cpt
        # stuff[5] => guess_normal
        if not rc:
            return None
        
        # If it's a face, we evaluate the face normal at (u, v)
        if comp_index.ComponentIndexType == rg.ComponentIndexType.BrepFace:
            face_id = comp_index.Index
            face = surface.Faces[face_id]
            exact_normal = face.NormalAt(u, v)
            if exact_normal:
                return [exact_normal.X, exact_normal.Y, exact_normal.Z]
            else:
                return None
        else:
            # edge/vertex
            return None
    
    elif isinstance(surface, rg.Surface):
        rc, u, v = surface.ClosestPoint(pt_rh)
        if rc:
            exact_normal = surface.NormalAt(u, v)
            return [exact_normal.X, exact_normal.Y, exact_normal.Z]
        else:
            return None

    # Not a Brep or Surface
    return None


def sample_psl(psl_pts, sample_interval):
    """
    Given a PSL (list of Rhino Point3d), sample it at every sample_interval (by index).
    Returns a list of numeric [x,y] points.
    """
    samples = []
    #print(sample_interval)
    for i in range(0, len(psl_pts), sample_interval):
        pt = psl_pts[i]
        
        if isinstance(pt, rg.Point3d):
            samples.append([pt.X, pt.Y, pt.Z])
        else:
            samples.append(pt)
        #print(samples)
    return samples

import math

def offset_seed(psl_pts_3d, index, offset_distance, surface):
    """
    Offsets the PSL at psl_pts_3d[index] in the local tangent plane of 'surface'.
    Steps:
      1) Compute PSL tangent at index
      2) Get surface normal at that point
      3) binormal = cross(surface_normal, psl_tangent)
      4) candidate1 = point + offset_distance*binormal
         candidate2 = point - offset_distance*binormal
      5) (optional) project candidates back onto the surface
    Returns: (candidate1, candidate2) as [x, y, z], or (None, None) on error.
    """
    n = len(psl_pts_3d)
    if n < 2:
        return None, None
    
    # 0) Current point
    px, py, pz = psl_pts_3d[index]
    
    # 1) PSL TANGENT
    if index == 0:
        # Use next point - current point
        nx, ny, nz = psl_pts_3d[1]
        tx = nx - px
        ty = ny - py
        tz = nz - pz
    elif index == n - 1:
        # Use current point - prev point
        px_prev, py_prev, pz_prev = psl_pts_3d[n - 2]
        tx = px - px_prev
        ty = py - py_prev
        tz = pz - pz_prev
    else:
        # Middle: use psl_pts_3d[index+1] - psl_pts_3d[index-1]
        px_prev, py_prev, pz_prev = psl_pts_3d[index - 1]
        px_next, py_next, pz_next = psl_pts_3d[index + 1]
        tx = px_next - px_prev
        ty = py_next - py_prev
        tz = pz_next - pz_prev

    # Normalize tangent
    t_len = math.sqrt(tx*tx + ty*ty + tz*tz)
    if t_len < 1e-12:
        return None, None
    tx /= t_len
    ty /= t_len
    tz /= t_len
    
    # 2) SURFACE NORMAL
    normal = surface_normal_at_point(surface, [px, py, pz])
    if not normal:
        print("no normal")
        return None, None
    nx, ny, nz = normal
    n_len = math.sqrt(nx*nx + ny*ny + nz*nz)
    if n_len < 1e-12:
        return None, None
    nx /= n_len
    ny /= n_len
    nz /= n_len
    
    # 3) BINORMAL = cross(normal, tangent)
    # This is guaranteed to be in the tangent plane if PSL is truly tangent to the surface
    # If the PSL isn't exactly tangent, you'll get some tilt. 
    bx = ny*tz - nz*ty
    by = nz*tx - nx*tz
    bz = nx*ty - ny*tx
    b_len = math.sqrt(bx*bx + by*by + bz*bz)
    if b_len < 1e-12:
        # Means normal and tangent are parallel or something degenerate
        return None, None
    bx /= b_len
    by /= b_len
    bz /= b_len
    
    # 4) OFFSET POINTS
    candidate1 = [px + offset_distance*bx,
                  py + offset_distance*by,
                  pz + offset_distance*bz]
    candidate2 = [px - offset_distance*bx,
                  py - offset_distance*by,
                  pz - offset_distance*bz]
    
    # 5) (OPTIONAL) Project them onto the surface if you want them exactly on the domain
    candidate1_proj = project_onto_surface(surface, candidate1)
    #print(f"this point is seed {candidate1_proj}")
    candidate2_proj = project_onto_surface(surface, candidate2)
    # if not candidate1_proj or not candidate2_proj:
    #     return None, None
    # return candidate1_proj, candidate2_proj

    # If you don't need the final projection, just return them:
    return candidate1_proj, candidate2_proj


def sample_psl_3d(psl_pts, sample_interval):
    """
    Given a PSL (list of Rhino Point3d or numeric [x,y,z] points),
    sample it every 'sample_interval' points.
    Returns a list of tuples: ( [x,y,z], original_index )
    """
    samples = []
    for i in range(0, len(psl_pts), sample_interval):
        pt3d = psl_pts[i]
        # Convert to numeric [x,y,z] if it's a Point3d
        if hasattr(pt3d, "X"):
            samples.append(([pt3d.X, pt3d.Y, pt3d.Z], i))
        else:
            samples.append((pt3d, i))
    return samples


def is_valid_seed(candidate, existing_trajectories, min_distance, boundary_curves, boundary_tolerance=0.1):
    """
    Check if candidate seed is valid:
      - It is not too close to any existing PSL (using min_distance).
      - It is not too close to any boundary curves (if boundary_curves is provided and
        candidate's distance < boundary_tolerance).
    """
    # Check candidate against existing PSLs
    idx, cp, dist = find_closest_existing_line_3d(candidate, existing_trajectories, min_distance)
    if idx is not None:
        return False

    # Check candidate against boundary curves if provided
    if boundary_curves:
        dist_edge, cp_edge = distance_to_brep_edges(candidate, boundary_curves)
        if dist_edge < 0.05:
            return False

    return True

def get_stress_value(sample_pt, kd_tree, stress_values):
    """
    Query the stress_kdtree to find the nearest stress sample.
    Return the corresponding stress value from stress_values.
    """
    # sample_pt is [x, y] in 2D
    dist, idx = kd_tree.query(sample_pt)  # single neighbor
    # stress_values[idx] is the stress at the nearest stress point
    return stress_values[idx]

# --- Main Loop: Iterative Seeding with a Queue ---

def trace_psl_both_directions(
    seed_point_3d, 
    h, 
    num_steps, 
    k, 
    principal_vectors, 
    points_3d,
    boundary_curves=None,
    boundary_tolerance=0.02,
    existing_trajectories=None,
    collision_threshold=0.05,
    closing_threshold=0.1, 
    kd_tree=None
):
    """
    Single-loop approach where forward/backward can stop independently.
    If forward hits a collision/boundary, it stops, but backward can continue, and vice versa.
    We only stop the entire PSL when BOTH directions are inactive, or when tips meet.
    """
    if existing_trajectories is None:
        existing_trajectories = []
    
    import Rhino.Geometry as rg
    bridging_lines = []
    edge_lines = []

    # We'll keep two lines: forward and backward
    forward_line = [rg.Point3d(*seed_point_3d)]
    backward_line = [rg.Point3d(*seed_point_3d)]
    
    # Current forward/backward points + directions
    f_current_pt = list(seed_point_3d)
    f_current_dir = None
    b_current_pt = list(seed_point_3d)
    b_current_dir = None

    # NEW: Boolean flags to track if forward/backward are still active
    forward_active = True
    backward_active = True

    for step_i in range(num_steps):
        
        # ---------------------------
        # FORWARD STEP (if still active)
        # ---------------------------
        if forward_active:
            f_next = runge_kutta_step_3d(
                f_current_pt,
                f_current_dir,
                h,
                k,
                principal_vectors,
                points_3d,
                step_sign=+1,
                kd_tree=kd_tree,
                boundary_curves=boundary_curves,
                boundary_tolerance=boundary_tolerance
            )
            if not f_next or f_next[0] is None:
                print(f"PSL forward direction stopped at iteration {step_i}.")
                forward_active = False
            else:
                f_next_pt, f_next_dir = f_next
                # Collision check with existing PSLs
                if existing_trajectories:
                    line_idx, close_pt, dist_cl = find_closest_existing_line_3d(
                        f_next_pt, existing_trajectories, collision_threshold
                    )
                    if line_idx is not None and close_pt is not None:
                        # Instead of break, we do bridging & disable forward
                        steps_back = 5
                        if len(forward_line) > steps_back:
                            bridging_line = [
                                forward_line[-steps_back],
                                rg.Point3d(*close_pt)
                            ]
                            bridging_lines.append(bridging_line)
                            del forward_line[-(steps_back-1):]

                        if len(forward_line)==0 or len(backward_line)==1:
                            print("too short for bridge")
                        else:
                            bridging_line = [
                                forward_line[-1],
                                rg.Point3d(*close_pt)
                            ]
                            bridging_lines.append(bridging_line)
                        
                        print(f"PSL forward collided with line {line_idx} at dist {dist_cl:.3f}.")
                        forward_active = False

                    # 2) Check distance to boundary edges, if we have them
                if boundary_curves:
                    dist_to_edge,cp = distance_to_brep_edges(f_next_pt, boundary_curves)
                    if dist_to_edge < boundary_tolerance:
                        # We consider that "off" or "too close" => stop
                        print(f"PSL forward reached boundary.")
                        forward_active = False
                        edge_line = [
                                forward_line[-1],
                                rg.Point3d(cp)
                            ]
                        edge_lines.append(edge_line)


                # If still active, accept the new forward step
                if forward_active:
                    forward_line.append(rg.Point3d(*f_next_pt))
                    f_current_pt = f_next_pt
                    f_current_dir = f_next_dir

        # ---------------------------
        # BACKWARD STEP (if still active)
        # ---------------------------
        if backward_active:
            b_next = runge_kutta_step_3d(
                b_current_pt,
                b_current_dir,
                h,
                k,
                principal_vectors,
                points_3d,
                step_sign=-1,
                kd_tree=kd_tree,
                boundary_curves=boundary_curves,
                boundary_tolerance=boundary_tolerance
            )
            if not b_next or b_next[0] is None:
                print(f"PSL backward direction stopped at iteration {step_i}.")
                backward_active = False
            else:
                b_next_pt, b_next_dir = b_next
                # Collision check with existing PSLs
                if existing_trajectories:
                    line_idx, close_pt, dist_cl = find_closest_existing_line_3d(
                        b_next_pt, existing_trajectories, collision_threshold
                    )
                    if line_idx is not None and close_pt is not None:
                        steps_back = 5
                        if len(backward_line) > steps_back:
                            bridging_line = [
                                backward_line[-steps_back],
                                rg.Point3d(*close_pt)
                            ]
                            bridging_lines.append(bridging_line)
                            del backward_line[-(steps_back-1):]

                        if len(backward_line)==0 or len(backward_line)==1:
                            print("too short for bridge")
                        else:
                            bridging_line = [
                                backward_line[-1],
                                rg.Point3d(*close_pt)
                            ]
                            bridging_lines.append(bridging_line)

                        print(f"PSL backward collided with line {line_idx} at dist {dist_cl:.3f}.")
                        backward_active = False


                if boundary_curves:
                    dist_to_edge,cp = distance_to_brep_edges(b_next_pt, boundary_curves)
                    if dist_to_edge < boundary_tolerance:
                        # We consider that "off" or "too close" => stop
                        print(f"PSL backward reached boundary.")
                        backward_active = False
                        edge_line = [
                                backward_line[-1],
                                rg.Point3d(cp)
                            ]
                        edge_lines.append(edge_line)

                # If still active, accept the new backward step
                if backward_active:
                    backward_line.append(rg.Point3d(*b_next_pt))
                    b_current_pt = b_next_pt
                    b_current_dir = b_next_dir
        
        # ---------------------------
        # Check if BOTH directions are done
        # ---------------------------
        if not forward_active and not backward_active:
            print("Both forward & backward directions inactive => stopping PSL.")
            break

        # ---------------------------
        # TIP DISTANCE CHECK
        # ---------------------------
        # Only if both are still active
        if forward_active and backward_active and step_i >= 10:
            f_xyz = [forward_line[-1].X, forward_line[-1].Y, forward_line[-1].Z]
            b_xyz = [backward_line[-1].X, backward_line[-1].Y, backward_line[-1].Z]
            dist_fb = distance_3d(f_xyz, b_xyz)
            if dist_fb < closing_threshold:
                bridging_line = [
                    forward_line[-1],
                    backward_line[-1]
                ]
                bridging_lines.append(bridging_line)

                print(
                    f"PSL tips meet at iteration {step_i}, dist= {dist_fb:.3f} < {closing_threshold}."
                )
                # Here we might disable both directions or just break:
                forward_active = False
                backward_active = False
                break
    
    # Merge lines
    backward_line.reverse()
    if len(backward_line) > 1:
        backward_line.pop()
    merged_pts = backward_line + forward_line
    
    return merged_pts, bridging_lines, edge_lines


def generate_all_psls_3d(
    initial_seed_3d,
    h, 
    num_steps, 
    k, 
    principal_vectors, 
    points_3d,
    kd_tree,
    boundary_curves,
    collision_threshold,
    sample_interval,
    min_seed_distance,
    # NEW: for stress-based offset
    stress_values
):
    """
    Generate PSLs using an iterative seeding strategy (3D version)
    with a GLOBAL PRIORITY QUEUE for candidate seeds based on stress.

    1) Trace an initial PSL from initial_seed_3d.
    2) Sample it, pushing candidate seeds into a priority queue (max stress first).
    3) Pop the highest-stress seed, validate it, trace a PSL, sample it, push new seeds...
    4) Stop when the priority queue is empty.

    Returns:
      - all_psls: list of (psl_points_3d, polyline_curve_3d)
      - bridging_lines: bridging segments
      - positive_candidates: seeds that were actually used
    """
    # 1) Trace the initial PSL
    initial_psl, initial_bridges, initial_edges = trace_psl_both_directions(
        seed_point_3d=initial_seed_3d,
        h=h,
        num_steps=num_steps,
        k=k,
        principal_vectors=principal_vectors,
        points_3d=points_3d,
        boundary_curves=boundary_curves,
        boundary_tolerance=0.01,
        existing_trajectories=None,
        collision_threshold=collision_threshold,
        kd_tree=kd_tree
    )
    # Convert to curve for collision checks
    initial_curve = build_polyline_curve_3d(initial_psl)

    all_psls = [(initial_psl, initial_curve)]
    bridging_lines = []
    positive_candidates = []
    edges = []


    if initial_bridges:
        bridging_lines.extend(initial_bridges)

    if initial_edges:
        edges.extend(initial_edges)

    # Helper: sample a PSL, push seeds to a global priority queue
    def add_candidates_from_psl(psl_points, sample_interval):
        samples = sample_psl_3d(psl_points, sample_interval)  # => [ ([x,y,z], index), ... ]
        psl_numeric = [[pt.X, pt.Y, pt.Z] for pt in psl_points]

        for (sample_pt_3d, orig_index) in samples:
            # 1) Query stress
            stress_val = get_stress_value(sample_pt_3d,kd_tree, stress_values)
            # 2) Compute dynamic offset e.g. offset = bar_capacity / stress_val, clamped
            if stress_val < 1e-6:
                continue
            raw_offset = 2.22 / stress_val
            #print(raw_offset)
            

            dyn_offset = min(raw_offset, 0.5) 
            #print(f"dyn_offset: {dyn_offset}")
            if dyn_offset < collision_threshold:
                print("Warning: Needed offset is smaller than collision_threshold -> Choose higher rebar diameter")
                warning = "Warning: Needed offset is smaller than collision_threshold -> Choose higher rebar diameter"
            if dyn_offset > 0.1:
                print(11111111111111111111111111111111111111111111111111111111111)

            # 3) Generate offset candidates
            cand1, cand2 = offset_seed(psl_numeric, orig_index, dyn_offset, domain_surface)
            for c in [cand1, cand2]:
                if c is not None:
                    # Use negative stress as priority => max stress first
                    heapq.heappush(candidate_queue, (-stress_val, c))

    # 2) Initialize a global priority queue for seeds
    candidate_queue = []
    # Sample the initial PSL, push seeds
    add_candidates_from_psl(initial_psl, sample_interval)

    # 3) Process the global priority queue
    while candidate_queue:
        neg_stress, candidate_3d = heapq.heappop(candidate_queue)
        s_val = -neg_stress

        # Check if candidate is valid: 
        #   1) not too close to existing PSLs
        #   2) not too close to domain boundary if you do so in is_valid_seed
        #   3) optionally: on surface, etc.
        if not is_valid_seed(candidate_3d, all_psls, min_seed_distance, boundary_curves, 0.1):
            continue

        positive_candidates.append(candidate_3d)
        # Now trace a PSL from this candidate
        new_psl, new_bridges, new_edges = trace_psl_both_directions(
            seed_point_3d=candidate_3d,
            h=h,
            num_steps=num_steps,
            k=k,
            principal_vectors=principal_vectors,
            points_3d=points_3d,
            boundary_curves=boundary_curves,
            boundary_tolerance=0.01,
            existing_trajectories=all_psls,
            collision_threshold=collision_threshold,
            kd_tree=kd_tree
        )
        new_curve = build_polyline_curve_3d(new_psl)
        all_psls.append((new_psl, new_curve))
        if new_bridges:
            bridging_lines.extend(new_bridges)

        if new_edges:
            edges.extend(new_edges)

        # Immediately sample the new PSL => add new seeds
        add_candidates_from_psl(new_psl, sample_interval)

    return all_psls, bridging_lines, positive_candidates, edges


# --- Example Main Routine in Grasshopper ---
def to_xyz(pt_or_vec):
    """Converts Rhino.Geometry.Point3d or Vector3d (or numeric [x,y,z]) to a Python list [x, y, z]."""
    if hasattr(pt_or_vec, "X"):
        return [pt_or_vec.X, pt_or_vec.Y, pt_or_vec.Z]
    else:
        # Already [x,y,z]
        return [pt_or_vec[0], pt_or_vec[1], pt_or_vec[2]]

# Suppose 'points' is a list of 3D points from Grasshopper input,
# and 'principal_vectors' is a matching list of 3D vectors.
# We'll build a KDTree in 3D:
points_array_3d = [to_xyz(pt) for pt in points]
points_np = np.array(points_array_3d)  # shape (N, 3)
kd_tree = KDTree(points_np)

# If your 'seed_points' input is also 3D, pick the first as initial:
initial_seed_3d = to_xyz(seed_points[0])

# Convert principal_vectors to [vx,vy,vz]
principal_vectors_3d = [to_xyz(vec) for vec in principal_vectors]

# We'll store the domain surface or Brep for offset + boundary checks
# If you are passing a Rhino surface or a single-face Brep from GH, you can just keep it:
domain_srf_or_brep = domain_surface

boundary_curves = boundary_curves

# Parameters (exposed as GH inputs or hard-coded here)
h = 0.05
num_steps = 700
k = 25
collision_threshold = 0.04
sample_interval = 1
offset_distance = 0.1
min_seed_distance = 0.06
bar_capacity = 0.02

# ----------------------------------------------------------------------
# CALL YOUR 3D PSL GENERATION FUNCTION
# ----------------------------------------------------------------------




all_psls, bridging_lines, positive_candidates,edges = generate_all_psls_3d(
    initial_seed_3d,
    h,
    num_steps,
    k,
    principal_vectors_3d,   # 3D vectors
    points_array_3d,        # 3D points
    kd_tree,
    boundary_curves,
    collision_threshold,
    sample_interval,
    min_seed_distance,
    stress_values

)

# `all_psls` is a list of (psl_points_3d, polyline_curve_3d)
# bridging_lines is a list of short bridging segments
# positive_candidates is a list of 3D seed coords that were actually used

# ----------------------------------------------------------------------
# PREPARE OUTPUTS FOR GH
# ----------------------------------------------------------------------
# 1) PSL polylines as GH curves
psl_curves = [psl_curve for (psl_points, psl_curve) in all_psls]

# 2) Bridging lines. If each bridging_line is [ptA, ptB], you might convert to GH lines or polylines
# For simplicity we just pass them out as is, or build lines:
# bridging_line_curves = []
# for bl in bridging_lines:
#     ptA, ptB = bl
#     bridging_line_curves.append(rg.Line(rg.Point3d(*ptA), rg.Point3d(*ptB)))

# 3) Convert positive_candidates to Point3d
generated_seed_points = [rg.Point3d(pc[0], pc[1], pc[2]) for pc in positive_candidates]
from ghpythonlib import treehelpers as tr
# 4) Finally set GH outputs (A, B, C, e.g.)
a = tr.list_to_tree(psl_curves)
b = tr.list_to_tree(bridging_lines)
w = tr.list_to_tree(generated_seed_points)
c = tr.list_to_tree(edges)
# ---------- end tracer_automatic_3d_self_single_loop_for ----------
psl = Curve(tracer_automatic_3d_self_single_loop_for.a)
pline = PolyLine(Vertices=tracer_automatic_3d_self_single_loop_for.b, Closed=False)  # -> flatten(Polyline)
generated_seeds = Point(tracer_automatic_3d_self_single_loop_for.w)

pline_2 = PolyLine(Vertices=tracer_automatic_3d_self_single_loop_for.c, Closed=False)  # -> flatten(Polyline)
textdot = DefineTextDot(Text=s_forces_2.Mxx_kNm_m, Location=shellvecresults.Points, Font="Arial", Size=8)  # disabled
panel_9 = Panel("-1")  # disabled
panel_10 = Panel("LC0")  # disabled
s_forces_3 = ShellSectionKaramba3D(
    Model=shellview_2.Model,
    IntersectionGeometry=crv_9,
    ProjectionDirection=Vector(0, 0, -1),
    mode="Forces",
    menu=[checkbox(on), checkbox(off), checkbox(on), slider(15), slider(0.65), slider(0.13), checkbox(off), checkbox(off), checkbox(off), checkbox(off), checkbox(on), checkbox(off), checkbox(off), checkbox(off), checkbox(off), slider(1)])  # -> Model, CuttingCurves, FaceIndices, MeshesOfRenderedResults, CurvesOfRenderedResults, Ntt_kN_m, Nnn_kN_m, Ntn_kN_m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; disabled
line_3 = Line(shelllineresults_3.Lines1)
panel_11 = Panel("0.2")  # disabled
pt_4 = Point(<point referenced from the Rhino model>)  # disabled
shellvecresults_3 = ResultVectorsOnShellsKaramba3D(Model=shellview_2.Model, LayerPosition=panel_9, mode="PrincStress")  # -> Model, Points, FirstPrincipalStressVector_kN_cm², SecondPrincipalStressVector_kN_cm², FirstPrincipalStressValue_kN_cm², SecondPrincipalStressValue_kN_cm²; disabled
s_forces_4 = ShellSectionKaramba3D(
    Model=shellview_3.Model,
    IntersectionGeometry=crv_11,
    ProjectionDirection=Vector(0, 0, -1),
    mode="Forces",
    menu=[checkbox(on), checkbox(off), checkbox(on), slider(15), slider(0.65), slider(0.13), checkbox(off), checkbox(off), checkbox(off), checkbox(off), checkbox(on), checkbox(off), checkbox(off), checkbox(off), checkbox(off), slider(1)])  # -> Model, CuttingCurves, FaceIndices, MeshesOfRenderedResults, CurvesOfRenderedResults, Ntt_kN_m, Nnn_kN_m, Ntn_kN_m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
explode_3 = Explode(Curve=psl, Recursive=True)  # -> Segments, Vertices
join = JoinCurves(Curves=flatten([psl, pline_2]), Preserve=False)
shellvecresults_4 = ResultVectorsOnShellsKaramba3D(Model=modelview_2.Model, LoadCase=panel_10, mode="PrincForce")  # -> Model, Points, FirstPrincipalNormalForceVector_kN_m, SecondPrincipalNormalForceVector_kN_m, FirstPrincipalMomentVector_kN, SecondPrincipalMomentVector_kN, FirstPrincipalNormalForceValue_kN_m, SecondPrincipalNormalForceValue_kN_m, FirstPrincipalMomentValue_kN, SecondPrincipalMomentValue_kN; disabled
py3_2 = Python3Script(x=shellvecresults_4.FirstPrincipalMomentValue_kN)  # -> out, a; inputs x: list; disabled; same code as py3
generated_seeds_2 = Point(generated_seeds)
lng = ListLength(List=generated_seeds_2)
panel_12 = Panel(lng)
dom = ConstructDomain(DomainStart=0, DomainEnd=expr("x-1", lng))
textdot_2 = DefineTextDot(Text=shellvecresults_2.SecondPrincipalMomentValue_kN, Location=shellvecresults_2.Points, Font="Arial", Size=14)  # disabled
vlen_2 = VectorLength(Vector=shellvecresults_3.FirstPrincipalStressVector_kN_cm²)  # disabled
s_forces_5 = ShellForcesKaramba3D(AnalysedModel=shellview_2.Model, mode="Local")  # -> Model, Nxx_kN_m, Nyy_kN_m, Nxy_kN_m, flatten(Mxx_kNm_m), flatten(Myy_kNm_m), flatten(Mxy_kNm_m), Vx_kN_m, Vy_kN_m, LoadCaseIndex; disabled
crv_12 = Curve(boundary_2)  # disabled
pt_5 = Point(<point referenced from the Rhino model>)
range = Range(Domain=dom, Steps=expr("x-1", lng))
gradient = Gradient(
    LowerLimit="0",
    UpperLimit=panel_12,
    Parameter=range,
    stops=[0: RGB(79, 61, 188), 0: RGB(157, 187, 170), 0.00817: RGB(0, 128, 0), 0.413: RGB(128, 255, 128), 0.699: RGB(255, 128, 0), 0.938: RGB(220, 0, 40)])
shellvecresults_5 = ResultVectorsOnShellsKaramba3D(Model=shellview_3.Model, LayerPosition="-1", mode="PrincStress")  # -> Model, Points, FirstPrincipalStressVector_kN_cm², SecondPrincipalStressVector_kN_cm², FirstPrincipalStressValue_kN_cm², SecondPrincipalStressValue_kN_cm²
panel_13 = Panel("1860")  # disabled
bnd_3 = Bounds(Numbers=vlen_2)  # disabled
stress_distribution = Python3Script(C=crv_2, Pts=shellvecresults.Points, V=vlen, minVec=dedomain.Start, maxVec=dedomain.End, minStep="0.13", maxStep="0.07")  # -> out, a, b; inputs C: Curve, Pts: list of Point3d, V: list of Double, minVec: Double, maxVec: Double, minStep: Double, maxStep: Double
# ---------- stress_distribution: Python ----------
""" 
Inputs:
    C: Curve
    V: list of Vector3d
    Pts: list of Point3d
    minVec: float
    maxVec: float
    minStep: float
    maxStep: float

Output:
    pts_on_curve: list of Point3d
"""

import Rhino
import math

def remap(value, in_min, in_max, out_min, out_max):
    """
    Linearly remaps 'value' from range [in_min, in_max] 
    to [out_min, out_max].
    """
    # Handle edge case if in_min == in_max to avoid division by zero
    if abs(in_max - in_min) < 1e-12:
        return out_min
    t = float(value - in_min) / float(in_max - in_min)
    return out_min + t * (out_max - out_min)

# Get the total length of the curve:
curve_length = C.GetLength()

# Start at curve parameter = 0 (the start)
# or, you can use curve domain if needed:
t = C.Domain.Min

# Convert param domain to length domain if you want to move in *units* along the curve
current_length_along_curve = 0.0

points_on_curve = []
# Evaluate the start point on the curve
start_pt = C.PointAtStart
points_on_curve.append(start_pt)

while True:
    # ----------------------------------------------------
    # 1) Get the current point on the curve
    current_pt = C.PointAt(C.Domain.ParameterAt(current_length_along_curve / curve_length))
    
    # ----------------------------------------------------
    # 2) Find the 4 closest “vector points” to current_pt
    #    We do a simple sort by distance and take the first 4
    # ----------------------------------------------------
    # Calculate distances from current_pt to each vector point
    distances = []
    for i, pt in enumerate(Pts):
        dist = current_pt.DistanceTo(pt)
        distances.append((dist, i))
    
    # Sort by distance
    distances.sort(key=lambda x: x[0])
    # Pick the 4 closest
    closest_indices = [distances[j][1] for j in range(min(2, len(distances)))]
    
    # ----------------------------------------------------
    # 3) From those 4 vectors, compute an "average magnitude"
    # ----------------------------------------------------
    sum_length = 0.0
    for idx in closest_indices:
        sum_length += V[idx]
    avg_length = sum_length / 2.0  if len(closest_indices) == 2 else 0.0
    
    # ----------------------------------------------------
    # 4) Remap that average magnitude from [minVec, maxVec] to [minStep, maxStep]
    # ----------------------------------------------------
    step_size = remap(avg_length, minVec, maxVec, minStep, maxStep)
    print(avg_length)
    
    # ----------------------------------------------------
    # 5) Advance along the curve by step_size
    # ----------------------------------------------------
    next_length_along_curve = current_length_along_curve + step_size
    
    # Stop if the next step goes beyond the end of the curve
    if next_length_along_curve > curve_length:
        break
    
    current_length_along_curve = next_length_along_curve
    
    # Evaluate next point on the curve
    next_pt = C.PointAt(C.Domain.ParameterAt(current_length_along_curve / curve_length))
    points_on_curve.append(next_pt)


    print("  current_pt =", current_pt)
    print("  closest_indices:", closest_indices)
    for idx in closest_indices:
        print("    Vector idx =", idx, " length =", V[idx])
    print("  average_length =", avg_length)
    print("  step_size =", step_size)
    print("--------------")



# Assign output
pts_on_curve = points_on_curve
a = pts_on_curve
# ---------- end stress_distribution ----------
stress_distribution_2 = Python3Script(C=crv, Pts=shellvecresults.Points, V=vlen, minVec=dedomain.Start, maxVec=dedomain.End, minStep="0.13", maxStep="0.07")  # -> out, a, b; inputs C: Curve, Pts: list of Point3d, V: list of Double, minVec: Double, maxVec: Double, minStep: Double, maxStep: Double; same code as stress_distribution
shellvecresults_6 = ResultVectorsOnShellsKaramba3D(Model=modelview_3.Model, LoadCase="LC0", mode="PrincForce")  # -> Model, Points, FirstPrincipalNormalForceVector_kN_m, SecondPrincipalNormalForceVector_kN_m, FirstPrincipalMomentVector_kN, SecondPrincipalMomentVector_kN, FirstPrincipalNormalForceValue_kN_m, SecondPrincipalNormalForceValue_kN_m, FirstPrincipalMomentValue_kN, SecondPrincipalMomentValue_kN
py3_3 = Python3Script(x=shellvecresults_6.SecondPrincipalMomentValue_kN)  # -> out, a; inputs x: list; same code as py3
vlen_3 = VectorLength(Vector=shellvecresults_5.FirstPrincipalStressVector_kN_cm²)
bnd_4 = Bounds(Numbers=shellvecresults_3.FirstPrincipalStressValue_kN_cm²)  # disabled
s_forces_6 = ShellForcesKaramba3D(AnalysedModel=shellview_3.Model, mode="Local")  # -> Model, Nxx_kN_m, Nyy_kN_m, Nxy_kN_m, flatten(Mxx_kNm_m), flatten(Myy_kNm_m), flatten(Mxy_kNm_m), Vx_kN_m, Vy_kN_m, LoadCaseIndex
crv_13 = Curve(boundary_3)
item_4 = ListItem(List=shellvecresults_4.Points, Index=panel_13, Wrap=True)  # disabled
crv_14 = Curve(boundary_2)  # disabled
python_3_script_2 = Python3Script(mxx_values=s_forces_5.Mxx_kNm_m, myy_values=s_forces_5.Myy_kNm_m, mxy_values=s_forces_5.Mxy_kNm_m)  # -> M1, M2; "M1/M2"; inputs mxx_values: list, myy_values: list, mxy_values: list; disabled; same code as python_3_script
dedomain_2 = DeconstructDomain(Domain=bnd_3)  # -> Start, End; disabled
bnd_5 = Bounds(Numbers=vlen_3)
item_5 = ListItem(List=shellvecresults_4.FirstPrincipalMomentValue_kN, Index=panel_13, Wrap=True)  # disabled
pt_6 = Point(stress_distribution_2.a)
bnd_6 = Bounds(Numbers=shellvecresults_5.FirstPrincipalStressValue_kN_cm²)
pt_7 = Point(stress_distribution.a)
textdot_3 = DefineTextDot(Text=range, Location=generated_seeds_2, Font="Arial", Size=9)
tag = TextTag3D(Location=generated_seeds_2, Text=range, Size=0.05, Colour=ColourSwatch(SwatchColor=RGB(5, 5, 5)), Justification=8)
explode_4 = Explode(Curve=crv_14, Recursive=True)  # -> Segments, Vertices; disabled

tracer_automatic_3d_self_single_loop_for_2 = Python3Script(
    seed_points=pt_4,
    principal_vectors=shellvecresults_3.SecondPrincipalStressVector_kN_cm²,
    points=shellvecresults_3.Points,
    domain_surface=boundary_2,
    collision_threshold=panel_11,
    boundary_curves=explode_4.Segments,
    stress_values=py3_2.a)  # -> out, a, b, w, Error_message, c, warning; "Tracer_automatic_3d_self_single_loop_force"; inputs seed_points: list of Point3d, principal_vectors: list of Vector3d, points: list of Point3d, domain_surface: Brep, collision_threshold: Double, boundary_curves: list of Curve, stress_values: list of Double; disabled; same code as tracer_automatic_3d_self_single_loop_for
psl_2 = Curve(tracer_automatic_3d_self_single_loop_for_2.a)  # disabled
pline_3 = PolyLine(Vertices=tracer_automatic_3d_self_single_loop_for_2.b, Closed=False)  # -> flatten(Polyline); disabled
generated_seeds_3 = Point(tracer_automatic_3d_self_single_loop_for_2.w)  # disabled

pline_4 = PolyLine(Vertices=tracer_automatic_3d_self_single_loop_for_2.c, Closed=False)  # -> flatten(Polyline); disabled
textdot_4 = DefineTextDot(Text=s_forces_5.Mxx_kNm_m, Location=shellvecresults_3.Points, Font="Arial", Size=8)  # disabled
item_6 = ListItem(List=shellvecresults_6.Points, Index="1860", Wrap=True)
crv_15 = Curve(boundary_3)
cull_i_7 = CullIndex(List=pt_7, Indices=0, Wrap=True)
python_3_script_3 = Python3Script(mxx_values=s_forces_6.Mxx_kNm_m, myy_values=s_forces_6.Myy_kNm_m, mxy_values=s_forces_6.Mxy_kNm_m)  # -> M1, M2; "M1/M2"; inputs mxx_values: list, myy_values: list, mxy_values: list; same code as python_3_script
dedomain_3 = DeconstructDomain(Domain=bnd_5)  # -> Start, End
cull_i_8 = CullIndex(List=pt_6, Indices=[0, -1], Wrap=True)
item_7 = ListItem(List=shellvecresults_6.FirstPrincipalMomentValue_kN, Index="1860", Wrap=True)
join_2 = JoinCurves(Curves=join, Preserve=False)
panel_14 = Panel("0")  # disabled
explode_5 = Explode(Curve=crv_15, Recursive=True)  # -> Segments, Vertices

tracer_automatic_3d_self_single_loop_for_3 = Python3Script(
    seed_points=pt_5,
    principal_vectors=shellvecresults_5.FirstPrincipalStressVector_kN_cm²,
    points=shellvecresults_5.Points,
    domain_surface=boundary_3,
    collision_threshold="0.15",
    boundary_curves=explode_5.Segments,
    stress_values=py3_3.a)  # -> out, a, b, w, Error_message, c, warning; "Tracer_automatic_3d_self_single_loop_force"; inputs seed_points: list of Point3d, principal_vectors: list of Vector3d, points: list of Point3d, domain_surface: Brep, collision_threshold: Double, boundary_curves: list of Curve, stress_values: list of Double
# ---------- tracer_automatic_3d_self_single_loop_for_3: Python ----------
import math
import numpy as np
import rhinoscriptsyntax as rs
import Rhino.Geometry as rg
import scriptcontext as sc
from scipy.spatial import KDTree
import heapq

# --- Your existing functions (with minor adaptations) ---

def distance_3d(a, b):
    return math.sqrt((a[0]-b[0])**2 + (a[1]-b[1])**2 + (a[2]-b[2])**2)

def normalize(vector):
    """Normalize a vector (2D) to unit length."""
    magnitude = math.sqrt(vector[0]**2 + vector[1]**2+vector[2]**2)
    return [vector[0] / magnitude, vector[1] / magnitude,vector[2] / magnitude] if magnitude != 0 else [0, 0, 0]

def to_numeric(vec):
    """Convert a Rhino object to a numeric [x,y,z] list; otherwise return vec as-is."""
    try:
        return [vec.X, vec.Y, vec.Z]
    except AttributeError:
        return vec

def find_closest_neighbors_kd(point, kd_tree, k):
    """
    Given a 2D point (as [x,y]) and a pre-built KDTree,
    return a list of indices of the k closest points.
    """

    distances, indices = kd_tree.query(point,k=k)
    if isinstance(indices, int):
        return [indices]
    return list(indices)

def interpolate_vector(point, points, vectors, neighbors, ref_dir):
    """
    Distance-weighted interpolation of neighbor vectors in 3D,
    flipping each neighbor's vector if dot < 0 with respect to 'ref_dir'.

    - pt: [x, y, z], the point where we want the interpolated vector
    - points_3d: Nx3 array of point coords
    - vectors_3d: Nx3 array of principal vectors
    - neighbors: list of indices from the KDTree
    - ref_dir: [dx, dy, dz], the direction from the previous step (or None if first step)
    """
    weights = []
    weighted_vec = [0.0, 0.0, 0.0]

    for i in neighbors:
        vx, vy, vz = vectors[i]  # copy so we can flip locally
        if ref_dir is not None:
            dotp = vx*ref_dir[0] + vy*ref_dir[1] + vz*ref_dir[2]
            if dotp < 0:
                vx, vy, vz = -vx, -vy, -vz
        
        npt = points[i]
        dx = point[0] - npt[0]
        dy = point[1] - npt[1]
        dz = point[2] - npt[2]
        dist = (dx*dx + dy*dy + dz*dz)**0.5
        
        w = 1.0 / (dist + 1e-6)
        weights.append(w)
        
        weighted_vec[0] += vx*w
        weighted_vec[1] += vy*w
        weighted_vec[2] += vz*w

    total_w = sum(weights)
    if total_w > 1e-12:
        weighted_vec[0] /= total_w
        weighted_vec[1] /= total_w
        weighted_vec[2] /= total_w

    mag = (weighted_vec[0]**2 + weighted_vec[1]**2 + weighted_vec[2]**2)**0.5
    if mag < 1e-12:
        return [0.0, 0.0, 0.0]
    
    return [weighted_vec[0]/mag, weighted_vec[1]/mag, weighted_vec[2]/mag]

def adjust_step_size_3d(current_point, neighbors, points, step_sign):

    if not neighbors:
        return 0.1 * step_sign
    
    distances = []
    for i in neighbors:
        npt = points[i]
        dx = current_point[0] - npt[0]
        dy = current_point[1] - npt[1]
        dz = current_point[2] - npt[2]
        dist = math.sqrt(dx*dx + dy*dy + dz*dz)
        distances.append(dist)
    
    avg_dist = sum(distances) / len(distances) if len(distances) else 0.1
    base_step = min(0.1, avg_dist / 2.0)
    return base_step * step_sign

def project_onto_surface(surface, pt3d, tolerance=2):
    pt_rh = rg.Point3d(pt3d[0], pt3d[1], pt3d[2])
    
    if isinstance(surface, rg.Brep):
        # Note the 6 returned values:
        rc, closest_pt, cindex, u, v, normal = surface.ClosestPoint(pt_rh, tolerance)
        if rc:
            # Check if cindex is a face
            if cindex.ComponentIndexType == rg.ComponentIndexType.BrepFace:
                face_id = cindex.Index
                face = surface.Faces[face_id]
                
                # 'closest_pt' is the 3D point on that face
                # Optionally confirm it's within the face domain or do face.IsPointOnFace(u,v)
                
                return [closest_pt.X, closest_pt.Y, closest_pt.Z]
            else:
                # The closest component might be an edge or vertex
                return None
        else:
            return None
    
    elif isinstance(surface, rg.Surface):
        rc, u, v = surface.ClosestPoint(pt_rh)
        if rc:
            pt_srf = surface.PointAt(u, v)
            return [pt_srf.X, pt_srf.Y, pt_srf.Z]
        else:
            return None
    else:
        return None

def get_brep_edge_curves(domain_surface):
    """
    Returns a list of Rhino.Geometry.Curve objects, one for each edge of the Brep.
    If 'domain_surface' is a plain NURBS surface, we convert it to a Brep first.
    """

    # If 'domain_surface' is actually a Surface, convert it to a Brep
    if isinstance(domain_surface, rg.Surface):
        domain_surface = rg.Brep.CreateFromSurface(domain_surface)
        if not domain_surface:
            # In case conversion fails
            return []

    edge_curves = []
    # Now 'domain_surface' should be a Brep
    for edge in domain_surface.Edges:
        crv = edge.ToNurbsCurve()  # or edge.EdgeCurve if you prefer
        edge_curves.append(crv)
    return edge_curves

def distance_to_brep_edges(pt3d, boundary_curves):
    test_pt = rg.Point3d(pt3d[0], pt3d[1], pt3d[2])
    min_dist = float('inf')
    best_cp = None  # keep track of the closest point so far
    
    for crv in boundary_curves:
        rc, t = crv.ClosestPoint(test_pt)
        if rc:
            cp = crv.PointAt(t)
            dist = cp.DistanceTo(test_pt)
            if dist < min_dist:
                min_dist = dist
                best_cp = cp
    
    return min_dist, best_cp

def is_on_surface(surface, pt3d, tol=0.01):
    """
    Returns True if pt3d is within 'tol' of the surface. 
    """
    if not surface: 
        return True  # no surface provided
    pproj = project_onto_surface(surface, pt3d)
    if pproj is None:
        return False
    dx = pt3d[0] - pproj[0]
    dy = pt3d[1] - pproj[1]
    dz = pt3d[2] - pproj[2]
    dist = math.sqrt(dx*dx + dy*dy + dz*dz)
    return (dist < tol)

def runge_kutta_step_3d(
    current_point, 
    current_dir,
    h, 
    k, 
    principal_vectors, 
    points_3d, 
    step_sign, 
    kd_tree, 
    boundary_curves=None, 
    boundary_tolerance=0.1, prev_dir=None):
    """
    Perform one RK4 step in 3D. Stop if next point is within 'boundary_tolerance'
    of any boundary curve (edges).
    Returns the next 3D point or None if out-of-bound / near boundary.
    """
    
    # 1) Neighbors & dynamic step size
    neighbors = find_closest_neighbors_kd(current_point, kd_tree, k)
    h = adjust_step_size_3d(current_point, neighbors, points_3d, step_sign)
    
    # k1
    k1_dir = interpolate_vector(current_point, points_3d, principal_vectors, neighbors, current_dir)
    mid1 = [
        current_point[0] + 0.5*h*k1_dir[0],
        current_point[1] + 0.5*h*k1_dir[1],
        current_point[2] + 0.5*h*k1_dir[2]
    ]
    
    # k2
    neigh_mid1 = find_closest_neighbors_kd(mid1, kd_tree, k)
    k2_dir = interpolate_vector(mid1, points_3d, principal_vectors, neigh_mid1, k1_dir)
    mid2 = [
        current_point[0] + 0.5*h*k2_dir[0],
        current_point[1] + 0.5*h*k2_dir[1],
        current_point[2] + 0.5*h*k2_dir[2]
    ]
    
    # k3
    neigh_mid2 = find_closest_neighbors_kd(mid2, kd_tree, k)
    k3_dir = interpolate_vector(mid2, points_3d, principal_vectors, neigh_mid2, k2_dir)
    end_pt = [
        current_point[0] + h*k3_dir[0],
        current_point[1] + h*k3_dir[1],
        current_point[2] + h*k3_dir[2]
    ]
    
    # k4
    neigh_end = find_closest_neighbors_kd(end_pt, kd_tree, k)
    k4_dir = interpolate_vector(end_pt, points_3d, principal_vectors, neigh_end, k3_dir)
    
    # Summation
    dx = h*(k1_dir[0] + 2*k2_dir[0] + 2*k3_dir[0] + k4_dir[0]) / 6.0
    dy = h*(k1_dir[1] + 2*k2_dir[1] + 2*k3_dir[1] + k4_dir[1]) / 6.0
    dz = h*(k1_dir[2] + 2*k2_dir[2] + 2*k3_dir[2] + k4_dir[2]) / 6.0
    
    next_point = [
        current_point[0] + dx,
        current_point[1] + dy,
        current_point[2] + dz
    ]
    next_dir = k4_dir

    if domain_surface is not None:
        projected = project_onto_surface(domain_surface, next_point)
        #print(projected)
        if projected is None:
            # Means we're off domain or near an open edge you consider invalid
            return None
        next_point = projected  # accept the projected coordinate

    # 2) Check distance to boundary edges, if we have them
    # if boundary_curves:
    #     dist_to_edge = distance_to_brep_edges(next_point, boundary_curves)
    #     if dist_to_edge < boundary_tolerance:
    #         # We consider that "off" or "too close" => stop
    #         return None

    # Otherwise return the next valid point
    return next_point, next_dir
# --- Collision Checking using Cached PSL Curves ---

def closest_point_on_polyline_3d(pt3d, poly_curve):
    """
    Return (closest_point, distance) from a 3D point to a polyline curve.
    """
    test_pt = rg.Point3d(pt3d[0], pt3d[1], pt3d[2])
    rc, t = poly_curve.ClosestPoint(test_pt)
    if rc:
        cp = poly_curve.PointAt(t)
        dist = cp.DistanceTo(test_pt)
        print(dist)
        return [cp.X, cp.Y, cp.Z], dist
    else:
        return None, float('inf')

def find_closest_existing_line_3d(next_point, existing_trajectories, threshold):
    """
    Among all previously traced lines (in 3D), find if 'next_point' is within 'threshold' of any line.
    Returns (closest_line_index, closest_point_on_line, distance).
    """
    min_dist = float('inf')
    closest_line_idx = None
    closest_pt = None
    
    for i, (polyline_pts, poly_curve) in enumerate(existing_trajectories):
        cp, dist = closest_point_on_polyline_3d(next_point, poly_curve)
        if dist < min_dist:
            min_dist = dist
            closest_line_idx = i
            closest_pt = cp
    
    if min_dist < threshold:
        return (closest_line_idx, closest_pt, min_dist)
    else:
        return (None, None, float('inf'))

def build_polyline_curve_3d(poly_pts):
    pts3d = [rg.Point3d(pt[0], pt[1], pt[2]) for pt in poly_pts]
    poly = rg.Polyline(pts3d)
    return rg.PolylineCurve(poly)

# --- New Functions for Sampling and Seeding ---

import Rhino.Geometry as rg
def surface_normal_at_point(surface, pt3d, tolerance=2):
    """
    Returns the surface normal [nx, ny, nz] at a 3D point on a multi-face Brep or rg.Surface.
    If near an open edge or invalid, returns None.
    """
    pt_rh = rg.Point3d(pt3d[0], pt3d[1], pt3d[2])

    if isinstance(surface, rg.Brep):
        stuff = surface.ClosestPoint(pt_rh, tolerance)
        if not stuff or len(stuff) < 6:
            return None
        b = stuff[0]
        rc = stuff[1]
        #print(rc)
        comp_index = stuff[2]
        u = stuff[3]
        v = stuff[4]
        # stuff[4] => cpt
        # stuff[5] => guess_normal
        if not rc:
            return None
        
        # If it's a face, we evaluate the face normal at (u, v)
        if comp_index.ComponentIndexType == rg.ComponentIndexType.BrepFace:
            face_id = comp_index.Index
            face = surface.Faces[face_id]
            exact_normal = face.NormalAt(u, v)
            if exact_normal:
                return [exact_normal.X, exact_normal.Y, exact_normal.Z]
            else:
                return None
        else:
            # edge/vertex
            return None
    
    elif isinstance(surface, rg.Surface):
        rc, u, v = surface.ClosestPoint(pt_rh)
        if rc:
            exact_normal = surface.NormalAt(u, v)
            return [exact_normal.X, exact_normal.Y, exact_normal.Z]
        else:
            return None

    # Not a Brep or Surface
    return None


def sample_psl(psl_pts, sample_interval):
    """
    Given a PSL (list of Rhino Point3d), sample it at every sample_interval (by index).
    Returns a list of numeric [x,y] points.
    """
    samples = []
    #print(sample_interval)
    for i in range(0, len(psl_pts), sample_interval):
        pt = psl_pts[i]
        
        if isinstance(pt, rg.Point3d):
            samples.append([pt.X, pt.Y, pt.Z])
        else:
            samples.append(pt)
        #print(samples)
    return samples

import math

def offset_seed(psl_pts_3d, index, offset_distance, surface):
    """
    Offsets the PSL at psl_pts_3d[index] in the local tangent plane of 'surface'.
    Steps:
      1) Compute PSL tangent at index
      2) Get surface normal at that point
      3) binormal = cross(surface_normal, psl_tangent)
      4) candidate1 = point + offset_distance*binormal
         candidate2 = point - offset_distance*binormal
      5) (optional) project candidates back onto the surface
    Returns: (candidate1, candidate2) as [x, y, z], or (None, None) on error.
    """
    n = len(psl_pts_3d)
    if n < 2:
        return None, None
    
    # 0) Current point
    px, py, pz = psl_pts_3d[index]
    
    # 1) PSL TANGENT
    if index == 0:
        # Use next point - current point
        nx, ny, nz = psl_pts_3d[1]
        tx = nx - px
        ty = ny - py
        tz = nz - pz
    elif index == n - 1:
        # Use current point - prev point
        px_prev, py_prev, pz_prev = psl_pts_3d[n - 2]
        tx = px - px_prev
        ty = py - py_prev
        tz = pz - pz_prev
    else:
        # Middle: use psl_pts_3d[index+1] - psl_pts_3d[index-1]
        px_prev, py_prev, pz_prev = psl_pts_3d[index - 1]
        px_next, py_next, pz_next = psl_pts_3d[index + 1]
        tx = px_next - px_prev
        ty = py_next - py_prev
        tz = pz_next - pz_prev

    # Normalize tangent
    t_len = math.sqrt(tx*tx + ty*ty + tz*tz)
    if t_len < 1e-12:
        return None, None
    tx /= t_len
    ty /= t_len
    tz /= t_len
    
    # 2) SURFACE NORMAL
    normal = surface_normal_at_point(surface, [px, py, pz])
    if not normal:
        print("no normal")
        return None, None
    nx, ny, nz = normal
    n_len = math.sqrt(nx*nx + ny*ny + nz*nz)
    if n_len < 1e-12:
        return None, None
    nx /= n_len
    ny /= n_len
    nz /= n_len
    
    # 3) BINORMAL = cross(normal, tangent)
    # This is guaranteed to be in the tangent plane if PSL is truly tangent to the surface
    # If the PSL isn't exactly tangent, you'll get some tilt. 
    bx = ny*tz - nz*ty
    by = nz*tx - nx*tz
    bz = nx*ty - ny*tx
    b_len = math.sqrt(bx*bx + by*by + bz*bz)
    if b_len < 1e-12:
        # Means normal and tangent are parallel or something degenerate
        return None, None
    bx /= b_len
    by /= b_len
    bz /= b_len
    
    # 4) OFFSET POINTS
    candidate1 = [px + offset_distance*bx,
                  py + offset_distance*by,
                  pz + offset_distance*bz]
    candidate2 = [px - offset_distance*bx,
                  py - offset_distance*by,
                  pz - offset_distance*bz]
    
    # 5) (OPTIONAL) Project them onto the surface if you want them exactly on the domain
    candidate1_proj = project_onto_surface(surface, candidate1)
    #print(f"this point is seed {candidate1_proj}")
    candidate2_proj = project_onto_surface(surface, candidate2)
    # if not candidate1_proj or not candidate2_proj:
    #     return None, None
    # return candidate1_proj, candidate2_proj

    # If you don't need the final projection, just return them:
    return candidate1_proj, candidate2_proj


def sample_psl_3d(psl_pts, sample_interval):
    """
    Given a PSL (list of Rhino Point3d or numeric [x,y,z] points),
    sample it every 'sample_interval' points.
    Returns a list of tuples: ( [x,y,z], original_index )
    """
    samples = []
    for i in range(0, len(psl_pts), sample_interval):
        pt3d = psl_pts[i]
        # Convert to numeric [x,y,z] if it's a Point3d
        if hasattr(pt3d, "X"):
            samples.append(([pt3d.X, pt3d.Y, pt3d.Z], i))
        else:
            samples.append((pt3d, i))
    return samples


def is_valid_seed(candidate, existing_trajectories, min_distance, boundary_curves, boundary_tolerance=0.1):
    """
    Check if candidate seed is valid:
      - It is not too close to any existing PSL (using min_distance).
      - It is not too close to any boundary curves (if boundary_curves is provided and
        candidate's distance < boundary_tolerance).
    """
    # Check candidate against existing PSLs
    idx, cp, dist = find_closest_existing_line_3d(candidate, existing_trajectories, min_distance)
    if idx is not None:
        return False

    # Check candidate against boundary curves if provided
    if boundary_curves:
        dist_edge, cp_edge = distance_to_brep_edges(candidate, boundary_curves)
        if dist_edge < 0.05:
            return False

    return True

def get_stress_value(sample_pt, kd_tree, stress_values):
    """
    Query the stress_kdtree to find the nearest stress sample.
    Return the corresponding stress value from stress_values.
    """
    # sample_pt is [x, y] in 2D
    dist, idx = kd_tree.query(sample_pt)  # single neighbor
    # stress_values[idx] is the stress at the nearest stress point
    return stress_values[idx]

# --- Main Loop: Iterative Seeding with a Queue ---

def trace_psl_both_directions(
    seed_point_3d, 
    h, 
    num_steps, 
    k, 
    principal_vectors, 
    points_3d,
    boundary_curves=None,
    boundary_tolerance=0.02,
    existing_trajectories=None,
    collision_threshold=0.05,
    closing_threshold=0.1, 
    kd_tree=None
):
    """
    Single-loop approach where forward/backward can stop independently.
    If forward hits a collision/boundary, it stops, but backward can continue, and vice versa.
    We only stop the entire PSL when BOTH directions are inactive, or when tips meet.
    """
    if existing_trajectories is None:
        existing_trajectories = []
    
    import Rhino.Geometry as rg
    bridging_lines = []
    edge_lines = []

    # We'll keep two lines: forward and backward
    forward_line = [rg.Point3d(*seed_point_3d)]
    backward_line = [rg.Point3d(*seed_point_3d)]
    
    # Current forward/backward points + directions
    f_current_pt = list(seed_point_3d)
    f_current_dir = None
    b_current_pt = list(seed_point_3d)
    b_current_dir = None

    # NEW: Boolean flags to track if forward/backward are still active
    forward_active = True
    backward_active = True

    for step_i in range(num_steps):
        
        # ---------------------------
        # FORWARD STEP (if still active)
        # ---------------------------
        if forward_active:
            f_next = runge_kutta_step_3d(
                f_current_pt,
                f_current_dir,
                h,
                k,
                principal_vectors,
                points_3d,
                step_sign=+1,
                kd_tree=kd_tree,
                boundary_curves=boundary_curves,
                boundary_tolerance=boundary_tolerance
            )
            if not f_next or f_next[0] is None:
                print(f"PSL forward direction stopped at iteration {step_i}.")
                forward_active = False
            else:
                f_next_pt, f_next_dir = f_next
                # Collision check with existing PSLs
                if existing_trajectories:
                    line_idx, close_pt, dist_cl = find_closest_existing_line_3d(
                        f_next_pt, existing_trajectories, collision_threshold
                    )
                    if line_idx is not None and close_pt is not None:
                        # Instead of break, we do bridging & disable forward
                        steps_back = 5
                        if len(forward_line) > steps_back:
                            bridging_line = [
                                forward_line[-steps_back],
                                rg.Point3d(*close_pt)
                            ]
                            bridging_lines.append(bridging_line)
                            del forward_line[-(steps_back-1):]

                        if len(forward_line)==0 or len(backward_line)==1:
                            print("too short for bridge")
                        else:
                            bridging_line = [
                                forward_line[-1],
                                rg.Point3d(*close_pt)
                            ]
                            bridging_lines.append(bridging_line)
                        
                        print(f"PSL forward collided with line {line_idx} at dist {dist_cl:.3f}.")
                        forward_active = False

                    # 2) Check distance to boundary edges, if we have them
                if boundary_curves:
                    dist_to_edge,cp = distance_to_brep_edges(f_next_pt, boundary_curves)
                    if dist_to_edge < boundary_tolerance:
                        # We consider that "off" or "too close" => stop
                        print(f"PSL forward reached boundary.")
                        forward_active = False
                        edge_line = [
                                forward_line[-1],
                                rg.Point3d(cp)
                            ]
                        edge_lines.append(edge_line)


                # If still active, accept the new forward step
                if forward_active:
                    forward_line.append(rg.Point3d(*f_next_pt))
                    f_current_pt = f_next_pt
                    f_current_dir = f_next_dir

        # ---------------------------
        # BACKWARD STEP (if still active)
        # ---------------------------
        if backward_active:
            b_next = runge_kutta_step_3d(
                b_current_pt,
                b_current_dir,
                h,
                k,
                principal_vectors,
                points_3d,
                step_sign=-1,
                kd_tree=kd_tree,
                boundary_curves=boundary_curves,
                boundary_tolerance=boundary_tolerance
            )
            if not b_next or b_next[0] is None:
                print(f"PSL backward direction stopped at iteration {step_i}.")
                backward_active = False
            else:
                b_next_pt, b_next_dir = b_next
                # Collision check with existing PSLs
                if existing_trajectories:
                    line_idx, close_pt, dist_cl = find_closest_existing_line_3d(
                        b_next_pt, existing_trajectories, collision_threshold
                    )
                    if line_idx is not None and close_pt is not None:
                        steps_back = 5
                        if len(backward_line) > steps_back:
                            bridging_line = [
                                backward_line[-steps_back],
                                rg.Point3d(*close_pt)
                            ]
                            bridging_lines.append(bridging_line)
                            del backward_line[-(steps_back-1):]

                        if len(backward_line)==0 or len(backward_line)==1:
                            print("too short for bridge")
                        else:
                            bridging_line = [
                                backward_line[-1],
                                rg.Point3d(*close_pt)
                            ]
                            bridging_lines.append(bridging_line)

                        print(f"PSL backward collided with line {line_idx} at dist {dist_cl:.3f}.")
                        backward_active = False


                if boundary_curves:
                    dist_to_edge,cp = distance_to_brep_edges(b_next_pt, boundary_curves)
                    if dist_to_edge < boundary_tolerance:
                        # We consider that "off" or "too close" => stop
                        print(f"PSL backward reached boundary.")
                        backward_active = False
                        edge_line = [
                                backward_line[-1],
                                rg.Point3d(cp)
                            ]
                        edge_lines.append(edge_line)

                # If still active, accept the new backward step
                if backward_active:
                    backward_line.append(rg.Point3d(*b_next_pt))
                    b_current_pt = b_next_pt
                    b_current_dir = b_next_dir
        
        # ---------------------------
        # Check if BOTH directions are done
        # ---------------------------
        if not forward_active and not backward_active:
            print("Both forward & backward directions inactive => stopping PSL.")
            break

        # ---------------------------
        # TIP DISTANCE CHECK
        # ---------------------------
        # Only if both are still active
        if forward_active and backward_active and step_i >= 10:
            f_xyz = [forward_line[-1].X, forward_line[-1].Y, forward_line[-1].Z]
            b_xyz = [backward_line[-1].X, backward_line[-1].Y, backward_line[-1].Z]
            dist_fb = distance_3d(f_xyz, b_xyz)
            if dist_fb < closing_threshold:
                bridging_line = [
                    forward_line[-1],
                    backward_line[-1]
                ]
                bridging_lines.append(bridging_line)

                print(
                    f"PSL tips meet at iteration {step_i}, dist= {dist_fb:.3f} < {closing_threshold}."
                )
                # Here we might disable both directions or just break:
                forward_active = False
                backward_active = False
                break
    
    # Merge lines
    backward_line.reverse()
    if len(backward_line) > 1:
        backward_line.pop()
    merged_pts = backward_line + forward_line
    
    return merged_pts, bridging_lines, edge_lines


def generate_all_psls_3d(
    initial_seed_3d,
    h, 
    num_steps, 
    k, 
    principal_vectors, 
    points_3d,
    kd_tree,
    boundary_curves,
    collision_threshold,
    sample_interval,
    min_seed_distance,
    # NEW: for stress-based offset
    stress_values
):
    """
    Generate PSLs using an iterative seeding strategy (3D version)
    with a GLOBAL PRIORITY QUEUE for candidate seeds based on stress.

    1) Trace an initial PSL from initial_seed_3d.
    2) Sample it, pushing candidate seeds into a priority queue (max stress first).
    3) Pop the highest-stress seed, validate it, trace a PSL, sample it, push new seeds...
    4) Stop when the priority queue is empty.

    Returns:
      - all_psls: list of (psl_points_3d, polyline_curve_3d)
      - bridging_lines: bridging segments
      - positive_candidates: seeds that were actually used
    """
    # 1) Trace the initial PSL
    initial_psl, initial_bridges, initial_edges = trace_psl_both_directions(
        seed_point_3d=initial_seed_3d,
        h=h,
        num_steps=num_steps,
        k=k,
        principal_vectors=principal_vectors,
        points_3d=points_3d,
        boundary_curves=boundary_curves,
        boundary_tolerance=0.01,
        existing_trajectories=None,
        collision_threshold=collision_threshold,
        kd_tree=kd_tree
    )
    # Convert to curve for collision checks
    initial_curve = build_polyline_curve_3d(initial_psl)

    all_psls = [(initial_psl, initial_curve)]
    bridging_lines = []
    positive_candidates = []
    edges = []


    if initial_bridges:
        bridging_lines.extend(initial_bridges)

    if initial_edges:
        edges.extend(initial_edges)

    # Helper: sample a PSL, push seeds to a global priority queue
    def add_candidates_from_psl(psl_points, sample_interval):
        samples = sample_psl_3d(psl_points, sample_interval)  # => [ ([x,y,z], index), ... ]
        psl_numeric = [[pt.X, pt.Y, pt.Z] for pt in psl_points]

        for (sample_pt_3d, orig_index) in samples:
            # 1) Query stress
            stress_val = get_stress_value(sample_pt_3d,kd_tree, stress_values)
            # 2) Compute dynamic offset e.g. offset = bar_capacity / stress_val, clamped
            if stress_val < 1e-6:
                continue
            raw_offset = 1.5 / stress_val#2.22
            #print(raw_offset)
            

            dyn_offset = min(raw_offset, 0.2) 
            #print(f"dyn_offset: {dyn_offset}")
            if dyn_offset < collision_threshold:
                print("Warning: Needed offset is smaller than collision_threshold -> Choose higher rebar diameter")
                warning = "Warning: Needed offset is smaller than collision_threshold -> Choose higher rebar diameter"
            if dyn_offset > 0.1:
                print(11111111111111111111111111111111111111111111111111111111111)

            # 3) Generate offset candidates
            cand1, cand2 = offset_seed(psl_numeric, orig_index, dyn_offset, domain_surface)
            for c in [cand1, cand2]:
                if c is not None:
                    # Use negative stress as priority => max stress first
                    heapq.heappush(candidate_queue, (-stress_val, c))

    # 2) Initialize a global priority queue for seeds
    candidate_queue = []
    # Sample the initial PSL, push seeds
    add_candidates_from_psl(initial_psl, sample_interval)

    # 3) Process the global priority queue
    while candidate_queue:
        neg_stress, candidate_3d = heapq.heappop(candidate_queue)
        s_val = -neg_stress

        # Check if candidate is valid: 
        #   1) not too close to existing PSLs
        #   2) not too close to domain boundary if you do so in is_valid_seed
        #   3) optionally: on surface, etc.
        if not is_valid_seed(candidate_3d, all_psls, min_seed_distance, boundary_curves, 0.1):
            continue

        positive_candidates.append(candidate_3d)
        # Now trace a PSL from this candidate
        new_psl, new_bridges, new_edges = trace_psl_both_directions(
            seed_point_3d=candidate_3d,
            h=h,
            num_steps=num_steps,
            k=k,
            principal_vectors=principal_vectors,
            points_3d=points_3d,
            boundary_curves=boundary_curves,
            boundary_tolerance=0.01,
            existing_trajectories=all_psls,
            collision_threshold=collision_threshold,
            kd_tree=kd_tree
        )
        new_curve = build_polyline_curve_3d(new_psl)
        all_psls.append((new_psl, new_curve))
        if new_bridges:
            bridging_lines.extend(new_bridges)

        if new_edges:
            edges.extend(new_edges)

        # Immediately sample the new PSL => add new seeds
        add_candidates_from_psl(new_psl, sample_interval)

    return all_psls, bridging_lines, positive_candidates, edges


# --- Example Main Routine in Grasshopper ---
def to_xyz(pt_or_vec):
    """Converts Rhino.Geometry.Point3d or Vector3d (or numeric [x,y,z]) to a Python list [x, y, z]."""
    if hasattr(pt_or_vec, "X"):
        return [pt_or_vec.X, pt_or_vec.Y, pt_or_vec.Z]
    else:
        # Already [x,y,z]
        return [pt_or_vec[0], pt_or_vec[1], pt_or_vec[2]]

# Suppose 'points' is a list of 3D points from Grasshopper input,
# and 'principal_vectors' is a matching list of 3D vectors.
# We'll build a KDTree in 3D:
points_array_3d = [to_xyz(pt) for pt in points]
points_np = np.array(points_array_3d)  # shape (N, 3)
kd_tree = KDTree(points_np)

# If your 'seed_points' input is also 3D, pick the first as initial:
initial_seed_3d = to_xyz(seed_points[0])

# Convert principal_vectors to [vx,vy,vz]
principal_vectors_3d = [to_xyz(vec) for vec in principal_vectors]

# We'll store the domain surface or Brep for offset + boundary checks
# If you are passing a Rhino surface or a single-face Brep from GH, you can just keep it:
domain_srf_or_brep = domain_surface

boundary_curves = boundary_curves

# Parameters (exposed as GH inputs or hard-coded here)
h = 0.05
num_steps = 700
k = 25
collision_threshold = 0.04
sample_interval = 1
offset_distance = 0.1
min_seed_distance = 0.06
bar_capacity = 0.02

# ----------------------------------------------------------------------
# CALL YOUR 3D PSL GENERATION FUNCTION
# ----------------------------------------------------------------------




all_psls, bridging_lines, positive_candidates,edges = generate_all_psls_3d(
    initial_seed_3d,
    h,
    num_steps,
    k,
    principal_vectors_3d,   # 3D vectors
    points_array_3d,        # 3D points
    kd_tree,
    boundary_curves,
    collision_threshold,
    sample_interval,
    min_seed_distance,
    stress_values

)

# `all_psls` is a list of (psl_points_3d, polyline_curve_3d)
# bridging_lines is a list of short bridging segments
# positive_candidates is a list of 3D seed coords that were actually used

# ----------------------------------------------------------------------
# PREPARE OUTPUTS FOR GH
# ----------------------------------------------------------------------
# 1) PSL polylines as GH curves
psl_curves = [psl_curve for (psl_points, psl_curve) in all_psls]

# 2) Bridging lines. If each bridging_line is [ptA, ptB], you might convert to GH lines or polylines
# For simplicity we just pass them out as is, or build lines:
# bridging_line_curves = []
# for bl in bridging_lines:
#     ptA, ptB = bl
#     bridging_line_curves.append(rg.Line(rg.Point3d(*ptA), rg.Point3d(*ptB)))

# 3) Convert positive_candidates to Point3d
generated_seed_points = [rg.Point3d(pc[0], pc[1], pc[2]) for pc in positive_candidates]
from ghpythonlib import treehelpers as tr
# 4) Finally set GH outputs (A, B, C, e.g.)
a = tr.list_to_tree(psl_curves)
b = tr.list_to_tree(bridging_lines)
w = tr.list_to_tree(generated_seed_points)
c = tr.list_to_tree(edges)
# ---------- end tracer_automatic_3d_self_single_loop_for_3 ----------
psl_3 = Curve(tracer_automatic_3d_self_single_loop_for_3.a)
pline_5 = PolyLine(Vertices=tracer_automatic_3d_self_single_loop_for_3.b, Closed=False)  # -> flatten(Polyline)
generated_seeds_4 = Point(tracer_automatic_3d_self_single_loop_for_3.w)

pline_6 = PolyLine(Vertices=tracer_automatic_3d_self_single_loop_for_3.c, Closed=False)  # -> flatten(Polyline)
textdot_5 = DefineTextDot(Text=s_forces_6.Mxx_kNm_m, Location=shellvecresults_5.Points, Font="Arial", Size=8)  # disabled
panel_15 = Panel("0.13")  # disabled
panel_16 = Panel("0.07")  # disabled
explode_6 = Explode(Curve=psl_2, Recursive=True)  # -> Segments, Vertices; disabled
join_3 = JoinCurves(Curves=flatten([psl_2, pline_4]), Preserve=False)  # disabled
panel_17 = Panel("0.13")  # disabled
panel_18 = Panel("0.07")  # disabled
generated_seeds_5 = Point(generated_seeds_3)  # disabled
lng_2 = ListLength(List=generated_seeds_5)  # disabled
panel_19 = Panel(lng_2)  # disabled
dom_2 = ConstructDomain(DomainStart=0, DomainEnd=expr("x-1", lng_2))  # disabled
textdot_6 = DefineTextDot(Text=shellvecresults_4.SecondPrincipalMomentValue_kN, Location=shellvecresults_4.Points, Font="Arial", Size=14)  # disabled
reb = RebuildCurve(Curve=join_2, Count=60, Tangents=False)
range_2 = Range(Domain=dom_2, Steps=expr("x-1", lng_2))  # disabled
gradient_2 = Gradient(
    LowerLimit=panel_14,
    UpperLimit=panel_19,
    Parameter=range_2,
    stops=[0: RGB(79, 61, 188), 0: RGB(157, 187, 170), 0.00817: RGB(0, 128, 0), 0.413: RGB(128, 255, 128), 0.699: RGB(255, 128, 0), 0.938: RGB(220, 0, 40)])  # disabled
swatch = ColourSwatch(SwatchColor=RGB(5, 5, 5))  # disabled
stress_distribution_3 = Python3Script(
    C=crv_5,
    Pts=shellvecresults_3.Points,
    V=vlen_2,
    minVec=dedomain_2.Start,
    maxVec=dedomain_2.End,
    minStep=panel_17,
    maxStep=panel_18)  # -> out, a, b; inputs C: Curve, Pts: list of Point3d, V: list of Double, minVec: Double, maxVec: Double, minStep: Double, maxStep: Double; disabled; same code as stress_distribution
stress_distribution_4 = Python3Script(
    C=crv_3,
    Pts=shellvecresults_3.Points,
    V=vlen_2,
    minVec=dedomain_2.Start,
    maxVec=dedomain_2.End,
    minStep=panel_15,
    maxStep=panel_16)  # -> out, a, b; inputs C: Curve, Pts: list of Point3d, V: list of Double, minVec: Double, maxVec: Double, minStep: Double, maxStep: Double; disabled; same code as stress_distribution
explode_7 = Explode(Curve=psl_3, Recursive=True)  # -> Segments, Vertices
join_4 = JoinCurves(Curves=flatten([psl_3, pline_6]), Preserve=False)
generated_seeds_6 = Point(generated_seeds_4)
lng_3 = ListLength(List=generated_seeds_6)
panel_20 = Panel(lng_3)
dom_3 = ConstructDomain(DomainStart=0, DomainEnd=expr("x-1", lng_3))
textdot_7 = DefineTextDot(Text=shellvecresults_6.SecondPrincipalMomentValue_kN, Location=shellvecresults_6.Points, Font="Arial", Size=14)
range_3 = Range(Domain=dom_3, Steps=expr("x-1", lng_3))
gradient_3 = Gradient(
    LowerLimit="0",
    UpperLimit=panel_20,
    Parameter=range_3,
    stops=[0: RGB(79, 61, 188), 0: RGB(157, 187, 170), 0.00817: RGB(0, 128, 0), 0.413: RGB(128, 255, 128), 0.699: RGB(255, 128, 0), 0.938: RGB(220, 0, 40)])
swatch_2 = ColourSwatch(SwatchColor=RGB(5, 5, 5))
stress_distribution_5 = Python3Script(
    C=crv_7,
    Pts=shellvecresults_5.Points,
    V=vlen_3,
    minVec=dedomain_3.Start,
    maxVec=dedomain_3.End,
    minStep="0.13",
    maxStep="0.07")  # -> out, a, b; inputs C: Curve, Pts: list of Point3d, V: list of Double, minVec: Double, maxVec: Double, minStep: Double, maxStep: Double; same code as stress_distribution
stress_distribution_6 = Python3Script(
    C=crv_6,
    Pts=shellvecresults_5.Points,
    V=vlen_3,
    minVec=dedomain_3.Start,
    maxVec=dedomain_3.End,
    minStep="0.13",
    maxStep="0.07")  # -> out, a, b; inputs C: Curve, Pts: list of Point3d, V: list of Double, minVec: Double, maxVec: Double, minStep: Double, maxStep: Double; same code as stress_distribution
shelllineresults_4 = LineResultsOnShellsKaramba3D(
    AnalysedModel=shellview.Model,
    LayerPosition=-1,
    ListOfSourcesOfPrincipalStressLinesLinesPoints=cull_i_8,
    SegmentLength_m=0.5,
    DA_deg=5,
    mode="PrincStress")  # -> Model, Lines1, Lines2
shelllineresults_5 = LineResultsOnShellsKaramba3D(
    AnalysedModel=shellview.Model,
    LayerPosition=-1,
    ListOfSourcesOfPrincipalStressLinesLinesPoints=cull_i_7,
    SegmentLength_m=0.5,
    DA_deg=5,
    mode="PrincStress")  # -> Model, Lines1, Lines2
pt_8 = Point(stress_distribution_4.a)  # disabled
pt_9 = Point(stress_distribution_3.a)  # disabled
explode_8 = Explode(Curve=reb, Recursive=True)  # -> Segments, Vertices
textdot_8 = DefineTextDot(Text=range_2, Location=generated_seeds_5, Font="Arial", Size=9)  # disabled
tag_2 = TextTag3D(Location=generated_seeds_5, Text=range_2, Size=0.05, Colour=swatch, Justification=8)  # disabled
cull_i_9 = CullIndex(List=pt_9, Indices=0, Wrap=True)  # disabled
cull_i_10 = CullIndex(List=pt_8, Indices=[0, -1], Wrap=True)  # disabled
pt_10 = Point(stress_distribution_6.a)
pt_11 = Point(stress_distribution_5.a)
join_5 = JoinCurves(Curves=join_3, Preserve=False)  # disabled
textdot_9 = DefineTextDot(Text=range_3, Location=generated_seeds_6, Font="Arial", Size=9)
tag_3 = TextTag3D(Location=generated_seeds_6, Text=range_3, Size=0.05, Colour=gradient_3, Justification=8)
cull_i_11 = CullIndex(List=pt_11, Indices=0, Wrap=True)
cull_i_12 = CullIndex(List=pt_10, Indices=[0, -1], Wrap=True)
crv_16 = Curve(shelllineresults_4.Lines1)
crv_17 = Curve(shelllineresults_5.Lines1)
join_6 = JoinCurves(Curves=join_4, Preserve=False)
popgeo_4 = PopulateGeometry(Count=100, Seed=1)  # disabled
join_7 = JoinCurves(Curves=crv_16, Preserve=False)  # -> flatten(Curves)
join_8 = JoinCurves(Curves=crv_17, Preserve=False)  # -> flatten(Curves)
reb_2 = RebuildCurve(Curve=join_5, Count=60, Tangents=False)  # disabled
join_9 = JoinCurves(Curves=join_7, Preserve=False)
join_10 = JoinCurves(Curves=join_8, Preserve=False)
reb_3 = RebuildCurve(Curve=join_6, Count=60, Tangents=False)
shelllineresults_6 = LineResultsOnShellsKaramba3D(
    AnalysedModel=shellview_2.Model,
    LayerPosition=-1,
    ListOfSourcesOfPrincipalStressLinesLinesPoints=cull_i_10,
    SegmentLength_m=0.5,
    DA_deg=5,
    mode="PrincStress")  # -> Model, Lines1, Lines2; disabled
shelllineresults_7 = LineResultsOnShellsKaramba3D(
    AnalysedModel=shellview_2.Model,
    LayerPosition=-1,
    ListOfSourcesOfPrincipalStressLinesLinesPoints=cull_i_9,
    SegmentLength_m=0.5,
    DA_deg=5,
    mode="PrincStress")  # -> Model, Lines1, Lines2; disabled
explode_9 = Explode(Curve=reb_2, Recursive=True)  # -> Segments, Vertices; disabled
reb_4 = RebuildCurve(Curve=join_9, Count=60, Tangents=False)
reb_5 = RebuildCurve(Curve=join_10, Count=60, Tangents=False)
shelllineresults_8 = LineResultsOnShellsKaramba3D(
    AnalysedModel=shellview_3.Model,
    LayerPosition=-1,
    ListOfSourcesOfPrincipalStressLinesLinesPoints=merge_3,
    SegmentLength_m=0.5,
    DA_deg=5,
    mode="PrincStress")  # -> Model, Lines1, Lines2
shelllineresults_9 = LineResultsOnShellsKaramba3D(
    AnalysedModel=shellview_3.Model,
    LayerPosition=-1,
    ListOfSourcesOfPrincipalStressLinesLinesPoints=merge_3,
    SegmentLength_m=0.5,
    DA_deg=5,
    mode="PrincStress")  # -> Model, Lines1, Lines2
explode_10 = Explode(Curve=reb_3, Recursive=True)  # -> Segments, Vertices
crv_18 = Curve(shelllineresults_6.Lines2)  # disabled
crv_19 = Curve(shelllineresults_7.Lines1)  # disabled
explode_11 = Explode(Curve=reb_5, Recursive=True)  # -> Segments, Vertices
explode_12 = Explode(Curve=reb_4, Recursive=True)  # -> Segments, Vertices
join_11 = JoinCurves(Curves=crv_18, Preserve=False)  # -> flatten(Curves); disabled
join_12 = JoinCurves(Curves=crv_19, Preserve=False)  # -> flatten(Curves); disabled
crv_20 = Curve(shelllineresults_8.Lines1)
pt_12 = Point(flatten(explode_8.Vertices))
crv_21 = Curve(shelllineresults_9.Lines1)
panel_21 = Panel("0.05")
pt_13 = Point(flatten([explode_12.Vertices, explode_11.Vertices]))
join_13 = JoinCurves(Curves=join_11, Preserve=False)  # disabled
join_14 = JoinCurves(Curves=join_12, Preserve=False)  # disabled
join_15 = JoinCurves(Curves=crv_20, Preserve=False)  # -> flatten(Curves)
join_16 = JoinCurves(Curves=crv_21, Preserve=False)  # -> flatten(Curves)
mesh_breps = MeshBrepsKaramba3D(
    Brep=boundary,
    InclusionPoints=pt_12,
    MeshResolution=0.1,
    EdgeRefinementFactor=0.67,
    PointReduction=False,
    SmoothingStepSize=1,
    SmoothingIterations=5)  # -> Mesh, Info
join_17 = JoinCurves(Curves=join_15, Preserve=False)
join_18 = JoinCurves(Curves=join_16, Preserve=False)
relay = Relay([reb_5, reb_4])
reb_6 = RebuildCurve(Curve=join_13, Count=60, Tangents=False)  # disabled
reb_7 = RebuildCurve(Curve=join_14, Count=60, Tangents=False)  # disabled
reb_8 = RebuildCurve(Curve=join_17, Count=60, Tangents=False)
reb_9 = RebuildCurve(Curve=join_18, Count=60, Tangents=False)
explode_13 = Explode(Curve=reb_7, Recursive=True)  # -> Segments, Vertices; disabled
explode_14 = Explode(Curve=reb_6, Recursive=True)  # -> Segments, Vertices; disabled
matselect_7 = MaterialSelectionKaramba3D(menu=[dropdown(7), dropdown(5)])
Z_7 = UnitZ(Factor=-10)
pt_14 = Point(flatten(explode_9.Vertices))  # disabled
Z_8 = UnitZ(Factor=-1)
matselect_8 = MaterialSelectionKaramba3D(menu=[dropdown(7), dropdown(5)])
explode_15 = Explode(Curve=reb_9, Recursive=True)  # -> Segments, Vertices
panel_22 = Panel("0.05")  # disabled
explode_16 = Explode(Curve=reb_8, Recursive=True)  # -> Segments, Vertices
Z_9 = UnitZ(Factor=-10)
pt_15 = Point(flatten([explode_14.Vertices, explode_13.Vertices]))  # disabled
Z_10 = UnitZ(Factor=-1)
matselect_9 = MaterialSelectionKaramba3D(menu=[dropdown(7), dropdown(5)])
loads_7 = LoadsKaramba3D(Vector=Z_8, LCase="LC0", mode="Gravity")
matselect_10 = MaterialSelectionKaramba3D(menu=[dropdown(7), dropdown(5)])
loads_8 = LoadsKaramba3D(Vector=Z_7, Mesh=mesh_breps.Mesh, LCase="LC0", mode="MeshLoad -Const.", menu=[buttons(off, on, off), buttons(on, on)])
pt_16 = Point(flatten(explode_10.Vertices))
mesh_breps_2 = MeshBrepsKaramba3D(
    Brep=boundary_2,
    InclusionPoints=pt_14,
    MeshResolution=0.1,
    EdgeRefinementFactor=0.67,
    PointReduction=False,
    SmoothingStepSize=1,
    SmoothingIterations=5)  # -> Mesh, Info; disabled
loads_9 = LoadsKaramba3D(Vector=Z_10, LCase="LC0", mode="Gravity")
pt_17 = Point(flatten([explode_16.Vertices, explode_15.Vertices]))
crv_22 = Curve(flatten(reb))
relay_2 = Relay([reb_7, reb_6])  # disabled
crv_23 = Curve(flatten([reb_4, reb_5]))
crosec_4 = CrossSectionKaramba3D(
    FamilyNameOfCrossSection="DefaultCroSec",
    Material=matselect_7,
    Height_cm="20",
    UpperFlangeWidth_cm="2",
    LowerFlangeWidth_cm="2",
    mode="Trapezoid")
mesh_breps_3 = MeshBrepsKaramba3D(
    Brep=boundary_3,
    InclusionPoints=pt_16,
    MeshResolution=0.1,
    EdgeRefinementFactor=0.67,
    PointReduction=False,
    SmoothingStepSize=1,
    SmoothingIterations=5)  # -> Mesh, Info
crosec_5 = CrossSectionKaramba3D(
    FamilyNameOfCrossSection="DefaultCroSec",
    Material=matselect_8,
    Height_cm="20",
    UpperFlangeWidth_cm="2",
    LowerFlangeWidth_cm="2",
    mode="Trapezoid")
crosec_6 = CrossSectionKaramba3D(FamilyNameOfCrossSection="DefaultCroSec", Material=matselect_9, Height_cm="10", mode="Shell - Const")
relay_3 = Relay([reb_9, reb_8])
crosec_7 = CrossSectionKaramba3D(FamilyNameOfCrossSection="DefaultCroSec", Material=matselect_10, Height_cm="10", mode="Shell - Const")
load_4 = LoadKaramba3D(flatten([loads_7, loads_8]))
matselect_11 = MaterialSelectionKaramba3D(menu=[dropdown(7), dropdown(5)])  # disabled
Z_11 = UnitZ(Factor=-10)  # disabled
Z_12 = UnitZ(Factor=-1)  # disabled
lineelem = CreateLinearElementKaramba3D(
    Line=crv_22,
    Identifier="rib",
    CrossSection=crosec_4,
    LimitDistance_m=0.005,
    BucklingLengthY_m=-1,
    BucklingLengthZ_m=-1,
    BucklingLengthLT_m=-1,
    Bending=True,
    ToPolylineMaxAngle=0.25,
    ToPolylineTolerance=0.1,
    ToPolylineMaxEdgeLength=0.25,
    New=True,
    Remove=True,
    mode="LineToBeam")  # -> Element, Points, Info
matselect_12 = MaterialSelectionKaramba3D(menu=[dropdown(7), dropdown(5)])  # disabled
matselect_13 = MaterialSelectionKaramba3D(menu=[dropdown(7), dropdown(5)])  # disabled
Z_13 = UnitZ(Factor=-10)  # disabled
Z_14 = UnitZ(Factor=-1)  # disabled
lineelem_2 = CreateLinearElementKaramba3D(
    Line=crv_23,
    Identifier="rib",
    CrossSection=crosec_5,
    LimitDistance_m=0.005,
    BucklingLengthY_m=-1,
    BucklingLengthZ_m=-1,
    BucklingLengthLT_m=-1,
    Bending=True,
    ToPolylineMaxAngle=0.25,
    ToPolylineTolerance=0.1,
    ToPolylineMaxEdgeLength=0.25,
    New=True,
    Remove=True,
    mode="LineToBeam")  # -> Element, Points, Info
matselect_14 = MaterialSelectionKaramba3D(menu=[dropdown(7), dropdown(5)])  # disabled
surfelem_4 = CreateSurfaceElementKaramba3D(Mesh=mesh_breps.Mesh, CrossSection=crosec_6, LimitDistance_m=0.005, Bending=True, mode="MeshToShell")  # -> Element, Points, Info
matselect_15 = MaterialSelectionKaramba3D(menu=[dropdown(7), dropdown(5)])
loads_10 = LoadsKaramba3D(Vector=Z_12, LCase="LC0", mode="Gravity")  # disabled
loads_11 = LoadsKaramba3D(Vector=Z_11, Mesh=mesh_breps_2.Mesh, LCase="LC0", mode="MeshLoad -Const.", menu=[buttons(off, on, off), buttons(on, on)])  # disabled
Z_15 = UnitZ(Factor=expr("x/-2", "20"))
Z_16 = UnitZ(Factor=-10)
Z_17 = UnitZ(Factor=-1)
panel_24 = Panel("2")  # disabled
panel_25 = Panel("20")  # disabled
matselect_16 = MaterialSelectionKaramba3D(menu=[dropdown(7), dropdown(5)])
loads_12 = LoadsKaramba3D(Vector=Z_14, LCase="LC0", mode="Gravity")  # disabled
matselect_17 = MaterialSelectionKaramba3D(menu=[dropdown(7), dropdown(5)])
Z_18 = UnitZ(Factor=expr("x/-2", "20"))
Z_19 = UnitZ(Factor=-10)
Z_20 = UnitZ(Factor=-1)
panel_26 = Panel("2")  # disabled
panel_27 = Panel("20")  # disabled
crv_24 = Curve(flatten(reb_2))  # disabled
matselect_18 = MaterialSelectionKaramba3D(menu=[dropdown(7), dropdown(5)])
loads_13 = LoadsKaramba3D(Vector=Z_17, LCase="LC0", mode="Gravity")
loads_14 = LoadsKaramba3D(Vector=Z_16, Mesh=mesh_breps_3.Mesh, LCase="LC0", mode="MeshLoad -Const.", menu=[buttons(off, on, off), buttons(on, on)])
crv_25 = Curve(flatten([reb_6, reb_7]))  # disabled
panel_28 = Panel("10")  # disabled
crosec_8 = CrossSectionKaramba3D(
    FamilyNameOfCrossSection="DefaultCroSec",
    Material=matselect_11,
    Height_cm=panel_25,
    UpperFlangeWidth_cm=panel_24,
    LowerFlangeWidth_cm=panel_24,
    mode="Trapezoid")  # disabled
eccent_beam = EccentricityOnBeamKaramba3D(Beam=lineelem.Element, GlobalEccentricity_cm=Z_15)
loads_15 = LoadsKaramba3D(Vector=Z_20, LCase="LC0", mode="Gravity")
panel_29 = Panel("10")  # disabled
crosec_9 = CrossSectionKaramba3D(
    FamilyNameOfCrossSection="DefaultCroSec",
    Material=matselect_12,
    Height_cm=panel_27,
    UpperFlangeWidth_cm=panel_26,
    LowerFlangeWidth_cm=panel_26,
    mode="Trapezoid")  # disabled
eccent_beam_2 = EccentricityOnBeamKaramba3D(Beam=lineelem_2.Element, GlobalEccentricity_cm=Z_18)
crosec_10 = CrossSectionKaramba3D(FamilyNameOfCrossSection="DefaultCroSec", Material=matselect_13, Height_cm=panel_28, mode="Shell - Const")  # disabled
crv_26 = Curve(flatten(reb_3))
crosec_11 = CrossSectionKaramba3D(FamilyNameOfCrossSection="DefaultCroSec", Material=matselect_14, Height_cm=panel_29, mode="Shell - Const")  # disabled
crv_27 = Curve(flatten([reb_8, reb_9]))
crosec_12 = CrossSectionKaramba3D(
    FamilyNameOfCrossSection="DefaultCroSec",
    Material=matselect_15,
    Height_cm="20",
    UpperFlangeWidth_cm="2",
    LowerFlangeWidth_cm="2",
    mode="Trapezoid")
load_5 = LoadKaramba3D(flatten([loads_10, loads_11]))  # disabled
panel_30 = Panel("rib")  # disabled
crosec_13 = CrossSectionKaramba3D(
    FamilyNameOfCrossSection="DefaultCroSec",
    Material=matselect_16,
    Height_cm="20",
    UpperFlangeWidth_cm="2",
    LowerFlangeWidth_cm="2",
    mode="Trapezoid")
crosec_14 = CrossSectionKaramba3D(FamilyNameOfCrossSection="DefaultCroSec", Material=matselect_17, Height_cm="10", mode="Shell - Const")
panel_31 = Panel("rib")  # disabled
assemble_4 = AssembleModelKaramba3D(Elem=flatten([surfelem_4.Element, eccent_beam]), Support=flatten(supp), Load=flatten(load_4), LimitDistance_m=0.005)  # -> Model, Info, Mass_kg, CentreOfGravity, LoadCaseNames
crosec_15 = CrossSectionKaramba3D(FamilyNameOfCrossSection="DefaultCroSec", Material=matselect_18, Height_cm="10", mode="Shell - Const")
lineelem_3 = CreateLinearElementKaramba3D(
    Line=crv_24,
    Identifier=panel_30,
    CrossSection=crosec_8,
    LimitDistance_m=0.005,
    BucklingLengthY_m=-1,
    BucklingLengthZ_m=-1,
    BucklingLengthLT_m=-1,
    Bending=True,
    ToPolylineMaxAngle=0.25,
    ToPolylineTolerance=0.1,
    ToPolylineMaxEdgeLength=0.25,
    New=True,
    Remove=True,
    mode="LineToBeam")  # -> Element, Points, Info; disabled
load_6 = LoadKaramba3D(flatten([loads_13, loads_14]))
lineelem_4 = CreateLinearElementKaramba3D(
    Line=crv_25,
    Identifier=panel_31,
    CrossSection=crosec_9,
    LimitDistance_m=0.005,
    BucklingLengthY_m=-1,
    BucklingLengthZ_m=-1,
    BucklingLengthLT_m=-1,
    Bending=True,
    ToPolylineMaxAngle=0.25,
    ToPolylineTolerance=0.1,
    ToPolylineMaxEdgeLength=0.25,
    New=True,
    Remove=True,
    mode="LineToBeam")  # -> Element, Points, Info; disabled
surfelem_5 = CreateSurfaceElementKaramba3D(Mesh=mesh_breps_2.Mesh, CrossSection=crosec_10, LimitDistance_m=0.005, Bending=True, mode="MeshToShell")  # -> Element, Points, Info; disabled
Z_21 = UnitZ(Factor=expr("x/-2", panel_25))  # disabled
lineelem_5 = CreateLinearElementKaramba3D(
    Line=crv_26,
    Identifier="rib",
    CrossSection=crosec_12,
    LimitDistance_m=0.005,
    BucklingLengthY_m=-1,
    BucklingLengthZ_m=-1,
    BucklingLengthLT_m=-1,
    Bending=True,
    ToPolylineMaxAngle=0.25,
    ToPolylineTolerance=0.1,
    ToPolylineMaxEdgeLength=0.25,
    New=True,
    Remove=True,
    mode="LineToBeam")  # -> Element, Points, Info
Z_22 = UnitZ(Factor=expr("x/-2", panel_27))  # disabled
lineelem_6 = CreateLinearElementKaramba3D(
    Line=crv_27,
    Identifier="rib",
    CrossSection=crosec_13,
    LimitDistance_m=0.005,
    BucklingLengthY_m=-1,
    BucklingLengthZ_m=-1,
    BucklingLengthLT_m=-1,
    Bending=True,
    ToPolylineMaxAngle=0.25,
    ToPolylineTolerance=0.1,
    ToPolylineMaxEdgeLength=0.25,
    New=True,
    Remove=True,
    mode="LineToBeam")  # -> Element, Points, Info
analyse_4 = AnalyseKaramba3D(Model=assemble_4.Model)  # -> AnalysedModel, MaximumDisplacement_cm, ResultingForce_kN, ChangeOfElasticEnergy_kNm
surfelem_6 = CreateSurfaceElementKaramba3D(Mesh=mesh_breps_3.Mesh, CrossSection=crosec_14, LimitDistance_m=0.005, Bending=True, mode="MeshToShell")  # -> Element, Points, Info
modelview_4 = ModelViewKaramba3D(Model=analyse_4.AnalysedModel)  # -> Model, DeformedMesh, DeformedAxes, DeformedModel, MaximumDeformation
Z_23 = UnitZ(Factor=expr("x/-2", "20"))
eccent_beam_3 = EccentricityOnBeamKaramba3D(Beam=lineelem_3.Element, GlobalEccentricity_cm=Z_21)  # disabled
mesh_breps_4 = MeshBrepsKaramba3D(
    Brep=boundary,
    InclusionPoints=pt_13,
    MeshResolution="0.05",
    EdgeRefinementFactor=0.67,
    PointReduction=False,
    SmoothingStepSize=1,
    SmoothingIterations=5)  # -> Mesh, Info
loads_16 = LoadsKaramba3D(Vector=Z_9, Mesh=mesh_breps_4.Mesh, LCase="LC0", mode="MeshLoad -Const.", menu=[buttons(off, on, off), buttons(on, on)])
load_7 = LoadKaramba3D(flatten([loads_9, loads_16]))
surfelem_7 = CreateSurfaceElementKaramba3D(Mesh=mesh_breps_4.Mesh, CrossSection=crosec_7, LimitDistance_m=0.005, Bending=True, mode="MeshToShell")  # -> Element, Points, Info
assemble_5 = AssembleModelKaramba3D(Elem=flatten([surfelem_7.Element, eccent_beam_2]), Support=flatten(supp), Load=flatten(load_7), LimitDistance_m=0.005)  # -> Model, Info, Mass_kg, CentreOfGravity, LoadCaseNames
analyse_5 = AnalyseKaramba3D(Model=assemble_5.Model, LoadCases="LC0")  # -> AnalysedModel, MaximumDisplacement_cm, ResultingForce_kN, ChangeOfElasticEnergy_kNm
react = ReactionForcesKaramba3D(AnalysedModel=analyse_5.AnalysedModel)  # -> Model, flatten(ReactionForces_kN), ReactionMoments_kNm, SupportPosition, SumOfReactionForces_kN, SumOfReactionMoments_kNm, GoverningLoadCaseIndex
modelview_5 = ModelViewKaramba3D(Model=analyse_5.AnalysedModel)  # -> Model, DeformedMesh, DeformedAxes, DeformedModel, MaximumDeformation
Z_24 = UnitZ(Factor=expr("x/-2", "20"))
eccent_beam_4 = EccentricityOnBeamKaramba3D(Beam=lineelem_4.Element, GlobalEccentricity_cm=Z_22)  # disabled
rec = DataRecorder(analyse_5.MaximumDisplacement_cm, DataLimit=-10, RecordData=True)
rec_2 = DataRecorder(analyse_5.ChangeOfElasticEnergy_kNm, DataLimit=-10, RecordData=True)
eccent_beam_5 = EccentricityOnBeamKaramba3D(Beam=lineelem_5.Element, GlobalEccentricity_cm=Z_23)
eccent_beam_6 = EccentricityOnBeamKaramba3D(Beam=lineelem_6.Element, GlobalEccentricity_cm=Z_24)
beamview = BeamViewKaramba3D(Model=modelview_4.Model)  # -> Model, MeshesOfRenderedBeams, DeformedBeamAxes, LegendColours, LegendTags
assemble_6 = AssembleModelKaramba3D(Elem=flatten([surfelem_5.Element, eccent_beam_3]), Support=flatten(supp_2), Load=flatten(load_5), LimitDistance_m=0.005)  # -> Model, Info, Mass_kg, CentreOfGravity, LoadCaseNames; disabled
beamview_2 = BeamViewKaramba3D(Model=modelview_5.Model)  # -> Model, MeshesOfRenderedBeams, DeformedBeamAxes, LegendColours, LegendTags
panel_32 = Panel(rec_2)
panel_33 = Panel(rec)
panel_34 = Panel("rib")  # disabled
assemble_7 = AssembleModelKaramba3D(Elem=flatten([surfelem_6.Element, eccent_beam_5]), Support=flatten(supp_3), Load=flatten(load_6), LimitDistance_m=0.005)  # -> Model, Info, Mass_kg, CentreOfGravity, LoadCaseNames
panel_35 = Panel("rib")  # disabled
panel_36 = Panel("LC0")  # disabled
legend_4 = Legend(Colour=beamview.LegendColours, Tags=beamview.LegendTags, LegendType=1)
utilization = UtilizationOfElementsKaramba3D(
    AnalysedModel=beamview.Model,
    ElementsIdentifiers="rib",
    NumberOfSamplePoints=3,
    ElasticDesign=True,
    GammaM0=1,
    GammaM1=1.1,
    SwayFrame=True,
    WithDetails=False,
    mode="Beams")  # -> Model, Utilization, SigMax_kN_cm², SigMin_kN_cm², TauMax_kN_cm², UtilN, UtilVy, UtilVz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
shellview_4 = ShellViewKaramba3D(Model=modelview_4.Model, IndexOfLayer=0)  # -> Model, MeshesOfRenderedShells, LegendColours, LegendTags
shellview_5 = ShellViewKaramba3D(Model=modelview_5.Model, IndexOfLayer=0)  # -> Model, MeshesOfRenderedShells, LegendColours, LegendTags
analyse_6 = AnalyseKaramba3D(Model=assemble_6.Model)  # -> AnalysedModel, MaximumDisplacement_cm, ResultingForce_kN, ChangeOfElasticEnergy_kNm; disabled
modelview_6 = ModelViewKaramba3D(Model=analyse_6.AnalysedModel)  # -> Model, DeformedMesh, DeformedAxes, DeformedModel, MaximumDeformation; disabled
legend_5 = Legend(Colour=beamview_2.LegendColours, Tags=beamview_2.LegendTags, LegendType=101)
utilization_2 = UtilizationOfElementsKaramba3D(
    AnalysedModel=beamview_2.Model,
    ElementsIdentifiers="rib",
    NumberOfSamplePoints=3,
    ElasticDesign=True,
    GammaM0=1,
    GammaM1=1.1,
    SwayFrame=True,
    WithDetails=False,
    mode="Beams")  # -> Model, flatten(Utilization), SigMax_kN_cm², SigMin_kN_cm², TauMax_kN_cm², flatten(UtilN), UtilVy, UtilVz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
panel_37 = Panel("0.05")  # disabled
mesh_breps_5 = MeshBrepsKaramba3D(
    Brep=boundary_2,
    InclusionPoints=pt_15,
    MeshResolution=panel_37,
    EdgeRefinementFactor=0.67,
    PointReduction=False,
    SmoothingStepSize=1,
    SmoothingIterations=5)  # -> Mesh, Info; disabled
loads_17 = LoadsKaramba3D(Vector=Z_13, Mesh=mesh_breps_5.Mesh, LCase="LC0", mode="MeshLoad -Const.", menu=[buttons(off, on, off), buttons(on, on)])  # disabled
load_8 = LoadKaramba3D(flatten([loads_12, loads_17]))  # disabled
surfelem_8 = CreateSurfaceElementKaramba3D(Mesh=mesh_breps_5.Mesh, CrossSection=crosec_11, LimitDistance_m=0.005, Bending=True, mode="MeshToShell")  # -> Element, Points, Info; disabled
assemble_8 = AssembleModelKaramba3D(Elem=flatten([surfelem_8.Element, eccent_beam_4]), Support=flatten(supp_2), Load=flatten(load_8), LimitDistance_m=0.005)  # -> Model, Info, Mass_kg, CentreOfGravity, LoadCaseNames; disabled
analyse_7 = AnalyseKaramba3D(Model=assemble_8.Model, LoadCases=panel_36)  # -> AnalysedModel, MaximumDisplacement_cm, ResultingForce_kN, ChangeOfElasticEnergy_kNm; disabled
react_2 = ReactionForcesKaramba3D(AnalysedModel=analyse_7.AnalysedModel)  # -> Model, flatten(ReactionForces_kN), ReactionMoments_kNm, SupportPosition, SumOfReactionForces_kN, SumOfReactionMoments_kNm, GoverningLoadCaseIndex; disabled
modelview_7 = ModelViewKaramba3D(Model=analyse_7.AnalysedModel)  # -> Model, DeformedMesh, DeformedAxes, DeformedModel, MaximumDeformation; disabled
pt_18 = Point(<point referenced from the Rhino model>)
analyse_8 = AnalyseKaramba3D(Model=assemble_7.Model)  # -> AnalysedModel, MaximumDisplacement_cm, ResultingForce_kN, ChangeOfElasticEnergy_kNm
modelview_8 = ModelViewKaramba3D(Model=analyse_8.AnalysedModel)  # -> Model, DeformedMesh, DeformedAxes, DeformedModel, MaximumDeformation
rec_3 = DataRecorder(analyse_7.MaximumDisplacement_cm, DataLimit=-10, RecordData=True)  # disabled
rec_4 = DataRecorder(analyse_7.ChangeOfElasticEnergy_kNm, DataLimit=-10, RecordData=True)  # disabled
panel_38 = Panel(utilization.SigMax_kN_cm²)
mesh_breps_6 = MeshBrepsKaramba3D(
    Brep=boundary_3,
    InclusionPoints=pt_17,
    MeshResolution="0.05",
    EdgeRefinementFactor=0.67,
    PointReduction=False,
    SmoothingStepSize=1,
    SmoothingIterations=5)  # -> Mesh, Info
loads_18 = LoadsKaramba3D(Vector=Z_19, Mesh=mesh_breps_6.Mesh, LCase="LC0", mode="MeshLoad -Const.", menu=[buttons(off, on, off), buttons(on, on)])
load_9 = LoadKaramba3D(flatten([loads_15, loads_18]))
surfelem_9 = CreateSurfaceElementKaramba3D(Mesh=mesh_breps_6.Mesh, CrossSection=crosec_15, LimitDistance_m=0.005, Bending=True, mode="MeshToShell")  # -> Element, Points, Info
assemble_9 = AssembleModelKaramba3D(Elem=flatten([surfelem_9.Element, eccent_beam_6]), Support=flatten(supp_3), Load=flatten(load_9), LimitDistance_m=0.005)  # -> Model, Info, Mass_kg, CentreOfGravity, LoadCaseNames
analyse_9 = AnalyseKaramba3D(Model=assemble_9.Model, LoadCases="LC0")  # -> AnalysedModel, MaximumDisplacement_cm, ResultingForce_kN, ChangeOfElasticEnergy_kNm
react_3 = ReactionForcesKaramba3D(AnalysedModel=analyse_9.AnalysedModel)  # -> Model, flatten(ReactionForces_kN), ReactionMoments_kNm, SupportPosition, SumOfReactionForces_kN, SumOfReactionMoments_kNm, GoverningLoadCaseIndex
modelview_9 = ModelViewKaramba3D(Model=analyse_9.AnalysedModel)  # -> Model, DeformedMesh, DeformedAxes, DeformedModel, MaximumDeformation
nodedisp = NodalDisplacementsKaramba3D(AnalysedModel=modelview_5.Model, PositionsIndexes=pt_18)  # -> Model, flatten(NodalTranslations_m), NodalRotations_rad, DisplacementPosition, LoadCaseIndex
beamview_3 = BeamViewKaramba3D(Model=modelview_6.Model)  # -> Model, MeshesOfRenderedBeams, DeformedBeamAxes, LegendColours, LegendTags; disabled
bar_graph = BarGraph(utilization.SigMin_kN_cm², BarColor=RGB(255, 0, 90))
bar_graph_2 = BarGraph(utilization.Utilization, BarColor=RGB(255, 0, 90))
panel_39 = Panel(utilization_2.SigMax_kN_cm²)
bar_graph_3 = BarGraph(utilization.SigMax_kN_cm², BarColor=RGB(255, 0, 90))
beamview_4 = BeamViewKaramba3D(Model=modelview_7.Model)  # -> Model, MeshesOfRenderedBeams, DeformedBeamAxes, LegendColours, LegendTags; disabled
b_forces = BeamForcesKaramba3D(Ts=[0, 1])  # -> Model, NormalForce_kN, ShearForceVz_kN, ShearForceVy_kN, TorsionalMomentMt_kNm, BendingMomentMy_kNm, BendingMomentMz_kNm, LoadCaseIndex
bar_graph_4 = BarGraph(utilization_2.SigMin_kN_cm², BarColor=RGB(255, 0, 90))
bar_graph_5 = BarGraph(utilization_2.SigMax_kN_cm², BarColor=RGB(255, 0, 90))
rec_5 = DataRecorder(analyse_9.MaximumDisplacement_cm, DataLimit=-10, RecordData=True)
rec_6 = DataRecorder(analyse_9.ChangeOfElasticEnergy_kNm, DataLimit=-10, RecordData=True)
bar_graph_6 = BarGraph(utilization_2.Utilization, BarColor=RGB(255, 0, 90))
panel_40 = Panel(rec_4)  # disabled
panel_41 = Panel(rec_3)  # disabled
beamview_5 = BeamViewKaramba3D(Model=modelview_8.Model)  # -> Model, MeshesOfRenderedBeams, DeformedBeamAxes, LegendColours, LegendTags
beamview_6 = BeamViewKaramba3D(Model=modelview_9.Model)  # -> Model, MeshesOfRenderedBeams, DeformedBeamAxes, LegendColours, LegendTags
panel_42 = Panel(rec_6)
panel_43 = Panel(rec_5)
legend_6 = Legend(Colour=beamview_3.LegendColours, Tags=beamview_3.LegendTags, LegendType=1)  # disabled
utilization_3 = UtilizationOfElementsKaramba3D(
    AnalysedModel=beamview_3.Model,
    ElementsIdentifiers=panel_34,
    NumberOfSamplePoints=3,
    ElasticDesign=True,
    GammaM0=1,
    GammaM1=1.1,
    SwayFrame=True,
    WithDetails=False,
    mode="Beams")  # -> Model, Utilization, SigMax_kN_cm², SigMin_kN_cm², TauMax_kN_cm², UtilN, UtilVy, UtilVz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; disabled
shellview_6 = ShellViewKaramba3D(Model=modelview_6.Model, IndexOfLayer=0)  # -> Model, MeshesOfRenderedShells, LegendColours, LegendTags; disabled
shellview_7 = ShellViewKaramba3D(Model=modelview_7.Model, IndexOfLayer=0)  # -> Model, MeshesOfRenderedShells, LegendColours, LegendTags; disabled
legend_7 = Legend(Colour=beamview_4.LegendColours, Tags=beamview_4.LegendTags, LegendType=101)  # disabled
utilization_4 = UtilizationOfElementsKaramba3D(
    AnalysedModel=beamview_4.Model,
    ElementsIdentifiers=panel_35,
    NumberOfSamplePoints=3,
    ElasticDesign=True,
    GammaM0=1,
    GammaM1=1.1,
    SwayFrame=True,
    WithDetails=False,
    mode="Beams")  # -> Model, flatten(Utilization), SigMax_kN_cm², SigMin_kN_cm², TauMax_kN_cm², flatten(UtilN), UtilVy, UtilVz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; disabled
textdot_10 = DefineTextDot(Text=nodedisp.NodalTranslations_m, Location=nodedisp.DisplacementPosition, Font="Arial", Size=14)
pt_19 = Point(<point referenced from the Rhino model>)  # disabled
legend_8 = Legend(Colour=beamview_5.LegendColours, Tags=beamview_5.LegendTags, LegendType=1)
utilization_5 = UtilizationOfElementsKaramba3D(
    AnalysedModel=beamview_5.Model,
    ElementsIdentifiers="rib",
    NumberOfSamplePoints=3,
    ElasticDesign=True,
    GammaM0=1,
    GammaM1=1.1,
    SwayFrame=True,
    WithDetails=False,
    mode="Beams")  # -> Model, Utilization, SigMax_kN_cm², SigMin_kN_cm², TauMax_kN_cm², UtilN, UtilVy, UtilVz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
shellview_8 = ShellViewKaramba3D(Model=modelview_8.Model, IndexOfLayer=0)  # -> Model, MeshesOfRenderedShells, LegendColours, LegendTags
shellview_9 = ShellViewKaramba3D(Model=modelview_9.Model, IndexOfLayer=0)  # -> Model, MeshesOfRenderedShells, LegendColours, LegendTags
legend_9 = Legend(Colour=beamview_6.LegendColours, Tags=beamview_6.LegendTags, LegendType=101)
utilization_6 = UtilizationOfElementsKaramba3D(
    AnalysedModel=beamview_6.Model,
    ElementsIdentifiers="rib",
    NumberOfSamplePoints=3,
    ElasticDesign=True,
    GammaM0=1,
    GammaM1=1.1,
    SwayFrame=True,
    WithDetails=False,
    mode="Beams")  # -> Model, flatten(Utilization), SigMax_kN_cm², SigMin_kN_cm², TauMax_kN_cm², flatten(UtilN), UtilVy, UtilVz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
panel_44 = Panel(utilization_3.SigMax_kN_cm²)  # disabled
nodedisp_2 = NodalDisplacementsKaramba3D(AnalysedModel=modelview_7.Model, PositionsIndexes=pt_19)  # -> Model, flatten(NodalTranslations_m), NodalRotations_rad, DisplacementPosition, LoadCaseIndex; disabled
pt_20 = Point(<point referenced from the Rhino model>)
bar_graph_7 = BarGraph(utilization_3.SigMin_kN_cm², BarColor=RGB(255, 0, 90))  # disabled
bar_graph_8 = BarGraph(utilization_3.Utilization, BarColor=RGB(255, 0, 90))  # disabled
bar_graph_9 = BarGraph(utilization_3.SigMax_kN_cm², BarColor=RGB(255, 0, 90))  # disabled
panel_45 = Panel(utilization_4.SigMax_kN_cm²)  # disabled
b_forces_2 = BeamForcesKaramba3D(Ts=[0, 1])  # -> Model, NormalForce_kN, ShearForceVz_kN, ShearForceVy_kN, TorsionalMomentMt_kNm, BendingMomentMy_kNm, BendingMomentMz_kNm, LoadCaseIndex; disabled
bar_graph_10 = BarGraph(utilization_4.SigMin_kN_cm², BarColor=RGB(255, 0, 90))  # disabled
bar_graph_11 = BarGraph(utilization_4.SigMax_kN_cm², BarColor=RGB(255, 0, 90))  # disabled
panel_46 = Panel(utilization_5.SigMax_kN_cm²)
bar_graph_12 = BarGraph(utilization_4.Utilization, BarColor=RGB(255, 0, 90))  # disabled
nodedisp_3 = NodalDisplacementsKaramba3D(AnalysedModel=modelview_9.Model, PositionsIndexes=pt_20)  # -> Model, flatten(NodalTranslations_m), NodalRotations_rad, DisplacementPosition, LoadCaseIndex
bar_graph_13 = BarGraph(utilization_5.SigMin_kN_cm², BarColor=RGB(255, 0, 90))
bar_graph_14 = BarGraph(utilization_5.Utilization, BarColor=RGB(255, 0, 90))
panel_47 = Panel(utilization_6.SigMax_kN_cm²)
bar_graph_15 = BarGraph(utilization_5.SigMax_kN_cm², BarColor=RGB(255, 0, 90))
load_case_classification_component = LoadCaseClassificationComponent(ActionIndex=0, DesignIndex=13, StandardIndex=0, menu=[dropdown(0), dropdown(0), dropdown(13)])  # -> ActionCategory, DesignSituationType
b_forces_3 = BeamForcesKaramba3D(Ts=[0, 1])  # -> Model, NormalForce_kN, ShearForceVz_kN, ShearForceVy_kN, TorsionalMomentMt_kNm, BendingMomentMy_kNm, BendingMomentMz_kNm, LoadCaseIndex
bar_graph_16 = BarGraph(utilization_6.SigMin_kN_cm², BarColor=RGB(255, 0, 90))
bar_graph_17 = BarGraph(utilization_6.SigMax_kN_cm², BarColor=RGB(255, 0, 90))
bar_graph_18 = BarGraph(utilization_6.Utilization, BarColor=RGB(255, 0, 90))
number_slider = Slider(1, range=0..1)
textdot_11 = DefineTextDot(Text=nodedisp_2.NodalTranslations_m, Location=nodedisp_2.DisplacementPosition, Font="Arial", Size=14)  # disabled
list = ValueList({"GEOMETRICALLY_LINEAR": 0, "LARGE_DEFORMATIONS": 1, "SECOND_ORDER_P_DELTA": 2}, selected="GEOMETRICALLY_LINEAR")
textdot_12 = DefineTextDot(Text=nodedisp_3.NodalTranslations_m, Location=nodedisp_3.DisplacementPosition, Font="Arial", Size=14)
static_analysis_settings = StaticAnalysisSettings(StaticAnalysisSettingNo=number_slider, AnalysisType=list, mode="Assemble")
number_slider_2 = Slider(1, range=0..1)
load_case = LoadCase(
    LoadCaseNo=number_slider_2,
    LoadCaseName="Self weight",
    StaticAnalysisSettings=number_slider,
    ActionCategory=load_case_classification_component.ActionCategory,
    SelfWeightActive=Toggle(True),
    ToSolve=Toggle(True),
    mode="Assemble")
list_2 = ValueList({"TYPE_BEAM_PANEL": 0, "TYPE_GLASS_COMPOSITION": 1, "TYPE_LAYERS": 2, "TYPE_SHAPE_ORTHOTROPY": 3, "TYPE_STIFFNESS_MATRIX": 4, "TYPE_THICKNESS_PHASE": 5, "TYPE_UNIFORM": 6, "TYPE_VARIABLE_CIRCLE": 7, "TYPE_VARIABLE_FOUR_SURFACE_CORNERS": 8, "TYPE_VARIABLE_THREE_NODES": 9, "TYPE_VARIABLE_TWO_NODES_AND_DIRECTION": 10, "TYPE_WALL_SHEAR_FREE": 11, "TYPE_WALL_SHEAR_FREE_IN_X": 12, "TYPE_WALL_SHEAR_FREE_IN_Y": 13}, selected="TYPE_UNIFORM")
material = Material(MaterialNo="2", MaterialName="C25/30", mode="Assemble")
nodal_support = NodalSupport(
    GHNode=disc.Points,
    TranslationalSpringX="inf",
    TranslationalSpringY="inf",
    TranslationalSpringZ="inf",
    RotationalRestraintX="0",
    RotationalRestraintY="0",
    RotationalRestraintZ="0",
    mode="Assemble")
panel_48 = Panel("extra")
list_3 = ValueList({"LOAD_DIRECTION_GLOBAL_X_OR_USER_DEFINED_U_PROJECTED": 0, "LOAD_DIRECTION_GLOBAL_X_OR_USER_DEFINED_U_TRUE": 1, "LOAD_DIRECTION_GLOBAL_Y_OR_USER_DEFINED_V_PROJECTED": 2, "LOAD_DIRECTION_GLOBAL_Y_OR_USER_DEFINED_V_TRUE": 3, "LOAD_DIRECTION_GLOBAL_Z_OR_USER_DEFINED_W_PROJECTED": 4, "LOAD_DIRECTION_GLOBAL_Z_OR_USER_DEFINED_W_TRUE": 5, "LOAD_DIRECTION_LOCAL_X": 6, "LOAD_DIRECTION_LOCAL_Y": 7, "LOAD_DIRECTION_LOCAL_Z": 8}, selected="LOAD_DIRECTION_GLOBAL_Z_OR_USER_DEFINED_W_TRUE")
list_4 = ValueList({"LOAD_TYPE_AXIAL_STRAIN": 0, "LOAD_TYPE_FORCE": 1, "LOAD_TYPE_FORM_FINDING": 2, "LOAD_TYPE_MASS": 3, "LOAD_TYPE_PONDING": 4, "LOAD_TYPE_PRECAMBER": 5, "LOAD_TYPE_ROTARY_MOTION": 6, "LOAD_TYPE_TEMPERATURE": 7}, selected="LOAD_TYPE_FORCE")
list_5 = ValueList({"LOAD_DISTRIBUTION_LINEAR": 0, "LOAD_DISTRIBUTION_LINEAR_IN_X": 1, "LOAD_DISTRIBUTION_LINEAR_IN_Y": 2, "LOAD_DISTRIBUTION_LINEAR_IN_Z": 3, "LOAD_DISTRIBUTION_RADIAL": 4, "LOAD_DISTRIBUTION_UNIFORM": 5, "LOAD_DISTRIBUTION_VARYING_IN_Z": 6}, selected="LOAD_DISTRIBUTION_UNIFORM")
division = Division(A="0.1", B=2)
section = Section(SectionNo="2", SectionName="R_M1 2/100", MaterialNo=material, DepthH="0.1", WidthB="0.01", mode="Assemble")
multiplication = Multiplication(A=division, B=-0.001)
thickness = Thickness(ThicknessNo="1", ThicknessType=list_2, MaterialNo=material, ThicknessD="0.1", mode="Assemble")
number_slider_3 = Slider(2, range=0..10)
list_6 = ValueList({"GEOMETRY_MINIMUM_CURVATURE_SPLINE": 0, "GEOMETRY_NURBS": 1, "GEOMETRY_PIPE": 2, "GEOMETRY_PLANE": 3, "GEOMETRY_QUADRANGLE": 4, "GEOMETRY_ROTATED": 5, "GEOMETRY_TRIMMED": 6}, selected="GEOMETRY_PLANE")
list_7 = ValueList({"TYPE_FLOOR": 0, "TYPE_FLOOR_DIAPHRAGM": 1, "TYPE_FLOOR_FLEXIBLE_DIAPHRAGM": 2, "TYPE_FLOOR_SEMIRIGID": 3, "TYPE_GROUNDWATER": 4, "TYPE_LOAD_TRANSFER": 5, "TYPE_MEMBRANE": 6, "TYPE_RIGID": 7, "TYPE_STANDARD": 8, "TYPE_WITHOUT_MEMBRANE_TENSION": 9, "TYPE_WITHOUT_THICKNESS": 10}, selected="TYPE_STANDARD")
explode_17 = Explode(Curve=flatten(relay), Recursive=True)  # -> Segments, Vertices
list_8 = ValueList({"TYPE_BEAM": 0, "TYPE_BUCKLING": 1, "TYPE_CABLE": 2, "TYPE_COMPRESSION": 3, "TYPE_COUPLING_HINGE_HINGE": 4, "TYPE_COUPLING_HINGE_RIGID": 5, "TYPE_COUPLING_RIGID_HINGE": 6, "TYPE_COUPLING_RIGID_RIGID": 7, "TYPE_DAMPER": 8, "TYPE_DEFINABLE_STIFFNESS": 9, "TYPE_JOIST": 10, "TYPE_PILE": 11, "TYPE_RESULT_BEAM": 12, "TYPE_RESULT_LINE": 13, "TYPE_RIB": 14, "TYPE_RIGID": 15, "TYPE_SPRING": 16, "TYPE_SURFACE_MODEL": 17, "TYPE_TENSION": 18, "TYPE_TRUSS": 19, "TYPE_TRUSS_ONLY_N": 20}, selected="TYPE_BEAM")
member_eccentricity = MemberEccentricity(EccentricityNo="2000", CoordinateSystemNo="0", AbsoluteOffsetE_z=division, mode="Assemble")
surface_load = SurfaceLoad(
    SurfaceLoadNo=Slider(1, range=0..1),
    LoadCaseNo=number_slider_2,
    SurfaceNo="1",
    LoadType=list_4,
    LoadDistribution=list_5,
    CoordinateSystem="1",
    LoadDirection=list_3,
    LoadMagnitudeP="-5",
    mode="Assemble")
member = Member(
    GHLine=flatten(explode_17.Segments),
    SectionStart=section,
    SectionEnd=section,
    MemberType=list_8,
    EccentricityStart="2000",
    EccentricityEnd="2000",
    mode="Assemble")
surface = Surface(
    GHSurface=boundary,
    SurfaceNo="1",
    ThicknessNo=thickness,
    GeometryType=list_6,
    StiffnessType=list_7,
    AutomaticObjectdetection=Toggle(True),
    mode="Assemble")
list_9 = ValueList({"None": 0, "Microns": 1, "Millimeters": 2, "Centimeters": 3, "Meters": 4, "Kilometers": 5, "Microinches": 6, "Mils": 7, "Inches": 8, "Feet": 9, "Miles": 10, "CustomUnits": 11, "Angstroms": 12, "Nanometers": 13, "Decimeters": 14, "Dekameters": 15, "Hectometers": 16, "Megameters": 17, "Gigameters": 18, "Yards": 19, "PrinterPoints": 20, "PrinterPicas": 21, "NauticalMiles": 22, "AstronomicalUnits": 23, "LightYears": 24, "Parsecs": 25, "Unset": 26}, selected="Meters")
rfem_export = RFEM6ExportComponent(
    Run=Toggle(False),
    Input=flatten([surface, thickness, load_case, static_analysis_settings, surface_load, member, section, material, nodal_support, member_eccentricity]),
    Units=list_9,
    Overwrite=Toggle(True),
    NameOfModelInRFEM="Ribbed floor")  # -> RFEMData, Log, SuccessfulExport
