# Grasshopper definition membrane_reinforcement_example.gh (Grasshopper 1.0.8)
# plug-ins: Karamba3D, RhinoCodePluginGH, GrasshopperRfem6WsPlugin, MeshEdit Components, Pufferfish, Weaverbird, Kiwi3d, Kangaroo2 Components

# Mesh topology influence on form-finding
qrsettings = QuadRemeshSettings(TargetCount=3000, AdaptiveSize=0, AdaptiveCount=False, HardEdges=False, SeamEdges=0, Symmetry=0, GuideCurves=0)  # disabled

input_mesh = Mesh(<mesh referenced from the Rhino model>)  # disabled
medges = MeshEdges(Mesh=input_mesh)  # -> NakedEdges, InteriorEdges, NonManifoldEdges; disabled
nv = NakedVertices(Mesh=input_mesh)  # -> ClothedIndex, NakedIndex, ClothedPts, NakedPts; disabled
inner_edges = Curve(flatten(medges.InteriorEdges))  # disabled
number_slider = Slider(0.5, range=0..1)  # disabled
number_slider_2 = Slider(10, range=1..10)  # disabled
len = Length(Curve=inner_edges)  # disabled
multiplication = Multiplication(A=len, B=number_slider)  # disabled
anchor = Anchor(Point=nv.NakedPts, Strength=1e+10)  # disabled
vertexloads = VertexLoads(Mesh=input_mesh, Strength=-1)  # disabled
length_line = LengthLine(Line=inner_edges, Length=multiplication, Strength=number_slider_2)  # disabled
show = Show(G=input_mesh)  # disabled
entwine = Entwine(Branch00=show, Branch01=anchor, Branch02=length_line, Branch03=vertexloads, FlattenInputs=True)  # disabled
button = Button()  # disabled
toggle = BooleanToggle(True)  # disabled
solver = Solver(GoalObjects=entwine, Reset=button, Threshold=1e-15, Tolerance=0.0001, On=toggle)  # -> I, V, O; disabled

qrmesh = QuadRemesh(Geometry=input_mesh, Settings=qrsettings)  # disabled
# Membrane desing
qrsettings_2 = QuadRemeshSettings(TargetCount=3000, AdaptiveSize=0, AdaptiveCount=False, HardEdges=False, SeamEdges=0, Symmetry=0, GuideCurves=0)
mesh = Mesh(<mesh referenced from the Rhino model>)  # disabled
srf = Surface(<surface referenced from the Rhino model>)  # disabled
mesh_2 = Mesh(mesh)  # disabled
srf_2 = Surface(srf)  # disabled
# SHELL DESIGN
qrsettings_3 = QuadRemeshSettings(TargetCount=3000, AdaptiveSize=0, AdaptiveCount=False, HardEdges=False, SeamEdges=0, Symmetry=0, GuideCurves=0)  # disabled
nv_2 = NakedVertices(Mesh=mesh_2)  # -> ClothedIndex, NakedIndex, ClothedPts, NakedPts; disabled
pipe = Pipe(Radius=1, Caps=0)
demesh = DeconstructMesh(Mesh=mesh_2)  # -> Vertices, Faces, Colours, Normals; disabled
disc = Discontinuity(Curve=srf_2, Level=1)  # -> Points, Parameters; disabled

# ----
# Concrete shell check
input_mesh_2 = Mesh(<mesh referenced from the Rhino model>)  # disabled
# Kangaroo
srf_3 = Surface(reparameterize(<surface referenced from the Rhino model>))  # disabled
crv = Curve(srf_3)  # disabled
disc_2 = Discontinuity(Curve=crv, Level=1)  # -> Points, Parameters; disabled
number_slider_3 = Slider(40, range=0..40)  # disabled
shatter = Shatter(Curve=crv, Parameters=disc_2.Parameters)  # disabled
divide = DivideCurve(Curve=shatter, Count=number_slider_3, Kinks=False)  # -> Points, Tangents, Parameters; disabled
medges_2 = MeshEdges(Mesh=input_mesh_2)  # -> NakedEdges, InteriorEdges, NonManifoldEdges; disabled
item = ListItem(List=shatter, Index=[1, 3], Wrap=True)  # disabled
nv_3 = NakedVertices(Mesh=input_mesh_2)  # -> ClothedIndex, NakedIndex, ClothedPts, NakedPts; disabled
inner_edges_2 = Curve(flatten([medges_2.InteriorEdges, medges_2.NakedEdges]))  # disabled
number_slider_4 = Slider(1, range=0..1)  # disabled
number_slider_5 = Slider(100, range=1..100)  # disabled
number_slider_6 = Slider(0.01, range=0..0.01)  # disabled
number_slider_7 = Slider(10, range=0..10)  # disabled
len_2 = Length(Curve=inner_edges_2)  # disabled
multiplication_2 = Multiplication(A=len_2, B=number_slider_4)  # disabled
edgelengths = EdgeLengths(Mesh=input_mesh_2, LengthFactor=number_slider_6, Strength=number_slider_7)  # disabled
vertexloads_2 = VertexLoads(Mesh=input_mesh_2, Strength=-1)  # disabled
anchor_2 = Anchor(Point=nv_3.NakedPts, Strength=1e+10)  # disabled
length_line_2 = LengthLine(Line=inner_edges_2, Length=multiplication_2, Strength=number_slider_5)  # disabled
show_2 = Show(G=input_mesh_2)  # disabled
entwine_2 = Entwine(
    Branch00=show_2,
    Branch01=anchor_2,
    Branch02=length_line_2,
    Branch03=edgelengths,
    Branch04=vertexloads_2,
    FlattenInputs=True)  # disabled
button_2 = Button()  # disabled
toggle_2 = BooleanToggle(False)  # disabled
solver_2 = Solver(GoalObjects=entwine_2, Reset=button_2, Threshold=1e-15, Tolerance=0.0001, On=toggle_2)  # -> I, V, O; disabled

cp = ClosestPoint(Point=disc.Points, Cloud=nv_2.NakedPts)  # -> ClosestPoint, CPIndex, Distance; disabled
swatch = ColourSwatch(SwatchColor=RGB(255, 3, 3))  # disabled
pipe_2 = Pipe(Radius=1, Caps=0)  # disabled
demesh_2 = DeconstructMesh(Mesh=input_mesh)  # -> Vertices, Faces, Colours, Normals; disabled
item_2 = ListItem(List=nv_2.NakedIndex, Index=cp.CPIndex, Wrap=True)  # disabled
replace = ReplaceItems(List=demesh.Vertices, Item=disc.Points, Indices=item_2, Wrap=False)  # disabled
sph = Sphere(Base=nv.NakedPts, Radius=0.2)  # disabled
crv_2 = Curve(<curve referenced from the Rhino model>)  # disabled
wbfacepolys = WeaverbirdsFacePolylines(Mesh=input_mesh)  # disabled
swatch_2 = ColourSwatch(SwatchColor=RGB(255, 0, 0))  # disabled
crv_3 = Curve(<curve referenced from the Rhino model>)  # disabled
pt = Point(nv.ClothedPts)  # disabled
area = Area(Geometry=wbfacepolys)  # -> Area, Centroid; disabled
pressure = Pressure(M=input_mesh, Strength=1)  # disabled
conmesh = ConstructMesh(Vertices=replace, Faces=demesh.Faces)  # disabled
swatch_3 = ColourSwatch(SwatchColor=RGB(255, 0, 0))  # disabled
preview = CustomPreview(Geometry=sph, Material=swatch_2)  # disabled
voronoi = Voronoi(Points=demesh_2.Vertices, Boundary=crv_2, BruteForceOverride=False)  # disabled
panel = Panel("0 to 1")  # disabled
area_2 = Area(Geometry=voronoi)  # -> Area, Centroid; disabled
panel_2 = Panel("0 to 1")  # disabled
bnd = Bounds(Numbers=area_2.Area)  # disabled
remap = RemapNumbers(Value=area_2.Area, Source=bnd, Target=panel)  # -> expr("x*-1", Mapped), Clipped; disabled
swatch_4 = ColourSwatch(SwatchColor=RGB(255, 0, 0))  # disabled
panel_3 = Panel("1849")  # disabled
load = Load(Point=demesh_2.Vertices, ForceVector=Vector(0, 0, 1), Weighting=1)  # disabled
vec = VectorXYZ(XComponent=0, YComponent=0, ZComponent=expr("x*-1", area_2.Area))  # -> Vector, Length; disabled
crv_4 = Curve(<curve referenced from the Rhino model>)
bang = ExplodeTree(Data=solver.O)  # -> Branch0, Branch1, Branch2, Branch3, Branch4, Branch5; disabled
boundary = BoundarySurfaces(Edges=crv_4)
qrmesh_2 = QuadRemesh(Geometry=boundary, Settings={aqc=True, as=50, dhe=True, gci=0, null=False, pme=2, sa=0, tqc=2000})

# ----
# Kiwi membrane PSL verification
list = ValueList({"STEEL": 1, "WOOD": 2, "GFRP": 3, "ETFE (Membrane)": 4, "CONCRETE": 5, "ALUMINIUM": 6}, selected="ETFE (Membrane)")  # disabled
crv_5 = Curve(boundary)  # disabled
matdef = MaterialDefaults(Type=list, IsNmm2=False, IskNcm2=False, IskNm2=True, mUnit=1)  # -> Material, YoungsModulus, AlphaT, Nue, Density, Strength; disabled
shell = ShellElement(Brep=boundary, Thickness=0.1, HingeCoupling=False)  # disabled
panel_4 = Panel("0.8")  # disabled
srfref = SurfaceRefinement(PDeg=3, QDeg=3, ElementRefU=5, ElementRefV=5, IsKnotApproxElementSize=False, IsKnotSubdivision=True)  # disabled
list_2 = ValueList({"Displacements": 1, "Stresses": 2, "SupportForces": 3}, selected=["Displacements", "Stresses", "SupportForces"])  # disabled
supcrv = SupportCurve(Crv=crv_5, DispX=True, DispY=True, DispZ=True, Rot=False, TryStrongSupport=True)  # disabled
membrane = MembraneElement(
    Brep=boundary,
    Material=matdef.Material,
    Thickness=0.001,
    Prestress1=panel_4,
    Prestress2=panel_4,
    Refinement=srfref,
    Formfinding=True,
    ShowPrestressDirections=False)  # disabled
nonlina = NonLinearAnalysis(
    Name="MyAnalysis",
    Iterations=100,
    EquilibriumAccurancy=0.001,
    OutputSetting=list_2,
    AdaptiveForceControl=0,
    OutputFrequency=1)  # disabled
toggle_3 = BooleanToggle(False)  # disabled
amodel = AnalysisModel(
    Analysis=nonlina,
    StructuralElements=membrane,
    Supports=supcrv,
    IntersectionTolerance=0.001,
    IsCarat=True,
    IsKratos=False,
    PenaltyFac=10000000,
    ShowCouplingIDs=False,
    ShowEdgeIDs=False,
    ShowGeo=True,
    ShowPatchIDs=True,
    ShowPrePro=True,
    ShowRef=False,
    mUsedVersion="BETA 0.6.0")  # disabled
list_3 = ValueList({"X Displacement": 1, "Y Displacement": 2, "Z Displacement": 3, "Displacement Length": 4, "P_N1": 5, "P_N2": 6, "N1": 7, "N2": 8, "N12": 9, "P_M1 (Shell)": 10, "P_M2 (Shell)": 11, "M1 (Shell)": 12, "M2 (Shell)": 13, "M12 (Shell)": 14, "von_Mises (Shell)": 15}, selected="P_N1")  # disabled
analysis_completed = IGASolver(AnalysisModel=amodel, Run=toggle_3, antiFreeze=False, showWindow=True)  # -> ResultModel, ErrorReport; disabled
defmod = DeformedModel(Model=analysis_completed.ResultModel, ScaleFactor=1, FlyingNodeLimit=100000)  # -> Model, Geo, DeformedStructuralElements; disabled
_2dresults = _2DElementResults(Model=analysis_completed.ResultModel, Type=list_3, Scaling=1)  # -> IDGP, V, R, LocationGP, ParameterLocationGP; disabled
end = EndPoints(Curve=_2dresults.R)  # -> Start, End; disabled
vec2pt = Vector2Pt(PointA=end.Start, PointB=end.End, Unitize=False)  # -> Vector, Length; disabled
vdisex = VectorDisplayEx(Point=end.Start, Vector=vec2pt.Vector, Colour=RGB(0, 0, 0), Width=2)  # disabled

matselect = MaterialSelectionKaramba3D(menu=[dropdown(7), dropdown(4)])
matselect_2 = MaterialSelectionKaramba3D(menu=[dropdown(7), dropdown(4)])
bang_2 = ExplodeTree(Data=solver_2.O)  # -> Branch0, Branch1, Branch2, Branch3, Branch4, Branch5; disabled
X = UnitX(Factor=1)  # disabled
srf_4 = Surface(<surface referenced from the Rhino model>)  # disabled
mesh_3 = Mesh(<mesh referenced from the Rhino model>)  # disabled
crv_6 = Curve(<curve referenced from the Rhino model>)
crv_7 = Curve(<curve referenced from the Rhino model>)
crv_8 = Curve(<curve referenced from the Rhino model>)  # disabled
panel_5 = Panel("180")  # disabled
Z = UnitZ(Factor="-1")
disc_3 = Discontinuity(Curve=srf_4, Level=1)  # -> Points, Parameters; disabled
matselect_3 = MaterialSelectionKaramba3D(menu=[dropdown(7), dropdown(4)])  # disabled
swatch_5 = ColourSwatch(SwatchColor=RGB(255, 0, 0))  # disabled
panel_6 = Panel("0 to 1")  # disabled
nv_4 = NakedVertices(Mesh=mesh_3)  # -> ClothedIndex, NakedIndex, ClothedPts, NakedPts; disabled
matselect_4 = MaterialSelectionKaramba3D(menu=[dropdown(7), dropdown(6)])  # disabled
crv_9 = Curve(boundary)
explode = Explode(Curve=crv_9, Recursive=True)  # -> Segments, Vertices
midpt = CurveMiddle(Curve=explode.Segments)
crv_10 = Curve()
crv_cp = CurveClosestPoint(Point=midpt, Curve=explode.Segments)  # -> Point, Parameter, Distance
crv_11 = Curve(<curve referenced from the Rhino model>)
shatter_2 = Shatter(Curve=explode.Segments, Parameters=crv_cp.Parameter)
srf_5 = Surface(<surface referenced from the Rhino model>)
crv_12 = Curve(<curve referenced from the Rhino model>)
mesh_uv = MeshSurface(Surface=srf_5, UCount="15", VCount="15", Overhang=True, Equalize=False)
item_3 = ListItem(List=shatter_2, Index=0, Wrap=True)
rec = Rectangle({Plane=PlaneXY(34.5, -13.5, 0), Size=Domain2(u=-3.5..3.5, v=-7.5..7.5)})
divide_2 = DivideCurve(Curve=item_3, Count=10, Kinks=False)  # -> Points, Tangents, Parameters
rec_2 = Rectangle({Plane=PlaneXY(34.5, -13.5, 0), Size=Domain2(u=-3.5..3.5, v=-7.5..7.5)})
demesh_3 = DeconstructMesh(Mesh=mesh_uv)  # -> Vertices, Faces, Colours, Normals
brep = Brep(<brep referenced from the Rhino model>)  # disabled
cull_i = CullIndex(List=divide_2.Points, Indices=[0, -1], Wrap=True)
crv_2_2 = Curve([<curve referenced from the Rhino model> x4])
triremesh = TriRemesh(Geometry=brep, Length=1, Iterations=25)  # -> Triangulation, Dual, Creases; disabled
crv_13 = Curve([<curve referenced from the Rhino model> x4])  # disabled
cullpt = CullDuplicates(Points=demesh_3.Vertices, Tolerance=0.1, CullMode=3)  # -> Points, Indices, Valence
quad_mesh = Mesh(<mesh referenced from the Rhino model>)  # disabled
crv_1 = Curve([<curve referenced from the Rhino model> x4])
popgeo = PopulateGeometry(Geometry=mesh_3, Count=100, Seed=1)  # disabled
crv_2_3 = Curve([<curve referenced from the Rhino model> x4])
divide_3 = DivideCurve(Curve=crv_2_2, Count=10, Kinks=False)  # -> Points, Tangents, Parameters
divide_4 = DivideCurve(Curve=crv_13, Count=10, Kinks=False)  # -> Points, Tangents, Parameters; disabled
crv_1_2 = Curve([<curve referenced from the Rhino model> x4])
divide_5 = DivideCurve(Curve=crv_2_3, Count=10, Kinks=False)  # -> Points, Tangents, Parameters
divide_6 = DivideCurve(Curve=crv_1, Count=10, Kinks=False)  # -> Points, Tangents, Parameters
cull_i_2 = CullIndex(List=divide_3.Points, Indices=[0, 1], Wrap=True)
crv_14 = Curve([<curve referenced from the Rhino model> x4])  # disabled
divide_7 = DivideCurve(Curve=crv_1_2, Count=10, Kinks=False)  # -> Points, Tangents, Parameters
cull_i_3 = CullIndex(List=divide_4.Points, Indices=[0, 1, 2], Wrap=True)  # disabled
skeleton_1 = Curve([<curve referenced from the Rhino model> x4])  # disabled
cull_i_4 = CullIndex(List=divide_5.Points, Indices=[0, 1], Wrap=True)
cull_i_5 = CullIndex(List=reverse(divide_6.Points), Indices=[0, 1], Wrap=True)
divide_8 = DivideCurve(Curve=crv_14, Count=10, Kinks=False)  # -> Points, Tangents, Parameters; disabled
divdist = DivideDistance(Curve=skeleton_1, Distance=1.5)  # -> Points, Tangents, Parameters
pt_2 = Point(Point(15, -21, 0))
cull_i_6 = CullIndex(List=reverse(divdist.Points), Indices=0, Wrap=True)
cull_i_7 = CullIndex(List=reverse(divide_7.Points), Indices=[0, 1], Wrap=True)
pipe_3 = Pipe(Curve=skeleton_1, Radius=0.05, Caps=0)
cull_i_8 = CullIndex(List=divide_8.Points, Indices=0, Wrap=True)  # disabled
skeleton_2 = Curve([<curve referenced from the Rhino model> x4])
sph_2 = Sphere(Base=pt_2, Radius=0.3)
sph_3 = Sphere(Base=cull_i_5, Radius=0.25)
divdist_2 = DivideDistance(Curve=skeleton_2, Distance=1.5)  # -> Points, Tangents, Parameters
pipe_4 = Pipe(Curve=skeleton_2, Radius=0.05, Caps=0)
rec_3 = Rectangle({Plane=PlaneXY(34.5, -13.5, 0), Size=Domain2(u=-3.5..3.5, v=-7.5..7.5)})  # disabled
cull_i_9 = CullIndex(List=reverse(divdist_2.Points), Indices=0, Wrap=True)
preview_2 = CustomPreview(Geometry=sph_2, Material=ColourSwatch(SwatchColor=RGB(0, 0, 0)))
pt_3 = Point([<point referenced from the Rhino model> x4])  # disabled
pt_4 = Point([<point referenced from the Rhino model> x4])  # disabled
panel_7 = Panel("1")  # disabled
pt_5 = ConstructPoint(XCoordinate=0, YCoordinate=0, ZCoordinate=0)  # disabled
number_slider_8 = Slider(0.2, range=0..1)  # disabled
number_slider_9 = Slider(8, range=1..10)  # disabled
number_slider_10 = Slider(0.2, range=0..1)  # disabled
number_slider_11 = Slider(8, range=1..10)  # disabled
evalsrf = EvaluateSurface(Point=pt_5)  # -> Point, Normal, UDirection, VDirection, Frame; disabled
panel_8 = Panel("2")  # disabled
panel_9 = Panel("1")  # disabled
item_4 = ListItem(List=cull_i_9, Index=0, Wrap=True)
rev = ReverseList(List=cull_i_9)
range = Range(Domain=Domain(0, 1), Steps=10)
swatch_6 = ColourSwatch(SwatchColor=RGB(3, 3, 3))
crv_15 = Curve()
crv_16 = Curve()
join = JoinCurves(Curves=crv_15, Preserve=False)  # -> flatten(Curves)
join_2 = JoinCurves(Curves=crv_16, Preserve=False)  # -> flatten(Curves)
join_3 = JoinCurves(Curves=join, Preserve=False)
swatch_7 = ColourSwatch(SwatchColor=RGB(8, 177, 255))
preview_3 = CustomPreview(Geometry=[pipe_4, sph_3], Material=swatch_7)
smaller = SmallerThan(FirstNumber=join_2, SecondNumber="2")  # -> SmallerThan, OrEqualTo
crv_17 = Curve([<curve referenced from the Rhino model> x10])
not = GateNot(A=smaller.SmallerThan)
preview_4 = CustomPreview(Geometry=crv_17, Material=swatch_7)
cull = CullPattern(List=join_2, CullPattern=not)
rev_2 = ReverseList(List=cull_i_5)
split = SplitList(List=rev_2, Index=2)  # -> reverse(ListA), ListB
pt_6 = Point([<point referenced from the Rhino model> x16])
crv_18 = Curve(<curve referenced from the Rhino model>)
merge = Merge(Data1=split.ListA, Data2=split.ListB)
item_5 = ListItem(List=merge, Index=0, Wrap=True)  # -> flatten(Item)
explode_2 = Explode(Curve=crv_18, Recursive=True)  # -> Segments, Vertices
item_6 = ListItem(List=item_5, Index=2, Wrap=True)
pt_7 = Point(<point referenced from the Rhino model>)
crv_19 = Curve(Tree({0}: [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], {0;0}: [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], {0;0;0}: [], {0;1}: [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], {0;1;0}: [], {0;2}: [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]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))
preview_5 = CustomPreview(Geometry=crv_19, Material=swatch_7)
cls = Closed()  # -> Closed, Periodic
panel_10 = Panel("10")  # disabled
panel_11 = Panel("2")  # disabled
panel_12 = Panel("5000")  # disabled
qrsettings_4 = QuadRemeshSettings(TargetCount=panel_12, AdaptiveSize=50, AdaptiveCount=True, HardEdges=True, SeamEdges=2, Symmetry=1, GuideCurves=2)  # disabled
mesh_4 = Mesh(<mesh referenced from the Rhino model>)
srf_6 = Surface(reparameterize(<surface referenced from the Rhino model>))  # disabled
crv_20 = Curve(srf_6)  # disabled
crv_21 = Curve(srf_6)  # disabled
supcrv_2 = SupportCurve(Crv=crv_20, DispX=True, DispY=True, DispZ=True, Rot=False, TryStrongSupport=True)  # disabled
# Kangaroo
panel_13 = Panel("0.1")
# Formfinding with inlays (Kiwi3D)
patch = Patch(Curves=crv_21, Spans=20, Flexibility=1, Trim=True)  # disabled
panel_14 = Panel("20000")  # disabled
panel_15 = Panel("20")  # disabled
panel_16 = Panel("3")  # disabled
panel_17 = Panel("0.1")  # disabled
panel_18 = Panel("Knit")  # disabled
mat = Material(
    Name=panel_18,
    Type="LIN_ELAST_ISOTROPIC",
    YoungsModulus=panel_14,
    AlphaT=0,
    Nue=panel_17,
    Density=panel_16,
    Strength=panel_15)  # disabled
number_slider_12 = Slider(1, range=0..10)  # disabled
panel_19 = Panel("7")  # disabled
panel_20 = Panel("0.07")  # disabled
list_4 = ValueList({"DEAD": 1, "SNOW": 2, "PRES": 3, "PRES_FL": 4}, selected="SNOW")  # disabled
srfref_2 = SurfaceRefinement(PDeg=3, QDeg=3, ElementRefU=panel_19, ElementRefV=panel_19, IsKnotApproxElementSize=False, IsKnotSubdivision=True)  # disabled
crv_2_4 = Curve([<curve referenced from the Rhino model> x30])
crv_3_2 = Curve([<curve referenced from the Rhino model> x30])
crv_1_3 = Curve([<curve referenced from the Rhino model> x30])
srfload = SurfaceLoad(Brep=patch, Loadtype=list_4, Direction=Vector(0, 0, -1), Value=panel_20, LoadCase=1)  # disabled
membrane_2 = MembraneElement(
    Brep=patch,
    Material=mat,
    Thickness=0.001,
    Prestress1=1,
    Prestress2=1,
    Refinement=srfref_2,
    Formfinding=True,
    ShowPrestressDirections=False)  # disabled
load_case_classification_component = LoadCaseClassificationComponent(ActionIndex=0, DesignIndex=13, StandardIndex=0, menu=[dropdown(0), dropdown(0), dropdown(13)])  # -> ActionCategory, DesignSituationType; disabled
lina = LinearAnalysis(Name="MyAnalysis")  # disabled
merge_2 = Merge(Data1=simplify(membrane_2))  # disabled
panel_21 = Panel("-0.5")  # disabled
fofi = Formfinding(Name="MyAnalysis", FormfindingSteps=10, Iterations=15)  # disabled
toggle_4 = BooleanToggle(True)  # disabled
number_slider_13 = Slider(1, range=0..1)  # disabled
list_5 = ValueList({"GEOMETRICALLY_LINEAR": 0, "LARGE_DEFORMATIONS": 1, "SECOND_ORDER_P_DELTA": 2}, selected="GEOMETRICALLY_LINEAR")  # disabled
list_6 = ValueList({"E_MATERIAL_MODEL_ISOTROPIC_SOIL_PLASTIC_MODIFIED_HARDENING_SOIL_3D": 0, "MODEL_ISOTROPIC_DAMAGE_2D_3D": 1, "MODEL_ISOTROPIC_LINEAR_ELASTIC": 2, "MODEL_ISOTROPIC_MASONRY_PLASTIC_2D": 3, "MODEL_ISOTROPIC_NONLINEAR_ELASTIC_1D": 4, "MODEL_ISOTROPIC_NONLINEAR_ELASTIC_2D_3D": 5, "MODEL_ISOTROPIC_PLASTIC_1D": 6, "MODEL_ISOTROPIC_PLASTIC_2D_3D": 7, "MODEL_ISOTROPIC_ROCK_PLASTIC_HOEK_BROWN_3D": 8, "MODEL_ISOTROPIC_SOIL_NONLINEAR_ELASTIC_3D": 9, "MODEL_ISOTROPIC_SOIL_PLASTIC_3D": 10, "MODEL_ISOTROPIC_TIMBER_LINEAR_ELASTIC_1D": 11, "MODEL_ORTHOTROPIC_2D": 12, "MODEL_ORTHOTROPIC_3D": 13, "MODEL_ORTHOTROPIC_FABRIC_NONLINEAR_ELASTIC_2D": 14, "MODEL_ORTHOTROPIC_MASONRY_PLASTIC_2D": 15, "MODEL_ORTHOTROPIC_PLASTIC_2D": 16, "MODEL_ORTHOTROPIC_PLASTIC_3D": 17, "MODEL_ORTHOTROPIC_TIMBER_LINEAR_ELASTIC_2D": 18, "MODEL_ORTHOTROPIC_WELD_PLASTIC_2D": 19}, selected="MODEL_ISOTROPIC_LINEAR_ELASTIC")  # disabled
panel_22 = Panel("1")  # disabled
panel_23 = Panel("10000")  # disabled
panel_24 = Panel("0.2")  # disabled
panel_25 = Panel("14")  # disabled
panel_26 = Panel("35")  # disabled
panel_27 = Panel("0")  # disabled
static_analysis_settings = StaticAnalysisSettings(StaticAnalysisSettingNo=number_slider_13, AnalysisType=list_5, mode="Assemble")  # disabled
list_7 = ValueList({"COORDINATE_SYSTEM_GLOBAL": 0, "COORDINATE_SYSTEM_LOCAL": 1}, selected="COORDINATE_SYSTEM_GLOBAL")  # disabled
material_characteristics = MaterialCharacteristics(
    ElasticityModulusE=panel_26,
    ShearModulusG=panel_25,
    PoissonRatio=panel_24,
    SpecificWeight=panel_22,
    Density=panel_23,
    ThermalExpansionA=panel_27,
    mode="Assemble")  # disabled
number_slider_14 = Slider(1, range=0..1)  # disabled
list_8 = ValueList({"DERIVED_G": 0, "DERIVED_NU": 1, "E_G_NO_NU": 2, "E_G_NU": 3, "NONE": 4}, selected="DERIVED_NU")  # disabled
panel_28 = Panel("Knitted Membrane")  # disabled
toggle_5 = BooleanToggle(True)  # disabled
toggle_6 = BooleanToggle(True)  # disabled
toggle_7 = BooleanToggle(True)  # disabled
panel_29 = Panel("Self weight")  # disabled
panel_30 = Panel("1")  # disabled
panel_31 = Panel("inf")  # disabled
panel_32 = Panel("0")  # disabled
panel_33 = Panel("11")  # disabled
load_case = LoadCase(
    LoadCaseNo=number_slider_14,
    LoadCaseName=panel_29,
    StaticAnalysisSettings=number_slider_13,
    ActionCategory=load_case_classification_component.ActionCategory,
    SelfWeightActive=toggle_5,
    ToSolve=toggle_6,
    mode="Assemble")  # disabled
material = Material(
    MaterialNo=panel_30,
    MaterialName=panel_28,
    UserDefinedMaterial=toggle_7,
    MaterialModel=list_6,
    DefinitionType=list_8,
    MaterialCharacteristics=material_characteristics,
    mode="Assemble")  # disabled
panel_34 = Panel("S235")  # disabled
panel_35 = Panel("2")  # disabled
list_9 = ValueList({"TYPE_BEAM_PANEL": 0, "TYPE_GLASS_COMPOSITION": 1, "TYPE_LAYERS": 2, "TYPE_SHAPE_ORTHOTROPY": 3, "TYPE_STIFFNESS_MATRIX": 4, "TYPE_THICKNESS_PHASE": 5, "TYPE_UNIFORM": 6, "TYPE_VARIABLE_CIRCLE": 7, "TYPE_VARIABLE_FOUR_SURFACE_CORNERS": 8, "TYPE_VARIABLE_THREE_NODES": 9, "TYPE_VARIABLE_TWO_NODES_AND_DIRECTION": 10}, selected="TYPE_UNIFORM")  # disabled
material_2 = Material(MaterialNo=panel_35, MaterialName=panel_34, mode="Assemble")  # disabled
matselect_5 = MaterialSelectionKaramba3D(menu=[dropdown(1), dropdown(2)])  # disabled
number_slider_15 = Slider(1, range=0..1)  # disabled
panel_36 = Panel("extra")  # disabled
list_10 = ValueList({"LOAD_DIRECTION_GLOBAL_X_OR_USER_DEFINED_U_PROJECTED": 0, "LOAD_DIRECTION_GLOBAL_X_OR_USER_DEFINED_U_TRUE": 1, "LOAD_DIRECTION_GLOBAL_Y_OR_USER_DEFINED_V_PROJECTED": 2, "LOAD_DIRECTION_GLOBAL_Y_OR_USER_DEFINED_V_TRUE": 3, "LOAD_DIRECTION_GLOBAL_Z_OR_USER_DEFINED_W_PROJECTED": 4, "LOAD_DIRECTION_GLOBAL_Z_OR_USER_DEFINED_W_TRUE": 5, "LOAD_DIRECTION_LOCAL_X": 6, "LOAD_DIRECTION_LOCAL_Y": 7, "LOAD_DIRECTION_LOCAL_Z": 8}, selected="LOAD_DIRECTION_GLOBAL_Z_OR_USER_DEFINED_W_TRUE")  # disabled
list_11 = ValueList({"LOAD_TYPE_AXIAL_STRAIN": 0, "LOAD_TYPE_FORCE": 1, "LOAD_TYPE_FORM_FINDING": 2, "LOAD_TYPE_MASS": 3, "LOAD_TYPE_PONDING": 4, "LOAD_TYPE_PRECAMBER": 5, "LOAD_TYPE_ROTARY_MOTION": 6, "LOAD_TYPE_TEMPERATURE": 7}, selected="LOAD_TYPE_FORCE")  # disabled
list_12 = ValueList({"LOAD_DISTRIBUTION_LINEAR": 0, "LOAD_DISTRIBUTION_LINEAR_IN_X": 1, "LOAD_DISTRIBUTION_LINEAR_IN_Y": 2, "LOAD_DISTRIBUTION_LINEAR_IN_Z": 3, "LOAD_DISTRIBUTION_RADIAL": 4, "LOAD_DISTRIBUTION_UNIFORM": 5, "LOAD_DISTRIBUTION_VARYING_IN_Z": 6}, selected="LOAD_DISTRIBUTION_UNIFORM")  # disabled
panel_37 = Panel("2")  # disabled
panel_38 = Panel("R 10")  # disabled
panel_39 = Panel("0.003")  # disabled
section = Section(SectionNo=panel_37, SectionName=panel_38, MaterialNo=material_2, mode="Assemble")  # disabled
panel_40 = Panel("1")  # disabled
thickness = Thickness(ThicknessNo=panel_40, ThicknessType=list_9, MaterialNo=material, ThicknessD=panel_39, mode="Assemble")  # disabled
panel_41 = Panel("1")  # disabled
crosec = CrossSectionKaramba3D(
    FamilyNameOfCrossSection="DefaultCroSec",
    Material=matselect_5,
    Diameter_cm=0.2,
    WallThickness_cm=0.01,
    mode="Circular Hollow")  # disabled
panel_42 = Panel("1.4")  # disabled
panel_43 = Panel("3")  # disabled
number_slider_16 = Slider(2, range=0..10)  # disabled
list_13 = ValueList({"GEOMETRY_MINIMUM_CURVATURE_SPLINE": 0, "GEOMETRY_NURBS": 1, "GEOMETRY_PIPE": 2, "GEOMETRY_PLANE": 3, "GEOMETRY_QUADRANGLE": 4, "GEOMETRY_ROTATED": 5, "GEOMETRY_TRIMMED": 6}, selected="GEOMETRY_PLANE")  # disabled
list_14 = ValueList({"TYPE_FLOOR": 0, "TYPE_FLOOR_DIAPHRAGM": 1, "TYPE_FLOOR_FLEXIBLE_DIAPHRAGM": 2, "TYPE_FLOOR_SEMIRIGID": 3, "TYPE_GROUNDWATER": 4, "TYPE_LOAD_TRANSFER": 5, "TYPE_MEMBRANE": 6, "TYPE_RIGID": 7, "TYPE_STANDARD": 8, "TYPE_WITHOUT_MEMBRANE_TENSION": 9, "TYPE_WITHOUT_THICKNESS": 10}, selected="TYPE_MEMBRANE")  # disabled
list_15 = ValueList({"TYPE_BEAM": 0, "TYPE_BUCKLING": 1, "TYPE_CABLE": 2, "TYPE_COMPRESSION": 3, "TYPE_COUPLING_HINGE_HINGE": 4, "TYPE_COUPLING_HINGE_RIGID": 5, "TYPE_COUPLING_RIGID_HINGE": 6, "TYPE_COUPLING_RIGID_RIGID": 7, "TYPE_DAMPER": 8, "TYPE_DEFINABLE_STIFFNESS": 9, "TYPE_JOIST": 10, "TYPE_RESULT_BEAM": 11, "TYPE_RIB": 12, "TYPE_RIGID": 13, "TYPE_SPRING": 14, "TYPE_SURFACE_MODEL": 15, "TYPE_TENSION": 16, "TYPE_TRUSS": 17, "TYPE_TRUSS_ONLY_N": 18}, selected="TYPE_CABLE")  # disabled
matprops = MaterialPropertiesKaramba3D(
    FamilyOfMaterial="Steel",
    Name="S235",
    YoungsModulus_kN_cm²=panel_43,
    InPlaneShearModulus_kN_cm²=panel_42,
    TransverseShearModulus_kN_cm²=panel_42,
    SpecificWeight_kN_m³=panel_41,
    CoefficientOfThermalExpansion_1=1.2e-05,
    TensileStrength_kN_cm²=23.5,
    CompressiveStrength_kN_cm²=-23.5,
    StrengthHypothesis="MISES",
    mode="Isotrop")  # disabled
loads = LoadsKaramba3D(Vector=Vector(0, 0, -1), LCase="LC0", mode="Gravity")  # disabled
panel_44 = Panel("-5")  # disabled
Z_2 = UnitZ(Factor=panel_21)  # disabled
mesh_patches = Mesh([<mesh referenced from the Rhino model> x21])  # disabled
crosec_2 = CrossSectionKaramba3D(FamilyNameOfCrossSection="DefaultCroSec", Material=matprops, Height_cm=0.2, mode="Shell - Const")  # disabled
panel_45 = Panel("-2")  # disabled
toggle_8 = BooleanToggle(True)  # disabled
panel_46 = Panel("cables")  # disabled
panel_47 = Panel("1")  # disabled
panel_48 = Panel("1")  # disabled
panel_49 = Panel("membrane")  # disabled
surface_load = SurfaceLoad(
    SurfaceLoadNo=number_slider_15,
    LoadCaseNo=number_slider_14,
    SurfaceNo=panel_48,
    LoadType=list_11,
    LoadDistribution=list_12,
    CoordinateSystem=panel_47,
    LoadDirection=list_10,
    LoadMagnitudeP=panel_44,
    mode="Assemble")  # disabled
loads_2 = LoadsKaramba3D(Eps0=panel_45, ElementIdentifiers=panel_49, LCase="LC0", mode="InitialStrain")  # disabled
panel_50 = Panel("-0.3")  # disabled
loads_3 = LoadsKaramba3D(Eps0=panel_50, ElementIdentifiers=panel_46, LCase="LC0", mode="InitialStrain")  # disabled
list_16 = ValueList({"None": 0, "Microns": 1, "Millimeters": 2, "Centimeters": 3, "Meters": 4, "Kilometers": 5, "Microinches": 6, "Mils": 7, "Inches": 8, "Feet": 9, "Miles": 10, "CustomUnits": 11, "Angstroms": 12, "Nanometers": 13, "Decimeters": 14, "Dekameters": 15, "Hectometers": 16, "Megameters": 17, "Gigameters": 18, "Yards": 19, "PrinterPoints": 20, "PrinterPicas": 21, "NauticalMiles": 22, "AstronomicalUnits": 23, "LightYears": 24, "Parsecs": 25, "Unset": 26}, selected="Centimeters")  # disabled
toggle_9 = BooleanToggle(True)  # disabled
toggle_10 = BooleanToggle(False)  # disabled

input_mesh_3 = Mesh(<mesh referenced from the Rhino model>)  # disabled
medges_3 = MeshEdges(Mesh=input_mesh_3)  # -> NakedEdges, InteriorEdges, NonManifoldEdges; disabled
nv_5 = NakedVertices(Mesh=input_mesh_3)  # -> ClothedIndex, NakedIndex, ClothedPts, NakedPts; disabled
inner_edges_3 = Curve(flatten(medges_3.InteriorEdges))  # disabled
number_slider_17 = Slider(0.5, range=0..1)  # disabled
number_slider_18 = Slider(10, range=1..10)  # disabled
len_3 = Length(Curve=inner_edges_3)  # disabled
multiplication_3 = Multiplication(A=len_3, B=number_slider_17)  # disabled
anchor_3 = Anchor(Point=nv_5.NakedPts, Strength=1e+10)  # disabled
length_line_3 = LengthLine(Line=inner_edges_3, Length=multiplication_3, Strength=number_slider_18)  # disabled
show_3 = Show(G=input_mesh_3)  # disabled
button_3 = Button()  # disabled
toggle_11 = BooleanToggle(False)  # disabled

demesh_4 = DeconstructMesh(Mesh=input_mesh_3)  # -> Vertices, Faces, Colours, Normals; disabled
sph_4 = Sphere(Base=nv_5.NakedPts, Radius=0.2)  # disabled
wbfacepolys_2 = WeaverbirdsFacePolylines(Mesh=input_mesh_3)  # disabled
area_3 = Area(Geometry=wbfacepolys_2)  # -> Area, Centroid; disabled
preview_6 = CustomPreview(Geometry=sph_4, Material=swatch_3)  # disabled
pt_8 = Point(nv_5.NakedPts)  # disabled
pressure_2 = Pressure(M=input_mesh_3, Strength=1)  # disabled
voronoi_2 = Voronoi(Points=demesh_4.Vertices, Boundary=crv_3, BruteForceOverride=False)  # disabled
area_4 = Area(Geometry=voronoi_2)  # -> Area, Centroid; disabled
ma = MassAddition(Input=area_4.Area)  # -> Result, PartialResults; disabled
bnd_2 = Bounds(Numbers=area_4.Area)  # disabled
remap_2 = RemapNumbers(Value=area_4.Area, Source=bnd_2, Target=panel_2)  # -> expr("x*-1", Mapped), Clipped; disabled
integer_division = IntegerDivision(A=panel_3, B=ma.Result)  # disabled
multiplication_4 = Multiplication(A=area_4.Area, B=integer_division)  # disabled
vec_2 = VectorXYZ(XComponent=0, YComponent=0, ZComponent=expr("x*-1", multiplication_4))  # -> Vector, Length; disabled
load_2 = Load(Point=demesh_4.Vertices, ForceVector=vec_2.Vector, Weighting=1)  # disabled

vertexloads_3 = VertexLoads(Mesh=input_mesh_3, Strength=remap_2.Mapped)  # disabled
entwine_3 = Entwine(Branch00=show_3, Branch01=anchor_3, Branch02=length_line_3, Branch04=load_2, FlattenInputs=True)  # disabled
solver_3 = Solver(GoalObjects=entwine_3, Reset=button_3, Threshold=1e-15, Tolerance=0.0001, On=toggle_11)  # -> I, V, O; disabled

bang_3 = ExplodeTree(Data=solver_3.O)  # -> Branch0, Branch1, Branch2, Branch3, Branch4, Branch5; disabled

input_mesh_4 = Mesh(<mesh referenced from the Rhino model>)
# Kangaroo
srf_7 = Surface(reparameterize(<surface referenced from the Rhino model>))
crv_22 = Curve(srf_7)
disc_4 = Discontinuity(Curve=crv_22, Level=1)  # -> Points, Parameters
shatter_3 = Shatter(Curve=crv_22, Parameters=disc_4.Parameters)
divide_9 = DivideCurve(Curve=shatter_3, Count=Slider(40, range=0..40), Kinks=False)  # -> Points, Tangents, Parameters
item_7 = ListItem(List=shatter_3, Index=[1, 3], Wrap=True)

qrmesh_3 = QuadRemesh(Geometry=input_mesh_4, Settings=qrsettings_2)
demesh_5 = DeconstructMesh(Mesh=qrmesh_3)  # -> Vertices, Faces, Colours, Normals
move = Move(Geometry=crv_22, Motion=Vector(0, 0, 10))  # -> Geometry, Transform
preview_7 = CustomPreview(Geometry=demesh_5.Vertices, Material=ColourSwatch(SwatchColor=RGB(0, 0, 0)))
preview_8 = CustomPreview(Geometry=move.Geometry, Material=ColourSwatch(SwatchColor=RGB(255, 3, 3)))

medges_4 = MeshEdges(Mesh=qrmesh_3)  # -> NakedEdges, InteriorEdges, NonManifoldEdges
nv_6 = NakedVertices(Mesh=qrmesh_3)  # -> ClothedIndex, NakedIndex, ClothedPts, NakedPts
inner_edges_4 = Curve(flatten(medges_4.InteriorEdges))
len_4 = Length(Curve=inner_edges_4)
multiplication_5 = Multiplication(A=len_4, B=Slider(0.6, range=0..1))
vertexloads_4 = VertexLoads(Mesh=qrmesh_3, Strength=-1e-06)
anchor_4 = Anchor(Point=nv_6.NakedPts, Strength=1e+10)
length_line_4 = LengthLine(Line=inner_edges_4, Length=multiplication_5, Strength=Slider(74, range=1..100))
show_4 = Show(G=qrmesh_3)
entwine_4 = Entwine(Branch00=show_4, Branch01=anchor_4, Branch02=length_line_4, Branch04=vertexloads_4, FlattenInputs=True)
solver_4 = Solver(GoalObjects=entwine_4, Reset=Button(), Threshold=1e-15, Tolerance=0.0001, On=Toggle(False))  # -> I, V, O

sph_5 = Sphere(Base=nv_6.NakedPts, Radius=0.2)
preview_9 = CustomPreview(Geometry=sph_5, Material=ColourSwatch(SwatchColor=RGB(255, 0, 0)))
bang_4 = ExplodeTree(Data=solver_4.O)  # -> Branch0, Branch1, Branch2, Branch3, Branch4, Branch5
demesh_6 = DeconstructMesh(Mesh=bang_4.Branch0)  # -> Vertices, Faces, Colours, Normals
preview_10 = CustomPreview(Geometry=demesh_6.Vertices, Material=ColourSwatch(SwatchColor=RGB(48, 252, 3)))
cp_2 = ClosestPoint(Point=graft(demesh_6.Vertices), Cloud=demesh_5.Vertices)  # -> ClosestPoint, CPIndex, flatten(Distance)
bnd_3 = Bounds(Numbers=cp_2.Distance)
crv_23 = Curve(srf_7)
explode_3 = Explode(Curve=crv_23, Recursive=True)  # -> Segments, Vertices
divide_10 = DivideCurve(Curve=explode_3.Segments, Count=30, Kinks=False)  # -> Points, Tangents, Parameters
split_2 = SplitList(List=divide_10.Points, Index=16)  # -> ListA, ListB
cullpt_2 = CullDuplicates(Points=flatten(split_2.ListA), Tolerance=0.1, CullMode=3)  # -> Points, Indices, Valence
crv_24 = Curve(srf_7)
explode_4 = Explode(Curve=crv_24, Recursive=True)  # -> Segments, Vertices
midpt_2 = CurveMiddle(Curve=explode_4.Segments)
crv_cp_2 = CurveClosestPoint(Point=midpt_2, Curve=explode_4.Segments)  # -> Point, Parameter, Distance
shatter_4 = Shatter(Curve=explode_4.Segments, Parameters=crv_cp_2.Parameter)
item_8 = ListItem(List=shatter_4, Index=0, Wrap=True)
offset = OffsetCurve(Curve=item_8, Distance=0.1, Corners=1)
eval = EvaluateCurve(Curve=offset)  # -> Point, Tangent, Angle
divdist_3 = DivideDistance(Curve=reparameterize(offset), Distance=1)  # -> Points, Tangents, Parameters
cull_i_10 = CullIndex(List=divdist_3.Points, Indices=0, Wrap=True)
sph_6 = Sphere(Base=cull_i_10, Radius=0.25)
preview_11 = CustomPreview(Geometry=[pipe_3, sph_6], Material=ColourSwatch(SwatchColor=RGB(255, 0, 0)))
crv_25 = Curve(srf_7)  # disabled
crv_26 = Curve(srf_7)  # disabled
explode_5 = Explode(Curve=crv_26, Recursive=True)  # -> Segments, Vertices; disabled
line_support = LineSupport(
    GHLine=explode_5.Segments,
    SupportNo=panel_33,
    CoordinateSystem=list_7,
    TranslationalSpringX=panel_31,
    TranslationalSpringY=panel_31,
    TranslationalSpringZ=panel_31,
    RotationalRestraintX=panel_32,
    RotationalRestraintY=panel_32,
    RotationalRestraintZ=panel_32,
    mode="Assemble")  # disabled
surface = Surface(
    GHSurface=srf_7,
    SurfaceNo=panel_48,
    ThicknessNo=thickness,
    GeometryType=list_13,
    StiffnessType=list_14,
    AutomaticObjectdetection=toggle_8,
    mode="Assemble")  # disabled

srf_8 = Surface(reparameterize(<surface referenced from the Rhino model>))  # disabled
crv_27 = Curve(srf_8)  # disabled
disc_5 = Discontinuity(Curve=crv_27, Level=1)  # -> Points, Parameters; disabled
number_slider_19 = Slider(40, range=0..40)  # disabled
shatter_5 = Shatter(Curve=crv_27, Parameters=disc_5.Parameters)  # disabled
divide_11 = DivideCurve(Curve=shatter_5, Count=number_slider_19, Kinks=False)  # -> Points, Tangents, Parameters; disabled
item_9 = ListItem(List=shatter_5, Index=[1, 3], Wrap=True)  # disabled
number_slider_20 = Slider(0.6, range=0..1)  # disabled
number_slider_21 = Slider(74, range=1..100)  # disabled
button_4 = Button()  # disabled
toggle_12 = BooleanToggle(False)  # disabled

# ----
# Kangaroo
qrmesh_4 = QuadRemesh(Geometry=srf_8, Settings=qrsettings_3)  # disabled
move_2 = Move(Geometry=crv_27, Motion=Vector(0, 0, 10))  # -> Geometry, Transform; disabled
preview_12 = CustomPreview(Geometry=move_2.Geometry, Material=swatch)  # disabled

medges_5 = MeshEdges(Mesh=qrmesh_4)  # -> NakedEdges, InteriorEdges, NonManifoldEdges; disabled
nv_7 = NakedVertices(Mesh=qrmesh_4)  # -> ClothedIndex, NakedIndex, ClothedPts, NakedPts; disabled
inner_edges_5 = Curve(flatten(medges_5.InteriorEdges))  # disabled
len_5 = Length(Curve=inner_edges_5)  # disabled
multiplication_6 = Multiplication(A=len_5, B=number_slider_20)  # disabled
vertexloads_5 = VertexLoads(Mesh=qrmesh_4, Strength=-1)  # disabled
anchor_5 = Anchor(Point=nv_7.NakedPts, Strength=1e+10)  # disabled
length_line_5 = LengthLine(Line=inner_edges_5, Length=multiplication_6, Strength=number_slider_21)  # disabled
show_5 = Show(G=qrmesh_4)  # disabled
entwine_5 = Entwine(Branch00=show_5, Branch01=anchor_5, Branch02=length_line_5, Branch04=vertexloads_5, FlattenInputs=True)  # disabled
solver_5 = Solver(GoalObjects=entwine_5, Reset=button_4, Threshold=1e-15, Tolerance=0.0001, On=toggle_12)  # -> I, V, O; disabled

sph_7 = Sphere(Base=nv_7.NakedPts, Radius=0.2)  # disabled
preview_13 = CustomPreview(Geometry=sph_7, Material=swatch_4)  # disabled
bang_5 = ExplodeTree(Data=solver_5.O)  # -> Branch0, Branch1, Branch2, Branch3, Branch4, Branch5; disabled

input_mesh_5 = Mesh(conmesh)  # disabled
# Kangaroo
srf_9 = Surface(<surface referenced from the Rhino model>)  # disabled
crv_28 = Curve(srf_9)  # disabled
disc_6 = Discontinuity(Curve=crv_28, Level=1)  # -> Points, Parameters; disabled
number_slider_22 = Slider(40, range=0..40)  # disabled
shatter_6 = Shatter(Curve=crv_28, Parameters=disc_6.Parameters)  # disabled
divide_12 = DivideCurve(Curve=shatter_6, Count=number_slider_22, Kinks=False)  # -> Points, Tangents, Parameters; disabled
medges_6 = MeshEdges(Mesh=input_mesh_5)  # -> NakedEdges, InteriorEdges, NonManifoldEdges; disabled
item_10 = ListItem(List=shatter_6, Index=[1, 3], Wrap=True)  # disabled
number_slider_23 = Slider(0.25, range=0..1)  # disabled
nv_8 = NakedVertices(Mesh=input_mesh_5)  # -> ClothedIndex, NakedIndex, ClothedPts, NakedPts; disabled
number_slider_24 = Slider(10, range=0..10)  # disabled
inner_edges_6 = Curve(flatten(medges_6.InteriorEdges))  # disabled
number_slider_25 = Slider(0.75, range=0..1)  # disabled
number_slider_26 = Slider(9, range=1..10)  # disabled
len_6 = Length(Curve=inner_edges_6)  # disabled
multiplication_7 = Multiplication(A=len_6, B=number_slider_25)  # disabled
vertexloads_6 = VertexLoads(Mesh=input_mesh_5, Strength=-1e-06)  # disabled
anchor_6 = Anchor(Point=nv_8.NakedPts, Strength=1e+10)  # disabled
length_line_6 = LengthLine(Line=inner_edges_6, Length=multiplication_7, Strength=number_slider_26)  # disabled
show_6 = Show(G=input_mesh_5)  # disabled
button_5 = Button()  # disabled
toggle_13 = BooleanToggle(False)  # disabled

outer_edges = Curve(flatten(medges_6.NakedEdges))  # disabled
len_7 = Length(Curve=outer_edges)  # disabled
multiplication_8 = Multiplication(A=len_7, B=number_slider_23)  # disabled
length_line_7 = LengthLine(Line=medges_6.NakedEdges, Length=multiplication_8, Strength=number_slider_24)  # disabled

entwine_6 = Entwine(
    Branch00=show_6,
    Branch01=anchor_6,
    Branch02=length_line_6,
    Branch03=length_line_7,
    Branch04=vertexloads_6,
    FlattenInputs=True)  # disabled
solver_6 = Solver(GoalObjects=entwine_6, Reset=button_5, Threshold=1e-15, Tolerance=0.0001, On=toggle_13)  # -> I, V, O; disabled

bang_6 = ExplodeTree(Data=solver_6.O)  # -> Branch0, Branch1, Branch2, Branch3, Branch4, Branch5; disabled

# ----
# Karamba
mesh_5 = Mesh(bang_6.Branch0)  # disabled
panel_51 = Panel("2")  # disabled
panel_52 = Panel("2")  # disabled
panel_53 = Panel("1.4")  # disabled
panel_54 = Panel("3")  # disabled
panel_55 = Panel("1")  # disabled
matprops_2 = MaterialPropertiesKaramba3D(
    FamilyOfMaterial="Steel",
    Name="S235",
    YoungsModulus_kN_cm²=panel_54,
    InPlaneShearModulus_kN_cm²=panel_53,
    TransverseShearModulus_kN_cm²=panel_53,
    SpecificWeight_kN_m³=panel_55,
    CoefficientOfThermalExpansion_1=1.2e-05,
    TensileStrength_kN_cm²=panel_52,
    CompressiveStrength_kN_cm²=panel_51,
    StrengthHypothesis="MISES",
    mode="Isotrop")  # disabled
panel_56 = Panel("0.1")  # disabled
nv_9 = NakedVertices(Mesh=mesh_5)  # -> ClothedIndex, NakedIndex, ClothedPts, NakedPts; disabled
crosec_3 = CrossSectionKaramba3D(FamilyNameOfCrossSection="DefaultCroSec", Material=matprops_2, Height_cm=panel_56, mode="Shell - Const")  # disabled
panel_57 = Panel("-0.072")  # disabled
panel_58 = Panel("-0.01")  # disabled
Z_3 = UnitZ(Factor=panel_57)  # disabled
surfelem = CreateSurfaceElementKaramba3D(Mesh=mesh_5, CrossSection=crosec_3, LimitDistance_m=0.005, Bending=False, mode="MeshToMembrane")  # -> Element, Points, Info; disabled
supp = SupportKaramba3D(PosInd=nv_9.NakedPts, menu=[buttons(on, on, on, off, off, off)])  # disabled
loads_4 = LoadsKaramba3D(Vector=Vector(0, 0, -1), LCase="LC0", mode="Gravity")  # disabled
loads_5 = LoadsKaramba3D(Eps0=panel_58, LCase="LC0", mode="InitialStrain")  # disabled
loads_6 = LoadsKaramba3D(Vector=Z_3, Mesh=mesh_5, LCase="LC0", mode="MeshLoad -Const.", menu=[buttons(off, on, off), buttons(on, on)])  # disabled
load_3 = LoadKaramba3D(flatten([loads_4, loads_5, loads_6]))  # disabled
assemble = AssembleModelKaramba3D(Elem=flatten(surfelem.Element), Support=flatten(supp), Load=flatten(load_3), LimitDistance_cm=0.0001)  # -> Model, Info, Mass_kg, CentreOfGravity, LoadCaseNames; disabled
analyse = AnalyseKaramba3D(Model=assemble.Model)  # -> AnalysedModel, MaximumDisplacement_cm, ResultingForce_kN, ChangeOfElasticEnergy_kNm; disabled
analysethii = AnalyseThIIKaramba3D(
    Model=assemble.Model,
    UseInitialNII=True,
    NIIFromCombination=True,
    NoTensionalNII=False,
    RTolerance=1e-07,
    MaxIterations=50)  # -> AnalysedModel, MaximumDisplacement_cm, ResultingForce_kN, ChangeOfElasticEnergy_kNm; disabled
modelview = ModelViewKaramba3D(Model=analysethii.AnalysedModel)  # -> Model, DeformedMesh, DeformedAxes, DeformedModel, MaximumDeformation; disabled
shellview = ShellViewKaramba3D(Model=modelview.Model, IndexOfLayer=0)  # -> Model, MeshesOfRenderedShells, LegendColours, LegendTags; disabled
number_slider_27 = Slider(10, range=0..40)  # disabled
legend = Legend(Colour=shellview.LegendColours, Tags=shellview.LegendTags, LegendType=1)  # disabled
popgeo_2 = PopulateGeometry(Geometry=mesh_5, Count=100, Seed=number_slider_27)  # disabled
shelllineresults = LineResultsOnShellsKaramba3D(
    AnalysedModel=analysethii.AnalysedModel,
    LayerPosition=0,
    ListOfSourcesOfPrincipalStressLinesLinesPoints=cull_i_8,
    SegmentLength_m=0.02,
    DA_deg=5,
    mode="PrincStress")  # -> Model, Lines1, Lines2; disabled

shelllineresults_2 = LineResultsOnShellsKaramba3D(
    AnalysedModel=analysethii.AnalysedModel,
    LayerPosition=0,
    ListOfSourcesOfPrincipalStressLinesLinesPoints=cull_i_3,
    SegmentLength_m=0.02,
    DA_deg=5,
    mode="PrincStress")  # -> Model, Lines1, Lines2; disabled
crv_29 = Curve(shelllineresults.Lines1)  # disabled
crv_30 = Curve(shelllineresults_2.Lines2)  # disabled
join_4 = JoinCurves(Curves=crv_29, Preserve=False)  # -> flatten(Curves); disabled
divide_13 = DivideCurve(Curve=join_4, Count=10, Kinks=False)  # -> Points, Tangents, Parameters; disabled
pdecon = Deconstruct(Point=divide_13.Points)  # -> XComponent, YComponent, ZComponent; disabled

input_mesh_6 = Mesh(<mesh referenced from the Rhino model>)  # disabled
medges_7 = MeshEdges(Mesh=input_mesh_6)  # -> NakedEdges, InteriorEdges, NonManifoldEdges; disabled
nv_10 = NakedVertices(Mesh=input_mesh_6)  # -> ClothedIndex, NakedIndex, ClothedPts, NakedPts; disabled
inner_edges_7 = Curve(flatten(medges_7.InteriorEdges))  # disabled
number_slider_28 = Slider(0.5, range=0..1)  # disabled
number_slider_29 = Slider(10, range=1..10)  # disabled
len_8 = Length(Curve=inner_edges_7)  # disabled
multiplication_9 = Multiplication(A=len_8, B=number_slider_28)  # disabled
vertexloads_7 = VertexLoads(Mesh=input_mesh_6, Strength=-1)  # disabled
anchor_7 = Anchor(Point=nv_10.NakedPts, Strength=1e+10)  # disabled
length_line_8 = LengthLine(Line=inner_edges_7, Length=multiplication_9, Strength=number_slider_29)  # disabled
show_7 = Show(G=input_mesh_6)  # disabled
button_6 = Button()  # disabled
toggle_14 = BooleanToggle(True)  # disabled

demesh_7 = DeconstructMesh(Mesh=input_mesh_6)  # -> Vertices, Faces, Colours, Normals; disabled
sph_8 = Sphere(Base=nv_10.NakedPts, Radius=0.2)  # disabled
voronoi_3 = Voronoi(Points=demesh_7.Vertices, Boundary=crv_8, BruteForceOverride=False)  # disabled
area_5 = Area(Geometry=voronoi_3)  # -> Area, Centroid; disabled
preview_14 = CustomPreview(Geometry=sph_8, Material=swatch_5)  # disabled
bnd_4 = Bounds(Numbers=area_5.Area)  # disabled
remap_3 = RemapNumbers(Value=area_5.Area, Source=bnd_4, Target=panel_6)  # -> expr("x*-1", Mapped), Clipped; disabled
vec_3 = VectorXYZ(XComponent=0, YComponent=0, ZComponent=expr("x*-1", area_5.Area))  # -> Vector, Length; disabled
load_4 = Load(Point=nv_10.ClothedPts, ForceVector=expr("x*-1", Vector(0, 0, 1)), Weighting=1)  # disabled
load_5 = Load(Point=demesh_7.Vertices, ForceVector=vec_3.Vector, Weighting=1)  # disabled

entwine_7 = Entwine(Branch00=show_7, Branch01=anchor_7, Branch02=length_line_8, Branch04=load_4, FlattenInputs=True)  # disabled
solver_7 = Solver(GoalObjects=entwine_7, Reset=button_6, Threshold=1e-15, Tolerance=0.0001, On=toggle_14)  # -> I, V, O; disabled

bang_7 = ExplodeTree(Data=solver_7.O)  # -> Branch0, Branch1, Branch2, Branch3, Branch4, Branch5; disabled

mesh_6 = Mesh(bang_4.Branch0)
matprops_3 = MaterialPropertiesKaramba3D(
    FamilyOfMaterial="Steel",
    Name="S235",
    YoungsModulus_kN_cm²="3.5",
    InPlaneShearModulus_kN_cm²="1.4",
    TransverseShearModulus_kN_cm²="1.4",
    SpecificWeight_kN_m³="1",
    CoefficientOfThermalExpansion_1=1.2e-05,
    TensileStrength_kN_cm²="1",
    CompressiveStrength_kN_cm²="0.1",
    StrengthHypothesis="MISES",
    mode="Isotrop")
nv_11 = NakedVertices(Mesh=mesh_6)  # -> ClothedIndex, NakedIndex, ClothedPts, NakedPts
crosec_4 = CrossSectionKaramba3D(FamilyNameOfCrossSection="DefaultCroSec", Material=matprops_3, Height_cm="0.3", mode="Shell - Const")
supp_2 = SupportKaramba3D(PosInd=nv_11.NakedPts, menu=[buttons(on, on, on, off, off, on)])
loads_7 = LoadsKaramba3D(Vector=Vector(0, 0, -1), LCase="LC0", mode="Gravity")
loads_8 = LoadsKaramba3D(Eps0="-10", LCase="LC0", mode="InitialStrain")
popgeo_3 = PopulateGeometry(Geometry=mesh_6, Count="35", Seed=Slider(22, range=0..40))

# ----
# Karamba
refine = Refine(Mesh=mesh_6, Level=1)
mesh_7 = Mesh(mesh_6)
crv_cp_3 = CurveClosestPoint(Point=nv_11.NakedPts, Curve=crv_7)  # -> Point, Parameter, Distance
smaller_2 = SmallerThan(FirstNumber=crv_cp_3.Distance, SecondNumber=0.01)  # -> SmallerThan, OrEqualTo
cull_2 = CullPattern(List=crv_cp_3.Point, CullPattern=smaller_2.SmallerThan)
loads_9 = LoadsKaramba3D(Vector=Z, Mesh=mesh_6, LCase="LC0", mode="MeshLoad -Const.", menu=[buttons(off, on, off), buttons(on, on)])
msh2psrf = MeshToPolysurface(Mesh=refine, Triangles=False, FaceMerge=False)

mesh_8 = Mesh(qrmesh_2)
matprops_4 = MaterialPropertiesKaramba3D(
    FamilyOfMaterial="Steel",
    Name="S235",
    YoungsModulus_kN_cm²="3.5",
    InPlaneShearModulus_kN_cm²="1.4",
    TransverseShearModulus_kN_cm²="1.4",
    SpecificWeight_kN_m³="1",
    CoefficientOfThermalExpansion_1=1.2e-05,
    TensileStrength_kN_cm²="1",
    CompressiveStrength_kN_cm²="0.1",
    StrengthHypothesis="MISES",
    mode="Isotrop")
nv_12 = NakedVertices(Mesh=mesh_8)  # -> ClothedIndex, NakedIndex, ClothedPts, NakedPts
crosec_5 = CrossSectionKaramba3D(FamilyNameOfCrossSection="DefaultCroSec", Material=matselect_2, Height_cm="0.3", mode="Shell - Const")
supp_3 = SupportKaramba3D(PosInd=nv_12.NakedPts, menu=[buttons(on, on, on, off, off, on)])
loads_10 = LoadsKaramba3D(Vector=Vector(0, 0, -1), LCase="LC0", mode="Gravity")
popgeo_4 = PopulateGeometry(Geometry=mesh_8, Count="35", Seed=Slider(22, range=0..40))

# ----
# Karamba
mesh_9 = Mesh(mesh_8)
crv_cp_4 = CurveClosestPoint(Point=nv_12.NakedPts, Curve=crv_6)  # -> Point, Parameter, Distance
smaller_3 = SmallerThan(FirstNumber=crv_cp_4.Distance, SecondNumber=0.01)  # -> SmallerThan, OrEqualTo
Z_4 = UnitZ(Factor="-20")
cull_3 = CullPattern(List=crv_cp_4.Point, CullPattern=smaller_3.SmallerThan)

mesh_10 = Mesh(bang_5.Branch0)  # disabled
panel_59 = Panel("0.3")  # disabled
crosec_6 = CrossSectionKaramba3D(FamilyNameOfCrossSection="DefaultCroSec", Material=matselect_4, Height_cm=panel_59, mode="Shell - Const")  # disabled
panel_60 = Panel("-30")  # disabled
Z_5 = UnitZ(Factor=panel_60)  # disabled
loads_11 = LoadsKaramba3D(Vector=Vector(0, 0, -1), LCase="LC0", mode="Gravity")  # disabled

area_6 = MeshArea(Mesh=mesh_10)  # -> Area, Centroid; disabled
line = LineSDL(Start=area_6.Centroid, Direction=X, Length=1)  # disabled
project = Project(Geometry=line, Plane=PlaneXY(0, 0, 0))  # -> Geometry, Transform; disabled
rotax = RotateAxis(Geometry=mesh_10, Angle=degrees(panel_5), Axis=project.Geometry)  # -> Geometry, Transform; disabled
# Karamba
mesh_11 = Mesh(rotax.Geometry)  # disabled
popgeo_5 = PopulateGeometry(Geometry=mesh_11, Count=100, Seed=1)  # disabled

# ----
# Karamba
mesh_12 = Mesh(input_mesh_2)  # disabled
panel_61 = Panel("2")  # disabled
panel_63 = Panel("190")  # disabled
panel_64 = Panel("400")  # disabled
panel_65 = Panel("1")  # disabled
panel_66 = Panel("0.5")  # disabled
panel_67 = Panel("-1")  # disabled
Z_6 = UnitZ(Factor=panel_67)  # disabled
supp_4 = SupportKaramba3D(PosInd=nv_4.NakedPts, menu=[buttons(on, on, on, off, off, on)])  # disabled
loads_12 = LoadsKaramba3D(Vector=Vector(0, 0, -1), LCase="LC0", mode="Gravity")  # disabled
loads_13 = LoadsKaramba3D(Vector=Z_6, Mesh=mesh_3, LCase="LC0", mode="MeshLoad -Const.", menu=[buttons(off, on, off), buttons(on, on)])  # disabled
load_6 = LoadKaramba3D(flatten([loads_12, loads_13]))  # disabled

crosec_7 = CrossSectionKaramba3D(FamilyNameOfCrossSection="DefaultCroSec", Material=matselect_3, Height_cm=panel_66, mode="Shell - Const")  # disabled

surfelem_2 = CreateSurfaceElementKaramba3D(Mesh=mesh_3, CrossSection=crosec_7, LimitDistance_m=0.005, Bending=True, mode="MeshToShell")  # -> Element, Points, Info; disabled

assemble_2 = AssembleModelKaramba3D(Elem=flatten(surfelem_2.Element), Support=flatten(supp_4), Load=flatten(load_6), LimitDistance_cm=0.005)  # -> Model, Info, Mass_kg, CentreOfGravity, LoadCaseNames; disabled
analysethii_2 = AnalyseThIIKaramba3D(
    Model=assemble_2.Model,
    UseInitialNII=True,
    NIIFromCombination=True,
    NoTensionalNII=False,
    RTolerance=1e-07,
    MaxIterations=50)  # -> AnalysedModel, MaximumDisplacement_cm, ResultingForce_kN, ChangeOfElasticEnergy_kNm; disabled
modelview_2 = ModelViewKaramba3D(Model=analysethii_2.AnalysedModel)  # -> Model, DeformedMesh, DeformedAxes, DeformedModel, MaximumDeformation; disabled
shellview_2 = ShellViewKaramba3D(Model=modelview_2.Model, IndexOfLayer=0)  # -> Model, MeshesOfRenderedShells, LegendColours, LegendTags; disabled
shelllineresults_3 = LineResultsOnShellsKaramba3D(
    AnalysedModel=shellview_2.Model,
    LayerPosition=1,
    ListOfSourcesOfPrincipalStressLinesLinesPoints=popgeo,
    SegmentLength_m=0.5,
    DA_deg=5,
    mode="PrincStress")  # -> Model, Lines1, Lines2; disabled
crv_31 = Curve(shelllineresults_3.Lines1)  # disabled
legend_2 = Legend(Colour=shellview_2.LegendColours, Tags=shellview_2.LegendTags, LegendType=1)  # disabled

surfelem_3 = CreateSurfaceElementKaramba3D(Mesh=mesh_7, CrossSection=crosec_4, LimitDistance_m=0.005, Bending=True, mode="MeshToShell")  # -> Element, Points, Info
load_7 = LoadKaramba3D(flatten([loads_7, loads_8, loads_9]))
assemble_3 = AssembleModelKaramba3D(Elem=flatten(surfelem_3.Element), Support=flatten(supp_2), Load=flatten(load_7), LimitDistance_cm=0.0001)  # -> Model, Info, Mass_kg, CentreOfGravity, LoadCaseNames

analysethii_3 = AnalyseThIIKaramba3D(
    Model=assemble_3.Model,
    UseInitialNII=True,
    NIIFromCombination=True,
    NoTensionalNII=False,
    RTolerance=1e-07,
    MaxIterations=50)  # -> AnalysedModel, MaximumDisplacement_cm, ResultingForce_kN, ChangeOfElasticEnergy_kNm

modelview_3 = ModelViewKaramba3D(Model=analysethii_3.AnalysedModel)  # -> Model, DeformedMesh, DeformedAxes, DeformedModel, MaximumDeformation
shellview_3 = ShellViewKaramba3D(Model=modelview_3.Model, IndexOfLayer=0)  # -> Model, MeshesOfRenderedShells, LegendColours, LegendTags
legend_3 = Legend(Colour=shellview_3.LegendColours, Tags=shellview_3.LegendTags, Rectangle=rec, LegendType=101)

react = ReactionForcesKaramba3D(AnalysedModel=modelview_3.Model)  # -> Model, flatten(ReactionForces_kN), ReactionMoments_kNm, SupportPosition, SumOfReactionForces_kN, SumOfReactionMoments_kNm, GoverningLoadCaseIndex
denergy = DeformationEnergyKaramba3D(AnalysedModel=shellview_3.Model, NIntervals=2)  # -> AnalysedModel, flatten(AxialDeformationEnergies_kNm), AxialDeformationEnergiesLoadCaseIndexes, flatten(BendingEnergies_kNm), BendingEnergiesLoadCaseIndexes
shellview_4 = ShellViewKaramba3D(Model=modelview_3.Model, IndexOfLayer=0)  # -> Model, MeshesOfRenderedShells, LegendColours, LegendTags
ma_2 = MassAddition(Input=denergy.AxialDeformationEnergies_kNm)  # -> Result, PartialResults
shelllineresults_4 = LineResultsOnShellsKaramba3D(AnalysedModel=shellview_3.Model, LayerPosition=0, SegmentLength_m=0.5, DA_deg=5, mode="PrincStress")  # -> Model, Lines1, Lines2
shellvecresults = ResultVectorsOnShellsKaramba3D(Model=shellview_3.Model, LayerPosition=0, mode="PrincStress")  # -> Model, Points, FirstPrincipalStressVector_kN_cm², SecondPrincipalStressVector_kN_cm², FirstPrincipalStressValue_kN_cm², SecondPrincipalStressValue_kN_cm²
cull_4 = CullPattern(List=shellvecresults.SecondPrincipalStressVector_kN_cm², CullPattern=[False, False, True, True, False, False])
cull_5 = CullPattern(List=shellvecresults.Points, CullPattern=[False, False, True, True, False, False])
unit = UnitVector(Vector=shellvecresults.FirstPrincipalStressVector_kN_cm²)
unit_2 = UnitVector(Vector=shellvecresults.SecondPrincipalStressVector_kN_cm²)
amp = Amplitude(Vector=cull_4, Amplitude="0.5")
vdisex_2 = VectorDisplayEx(Point=cull_5, Vector=amp, Colour=RGB(0, 0, 0), Width=2)
equalst = EqualityWithinTolerance(
    FirstNumber=shellvecresults.FirstPrincipalStressValue_kN_cm²,
    SecondNumber=shellvecresults.SecondPrincipalStressValue_kN_cm²,
    Tolerance=1e-11)  # -> Equality, Inequality; disabled
py3 = Python3Script(
    pts=shellvecresults.Points,
    y=pt_2,
    e1_list=unit,
    sigma1_list=shellvecresults.FirstPrincipalStressValue_kN_cm²,
    e2_list=unit_2,
    sigma2_list=shellvecresults.SecondPrincipalStressValue_kN_cm²)  # -> out, a, b, c, d, angles; inputs pts: list of Point3d, y: list of Point3d, e1_list: list of Vector3d, sigma1_list: list, e2_list: list of Vector3d, sigma2_list: list
# ---------- py3: Python ----------
import Rhino.Geometry as rg
import numpy as np

"""
We now have real data stored in:
  pts        : a list of Rhino.Geometry.Point3d
  e1_list    : principal direction #1 (Vector3d)
  sigma1_list: principal stress #1 (float)
  e2_list    : principal direction #2 (Vector3d)
  sigma2_list: principal stress #2 (float)

We'll build a stress tensor [T11, T12, T22] for each point using build_stress_tensors.
Then for partial derivatives, we do finite differences using 'interpolate_tensor'.
"""

###########################################################
# 0) Building Tensors from principal data
###########################################################
def build_stress_tensor(e1, sigma1, e2, sigma2):
    v1 = [e1.X, e1.Y]
    v2 = [e2.X, e2.Y]
    T11 = sigma1*(v1[0]**2) + sigma2*(v2[0]**2)
    T12 = sigma1*(v1[0]*v1[1]) + sigma2*(v2[0]*v2[1])
    T22 = sigma1*(v1[1]**2) + sigma2*(v2[1]**2)
    return [T11, T12, T22]

def build_stress_tensors(e1_list, sigma1_list, e2_list, sigma2_list):
    tensors = []
    for e1, s1, e2, s2 in zip(e1_list, sigma1_list, e2_list, sigma2_list):
        t = build_stress_tensor(e1, s1, e2, s2)
        tensors.append(t)
    return tensors

###########################################################
# 1) Interpolating T (no more example_tensor)
###########################################################
def interpolate_tensor(x, y, pts, tensors, k=3):
    """
    Weighted K-NN approach:
      - find k nearest sample points from 'pts'
      - do weighted average of their [T11,T12,T22]
      - return that as T
    """
    dists_idx = []
    for i, p in enumerate(pts):
        dx = x - p.X
        dy = y - p.Y
        dist2 = dx*dx + dy*dy
        dists_idx.append((dist2, i))
    dists_idx.sort(key=lambda x: x[0])
    
    if dists_idx[0][0] < 1e-12:
        # exactly on that data point
        return tensors[dists_idx[0][1]]
    
    wsum = 0.0
    Tacc = [0.0, 0.0, 0.0]
    for dist2, idx in dists_idx[:k]:
        w = 1.0/(dist2+1e-12)
        Tacc[0] += w*tensors[idx][0]
        Tacc[1] += w*tensors[idx][1]
        Tacc[2] += w*tensors[idx][2]
        wsum += w
    return [v/wsum for v in Tacc]

###########################################################
# 2) Defining f_func, g_func for partial derivatives
###########################################################
def f_func2(x,y, pts, tensors):
    # f = T11 - T22
    T = interpolate_tensor(x,y, pts, tensors)
    return T[0] - T[2]

def g_func2(x,y, pts, tensors):
    # g = T12
    T = interpolate_tensor(x,y, pts, tensors)
    return T[1]

###########################################################
# 3) First-order partials => (a,b,c,d)
###########################################################
def compute_abcd(x0, y0, pts, tensors, eps=1e-3):
    fxp = f_func2(x0+eps, y0, pts, tensors)
    fxm = f_func2(x0-eps, y0, pts, tensors)
    a = 0.5*((fxp - fxm)/(2*eps))
    
    fyp = f_func2(x0, y0+eps, pts, tensors)
    fym = f_func2(x0, y0-eps, pts, tensors)
    b = 0.5*((fyp - fym)/(2*eps))
    
    gxp = g_func2(x0+eps, y0, pts, tensors)
    gxm = g_func2(x0-eps, y0, pts, tensors)
    c_ = (gxp - gxm)/(2*eps)
    
    gyp = g_func2(x0, y0+eps, pts, tensors)
    gym = g_func2(x0, y0-eps, pts, tensors)
    d_ = (gyp - gym)/(2*eps)
    
    return (a,b,c_,d_)

def delta_invariant(a,b,c_,d_):
    return a*d_ - b*c_

###########################################################
# 4) Solve the cubic for separatrix directions
###########################################################
def solve_cubic(a,b,c_,d_):
    # d x^3 + (c+2b)x^2 + (2a - d)x - c = 0
    A = d_
    B = c_ + 2*b
    C = 2*a - d_
    D = -c_
    coeffs = [A,B,C,D]
    roots = np.roots(coeffs)
    real_roots = [r.real for r in roots if abs(r.imag)<1e-6]
    return real_roots

###########################################################
# 5) Second-order expansions if needed
###########################################################
def second_order_expansion(func, x0, y0, eps=1e-3):
    """
    Return (f0, fx, fy, fxx, fxy, fyy) using finite differences,
    but 'func' must also use 'pts, tensors' behind the scenes or be a closure.
    """
    f0 = func(x0,y0)
    
    fp_xp = func(x0+eps,y0)
    fp_xm = func(x0-eps,y0)
    fx = (fp_xp - fp_xm)/(2*eps)
    
    fp_yp = func(x0,y0+eps)
    fp_ym = func(x0,y0-eps)
    fy = (fp_yp - fp_ym)/(2*eps)
    
    fxx = (fp_xp - 2*f0 + fp_xm)/(eps*eps)
    fyy = (fp_yp - 2*f0 + fp_ym)/(eps*eps)
    
    f_xypp = func(x0+eps, y0+eps)
    f_xypm = func(x0+eps, y0-eps)
    f_xymp = func(x0-eps, y0+eps)
    f_xymm = func(x0-eps, y0-eps)
    fxy = (f_xypp - f_xypm - f_xymp + f_xymm)/(4*eps*eps)
    
    return (f0,fx,fy,fxx,fxy,fyy)

def interpret_second_order_saddle(x0,y0, pts, tensors, eps=1e-3):
    """
    If the first-order delta=0 => do second-order expansions for
    f(x,y)=T11-T22, g(x,y)=T12, both must rely on 'pts, tensors'.
    We'll do a minimal check => label "Saddle(I=-1) [2nd order]" or "HigherOrder? not sure"
    """
    def f_local(xx,yy):
        T = interpolate_tensor(xx,yy, pts, tensors)
        return T[0] - T[2]
    def g_local(xx,yy):
        T = interpolate_tensor(xx,yy, pts, tensors)
        return T[1]
    
    f0,fx,fy,fxx,fxy,fyy = second_order_expansion(f_local, x0,y0, eps)
    g0,gx,gy,gxx,gxy,gyy = second_order_expansion(g_local, x0,y0, eps)
    
    near_zero_1st = (abs(f0)<1e-7 and abs(g0)<1e-7
                     and abs(fx)<1e-7 and abs(fy)<1e-7
                     and abs(gx)<1e-7 and abs(gy)<1e-7)
    large_2nd = (abs(fxx)>1e-7 or abs(fyy)>1e-7
                 or abs(gxx)>1e-7 or abs(gyy)>1e-7
                 or abs(fxy)>1e-7 or abs(gxy)>1e-7)
    if near_zero_1st and large_2nd:
        return "Saddle(I=-1) [2nd order]"
    else:
        return "HigherOrder? not sure"

###########################################################
# 6) find degenerate points
###########################################################
def find_degenerate_points(pts, real_tensors, tol=1e-3):
    """
    Quick approach:
     for each point p, if T11-T22 ~0 and T12 ~0 => degenerate
     (Similar to your domain check, but we just do it EXACT for each data point).
    If you want to do a continuous search in the plane, you'd do more interpolation checks.
    """
    degs = []
    for i, p in enumerate(pts):
        T = real_tensors[i]
        T11,T12,T22 = T
        if abs(T11-T22)<tol and abs(T12)<tol:
            degs.append(p)
    return degs

###########################################################
# MAIN GH CODE
###########################################################
# We assume the user provided:
#  1) pts (List[rg.Point3d]) - sample positions
#  2) e1_list (List[rg.Vector3d])
#  3) sigma1_list (List[float])
#  4) e2_list (List[rg.Vector3d])
#  5) sigma2_list (List[float])
# as GH inputs.

# 1) build the stress (T11, T12, T22) for each pt
tensors = build_stress_tensors(e1_list, sigma1_list, e2_list, sigma2_list)

# 2) find degenerate points among those exact positions
deg_tol = 1e-3
deg_points = y

classifications = []
separatrix_directions = []
eps_delta = 1e-12

for dp in deg_points:
    x0, y0 = dp.X, dp.Y
    # gather first-order partials
    a,b,c_,d_ = compute_abcd(x0, y0, pts, tensors, eps=1e-3)
    delt = delta_invariant(a,b,c_,d_)
    print(delt)
    # classify
    if abs(delt) < eps_delta:
        # second order check
        ctype_2nd = interpret_second_order_saddle(x0,y0, pts, tensors, eps=1e-3)
        ctype = ctype_2nd
        print(ctype_2nd)
    if delt < 0:
        ctype = "Trisector(I=-1/2)"
        print(ctype)
    else:
        ctype = "Wedge(I=+1/2)"
    
    # solve cubic for directions
    roots = solve_cubic(a,b,c_,d_)
    angles = [np.arctan(r) for r in roots]
    
    classifications.append((dp,a,b,c_,d_,delt, ctype))
    separatrix_directions.append((dp,angles))



# Output to GH
from ghpythonlib import treehelpers as tr
# a) degenerate points
a = deg_points

# b) classification info
b_out = []
for (dp,a_,b_,c__,d__, delt, ctype) in classifications:
    b_out.append((ctype))

b = b_out

# e) angles
e_out = []
for dp, angs in separatrix_directions:
    e_out.append((dp, [round(a,4) for a in angs]))
angles = tr.list_to_tree(e_out)
# ---------- end py3 ----------
vlen = VectorLength(Vector=shellvecresults.SecondPrincipalStressVector_kN_cm²)
cull_6 = CullPattern(List=shellvecresults.Points, CullPattern=equalst.Equality)  # disabled
bnd_5 = Bounds(Numbers=vlen)
panel_68 = Panel(py3.b)
dedomain = DeconstructDomain(Domain=bnd_5)  # -> Start, End; disabled
stress_distribution = Python3Script(
    C=skeleton_2,
    Pts=shellvecresults.Points,
    V=vlen,
    minVec=dedomain.Start,
    maxVec=dedomain.End,
    minStep=panel_8,
    maxStep=panel_9)  # -> out, a, b; inputs C: Curve, Pts: list of Point3d, V: list of Double, minVec: Double, maxVec: Double, minStep: Double, maxStep: Double; disabled
# ---------- stress_distribution: Python ----------
""" 
Inputs:
    C: Curve
    V: list of Vector3d
    Pts: list of Point3d
    minVec: float
    maxVec: float
    minStep: float
    maxStep: float

Output:
    pts_on_curve: list of Point3d
"""

import Rhino
import math

def remap(value, in_min, in_max, out_min, out_max):
    """
    Linearly remaps 'value' from range [in_min, in_max] 
    to [out_min, out_max].
    """
    # Handle edge case if in_min == in_max to avoid division by zero
    if abs(in_max - in_min) < 1e-12:
        return out_min
    t = float(value - in_min) / float(in_max - in_min)
    return out_min + t * (out_max - out_min)

# Get the total length of the curve:
curve_length = C.GetLength()

# Start at curve parameter = 0 (the start)
# or, you can use curve domain if needed:
t = C.Domain.Min

# Convert param domain to length domain if you want to move in *units* along the curve
current_length_along_curve = 0.0

points_on_curve = []
# Evaluate the start point on the curve
start_pt = C.PointAtStart
points_on_curve.append(start_pt)

while True:
    # ----------------------------------------------------
    # 1) Get the current point on the curve
    current_pt = C.PointAt(C.Domain.ParameterAt(current_length_along_curve / curve_length))
    
    # ----------------------------------------------------
    # 2) Find the 4 closest “vector points” to current_pt
    #    We do a simple sort by distance and take the first 4
    # ----------------------------------------------------
    # Calculate distances from current_pt to each vector point
    distances = []
    for i, pt in enumerate(Pts):
        dist = current_pt.DistanceTo(pt)
        distances.append((dist, i))
    
    # Sort by distance
    distances.sort(key=lambda x: x[0])
    # Pick the 4 closest
    closest_indices = [distances[j][1] for j in range(min(2, len(distances)))]
    
    # ----------------------------------------------------
    # 3) From those 4 vectors, compute an "average magnitude"
    # ----------------------------------------------------
    sum_length = 0.0
    for idx in closest_indices:
        sum_length += V[idx]
    avg_length = sum_length / 2.0  if len(closest_indices) == 2 else 0.0
    
    # ----------------------------------------------------
    # 4) Remap that average magnitude from [minVec, maxVec] to [minStep, maxStep]
    # ----------------------------------------------------
    step_size = remap(avg_length, minVec, maxVec, minStep, maxStep)
    print(avg_length)
    
    # ----------------------------------------------------
    # 5) Advance along the curve by step_size
    # ----------------------------------------------------
    next_length_along_curve = current_length_along_curve + step_size
    
    # Stop if the next step goes beyond the end of the curve
    if next_length_along_curve > curve_length:
        break
    
    current_length_along_curve = next_length_along_curve
    
    # Evaluate next point on the curve
    next_pt = C.PointAt(C.Domain.ParameterAt(current_length_along_curve / curve_length))
    points_on_curve.append(next_pt)


    print("  current_pt =", current_pt)
    print("  closest_indices:", closest_indices)
    for idx in closest_indices:
        print("    Vector idx =", idx, " length =", V[idx])
    print("  average_length =", avg_length)
    print("  step_size =", step_size)
    print("--------------")



# Assign output
pts_on_curve = points_on_curve
a = pts_on_curve
# ---------- end stress_distribution ----------
stress_distribution_2 = Python3Script(
    C=offset,
    Pts=shellvecresults.Points,
    V=vlen,
    minVec=dedomain.Start,
    maxVec=dedomain.End,
    minStep=panel_8,
    maxStep=panel_9)  # -> out, a, b; inputs C: Curve, Pts: list of Point3d, V: list of Double, minVec: Double, maxVec: Double, minStep: Double, maxStep: Double; disabled; same code as stress_distribution
pt_9 = Point(stress_distribution.a)  # disabled
shelllineresults_5 = LineResultsOnShellsKaramba3D(
    AnalysedModel=shellview_3.Model,
    LayerPosition=0,
    ListOfSourcesOfPrincipalStressLinesLinesPoints=flatten(rev),
    SegmentLength_m=0.02,
    DA_deg=5,
    mode="PrincStress")  # -> Model, Lines1, Lines2
shelllineresults_6 = LineResultsOnShellsKaramba3D(
    AnalysedModel=shellview_3.Model,
    LayerPosition=0,
    ListOfSourcesOfPrincipalStressLinesLinesPoints=flatten(cull_i_10),
    SegmentLength_m=0.02,
    DA_deg=5,
    mode="PrincStress")  # -> Model, Lines1, Lines2
crv_32 = Curve(shelllineresults_5.Lines2)
crv_33 = Curve(shelllineresults_6.Lines1)
join_5 = JoinCurves(Curves=flatten(crv_32), Preserve=False)
sph_9 = Sphere(Base=pt_9, Radius=0.3)
join_6 = JoinCurves(Curves=crv_33, Preserve=False)  # -> flatten(Curves)
preview_15 = CustomPreview(Geometry=sph_9, Material=swatch_7)
py3_2 = Python3Script(x=join_5, y="0.5")  # -> kept, removed; inputs x: list of Curve, y: Double, z: list of Curve
# ---------- py3_2: Python ----------
from Curve_Removal import MIS_curves


kept, removed, test = MIS_curves.main(x,y,z)
# ---------- end py3_2 ----------
preview_16 = CustomPreview(Geometry=crv_33, Material=ColourSwatch(SwatchColor=RGB(3, 3, 3)))
join_7 = JoinCurves(Curves=join_6, Preserve=False)
smaller_4 = SmallerThan(FirstNumber=join_7, SecondNumber="2")  # -> SmallerThan, OrEqualTo
explode_6 = Explode(Curve=join_7, Recursive=True)  # -> Segments, Vertices
not_2 = GateNot(A=smaller_4.SmallerThan)
cull_7 = CullPattern(List=join_7, CullPattern=not_2)
py3_3 = Python3Script(curve_ids=join_5, min_dist="0.5")  # -> a, b; inputs curve_ids: list of Curve, min_dist: Double
# ---------- py3_3: Python ----------
import Rhino

def curve_min_distance(crvA, crvB):
    # This overload returns bool, pointOnA, pointOnB
    success, pointOnA, pointOnB = crvA.ClosestPoints(crvB)
    if success:
        print(pointOnA.DistanceTo(pointOnB))
        return pointOnA.DistanceTo(pointOnB)
    else:
        return float('inf')

def remove_curves_too_close(curves, min_dist):
    """
    curves: a list of Rhino.Geometry.Curve objects
    min_dist: float
    returns (kept_list, removed_list),
             each is a subset of `curves` (the actual geometry objects)
    """
    n = len(curves)
    conflicts = {i: [] for i in range(n)}

    # 1. Build conflict adjacency
    for i in range(n):
        for j in range(i+1, n):
            dist_ij = curve_min_distance(curves[i], curves[j])
            if dist_ij < min_dist:
                conflicts[i].append(j)
                conflicts[j].append(i)

    keep_indices = set(range(n))

    # 2. Greedy removal
    while True:
        conflict_found = False
        for i in keep_indices:
            for j in conflicts[i]:
                if j in keep_indices and i < j:
                    conflict_found = True
                    break
            if conflict_found:
                break

        if not conflict_found:
            break

        # find worst offender
        worst_index = None
        max_conf = -1
        for i in keep_indices:
            ccount = sum(1 for x in conflicts[i] if x in keep_indices)
            if ccount > max_conf:
                max_conf = ccount
                worst_index = i

        if worst_index is not None:
            keep_indices.remove(worst_index)

    removed_indices = set(range(n)) - keep_indices
    kept_curves = [curves[i] for i in keep_indices]
    removed_curves = [curves[i] for i in removed_indices]
    return kept_curves, removed_curves

# --------------------------------------------------
# GHPython component "run" code:
# Inputs:
#    x  -> list of Rhino.Geometry.Curve
#    y  -> float (min_dist)
# Outputs:
#    a  -> kept curves (geometry)
#    b  -> removed curves (geometry)
# --------------------------------------------------


kept, removed = remove_curves_too_close(curve_ids, min_dist)
a = kept
b = removed
# ---------- end py3_3 ----------
join_8 = JoinCurves(Curves=cull_7, Preserve=False)
py3_4 = Python3Script(curve_ids=join_8, min_dist="0.5")  # -> a, b, c; inputs curve_ids: list of Curve, min_dist: Double
# ---------- py3_4: Python ----------
import Rhino

def curve_min_distance(crvA, crvB):
    # This overload returns bool, pointOnA, pointOnB
    success, pointOnA, pointOnB = crvA.ClosestPoints(crvB)
    if success:
        #print(pointOnA.DistanceTo(pointOnB))
        return pointOnA.DistanceTo(pointOnB)
    else:
        return float('inf')

def remove_curves_too_close(curves, min_dist):
    """
    curves: a list of Rhino.Geometry.Curve objects
    min_dist: float
    returns (kept_list, removed_list),
             each is a subset of `curves` (the actual geometry objects)
    """
    n = len(curves)
    conflicts = {i: [] for i in range(n)}

    # 1. Build conflict adjacency
    for i in range(n):
        for j in range(i+1, n):
            dist_ij = curve_min_distance(curves[i], curves[j])
            if dist_ij < min_dist:
                conflicts[i].append(j)
                conflicts[j].append(i)

    keep_indices = set(range(n))

    # 2. Greedy removal
    while True:
        conflict_found = False
        for i in keep_indices:
            for j in conflicts[i]:
                if j in keep_indices and i < j:
                    conflict_found = True
                    break
            if conflict_found:
                break

        if not conflict_found:
            break

        # find worst offender
        worst_index = None
        max_conf = -1
        for i in keep_indices:
            ccount = sum(1 for x in conflicts[i] if x in keep_indices)
            if ccount > max_conf:
                max_conf = ccount
                worst_index = i

        if worst_index is not None:
            keep_indices.remove(worst_index)

    removed_indices = set(range(n)) - keep_indices
    kept_curves = [curves[i] for i in keep_indices]
    removed_curves = [curves[i] for i in removed_indices]
    return kept_curves, removed_curves

# --------------------------------------------------
# GHPython component "run" code:
# Inputs:
#    x  -> list of Rhino.Geometry.Curve
#    y  -> float (min_dist)
# Outputs:
#    a  -> kept curves (geometry)
#    b  -> removed curves (geometry)
# --------------------------------------------------


kept, removed = remove_curves_too_close(curve_ids, min_dist)
a = kept
b = removed
def shorten_curve_against_set(curve_to_trim, reference_curves, min_dist, sample_count=50):
    """
    Given a curve that was removed, trim away any portions that come
    within min_dist of any curve in reference_curves.
    
    Returns a list of sub-curves (Rhino.Geometry.Curve) that are conflict-free.
    NOTE: This uses naive uniform sampling. For large curves, increase sample_count
          or use a more advanced approach.
    """
    domain = curve_to_trim.Domain
    t0, t1 = domain.Min, domain.Max
    total_param_range = t1 - t0

    # 1) Create sample parameters along the curve
    sample_params = []
    for i in range(sample_count):
        frac = float(i) / (sample_count - 1)
        sample_params.append(t0 + frac * total_param_range)

    # 2) For each sample param, check if it conflicts with any reference curve
    conflict_flags = []
    for param in sample_params:
        pt_on_curve = curve_to_trim.PointAt(param)

        # Check distance to each reference curve
        in_conflict = False
        for kc in reference_curves:
            success, ptA, ptB = kc.ClosestPoints(curve_to_trim)  
            # NOTE: Alternatively, you could do: 
            #   suc2, closest_ref_pt = kc.ClosestPoint(pt_on_curve)
            #   if suc2: dist = pt_on_curve.DistanceTo(closest_ref_pt)
            # We'll do a simpler direct point check below:
            
            # Let's do a direct point-to-curve approach for clarity:
            suc2, param_on_kc = kc.ClosestPoint(pt_on_curve)
            if suc2:
                real_pt_on_kc = kc.PointAt(param_on_kc)      # Convert param to 3D point
                dist = pt_on_curve.DistanceTo(real_pt_on_kc) # Now it is a valid point
                if dist < min_dist:
                    in_conflict = True
                    break
        
        conflict_flags.append(in_conflict)

    # 3) Identify "safe" parameter intervals
    safe_ranges = []
    current_start = None

    for i, param in enumerate(sample_params):
        if not conflict_flags[i]:
            # Not in conflict
            if current_start is None:
                current_start = param
        else:
            # Conflict
            if current_start is not None:
                # We just ended a safe range
                safe_ranges.append((current_start, param))
                current_start = None

    # If ended safe range at final sample
    if current_start is not None:
        safe_ranges.append((current_start, sample_params[-1]))

    # 4) Trim the curve to these safe ranges
    sub_curves = []
    for (st, en) in safe_ranges:
        # Make sure the interval is not tiny
        if (en - st) > 1e-8:
            trimmed = curve_to_trim.Trim(st, en)
            if trimmed and trimmed.GetLength() > 1e-8:
                sub_curves.append(trimmed)

    return sub_curves



alle = kept + removed
print(alle)
shortened_sub_curves = []
for c in removed:
    subcs = shorten_curve_against_set(c, alle, min_dist, sample_count=50)
    shortened_sub_curves.extend(subcs)

c = shortened_sub_curves
# ---------- end py3_4 ----------
crv_34 = Curve(py3_4.c)  # disabled
inlays_1 = Curve(py3_4.a)
preview_17 = CustomPreview(Geometry=inlays_1, Material=ColourSwatch(SwatchColor=RGB(249, 2, 0)))
len_9 = Length(Curve=inlays_1)
tracer_manual_3d_self = Python3Script(
    seed_points=flatten(pt_6),
    principal_vectors=shellvecresults.SecondPrincipalStressVector_kN_cm²,
    points=shellvecresults.Points,
    domain_surface=msh2psrf,
    collision_threshold="0.5",
    boundary_curves=explode_2.Segments)  # -> out, a, b, w, Error_message; inputs seed_points: list of Point3d, principal_vectors: list of Vector3d, points: list of Point3d, domain_surface: Brep, collision_threshold: Double, boundary_curves: list of Curve
# ---------- tracer_manual_3d_self: Python ----------
import math
import rhinoscriptsyntax as rs
import Rhino
import Rhino.Geometry as rg
import scriptcontext as sc
import numpy as np
from scipy.spatial import KDTree
from ghpythonlib import treehelpers as tr


# ------------------------------------------------------------------------
# 3D UTILITY FUNCTIONS
# ------------------------------------------------------------------------
def distance_3d(a, b):
    return math.sqrt((a[0]-b[0])**2 + (a[1]-b[1])**2 + (a[2]-b[2])**2)

def to_xyz(pt_or_vec):
    """Converts Rhino.Geometry.Point3d or Vector3d (or numeric [x,y,z]) to a Python list [x, y, z]."""
    if hasattr(pt_or_vec, "X"):
        return [pt_or_vec.X, pt_or_vec.Y, pt_or_vec.Z]
    else:
        return [pt_or_vec[0], pt_or_vec[1], pt_or_vec[2]]

def normalize_3d(vec):
    """Normalize a 3D vector [x, y, z] to unit length. Returns [0,0,0] if near zero length."""
    mag = math.sqrt(vec[0]**2 + vec[1]**2 + vec[2]**2)
    if mag < 1e-12:
        return [0.0, 0.0, 0.0]
    return [vec[0]/mag, vec[1]/mag, vec[2]/mag]

def find_closest_neighbors_kd_3d(point, kd_tree, k):
    """
    Given a 3D point [x, y, z] and a KDTree, returns a list of indices of the k closest points.
    """
    distances, indices = kd_tree.query(point, k=k)
    if isinstance(indices, int):
        return [indices]
    return list(indices)

def interpolate_vector_3d_consistent(pt, points_3d, vectors_3d, neighbors, ref_dir):
    """
    Distance-weighted interpolation of neighbor vectors in 3D,
    flipping each neighbor's vector if dot < 0 with respect to 'ref_dir'.

    - pt: [x, y, z], the point where we want the interpolated vector
    - points_3d: Nx3 array of point coords
    - vectors_3d: Nx3 array of principal vectors
    - neighbors: list of indices from the KDTree
    - ref_dir: [dx, dy, dz], the direction from the previous step (or None if first step)
    """
    weights = []
    weighted_vec = [0.0, 0.0, 0.0]

    for i in neighbors:
        vx, vy, vz = vectors_3d[i]  # copy so we can flip locally
        if ref_dir is not None:
            dotp = vx*ref_dir[0] + vy*ref_dir[1] + vz*ref_dir[2]
            if dotp < 0:
                vx, vy, vz = -vx, -vy, -vz
        
        npt = points_3d[i]
        dx = pt[0] - npt[0]
        dy = pt[1] - npt[1]
        dz = pt[2] - npt[2]
        dist = (dx*dx + dy*dy + dz*dz)**0.5
        
        w = 1.0 / (dist + 1e-6)
        weights.append(w)
        
        weighted_vec[0] += vx*w
        weighted_vec[1] += vy*w
        weighted_vec[2] += vz*w

    total_w = sum(weights)
    if total_w > 1e-12:
        weighted_vec[0] /= total_w
        weighted_vec[1] /= total_w
        weighted_vec[2] /= total_w

    mag = (weighted_vec[0]**2 + weighted_vec[1]**2 + weighted_vec[2]**2)**0.5
    if mag < 1e-12:
        return [0.0, 0.0, 0.0]
    
    return [weighted_vec[0]/mag, weighted_vec[1]/mag, weighted_vec[2]/mag]

def adjust_step_size_3d(current_pt, neighbors, points_3d, step_sign):

    if not neighbors:
        return 0.1 * step_sign
    
    distances = []
    for i in neighbors:
        npt = points_3d[i]
        dx = current_pt[0] - npt[0]
        dy = current_pt[1] - npt[1]
        dz = current_pt[2] - npt[2]
        dist = math.sqrt(dx*dx + dy*dy + dz*dz)
        distances.append(dist)
    
    avg_dist = sum(distances) / len(distances) if len(distances) else 0.1
    base_step = min(0.1, avg_dist / 2.0)
    return base_step * step_sign

# ------------------------------------------------------------------------#
# SURFACE / BREP PROJECTION UTILS
# ------------------------------------------------------------------------#

def project_onto_surface(surface, pt3d, tolerance=2):
    pt_rh = rg.Point3d(pt3d[0], pt3d[1], pt3d[2])
    
    if isinstance(surface, rg.Brep):
        # Note the 6 returned values:
        rc, closest_pt, cindex, u, v, normal = surface.ClosestPoint(pt_rh, tolerance)
        if rc:
            # Check if cindex is a face
            if cindex.ComponentIndexType == rg.ComponentIndexType.BrepFace:
                face_id = cindex.Index
                face = surface.Faces[face_id]
                
                # 'closest_pt' is the 3D point on that face
                # Optionally confirm it's within the face domain or do face.IsPointOnFace(u,v)
                
                return [closest_pt.X, closest_pt.Y, closest_pt.Z]
            else:
                # The closest component might be an edge or vertex
                return None
        else:
            return None
    
    elif isinstance(surface, rg.Surface):
        rc, u, v = surface.ClosestPoint(pt_rh)
        if rc:
            pt_srf = surface.PointAt(u, v)
            return [pt_srf.X, pt_srf.Y, pt_srf.Z]
        else:
            return None
    else:
        return None

    

def is_on_surface(surface, pt3d, tol=0.01):
    """
    Returns True if pt3d is within 'tol' of the surface. 
    """
    if not surface: 
        return True  # no surface provided
    pproj = project_onto_surface(surface, pt3d)
    if pproj is None:
        return False
    dx = pt3d[0] - pproj[0]
    dy = pt3d[1] - pproj[1]
    dz = pt3d[2] - pproj[2]
    dist = math.sqrt(dx*dx + dy*dy + dz*dz)
    return (dist < tol)

def get_brep_edge_curves(domain_surface):
    """
    Returns a list of Rhino.Geometry.Curve objects, one for each edge of the Brep.
    If 'domain_surface' is a plain NURBS surface, we convert it to a Brep first.
    """

    # If 'domain_surface' is actually a Surface, convert it to a Brep
    if isinstance(domain_surface, rg.Surface):
        domain_surface = rg.Brep.CreateFromSurface(domain_surface)
        if not domain_surface:
            # In case conversion fails
            return []

    edge_curves = []
    # Now 'domain_surface' should be a Brep
    for edge in domain_surface.Edges:
        crv = edge.ToNurbsCurve()  # or edge.EdgeCurve if you prefer
        edge_curves.append(crv)
    return edge_curves

def distance_to_brep_edges(pt3d, boundary_curves):
    test_pt = rg.Point3d(pt3d[0], pt3d[1], pt3d[2])
    min_dist = float('inf')
    best_cp = None  # keep track of the closest point so far
    
    for crv in boundary_curves:
        rc, t = crv.ClosestPoint(test_pt)
        if rc:
            cp = crv.PointAt(t)
            dist = cp.DistanceTo(test_pt)
            if dist < min_dist:
                min_dist = dist
                best_cp = cp
    
    return min_dist, best_cp

def runge_kutta_step_3d(
    current_point, 
    current_dir,
    h, 
    k, 
    principal_vectors, 
    points_3d, 
    step_sign, 
    kd_tree, 
    boundary_curves=None, 
    boundary_tolerance=0.01,prev_dir=None):
    """
    Perform one RK4 step in 3D. Stop if next point is within 'boundary_tolerance'
    of any boundary curve (edges).
    Returns the next 3D point or None if out-of-bound / near boundary.
    """
    
    # 1) Neighbors & dynamic step size
    neighbors = find_closest_neighbors_kd_3d(current_point, kd_tree, k)
    h = adjust_step_size_3d(current_point, neighbors, points_3d, step_sign)
    
    # k1
    k1_dir = interpolate_vector_3d_consistent(current_point, points_3d, principal_vectors, neighbors, current_dir)
    mid1 = [
        current_point[0] + 0.5*h*k1_dir[0],
        current_point[1] + 0.5*h*k1_dir[1],
        current_point[2] + 0.5*h*k1_dir[2]
    ]
    
    # k2
    neigh_mid1 = find_closest_neighbors_kd_3d(mid1, kd_tree, k)
    k2_dir = interpolate_vector_3d_consistent(mid1, points_3d, principal_vectors, neigh_mid1, k1_dir)
    mid2 = [
        current_point[0] + 0.5*h*k2_dir[0],
        current_point[1] + 0.5*h*k2_dir[1],
        current_point[2] + 0.5*h*k2_dir[2]
    ]
    
    # k3
    neigh_mid2 = find_closest_neighbors_kd_3d(mid2, kd_tree, k)
    k3_dir = interpolate_vector_3d_consistent(mid2, points_3d, principal_vectors, neigh_mid2, k2_dir)
    end_pt = [
        current_point[0] + h*k3_dir[0],
        current_point[1] + h*k3_dir[1],
        current_point[2] + h*k3_dir[2]
    ]
    
    # k4
    neigh_end = find_closest_neighbors_kd_3d(end_pt, kd_tree, k)
    k4_dir = interpolate_vector_3d_consistent(end_pt, points_3d, principal_vectors, neigh_end, k3_dir)
    
    # Summation
    dx = h*(k1_dir[0] + 2*k2_dir[0] + 2*k3_dir[0] + k4_dir[0]) / 6.0
    dy = h*(k1_dir[1] + 2*k2_dir[1] + 2*k3_dir[1] + k4_dir[1]) / 6.0
    dz = h*(k1_dir[2] + 2*k2_dir[2] + 2*k3_dir[2] + k4_dir[2]) / 6.0
    
    next_point = [
        current_point[0] + dx,
        current_point[1] + dy,
        current_point[2] + dz
    ]
    next_dir = k4_dir

    if domain_surface is not None:
        projected = project_onto_surface(domain_surface, next_point)
        print(projected)
        if projected is None:
            # Means we're off domain or near an open edge you consider invalid
            return None
        next_point = projected  # accept the projected coordinate
    # 2) Check distance to boundary edges, if we have them
    # if boundary_curves:
    #     dist_to_edge,cp = distance_to_brep_edges(next_point, boundary_curves)
    #     if dist_to_edge < boundary_tolerance:
    #         # We consider that "off" or "too close" => stop
    #         return None

    # Otherwise return the next valid point
    return next_point, next_dir


# ------------------------------------------------------------------------
# COLLISION / MERGING CHECKS IN 3D
# ------------------------------------------------------------------------

def build_polyline_curve_3d(poly_pts):
    pts3d = [rg.Point3d(pt[0], pt[1], pt[2]) for pt in poly_pts]
    poly = rg.Polyline(pts3d)
    return rg.PolylineCurve(poly)

def closest_point_on_polyline_3d(pt3d, poly_curve):
    """
    Return (closest_point, distance) from a 3D point to a polyline curve.
    """
    test_pt = rg.Point3d(pt3d[0], pt3d[1], pt3d[2])
    rc, t = poly_curve.ClosestPoint(test_pt)
    if rc:
        cp = poly_curve.PointAt(t)
        dist = cp.DistanceTo(test_pt)
        return [cp.X, cp.Y, cp.Z], dist
    else:
        return None, float('inf')

def find_closest_existing_line_3d(next_point, existing_trajectories, threshold):
    """
    Among all previously traced lines (in 3D), find if 'next_point' is within 'threshold' of any line.
    Returns (closest_line_index, closest_point_on_line, distance).
    """
    min_dist = float('inf')
    closest_line_idx = None
    closest_pt = None
    
    for i, (polyline_pts, poly_curve) in enumerate(existing_trajectories):
        cp, dist = closest_point_on_polyline_3d(next_point, poly_curve)
        if dist < min_dist:
            min_dist = dist
            closest_line_idx = i
            closest_pt = cp
    
    if min_dist < threshold:
        return (closest_line_idx, closest_pt, min_dist)
    else:
        return (None, None, float('inf'))

# ------------------------------------------------------------------------
# MAIN PSL TRACING FUNCTION (3D)
# ------------------------------------------------------------------------

def trace_principal_stress_line_3d(
    p_start, 
    h, 
    num_steps, 
    k, 
    principal_vectors,  # Nx3
    points_3d,          # Nx3
    boundary_curves=None,      # list of curve edges
    boundary_tolerance=0.1,
    existing_trajectories=None,
    collision_threshold=0.05,
    step_sign=1,
    closing_threshold=0.1  # <-- NEW parameter
):
    """
    Trace a principal stress line starting from p_start (3D) using RK4 in 3D.
    Now also stops if the PSL loops back on itself within 'closing_threshold'.
    """
    if existing_trajectories is None:
        existing_trajectories = []
    
    trajectory = [rg.Point3d(p_start[0], p_start[1], p_start[2])]
    bridging_line = None
    
    current_point_3d = p_start[:]
    current_dir = None 
    
    for _ in range(num_steps):
        # 1) Get next point
        next_result = runge_kutta_step_3d(
            current_point_3d, 
            current_dir,
            h, 
            k, 
            principal_vectors,
            points_3d,
            step_sign,
            kd_tree,
            boundary_curves,
            boundary_tolerance,
        )
        
        if (not next_result) or (next_result[0] is None):
            print("PSL stopped: near or off boundary.")
            break

        next_pt, next_dir = next_result
        
        # -------------------------------------------------------
        # NEW: SELF-CLOSING CHECK
        # Check if 'next_pt' is within 'closing_threshold' of ANY earlier point
        # in 'trajectory'. If yes, stop to avoid a spiral/loop.
        next_xyz = [next_pt[0], next_pt[1], next_pt[2]]
        if len(trajectory) >= 20:
            for old_pt in trajectory[:-10]:
                old_xyz = [old_pt.X, old_pt.Y, old_pt.Z]
                dist = distance_3d(next_xyz, old_xyz)
                if dist < closing_threshold:
                    print("PSL stopped: self-closing detected (dist=%.3f < %.3f)." 
                        % (dist, closing_threshold))
                    bridging_line = None  # optional
                    # break out of the for-loop
                    break
            else:
                # The "else" of a for-loop executes if we *didn't* break, so if we didn't find a close point
                pass
            # But we need to know if we broke from the loop
            # We can check that by adding an "if" after the for/else:
            if dist < closing_threshold:
                # we definitely broke for a self-collision
                break
        # -------------------------------------------------------

        # 3) Collision check with existing lines (unchanged)
        if existing_trajectories:
            line_idx, close_pt, dist_cl = find_closest_existing_line_3d(next_xyz, existing_trajectories, collision_threshold)
            if line_idx is not None and close_pt is not None:
                # Attempt bridging
                steps_back = 15
                if len(trajectory) > steps_back:
                    bridging_line = [
                        trajectory[-steps_back],
                        rg.Point3d(close_pt[0], close_pt[1], close_pt[2])
                    ]
                    # remove last steps so it merges more smoothly
                    del trajectory[-(steps_back-1):]
                else:
                    bridging_line = [
                        trajectory[-1],
                        rg.Point3d(close_pt[0], close_pt[1], close_pt[2])
                    ]
                print("PSL stopped: close to line %d at distance %.3f - merging initiated" % (line_idx, dist_cl))
                break
        
        # If we reach here, we accept next_pt
        trajectory.append(rg.Point3d(next_pt[0], next_pt[1], next_pt[2]))
        current_point_3d = next_pt
        current_dir = next_dir
    
    return trajectory, bridging_line

# ------------------------------------------------------------------------
# TRACE PSL IN BOTH DIRECTIONS (3D)
# ------------------------------------------------------------------------



def trace_psl_both_directions_in_one_loop_3d(
    seed_point_3d,
    h, 
    num_steps,
    k,
    principal_vectors, 
    points_3d,
    kd_tree,
    boundary_curves=None,
    boundary_tolerance=0.01,
    existing_trajectories=None,
    collision_threshold=0.05,
    closing_threshold=0.1
):
    """
    Traces a PSL forward (+1) and backward (-1) in ONE loop, letting each direction
    stop or collide independently. If forward is done, backward can keep going (and vice versa).
    If both are done, or tips meet, we stop entirely.
    """
    if existing_trajectories is None:
        existing_trajectories = []
    
    import Rhino.Geometry as rg
    from math import sqrt

    # Initialize lines
    forward_line = [rg.Point3d(*seed_point_3d)]
    backward_line = [rg.Point3d(*seed_point_3d)]

    # Current states
    f_current_pt = list(seed_point_3d)
    f_current_dir = None
    b_current_pt = list(seed_point_3d)
    b_current_dir = None

    bridging_lines = []

    # NEW: Flags for forward/backward
    forward_active = True
    backward_active = True

    for step_i in range(num_steps):
        # --------------------------------------------------
        # FORWARD STEP (if still active)
        # --------------------------------------------------
        if forward_active:
            f_next = runge_kutta_step_3d(
                f_current_pt,
                f_current_dir,
                h,
                k,
                principal_vectors,
                points_3d,
                step_sign=+1,
                kd_tree=kd_tree,
                boundary_curves=boundary_curves,
                boundary_tolerance=boundary_tolerance
            )
            if not f_next or (f_next[0] is None):
                print(f"PSL forward direction stopped at iteration {step_i}.")
                # Do NOT break from the entire loop
                forward_active = False
            else:
                # Accept the new point
                f_next_pt, f_next_dir = f_next
                
                # Optional collision check
                if existing_trajectories:
                    line_idx, close_pt, dist_cl = find_closest_existing_line_3d(
                        f_next_pt, existing_trajectories, collision_threshold
                    )
                    if line_idx is not None and close_pt is not None:
                        # Instead of break, we do bridging & disable forward
                        steps_back = 5
                        if len(forward_line) > steps_back:
                            bridging_line = [
                                forward_line[-steps_back],
                                rg.Point3d(*close_pt)
                            ]
                            bridging_lines.append(bridging_line)
                            del forward_line[-(steps_back-1):]
                        if len(forward_line)==0:
                            print("too short for bridge")
                        else:
                            bridging_line = [
                                forward_line[-1],
                                rg.Point3d(*close_pt)
                            ]
                            bridging_lines.append(bridging_line)
                        
                        print(f"PSL forward collided with line {line_idx} at dist {dist_cl:.3f}.")
                        forward_active = False

                    # 2) Check distance to boundary edges, if we have them
                if boundary_curves:
                    dist_to_edge,cp = distance_to_brep_edges(f_next_pt, boundary_curves)
                    if dist_to_edge < boundary_tolerance:
                        # We consider that "off" or "too close" => stop
                        print(f"PSL backward reached boundary.")
                        forward_active = False
                        bridging_line = [
                                forward_line[-1],
                                rg.Point3d(cp)
                            ]
                        bridging_lines.append(bridging_line)
                        
                # If still active after collision checks, append the step
                if forward_active:
                    forward_line.append(rg.Point3d(*f_next_pt))
                    f_current_pt = f_next_pt
                    f_current_dir = f_next_dir

        # --------------------------------------------------
        # BACKWARD STEP (if still active)
        # --------------------------------------------------
        if backward_active:
            b_next = runge_kutta_step_3d(
                b_current_pt,
                b_current_dir,
                h,
                k,
                principal_vectors,
                points_3d,
                step_sign=-1,
                kd_tree=kd_tree,
                boundary_curves=boundary_curves,
                boundary_tolerance=boundary_tolerance
            )
            if not b_next or (b_next[0] is None):
                print(f"PSL backward direction stopped at iteration {step_i}.")
                backward_active = False
            else:
                b_next_pt, b_next_dir = b_next
                
                if existing_trajectories:
                    line_idx, close_pt, dist_cl = find_closest_existing_line_3d(
                        b_next_pt, existing_trajectories, collision_threshold
                    )
                    if line_idx is not None and close_pt is not None:
                        steps_back = 5
                        if len(backward_line) > steps_back:
                            bridging_line = [
                                backward_line[-steps_back],
                                rg.Point3d(*close_pt)
                            ]
                            del backward_line[-(steps_back-1):]
                            bridging_lines.append(bridging_line)

                        if len(backward_line)==0:
                            print("too short for bridge")
                        else:
                            bridging_line = [
                                backward_line[-1],
                                rg.Point3d(*close_pt)
                            ]
                            bridging_lines.append(bridging_line)
                        print(f"PSL backward collided with line {line_idx} at dist {dist_cl:.3f}.")
                        backward_active = False

                if boundary_curves:
                    dist_to_edge,cp = distance_to_brep_edges(b_next_pt, boundary_curves)
                    if dist_to_edge < boundary_tolerance:
                        # We consider that "off" or "too close" => stop
                        print(f"PSL forward reached boundary.")
                        backward_active = False
                        bridging_line = [
                                backward_line[-1],
                                rg.Point3d(cp)
                            ]
                        bridging_lines.append(bridging_line)



                if backward_active:
                    backward_line.append(rg.Point3d(*b_next_pt))
                    b_current_pt = b_next_pt
                    b_current_dir = b_next_dir

        # --------------------------------------------------
        # If BOTH directions are inactive => stop
        # --------------------------------------------------
        if not forward_active and not backward_active:
            print("Both directions inactive => done.")
            break

        # --------------------------------------------------
        # TIP DISTANCE CHECK
        # (only if both are active, or up to you)
        # --------------------------------------------------
        if forward_active and backward_active and step_i >= 10:
            f_tip = [forward_line[-1].X, forward_line[-1].Y, forward_line[-1].Z]
            b_tip = [backward_line[-1].X, backward_line[-1].Y, backward_line[-1].Z]
            dist_fb = sqrt(
                (f_tip[0] - b_tip[0])**2 +
                (f_tip[1] - b_tip[1])**2 +
                (f_tip[2] - b_tip[2])**2
            )
            if dist_fb < closing_threshold:
                # bridging line if you like
                bridging_line = [forward_line[-1], backward_line[-1]]
                bridging_lines.append(bridging_line)

                print(
                    f"PSL tips meet at iteration {step_i}, dist= {dist_fb:.3f} < {closing_threshold}."
                )
                forward_active = False
                backward_active = False
                break

    # MERGE
    backward_line.reverse()
    if len(backward_line) > 1:
        backward_line.pop()
    merged_pts = backward_line + forward_line

    return merged_pts, bridging_lines


# ------------------------------------------------------------------------
# "MAIN" LOGIC IN GRASSHOPPER
# ------------------------------------------------------------------------
# Below is just an example of how you'd use these functions in GH:
#   1) Build the 3D KDTree from your data.
#   2) Loop over seed points.
#   3) Keep a global 'existing_trajectories' for collisions.
# ------------------------------------------------------------------------

# Example usage in a GH Python component:

# 1) Convert your input points/vectors to lists of [x,y,z].
points_array_3d = [to_xyz(pt) for pt in points]

boundary_curves = boundary_curves #get_brep_edge_curves(domain_surface)





# 1.1) Make vector field globally consistent (local consistency is handled on the go)
def get_knn_adjacency(points_3d, k=6):
    """
    Build adjacency by connecting each point to its 'k' nearest neighbors.
    points_3d: Nx3 array (or list) of 3D coords
    Returns: adjacency (list of lists),
             where adjacency[i] is the list of neighbor indices for point i.
    """
    points_np = np.array(points_3d)
    tree = KDTree(points_np)
    adjacency = []

    n = len(points_3d)
    for i in range(n):
        # Query K+1 because the nearest neighbor list includes the point itself at distance 0
        dists, indices = tree.query(points_np[i], k=k+1)
        # Drop 'i' itself
        neighbors = [idx for idx in indices if idx != i]
        adjacency.append(neighbors)
    
    return adjacency

def unify_vector_field(points_3d, vectors_3d, adjacency):
    """
    points_3d: Nx3 array of point positions
    vectors_3d: Nx3 array of directions
    adjacency: a list of lists, adjacency[i] = indices of neighbors of i
    """
    visited = [False]*len(points_3d)
    queue = [0]  # start BFS from index 0, or any random index
    visited[0] = True
    
    while queue:
        i = queue.pop(0)
        v_i = vectors_3d[i]
        
        for nbr in adjacency[i]:
            if not visited[nbr]:
                # Compare dot product
                dotp = (v_i[0]*vectors_3d[nbr][0] + 
                        v_i[1]*vectors_3d[nbr][1] + 
                        v_i[2]*vectors_3d[nbr][2])
                if dotp < 0:
                    # Flip neighbor's vector
                    vectors_3d[nbr][0] = -vectors_3d[nbr][0]
                    vectors_3d[nbr][1] = -vectors_3d[nbr][1]
                    vectors_3d[nbr][2] = -vectors_3d[nbr][2]
                visited[nbr] = True
                queue.append(nbr)
    
    # Now vectors_3d should be locally consistent
    return vectors_3d

adjacency = get_knn_adjacency(points_array_3d,k=1)
constant_vectors = unify_vector_field(points,principal_vectors,adjacency)
vectors_array_3d = [to_xyz(vec) for vec in constant_vectors]



w = tr.list_to_tree(vectors_array_3d)





# 2) Build a 3D KD-tree
points_np = np.array(points_array_3d)  # shape (N, 3)
kd_tree = KDTree(points_np)

# 3) We'll store PSL results in 'existing_trajectories' as: ( [pt3d_list], polyline_curve )
existing_trajectories = []
bridging_lines_out = []

# If 'domain_surface' is a Rhino Surface or a single-face Brep, you can store it here:
surface_id = None
if domain_surface:
    # If it's a Brep or Surface, no need to do 'sc.doc.Objects.AddSurface' necessarily,
    # but store it in a variable for the above projection checks
    surface_id = domain_surface  # rename for clarity

# 4) Loop over seed points (3D)
for seed in seed_points:
    seed_xyz = to_xyz(seed)
    
    merged_psl,  new_bridges = trace_psl_both_directions_in_one_loop_3d(
        seed_point_3d=seed_xyz,
        h=0.1,
        num_steps=400,
        k=25,
        principal_vectors=vectors_array_3d,
        points_3d=points_array_3d,
        kd_tree=kd_tree,
        boundary_curves=boundary_curves,
        boundary_tolerance=0.1,
        existing_trajectories=existing_trajectories,
        collision_threshold=0.5,
        closing_threshold=0.1  # or whatever
    )
    
    # Build the cached polyline for collisions
    psl_curve_3d = build_polyline_curve_3d([[pt.X, pt.Y, pt.Z] for pt in merged_psl])
    existing_trajectories.append((merged_psl, psl_curve_3d))
    bridging_lines_out.extend(new_bridges)

# 5) Output
a = tr.list_to_tree(existing_trajectories)  # Each branch: (pts, polylineCurve)
b = tr.list_to_tree(bridging_lines_out)



# import cProfile, pstats, io

# # Create a profiler object and enable it.
# profiler = cProfile.Profile()
# profiler.enable()

# # Run your main function
# main()  # or capture its output if needed

# # Disable the profiler
# profiler.disable()

# # Create a stream to capture the profiler output
# s = io.StringIO()
# ps = pstats.Stats(profiler, stream=s).sort_stats('cumtime')
# ps.print_stats()  # You can also use 'time' or 'ncalls' as the sort key

# # Print the profiling results
# print(s.getvalue())
# ---------- end tracer_manual_3d_self ----------
tracer_automatic_3d_self_single_loop = Python3Script(
    seed_points=pt_7,
    principal_vectors=shellvecresults.SecondPrincipalStressVector_kN_cm²,
    points=shellvecresults.Points,
    domain_surface=msh2psrf,
    collision_threshold="0.5",
    boundary_curves=explode_2.Segments)  # -> out, a, b, w, Error_message; inputs seed_points: list of Point3d, principal_vectors: list of Vector3d, points: list of Point3d, domain_surface: Brep, collision_threshold: Double, boundary_curves: list of Curve
# ---------- tracer_automatic_3d_self_single_loop: Python ----------
import math
import numpy as np
import rhinoscriptsyntax as rs
import Rhino.Geometry as rg
import scriptcontext as sc
from scipy.spatial import KDTree

# --- Your existing functions (with minor adaptations) ---

def distance_3d(a, b):
    return math.sqrt((a[0]-b[0])**2 + (a[1]-b[1])**2 + (a[2]-b[2])**2)

def normalize(vector):
    """Normalize a vector (2D) to unit length."""
    magnitude = math.sqrt(vector[0]**2 + vector[1]**2+vector[2]**2)
    return [vector[0] / magnitude, vector[1] / magnitude,vector[2] / magnitude] if magnitude != 0 else [0, 0, 0]

def to_numeric(vec):
    """Convert a Rhino object to a numeric [x,y,z] list; otherwise return vec as-is."""
    try:
        return [vec.X, vec.Y, vec.Z]
    except AttributeError:
        return vec

def find_closest_neighbors_kd(point, kd_tree, k):
    """
    Given a 2D point (as [x,y]) and a pre-built KDTree,
    return a list of indices of the k closest points.
    """

    distances, indices = kd_tree.query(point,k=k)
    if isinstance(indices, int):
        return [indices]
    return list(indices)

def interpolate_vector(point, points, vectors, neighbors, ref_dir):
    """
    Distance-weighted interpolation of neighbor vectors in 3D,
    flipping each neighbor's vector if dot < 0 with respect to 'ref_dir'.

    - pt: [x, y, z], the point where we want the interpolated vector
    - points_3d: Nx3 array of point coords
    - vectors_3d: Nx3 array of principal vectors
    - neighbors: list of indices from the KDTree
    - ref_dir: [dx, dy, dz], the direction from the previous step (or None if first step)
    """
    weights = []
    weighted_vec = [0.0, 0.0, 0.0]

    for i in neighbors:
        vx, vy, vz = vectors[i]  # copy so we can flip locally
        if ref_dir is not None:
            dotp = vx*ref_dir[0] + vy*ref_dir[1] + vz*ref_dir[2]
            if dotp < 0:
                vx, vy, vz = -vx, -vy, -vz
        
        npt = points[i]
        dx = point[0] - npt[0]
        dy = point[1] - npt[1]
        dz = point[2] - npt[2]
        dist = (dx*dx + dy*dy + dz*dz)**0.5
        
        w = 1.0 / (dist + 1e-6)
        weights.append(w)
        
        weighted_vec[0] += vx*w
        weighted_vec[1] += vy*w
        weighted_vec[2] += vz*w

    total_w = sum(weights)
    if total_w > 1e-12:
        weighted_vec[0] /= total_w
        weighted_vec[1] /= total_w
        weighted_vec[2] /= total_w

    mag = (weighted_vec[0]**2 + weighted_vec[1]**2 + weighted_vec[2]**2)**0.5
    if mag < 1e-12:
        return [0.0, 0.0, 0.0]
    
    return [weighted_vec[0]/mag, weighted_vec[1]/mag, weighted_vec[2]/mag]

def adjust_step_size_3d(current_point, neighbors, points, step_sign):

    if not neighbors:
        return 0.1 * step_sign
    
    distances = []
    for i in neighbors:
        npt = points[i]
        dx = current_point[0] - npt[0]
        dy = current_point[1] - npt[1]
        dz = current_point[2] - npt[2]
        dist = math.sqrt(dx*dx + dy*dy + dz*dz)
        distances.append(dist)
    
    avg_dist = sum(distances) / len(distances) if len(distances) else 0.1
    base_step = min(0.1, avg_dist / 2.0)
    return base_step * step_sign

def project_onto_surface(surface, pt3d, tolerance=2):
    pt_rh = rg.Point3d(pt3d[0], pt3d[1], pt3d[2])
    
    if isinstance(surface, rg.Brep):
        # Note the 6 returned values:
        rc, closest_pt, cindex, u, v, normal = surface.ClosestPoint(pt_rh, tolerance)
        if rc:
            # Check if cindex is a face
            if cindex.ComponentIndexType == rg.ComponentIndexType.BrepFace:
                face_id = cindex.Index
                face = surface.Faces[face_id]
                
                # 'closest_pt' is the 3D point on that face
                # Optionally confirm it's within the face domain or do face.IsPointOnFace(u,v)
                
                return [closest_pt.X, closest_pt.Y, closest_pt.Z]
            else:
                # The closest component might be an edge or vertex
                return None
        else:
            return None
    
    elif isinstance(surface, rg.Surface):
        rc, u, v = surface.ClosestPoint(pt_rh)
        if rc:
            pt_srf = surface.PointAt(u, v)
            return [pt_srf.X, pt_srf.Y, pt_srf.Z]
        else:
            return None
    else:
        return None

    


def get_brep_edge_curves(domain_surface):
    """
    Returns a list of Rhino.Geometry.Curve objects, one for each edge of the Brep.
    If 'domain_surface' is a plain NURBS surface, we convert it to a Brep first.
    """

    # If 'domain_surface' is actually a Surface, convert it to a Brep
    if isinstance(domain_surface, rg.Surface):
        domain_surface = rg.Brep.CreateFromSurface(domain_surface)
        if not domain_surface:
            # In case conversion fails
            return []

    edge_curves = []
    # Now 'domain_surface' should be a Brep
    for edge in domain_surface.Edges:
        crv = edge.ToNurbsCurve()  # or edge.EdgeCurve if you prefer
        edge_curves.append(crv)
    return edge_curves

def distance_to_brep_edges(pt3d, boundary_curves):
    test_pt = rg.Point3d(pt3d[0], pt3d[1], pt3d[2])
    min_dist = float('inf')
    best_cp = None  # keep track of the closest point so far
    
    for crv in boundary_curves:
        rc, t = crv.ClosestPoint(test_pt)
        if rc:
            cp = crv.PointAt(t)
            dist = cp.DistanceTo(test_pt)
            if dist < min_dist:
                min_dist = dist
                best_cp = cp
    
    return min_dist, best_cp

def is_on_surface(surface, pt3d, tol=0.01):
    """
    Returns True if pt3d is within 'tol' of the surface. 
    """
    if not surface: 
        return True  # no surface provided
    pproj = project_onto_surface(surface, pt3d)
    if pproj is None:
        return False
    dx = pt3d[0] - pproj[0]
    dy = pt3d[1] - pproj[1]
    dz = pt3d[2] - pproj[2]
    dist = math.sqrt(dx*dx + dy*dy + dz*dz)
    return (dist < tol)

def runge_kutta_step_3d(
    current_point, 
    current_dir,
    h, 
    k, 
    principal_vectors, 
    points_3d, 
    step_sign, 
    kd_tree, 
    boundary_curves=None, 
    boundary_tolerance=0.1, prev_dir=None):
    """
    Perform one RK4 step in 3D. Stop if next point is within 'boundary_tolerance'
    of any boundary curve (edges).
    Returns the next 3D point or None if out-of-bound / near boundary.
    """
    
    # 1) Neighbors & dynamic step size
    neighbors = find_closest_neighbors_kd(current_point, kd_tree, k)
    h = adjust_step_size_3d(current_point, neighbors, points_3d, step_sign)
    
    # k1
    k1_dir = interpolate_vector(current_point, points_3d, principal_vectors, neighbors, current_dir)
    mid1 = [
        current_point[0] + 0.5*h*k1_dir[0],
        current_point[1] + 0.5*h*k1_dir[1],
        current_point[2] + 0.5*h*k1_dir[2]
    ]
    
    # k2
    neigh_mid1 = find_closest_neighbors_kd(mid1, kd_tree, k)
    k2_dir = interpolate_vector(mid1, points_3d, principal_vectors, neigh_mid1, k1_dir)
    mid2 = [
        current_point[0] + 0.5*h*k2_dir[0],
        current_point[1] + 0.5*h*k2_dir[1],
        current_point[2] + 0.5*h*k2_dir[2]
    ]
    
    # k3
    neigh_mid2 = find_closest_neighbors_kd(mid2, kd_tree, k)
    k3_dir = interpolate_vector(mid2, points_3d, principal_vectors, neigh_mid2, k2_dir)
    end_pt = [
        current_point[0] + h*k3_dir[0],
        current_point[1] + h*k3_dir[1],
        current_point[2] + h*k3_dir[2]
    ]
    
    # k4
    neigh_end = find_closest_neighbors_kd(end_pt, kd_tree, k)
    k4_dir = interpolate_vector(end_pt, points_3d, principal_vectors, neigh_end, k3_dir)
    
    # Summation
    dx = h*(k1_dir[0] + 2*k2_dir[0] + 2*k3_dir[0] + k4_dir[0]) / 6.0
    dy = h*(k1_dir[1] + 2*k2_dir[1] + 2*k3_dir[1] + k4_dir[1]) / 6.0
    dz = h*(k1_dir[2] + 2*k2_dir[2] + 2*k3_dir[2] + k4_dir[2]) / 6.0
    
    next_point = [
        current_point[0] + dx,
        current_point[1] + dy,
        current_point[2] + dz
    ]
    next_dir = k4_dir

    if domain_surface is not None:
        projected = project_onto_surface(domain_surface, next_point)
        print(projected)
        if projected is None:
            # Means we're off domain or near an open edge you consider invalid
            return None
        next_point = projected  # accept the projected coordinate

    # 2) Check distance to boundary edges, if we have them
    # if boundary_curves:
    #     dist_to_edge = distance_to_brep_edges(next_point, boundary_curves)
    #     if dist_to_edge < boundary_tolerance:
    #         # We consider that "off" or "too close" => stop
    #         return None

    # Otherwise return the next valid point
    return next_point, next_dir
# --- Collision Checking using Cached PSL Curves ---

def closest_point_on_polyline_3d(pt3d, poly_curve):
    """
    Return (closest_point, distance) from a 3D point to a polyline curve.
    """
    test_pt = rg.Point3d(pt3d[0], pt3d[1], pt3d[2])
    rc, t = poly_curve.ClosestPoint(test_pt)
    if rc:
        cp = poly_curve.PointAt(t)
        dist = cp.DistanceTo(test_pt)
        return [cp.X, cp.Y, cp.Z], dist
    else:
        return None, float('inf')

def find_closest_existing_line_3d(next_point, existing_trajectories, threshold):
    """
    Among all previously traced lines (in 3D), find if 'next_point' is within 'threshold' of any line.
    Returns (closest_line_index, closest_point_on_line, distance).
    """
    min_dist = float('inf')
    closest_line_idx = None
    closest_pt = None
    
    for i, (polyline_pts, poly_curve) in enumerate(existing_trajectories):
        cp, dist = closest_point_on_polyline_3d(next_point, poly_curve)
        if dist < min_dist:
            min_dist = dist
            closest_line_idx = i
            closest_pt = cp
    
    if min_dist < threshold:
        return (closest_line_idx, closest_pt, min_dist)
    else:
        return (None, None, float('inf'))

def build_polyline_curve_3d(poly_pts):
    pts3d = [rg.Point3d(pt[0], pt[1], pt[2]) for pt in poly_pts]
    poly = rg.Polyline(pts3d)
    return rg.PolylineCurve(poly)

# --- New Functions for Sampling and Seeding ---

import Rhino.Geometry as rg
def surface_normal_at_point(surface, pt3d, tolerance=2):
    """
    Returns the surface normal [nx, ny, nz] at a 3D point on a multi-face Brep or rg.Surface.
    If near an open edge or invalid, returns None.
    """
    pt_rh = rg.Point3d(pt3d[0], pt3d[1], pt3d[2])

    if isinstance(surface, rg.Brep):
        stuff = surface.ClosestPoint(pt_rh, tolerance)
        if not stuff or len(stuff) < 6:
            return None
        b = stuff[0]
        rc = stuff[1]
        print(rc)
        comp_index = stuff[2]
        u = stuff[3]
        v = stuff[4]
        # stuff[4] => cpt
        # stuff[5] => guess_normal
        if not rc:
            return None
        
        # If it's a face, we evaluate the face normal at (u, v)
        if comp_index.ComponentIndexType == rg.ComponentIndexType.BrepFace:
            face_id = comp_index.Index
            face = surface.Faces[face_id]
            exact_normal = face.NormalAt(u, v)
            if exact_normal:
                return [exact_normal.X, exact_normal.Y, exact_normal.Z]
            else:
                return None
        else:
            # edge/vertex
            return None
    
    elif isinstance(surface, rg.Surface):
        rc, u, v = surface.ClosestPoint(pt_rh)
        if rc:
            exact_normal = surface.NormalAt(u, v)
            return [exact_normal.X, exact_normal.Y, exact_normal.Z]
        else:
            return None

    # Not a Brep or Surface
    return None


def sample_psl(psl_pts, sample_interval):
    """
    Given a PSL (list of Rhino Point3d), sample it at every sample_interval (by index).
    Returns a list of numeric [x,y] points.
    """
    samples = []
    #print(sample_interval)
    for i in range(0, len(psl_pts), sample_interval):
        pt = psl_pts[i]
        
        if isinstance(pt, rg.Point3d):
            samples.append([pt.X, pt.Y, pt.Z])
        else:
            samples.append(pt)
        #print(samples)
    return samples

import math

def offset_seed(psl_pts_3d, index, offset_distance, surface):
    """
    Offsets the PSL at psl_pts_3d[index] in the local tangent plane of 'surface'.
    Steps:
      1) Compute PSL tangent at index
      2) Get surface normal at that point
      3) binormal = cross(surface_normal, psl_tangent)
      4) candidate1 = point + offset_distance*binormal
         candidate2 = point - offset_distance*binormal
      5) (optional) project candidates back onto the surface
    Returns: (candidate1, candidate2) as [x, y, z], or (None, None) on error.
    """
    n = len(psl_pts_3d)
    if n < 2:
        return None, None
    
    # 0) Current point
    px, py, pz = psl_pts_3d[index]
    
    # 1) PSL TANGENT
    if index == 0:
        # Use next point - current point
        nx, ny, nz = psl_pts_3d[1]
        tx = nx - px
        ty = ny - py
        tz = nz - pz
    elif index == n - 1:
        # Use current point - prev point
        px_prev, py_prev, pz_prev = psl_pts_3d[n - 2]
        tx = px - px_prev
        ty = py - py_prev
        tz = pz - pz_prev
    else:
        # Middle: use psl_pts_3d[index+1] - psl_pts_3d[index-1]
        px_prev, py_prev, pz_prev = psl_pts_3d[index - 1]
        px_next, py_next, pz_next = psl_pts_3d[index + 1]
        tx = px_next - px_prev
        ty = py_next - py_prev
        tz = pz_next - pz_prev

    # Normalize tangent
    t_len = math.sqrt(tx*tx + ty*ty + tz*tz)
    if t_len < 1e-12:
        return None, None
    tx /= t_len
    ty /= t_len
    tz /= t_len
    
    # 2) SURFACE NORMAL
    normal = surface_normal_at_point(surface, [px, py, pz])
    if not normal:
        print("no normal")
        return None, None
    nx, ny, nz = normal
    n_len = math.sqrt(nx*nx + ny*ny + nz*nz)
    if n_len < 1e-12:
        return None, None
    nx /= n_len
    ny /= n_len
    nz /= n_len
    
    # 3) BINORMAL = cross(normal, tangent)
    # This is guaranteed to be in the tangent plane if PSL is truly tangent to the surface
    # If the PSL isn't exactly tangent, you'll get some tilt. 
    bx = ny*tz - nz*ty
    by = nz*tx - nx*tz
    bz = nx*ty - ny*tx
    b_len = math.sqrt(bx*bx + by*by + bz*bz)
    if b_len < 1e-12:
        # Means normal and tangent are parallel or something degenerate
        return None, None
    bx /= b_len
    by /= b_len
    bz /= b_len
    
    # 4) OFFSET POINTS
    candidate1 = [px + offset_distance*bx,
                  py + offset_distance*by,
                  pz + offset_distance*bz]
    candidate2 = [px - offset_distance*bx,
                  py - offset_distance*by,
                  pz - offset_distance*bz]
    
    # 5) (OPTIONAL) Project them onto the surface if you want them exactly on the domain
    candidate1_proj = project_onto_surface(surface, candidate1)
    print(f"this point is seed {candidate1_proj}")
    candidate2_proj = project_onto_surface(surface, candidate2)
    # if not candidate1_proj or not candidate2_proj:
    #     return None, None
    # return candidate1_proj, candidate2_proj

    # If you don't need the final projection, just return them:
    return candidate1_proj, candidate2_proj


def sample_psl_3d(psl_pts, sample_interval):
    """
    Given a PSL (list of Rhino Point3d or numeric [x,y,z] points),
    sample it every 'sample_interval' points.
    Returns a list of tuples: ( [x,y,z], original_index )
    """
    samples = []
    for i in range(0, len(psl_pts), sample_interval):
        pt3d = psl_pts[i]
        # Convert to numeric [x,y,z] if it's a Point3d
        if hasattr(pt3d, "X"):
            samples.append(([pt3d.X, pt3d.Y, pt3d.Z], i))
        else:
            samples.append((pt3d, i))
    return samples


def is_valid_seed(candidate, existing_trajectories, min_distance, boundary_curves, boundary_tolerance=0.1):
    """
    Check if candidate seed is valid:
      - It is not too close to any existing PSL (using min_distance).
      - It is not too close to any boundary curves (if boundary_curves is provided and
        candidate's distance < boundary_tolerance).
    """
    # Check candidate against existing PSLs
    idx, cp, dist = find_closest_existing_line_3d(candidate, existing_trajectories, min_distance)
    if idx is not None:
        return False

    # Check candidate against boundary curves if provided
    if boundary_curves:
        dist_edge, cp_edge = distance_to_brep_edges(candidate, boundary_curves)
        if dist_edge < 0.1:
            return False

    return True


# --- Main Loop: Iterative Seeding with a Queue ---
def trace_principal_stress_line(
    p_start, 
    h, 
    num_steps, 
    k, 
    principal_vectors,  # Nx3
    points_3d,          # Nx3
    boundary_curves = None,      # list of curve edges
    boundary_tolerance=0.1,
    existing_trajectories=None,
    collision_threshold=0.05,
    step_sign=1):
    """
    Trace a principal stress line starting from p_start (3D) using RK4 in 3D.
    - p_start: [x, y, z]
    - principal_vectors, points_3d: lists or arrays of same length
    - surface: optional Rhino surface or Brep to constrain PSL
    - boundary_tolerance: distance threshold to consider 'off the surface'
    - existing_trajectories: list of ( [pts], polyline_curve ) to detect collisions
    - collision_threshold: distance threshold for merging lines
    - step_sign: +1 forward or -1 backward
    Returns: (trajectory_pts, bridging_line)
    """
    if existing_trajectories is None:
        existing_trajectories = []
    
    trajectory = [rg.Point3d(p_start[0], p_start[1], p_start[2])]
    bridging_line = None
    
    current_point_3d = p_start[:]
    current_dir = None 
    
    for _ in range(num_steps):
        # 1) Get next point
        next_result = runge_kutta_step_3d(
            current_point_3d, 
            current_dir,
            h, 
            k, 
            principal_vectors,
            points_3d,
            step_sign,
            kd_tree,
            boundary_curves,
            boundary_tolerance,
        )
        
        if not next_result or next_result[0] is None:
            print("PSL stopped: near or off boundary.")
            break
        next_pt, next_dir = next_result
        
        # # 2a) Check alignment with principal vectors (optional)
        # #     For example, compare direction of (next_point - current_point)
        # #     with the local principal vector at next_point
        # move_vec = normalize_3d([
        #     next_point_3d[0] - current_point_3d[0],
        #     next_point_3d[1] - current_point_3d[1],
        #     next_point_3d[2] - current_point_3d[2]
        # ])
        # neigh2 = find_closest_neighbors_kd_3d(next_point_3d, kd_tree, k)
        # local_vec = interpolate_vector_3d(next_point_3d, points_3d, principal_vectors, neigh2)
        # dotp = abs(move_vec[0]*local_vec[0] + move_vec[1]*local_vec[1] + move_vec[2]*local_vec[2])
        # if dotp < 0.7:
        #     print("PSL stopped: direction misaligned with principal vectors.")
        #     break
        
        # 3) Collision check with existing lines
        if existing_trajectories:
            line_idx, close_pt, dist = find_closest_existing_line_3d(next_pt, existing_trajectories, collision_threshold)
            if line_idx is not None and close_pt is not None:
                # Attempt bridging
                steps_back = 5
                if len(trajectory) > steps_back:
                    bridging_line = [
                        trajectory[-steps_back],
                        rg.Point3d(close_pt[0], close_pt[1], close_pt[2])
                    ]
                    # remove last steps so it merges more smoothly
                    del trajectory[-(steps_back-1):]
                else:
                    bridging_line = [
                        trajectory[-1],
                        rg.Point3d(close_pt[0], close_pt[1], close_pt[2])
                    ]
                print("PSL stopped: close to line %d at distance %.3f - merging initiated" % (line_idx, dist))
                break
        
        if len(trajectory) > 20:
            if trajectory[0].DistanceTo(rg.Point3d(next_pt[0], next_pt[1], next_pt[2])) < 0.1:
                trajectory.append(trajectory[0])
                print("Loop detected and closed")
                break

        
        trajectory.append(rg.Point3d(next_pt[0], next_pt[1], next_pt[2]))
        current_point_3d = next_pt
        current_dir = next_dir
    
    return trajectory, bridging_line

def trace_psl_backwards_with_closing_check(
    p_start_3d,
    h,
    num_steps,
    k,
    principal_vectors,
    points_3d,
    boundary_curves,
    boundary_tolerance,
    existing_trajectories,
    collision_threshold,
    forward_line,
    closing_threshold,
    kd_tree,
    step_sign=-1):
    """
    Similar to trace_principal_stress_line, but:
      - We move one step at a time
      - After each step, we check distance to forward_line[-1]. 
      - If it's < closing_threshold, we stop.
    """
    import math
    
    def distance_3d(a, b):
        return math.sqrt((a[0]-b[0])**2 + (a[1]-b[1])**2 + (a[2]-b[2])**2)
    
    trajectory = [rg.Point3d(*p_start_3d)]
    bridging_line = None
    current_point_3d = list(p_start_3d)
    current_dir = None
    
    # Convert the far end of forward_line (the last point) to a numeric [x,y,z]
    forward_end = forward_line[-1]
    if hasattr(forward_end, "X"):
        forward_end_xyz = [forward_end.X, forward_end.Y, forward_end.Z]
    else:
        forward_end_xyz = forward_end
    
    for _ in range(num_steps):
        # 1) Attempt a single RK4 step
        next_result = runge_kutta_step_3d(
            current_point_3d, 
            current_dir,
            h, 
            k, 
            principal_vectors, 
            points_3d, 
            step_sign,
            kd_tree,
            boundary_curves,
            boundary_tolerance
        )
        if not next_result or not next_result[0]:
            # boundary/collision check
            print("PSL backward: off boundary or step failed.")
            break
        
        next_pt, next_dir = next_result
        nxt_xyz = [next_pt[0], next_pt[1], next_pt[2]]
        
        # 2) Collision check w. existing PSLs (same as your code)
        if existing_trajectories:
            line_idx, close_pt, dist_cl = find_closest_existing_line_3d(
                nxt_xyz, existing_trajectories, collision_threshold
            )
            if line_idx is not None and close_pt is not None:
                # bridging, etc.
                bridging_line = [
                    trajectory[-1],
                    rg.Point3d(close_pt[0], close_pt[1], close_pt[2])
                ]
                print("PSL backward: bridging or collision => stop.")
                break
        
        # 3) **Closing check**: compare distance to forward_line[-1]
        dist_ff = distance_3d(nxt_xyz, forward_end_xyz)
        if dist_ff < closing_threshold:
            print(
                "PSL backward: tips near forward line end (dist=%.3f < %.3f), stopping." 
                % (dist_ff, closing_threshold)
            )
            break
        
        # Accept the step
        trajectory.append(rg.Point3d(*nxt_xyz))
        current_point_3d = nxt_xyz
        current_dir = next_dir
    
    return trajectory, bridging_line

def trace_psl_both_directions(
    seed_point_3d, 
    h, 
    num_steps, 
    k, 
    principal_vectors, 
    points_3d,
    boundary_curves=None,
    boundary_tolerance=0.1,
    existing_trajectories=None,
    collision_threshold=0.05,
    closing_threshold=0.1, 
    kd_tree=None
):
    """
    Single-loop approach where forward/backward can stop independently.
    If forward hits a collision/boundary, it stops, but backward can continue, and vice versa.
    We only stop the entire PSL when BOTH directions are inactive, or when tips meet.
    """
    if existing_trajectories is None:
        existing_trajectories = []
    
    import Rhino.Geometry as rg
    bridging_lines = []

    # We'll keep two lines: forward and backward
    forward_line = [rg.Point3d(*seed_point_3d)]
    backward_line = [rg.Point3d(*seed_point_3d)]
    
    # Current forward/backward points + directions
    f_current_pt = list(seed_point_3d)
    f_current_dir = None
    b_current_pt = list(seed_point_3d)
    b_current_dir = None

    # NEW: Boolean flags to track if forward/backward are still active
    forward_active = True
    backward_active = True

    for step_i in range(num_steps):
        
        # ---------------------------
        # FORWARD STEP (if still active)
        # ---------------------------
        if forward_active:
            f_next = runge_kutta_step_3d(
                f_current_pt,
                f_current_dir,
                h,
                k,
                principal_vectors,
                points_3d,
                step_sign=+1,
                kd_tree=kd_tree,
                boundary_curves=boundary_curves,
                boundary_tolerance=boundary_tolerance
            )
            if not f_next or f_next[0] is None:
                print(f"PSL forward direction stopped at iteration {step_i}.")
                forward_active = False
            else:
                f_next_pt, f_next_dir = f_next
                # Collision check with existing PSLs
                if existing_trajectories:
                    line_idx, close_pt, dist_cl = find_closest_existing_line_3d(
                        f_next_pt, existing_trajectories, collision_threshold
                    )
                    if line_idx is not None and close_pt is not None:
                        # Instead of break, we do bridging & disable forward
                        steps_back = 5
                        if len(forward_line) > steps_back:
                            bridging_line = [
                                forward_line[-steps_back],
                                rg.Point3d(*close_pt)
                            ]
                            bridging_lines.append(bridging_line)
                            del forward_line[-(steps_back-1):]

                        if len(forward_line)==0 or len(backward_line)==1:
                            print("too short for bridge")
                        else:
                            bridging_line = [
                                forward_line[-1],
                                rg.Point3d(*close_pt)
                            ]
                            bridging_lines.append(bridging_line)
                        
                        print(f"PSL forward collided with line {line_idx} at dist {dist_cl:.3f}.")
                        forward_active = False

                    # 2) Check distance to boundary edges, if we have them
                if boundary_curves:
                    dist_to_edge,cp = distance_to_brep_edges(f_next_pt, boundary_curves)
                    if dist_to_edge < boundary_tolerance:
                        # We consider that "off" or "too close" => stop
                        print(f"PSL forward reached boundary.")
                        forward_active = False
                        bridging_line = [
                                forward_line[-1],
                                rg.Point3d(cp)
                            ]
                        bridging_lines.append(bridging_line)


                # If still active, accept the new forward step
                if forward_active:
                    forward_line.append(rg.Point3d(*f_next_pt))
                    f_current_pt = f_next_pt
                    f_current_dir = f_next_dir

        # ---------------------------
        # BACKWARD STEP (if still active)
        # ---------------------------
        if backward_active:
            b_next = runge_kutta_step_3d(
                b_current_pt,
                b_current_dir,
                h,
                k,
                principal_vectors,
                points_3d,
                step_sign=-1,
                kd_tree=kd_tree,
                boundary_curves=boundary_curves,
                boundary_tolerance=boundary_tolerance
            )
            if not b_next or b_next[0] is None:
                print(f"PSL backward direction stopped at iteration {step_i}.")
                backward_active = False
            else:
                b_next_pt, b_next_dir = b_next
                # Collision check with existing PSLs
                if existing_trajectories:
                    line_idx, close_pt, dist_cl = find_closest_existing_line_3d(
                        b_next_pt, existing_trajectories, collision_threshold
                    )
                    if line_idx is not None and close_pt is not None:
                        steps_back = 5
                        if len(backward_line) > steps_back:
                            bridging_line = [
                                backward_line[-steps_back],
                                rg.Point3d(*close_pt)
                            ]
                            bridging_lines.append(bridging_line)
                            del backward_line[-(steps_back-1):]

                        if len(backward_line)==0 or len(backward_line)==1:
                            print("too short for bridge")
                        else:
                            bridging_line = [
                                backward_line[-1],
                                rg.Point3d(*close_pt)
                            ]
                            bridging_lines.append(bridging_line)

                        print(f"PSL backward collided with line {line_idx} at dist {dist_cl:.3f}.")
                        backward_active = False


                if boundary_curves:
                    dist_to_edge,cp = distance_to_brep_edges(b_next_pt, boundary_curves)
                    if dist_to_edge < boundary_tolerance:
                        # We consider that "off" or "too close" => stop
                        print(f"PSL backward reached boundary.")
                        backward_active = False
                        bridging_line = [
                                backward_line[-1],
                                rg.Point3d(cp)
                            ]
                        bridging_lines.append(bridging_line)

                # If still active, accept the new backward step
                if backward_active:
                    backward_line.append(rg.Point3d(*b_next_pt))
                    b_current_pt = b_next_pt
                    b_current_dir = b_next_dir
        
        # ---------------------------
        # Check if BOTH directions are done
        # ---------------------------
        if not forward_active and not backward_active:
            print("Both forward & backward directions inactive => stopping PSL.")
            break

        # ---------------------------
        # TIP DISTANCE CHECK
        # ---------------------------
        # Only if both are still active
        if forward_active and backward_active and step_i >= 10:
            f_xyz = [forward_line[-1].X, forward_line[-1].Y, forward_line[-1].Z]
            b_xyz = [backward_line[-1].X, backward_line[-1].Y, backward_line[-1].Z]
            dist_fb = distance_3d(f_xyz, b_xyz)
            if dist_fb < closing_threshold:
                bridging_line = [
                    forward_line[-1],
                    backward_line[-1]
                ]
                bridging_lines.append(bridging_line)

                print(
                    f"PSL tips meet at iteration {step_i}, dist= {dist_fb:.3f} < {closing_threshold}."
                )
                # Here we might disable both directions or just break:
                forward_active = False
                backward_active = False
                break
    
    # Merge lines
    backward_line.reverse()
    if len(backward_line) > 1:
        backward_line.pop()
    merged_pts = backward_line + forward_line
    
    return merged_pts, bridging_lines


def generate_all_psls_3d(
    initial_seed_3d,
    h, 
    num_steps, 
    k, 
    principal_vectors, 
    points_3d,
    kd_tree,
    boundary_curves,
    collision_threshold,
    sample_interval,
    offset_distance,
    min_seed_distance):
    """
    Generate PSLs using an iterative seeding strategy (3D version).

    1) Trace the initial PSL from initial_seed_3d.
    2) Put that PSL in a queue.
    3) For each PSL in the queue, sample it, offset each sample to find new seeds.
    4) If a new seed is valid, trace a new PSL & add it to the queue.
    
    Returns:
      - all_psls: list of (psl_points, polyline_curve)
      - bridging_lines: short lines merging PSLs
      - positive_candidates: list of seeds that were actually used
    """
    initial_psl, initial_bridges = trace_psl_both_directions(
        seed_point_3d=initial_seed_3d,
        h=h,
        num_steps=num_steps,
        k=k,
        principal_vectors=principal_vectors,
        points_3d=points_3d,
        boundary_curves=boundary_curves,
        boundary_tolerance=0.1,
        existing_trajectories=None,
        collision_threshold=collision_threshold,
        closing_threshold=0.25,  # or some distance
        kd_tree=kd_tree
    )


    # Build polyline curve (3D) for collision checking
    initial_curve = build_polyline_curve_3d(initial_psl)
    all_psls = [(initial_psl, initial_curve)]
    bridging_lines = []
    positive_candidates = []
    if initial_bridges:
        bridging_lines.extend(initial_bridges)
    
    # 2) PSL queue
    psl_queue = [(initial_psl, initial_curve)]
    
    # 3) BFS-like expansion
    while psl_queue:
        
        current_psl, current_curve = psl_queue.pop(0)
        # numeric version
        psl_numeric_3d = [[pt.X, pt.Y, pt.Z] for pt in current_psl]
        
        # Sample
        samples = sample_psl_3d(current_psl, sample_interval)  # returns ( [x,y,z], index )
        
        # For each sample, offset in 3D
        for sample_pt_3d, orig_index in samples:
            cand1, cand2 = offset_seed(psl_numeric_3d, orig_index, offset_distance, domain_surface)
            if not cand1 or not cand2:
                continue  # offset failed or degenerate tangent
            
            # We'll try both
            candidates_3d = [cand1, cand2]
            
            traced_this_sample = False
            for candidate_3d in candidates_3d:
                # Check if candidate is valid:
                #   1) at least min_seed_distance from existing PSL
                if not is_valid_seed(candidate_3d, all_psls, min_seed_distance,boundary_curves, boundary_tolerance=0.1):
                    continue
                # #   2) on or within boundary surface (if you want)
                # if not rs.IsPointOnSurface(domain_surface, candidate_3d):
                #     continue
                
                # We have a new seed
                print("Candidate seed found:", candidate_3d)
                positive_candidates.append(candidate_3d)
                
                # Trace a new PSL
                new_psl, new_bridges = trace_psl_both_directions(
                    seed_point_3d=candidate_3d,
                    h=h,
                    num_steps=num_steps,
                    k=k,
                    principal_vectors=principal_vectors,
                    points_3d=points_3d,
                    boundary_curves=boundary_curves,
                    boundary_tolerance=0.1,
                    existing_trajectories=all_psls,
                    collision_threshold=collision_threshold,
                    closing_threshold=0.2,  # or some distance
                    kd_tree=kd_tree
                )
                new_curve = build_polyline_curve_3d(new_psl)
                
                # Add to collection
                all_psls.append((new_psl, new_curve))
                psl_queue.append((new_psl, new_curve))
                if new_bridges:
                    bridging_lines.extend(new_bridges)
                
                traced_this_sample = True
                # If you only want one PSL from this sample, break here
                break
    
    return all_psls, bridging_lines, positive_candidates


# --- Example Main Routine in Grasshopper ---
def to_xyz(pt_or_vec):
    """Converts Rhino.Geometry.Point3d or Vector3d (or numeric [x,y,z]) to a Python list [x, y, z]."""
    if hasattr(pt_or_vec, "X"):
        return [pt_or_vec.X, pt_or_vec.Y, pt_or_vec.Z]
    else:
        # Already [x,y,z]
        return [pt_or_vec[0], pt_or_vec[1], pt_or_vec[2]]

# Suppose 'points' is a list of 3D points from Grasshopper input,
# and 'principal_vectors' is a matching list of 3D vectors.
# We'll build a KDTree in 3D:
points_array_3d = [to_xyz(pt) for pt in points]
points_np = np.array(points_array_3d)  # shape (N, 3)
kd_tree = KDTree(points_np)

# If your 'seed_points' input is also 3D, pick the first as initial:
initial_seed_3d = to_xyz(seed_points[0])

# Convert principal_vectors to [vx,vy,vz]
principal_vectors_3d = [to_xyz(vec) for vec in principal_vectors]

# We'll store the domain surface or Brep for offset + boundary checks
# If you are passing a Rhino surface or a single-face Brep from GH, you can just keep it:
domain_srf_or_brep = domain_surface

boundary_curves = boundary_curves

# Parameters (exposed as GH inputs or hard-coded here)
h = 0.1
num_steps = 300
k = 25
collision_threshold = 0.5
sample_interval = 3
offset_distance = 2
min_seed_distance = 1.5

# ----------------------------------------------------------------------
# CALL YOUR 3D PSL GENERATION FUNCTION
# ----------------------------------------------------------------------
all_psls, bridging_lines, positive_candidates = generate_all_psls_3d(
    initial_seed_3d,
    h,
    num_steps,
    k,
    principal_vectors_3d,   # 3D vectors
    points_array_3d,        # 3D points
    kd_tree,
    boundary_curves,
    collision_threshold,
    sample_interval,
    offset_distance,
    min_seed_distance
)

# `all_psls` is a list of (psl_points_3d, polyline_curve_3d)
# bridging_lines is a list of short bridging segments
# positive_candidates is a list of 3D seed coords that were actually used

# ----------------------------------------------------------------------
# PREPARE OUTPUTS FOR GH
# ----------------------------------------------------------------------
# 1) PSL polylines as GH curves
psl_curves = [psl_curve for (psl_points, psl_curve) in all_psls]

# 2) Bridging lines. If each bridging_line is [ptA, ptB], you might convert to GH lines or polylines
# For simplicity we just pass them out as is, or build lines:
# bridging_line_curves = []
# for bl in bridging_lines:
#     ptA, ptB = bl
#     bridging_line_curves.append(rg.Line(rg.Point3d(*ptA), rg.Point3d(*ptB)))

# 3) Convert positive_candidates to Point3d
generated_seed_points = [rg.Point3d(pc[0], pc[1], pc[2]) for pc in positive_candidates]
from ghpythonlib import treehelpers as tr
# 4) Finally set GH outputs (A, B, C, e.g.)
a = tr.list_to_tree(psl_curves)
b = tr.list_to_tree(bridging_lines)
w = tr.list_to_tree(generated_seed_points)
# ---------- end tracer_automatic_3d_self_single_loop ----------
sort = SortList(Keys=len_9, ValuesA=inlays_1)  # -> Keys, ValuesA
cull_i_11 = CullIndex(List=reverse(sort.ValuesA), Indices=0, Wrap=True)
pline = PolyLine(Vertices=tracer_automatic_3d_self_single_loop.b, Closed=False)  # -> flatten(Polyline)
generated_seeds = Point(tracer_automatic_3d_self_single_loop.w)
pline_2 = PolyLine(Vertices=tracer_manual_3d_self.b, Closed=False)  # -> flatten(Polyline)
crv_35 = Curve(tracer_manual_3d_self.a)
psl = Curve(tracer_automatic_3d_self_single_loop.a)
explode_7 = Explode(Curve=pline_2, Recursive=True)  # -> Segments, Vertices
explode_8 = Explode(Curve=psl, Recursive=True)  # -> Segments, Vertices
join_9 = JoinCurves(Curves=explode_7.Segments, Preserve=False)  # -> flatten(Curves)
join_10 = JoinCurves(Curves=explode_8.Segments, Preserve=False)  # -> flatten(Curves)
join_11 = JoinCurves(Curves=flatten([crv_35, pline_2]), Preserve=False)
join_12 = JoinCurves(Curves=join_9, Preserve=False)
join_13 = JoinCurves(Curves=flatten([join_11, join_12]), Preserve=False)
project_2 = Project(Curve=inlays_1, Brep=srf_7, Direction=Vector(0, 0, 1))  # -> flatten(Curve); disabled
join_14 = JoinCurves(Curves=project_2, Preserve=False)  # disabled
len_10 = Length(Curve=join_14)  # disabled
smaller_5 = SmallerThan(FirstNumber=len_10, SecondNumber=panel_10)  # -> SmallerThan, OrEqualTo; disabled
cull_8 = CullPattern(List=join_14, CullPattern=invert(smaller_5.SmallerThan))  # disabled
explode_9 = Explode(Curve=cull_8, Recursive=True)  # -> Segments, Vertices; disabled
intcrv = Interpolate(Vertices=explode_9.Vertices, Degree=3, Periodic=False, KnotStyle=1)  # -> reparameterize(flatten(Curve)), Length, Domain; disabled
curvepoint = PointOnCurve(intcrv.Curve, parameter=0.022)  # disabled
curvepoint_2 = PointOnCurve(intcrv.Curve, parameter=0.979)  # disabled
crv_cp_5 = CurveClosestPoint(Point=curvepoint, Curve=intcrv.Curve)  # -> Point, Parameter, Distance; disabled
crv_cp_6 = CurveClosestPoint(Point=curvepoint_2, Curve=intcrv.Curve)  # -> Point, Parameter, Distance; disabled
merge_3 = Merge(Data1=graft(crv_cp_5.Parameter), Data2=graft(crv_cp_6.Parameter))  # disabled
shatter_7 = Shatter(Curve=intcrv.Curve, Parameters=merge_3)  # disabled
cull_i_12 = CullIndex(List=shatter_7, Indices=[-1, 0], Wrap=True)  # disabled
ext = ExtendCurve(Curve=cull_i_12, Type=0, Start=panel_11, End=panel_11)  # -> simplify(Curve); disabled
trim = TrimTree(Tree=ext, Depth=1)  # disabled
join_15 = JoinCurves(Curves=trim, Preserve=False)  # disabled
bang_8 = ExplodeTree(Data=join_15)  # -> Branch0, Branch1; disabled
ccx = CurveCurve(CurveA=crv_25, CurveB=bang_8.Branch0)  # -> Points, ParamsA, ParamsB; disabled
crv_36 = Curve(bang_8.Branch0)  # disabled
shatter_8 = Shatter(Curve=graft(crv_36), Parameters=ccx.ParamsB)  # disabled
item_11 = ListItem(List=shatter_8, Index=1, Wrap=True)  # disabled
join_16 = JoinCurves(Curves=item_11, Preserve=False)  # -> flatten(Curves); disabled
qrmesh_5 = QuadRemesh(Geometry=input_mesh_4, Guides=join_16, Settings=qrsettings_4)  # disabled

# ----
# Fix mesh
mesh_13 = Mesh(qrmesh_5)
srf_10 = Surface(srf_7)
nv_13 = NakedVertices(Mesh=mesh_13)  # -> ClothedIndex, NakedIndex, ClothedPts, NakedPts
demesh_8 = DeconstructMesh(Mesh=mesh_13)  # -> Vertices, Faces, Colours, Normals
disc_7 = Discontinuity(Curve=srf_10, Level=1)  # -> Points, Parameters
cp_3 = ClosestPoint(Point=disc_7.Points, Cloud=nv_13.NakedPts)  # -> ClosestPoint, CPIndex, Distance
item_12 = ListItem(List=nv_13.NakedIndex, Index=cp_3.CPIndex, Wrap=True)
replace_2 = ReplaceItems(List=demesh_8.Vertices, Item=disc_7.Points, Indices=item_12, Wrap=False)
conmesh_2 = ConstructMesh(Vertices=replace_2, Faces=demesh_8.Faces)

cull_i_13 = CullIndex(List=join_16, Indices=[0, 10], Wrap=True)
crv_37 = Curve(graft(join_16))
crv_38 = Curve(join_16)  # disabled
end_2 = EndPoints(Curve=crv_38)  # -> Start, End; disabled
suppt = SupportPoint(
    Point=flatten([end_2.Start, end_2.End]),
    DispX=True,
    DispY=True,
    DispZ=True,
    Rotation=False,
    Torsion=False,
    TryStrongSupport=True)  # disabled
merge_4 = Merge(Data1=suppt, Data2=supcrv_2)  # disabled
amodel_2 = AnalysisModel(
    Analysis=lina,
    StructuralElements=flatten(merge_2),
    Supports=merge_4,
    Loads=srfload,
    IntersectionTolerance=0.001,
    IsCarat=True,
    IsKratos=False,
    PenaltyFac=10000000,
    ShowCouplingIDs=False,
    ShowEdgeIDs=False,
    ShowGeo=True,
    ShowPatchIDs=True,
    ShowPrePro=True,
    ShowRef=False,
    mUsedVersion="BETA 0.6.0")  # disabled
analysis_completed_2 = IGASolver(AnalysisModel=amodel_2, Run=toggle_4, antiFreeze=False, showWindow=True)  # -> ResultModel, ErrorReport; disabled
defmod_2 = DeformedModel(Model=analysis_completed_2.ResultModel, ScaleFactor=1, FlyingNodeLimit=100000)  # -> Model, Geo, DeformedStructuralElements; disabled
member = Member(GHLine=flatten(crv_37), SectionStart=section, SectionEnd=section, MemberType=list_15, mode="Assemble")  # disabled
rfem_export = RFEM6ExportComponent(
    Run=toggle_10,
    Input=flatten([surface, thickness, material, line_support, load_case, static_analysis_settings, surface_load, member, section, material_2, material_characteristics]),
    Units=list_16,
    Overwrite=toggle_9)  # -> RFEMData, Log, SuccessfulExport; disabled

loads_14 = LoadsKaramba3D(Vector=Z_4, Mesh=mesh_8, LCase="LC0", mode="MeshLoad -Const.", menu=[buttons(off, on, off), buttons(on, on)])
surfelem_4 = CreateSurfaceElementKaramba3D(Mesh=mesh_9, CrossSection=crosec_5, LimitDistance_m=0.005, Bending=True, mode="MeshToShell")  # -> Element, Points, Info
load_8 = LoadKaramba3D(flatten([loads_10, loads_14]))
assemble_4 = AssembleModelKaramba3D(Elem=flatten(surfelem_4.Element), Support=flatten(supp_3), Load=flatten(load_8), LimitDistance_cm=0.0001)  # -> Model, Info, Mass_kg, CentreOfGravity, LoadCaseNames

analysethii_4 = AnalyseThIIKaramba3D(
    Model=assemble_4.Model,
    UseInitialNII=True,
    NIIFromCombination=True,
    NoTensionalNII=False,
    RTolerance=1e-07,
    MaxIterations=50)  # -> AnalysedModel, MaximumDisplacement_cm, ResultingForce_kN, ChangeOfElasticEnergy_kNm

modelview_4 = ModelViewKaramba3D(Model=analysethii_4.AnalysedModel)  # -> Model, DeformedMesh, DeformedAxes, DeformedModel, MaximumDeformation
shellview_5 = ShellViewKaramba3D(Model=modelview_4.Model, IndexOfLayer=0)  # -> Model, MeshesOfRenderedShells, LegendColours, LegendTags
legend_4 = Legend(Colour=shellview_5.LegendColours, Tags=shellview_5.LegendTags, Rectangle=rec_2, LegendType=101)
shelllineresults_7 = LineResultsOnShellsKaramba3D(
    AnalysedModel=shellview_5.Model,
    LayerPosition=-1,
    ListOfSourcesOfPrincipalStressLinesLinesPoints=cull_i,
    SegmentLength_m=0.02,
    DA_deg=5,
    mode="PrincStress")  # -> Model, Lines1, Lines2

react_2 = ReactionForcesKaramba3D(AnalysedModel=modelview_4.Model)  # -> Model, flatten(ReactionForces_kN), ReactionMoments_kNm, SupportPosition, SumOfReactionForces_kN, SumOfReactionMoments_kNm, GoverningLoadCaseIndex
denergy_2 = DeformationEnergyKaramba3D(AnalysedModel=shellview_5.Model, NIntervals=2)  # -> AnalysedModel, flatten(AxialDeformationEnergies_kNm), AxialDeformationEnergiesLoadCaseIndexes, flatten(BendingEnergies_kNm), BendingEnergiesLoadCaseIndexes
shellview_6 = ShellViewKaramba3D(Model=modelview_4.Model, IndexOfLayer=0)  # -> Model, MeshesOfRenderedShells, LegendColours, LegendTags
ma_3 = MassAddition(Input=denergy_2.AxialDeformationEnergies_kNm)  # -> Result, PartialResults

nv_14 = NakedVertices(Mesh=mesh_11)  # -> ClothedIndex, NakedIndex, ClothedPts, NakedPts; disabled
supp_5 = SupportKaramba3D(PosInd=nv_14.NakedPts, menu=[buttons(on, on, on, off, off, on)])  # disabled
loads_15 = LoadsKaramba3D(Vector=Z_5, Mesh=mesh_11, LCase="LC0", mode="MeshLoad -Const.", menu=[buttons(off, on, off), buttons(on, on)])  # disabled
surfelem_5 = CreateSurfaceElementKaramba3D(Mesh=mesh_11, CrossSection=crosec_6, LimitDistance_m=0.005, Bending=True, mode="MeshToShell")  # -> Element, Points, Info; disabled
load_9 = LoadKaramba3D(flatten([loads_11, loads_15]))  # disabled
assemble_5 = AssembleModelKaramba3D(Elem=flatten(surfelem_5.Element), Support=flatten(supp_5), Load=flatten(load_9), LimitDistance_cm=0.0001)  # -> Model, Info, Mass_kg, CentreOfGravity, LoadCaseNames; disabled

analysethii_5 = AnalyseThIIKaramba3D(
    Model=assemble_5.Model,
    UseInitialNII=True,
    NIIFromCombination=True,
    NoTensionalNII=False,
    RTolerance=1e-07,
    MaxIterations=50)  # -> AnalysedModel, MaximumDisplacement_cm, ResultingForce_kN, ChangeOfElasticEnergy_kNm; disabled

modelview_5 = ModelViewKaramba3D(Model=analysethii_5.AnalysedModel)  # -> Model, DeformedMesh, DeformedAxes, DeformedModel, MaximumDeformation; disabled
shellview_7 = ShellViewKaramba3D(Model=modelview_5.Model, IndexOfLayer=0)  # -> Model, MeshesOfRenderedShells, LegendColours, LegendTags; disabled
legend_5 = Legend(Colour=shellview_7.LegendColours, Tags=shellview_7.LegendTags, Rectangle=rec_3, LegendType=101)  # disabled

shelllineresults_8 = LineResultsOnShellsKaramba3D(
    AnalysedModel=shellview_7.Model,
    LayerPosition=panel_7,
    ListOfSourcesOfPrincipalStressLinesLinesPoints=popgeo_5,
    SegmentLength_m=0.5,
    DA_deg=5,
    mode="PrincStress")  # -> Model, Lines1, Lines2; disabled
crv_39 = Curve(shelllineresults_8.Lines1)  # disabled

input_mesh_7 = Mesh(quad_mesh)  # disabled
medges_8 = MeshEdges(Mesh=input_mesh_7)  # -> NakedEdges, InteriorEdges, NonManifoldEdges; disabled
inner_edges_8 = Curve(flatten(medges_8.InteriorEdges))  # disabled
number_slider_30 = Slider(0.39, range=0..1)  # disabled
number_slider_31 = Slider(10, range=1..10)  # disabled
len_11 = Length(Curve=inner_edges_8)  # disabled
multiplication_10 = Multiplication(A=len_11, B=number_slider_30)  # disabled
length_line_9 = LengthLine(Line=inner_edges_8, Length=multiplication_10, Strength=number_slider_31)  # disabled
anchor_8 = Anchor(Point=pt_3, Strength=1e+10)  # disabled
show_8 = Show(G=input_mesh_7)  # disabled
button_7 = Button()  # disabled
toggle_15 = BooleanToggle(False)  # disabled

outer_edges_2 = Curve(flatten(medges_8.NakedEdges))  # disabled
len_12 = Length(Curve=outer_edges_2)  # disabled
multiplication_11 = Multiplication(A=len_12, B=number_slider_8)  # disabled
length_line_10 = LengthLine(Line=outer_edges_2, Length=multiplication_11, Strength=number_slider_9)  # disabled

entwine_8 = Entwine(Branch00=show_8, Branch01=anchor_8, Branch02=length_line_9, Branch03=length_line_10, FlattenInputs=True)  # disabled
solver_8 = Solver(GoalObjects=entwine_8, Reset=button_7, Threshold=1e-15, Tolerance=0.0001, On=toggle_15)  # -> I, V, O; disabled

bang_9 = ExplodeTree(Data=solver_8.O)  # -> Branch0, Branch1, Branch2, Branch3, Branch4, Branch5; disabled

input_mesh_8 = Mesh(triremesh.Triangulation)  # disabled
medges_9 = MeshEdges(Mesh=input_mesh_8)  # -> NakedEdges, InteriorEdges, NonManifoldEdges; disabled
inner_edges_9 = Curve(flatten(medges_9.InteriorEdges))  # disabled
number_slider_32 = Slider(0.39, range=0..1)  # disabled
number_slider_33 = Slider(10, range=1..10)  # disabled
len_13 = Length(Curve=inner_edges_9)  # disabled
multiplication_12 = Multiplication(A=len_13, B=number_slider_32)  # disabled
length_line_11 = LengthLine(Line=inner_edges_9, Length=multiplication_12, Strength=number_slider_33)  # disabled
anchor_9 = Anchor(Point=pt_4, Strength=1e+10)  # disabled
show_9 = Show(G=input_mesh_8)  # disabled
button_8 = Button()  # disabled
toggle_16 = BooleanToggle(False)  # disabled

outer_edges_3 = Curve(flatten(medges_9.NakedEdges))  # disabled
len_14 = Length(Curve=outer_edges_3)  # disabled
multiplication_13 = Multiplication(A=len_14, B=number_slider_10)  # disabled
length_line_12 = LengthLine(Line=outer_edges_3, Length=multiplication_13, Strength=number_slider_11)  # disabled

entwine_9 = Entwine(Branch00=show_9, Branch01=anchor_9, Branch02=length_line_11, Branch03=length_line_12, FlattenInputs=True)  # disabled
solver_9 = Solver(GoalObjects=entwine_9, Reset=button_8, Threshold=1e-15, Tolerance=0.0001, On=toggle_16)  # -> I, V, O; disabled

bang_10 = ExplodeTree(Data=solver_9.O)  # -> Branch0, Branch1, Branch2, Branch3, Branch4, Branch5; disabled

srf_11 = Surface(reparameterize(<surface referenced from the Rhino model>))
input_mesh_9 = Mesh(qrmesh_5)
crv_40 = Curve(srf_11)
disc_8 = Discontinuity(Curve=crv_40, Level=1)  # -> Points, Parameters
shatter_9 = Shatter(Curve=crv_40, Parameters=disc_8.Parameters)
divide_14 = DivideCurve(Curve=shatter_9, Count=Slider(40, range=0..40), Kinks=False)  # -> Points, Tangents, Parameters
item_13 = ListItem(List=shatter_9, Index=[1, 3], Wrap=True)
medges_10 = MeshEdges(Mesh=input_mesh_9)  # -> NakedEdges, InteriorEdges, NonManifoldEdges
inner_edges_10 = Curve(flatten(medges_10.InteriorEdges))
nv_15 = NakedVertices(Mesh=input_mesh_9)  # -> ClothedIndex, NakedIndex, ClothedPts, NakedPts
len_15 = Length(Curve=inner_edges_10)
multiplication_14 = Multiplication(A=len_15, B=Slider(0.66, range=0..1))
vertexloads_8 = VertexLoads(Mesh=input_mesh_9, Strength=-0.1)  # disabled
anchor_10 = Anchor(Point=nv_15.NakedPts, Strength=1e+10)
length_line_13 = LengthLine(Line=inner_edges_10, Length=multiplication_14, Strength=Slider(10, range=1..10))
show_10 = Show(G=input_mesh_9)

crv_41 = Curve(medges_10.InteriorEdges)
midpt_3 = CurveMiddle(Curve=crv_41)
crv_cp_7 = CurveClosestPoint(Point=midpt_3, Curve=crv_37)  # -> Point, Parameter, Distance
smaller_6 = SmallerThan(FirstNumber=crv_cp_7.Distance, SecondNumber=panel_13)  # -> SmallerThan, OrEqualTo
mesh_lines = CullPattern(List=crv_41, CullPattern=smaller_6.SmallerThan)
cull_9 = CullPattern(List=crv_cp_7.Point, CullPattern=smaller_6.SmallerThan)
bang_11 = ExplodeTree(Data=mesh_lines)  # -> Branch0, Branch1, Branch2, Branch3, Branch4, Branch5, Branch6, Branch7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
entwine_10 = Entwine(
    Branch00=bang_11.Branch0,
    Branch01=bang_11.Branch1,
    Branch02=bang_11.Branch2,
    Branch03=bang_11.Branch3,
    Branch04=bang_11.Branch4,
    Branch05=bang_11.Branch5,
    Branch06=bang_11.Branch6,
    Branch07=bang_11.Branch7,
    Branch08=bang_11.Branch8,
    Branch09=bang_11.Branch9,
    Branch010=bang_11.Branch10,
    Branch011=crv_2_4,
    Branch012=bang_11.Branch12,
    Branch013=bang_11.Branch13,
    Branch014=bang_11.Branch14,
    Branch015=crv_1_3,
    Branch016=crv_3_2,
    Branch017=bang_11.Branch17,
    Branch018=bang_11.Branch18,
    Branch019=bang_11.Branch19,
    FlattenInputs=True)  # -> flatten(Result)
midpt_4 = CurveMiddle(Curve=entwine_10)  # -> graft(Midpoint)
midpt_5 = CurveMiddle(Curve=crv_41)
cp_4 = ClosestPoint(Point=midpt_4, Cloud=midpt_5)  # -> ClosestPoint, flatten(CPIndex), Distance
len_16 = Length(Curve=entwine_10)
len_17 = Length(Curve=entwine_10)  # disabled
multiplication_15 = Multiplication(A=len_16, B=Slider(0.16, range=0..1))
length_line_14 = LengthLine(Line=entwine_10, Length=multiplication_15, Strength=Slider(40, range=0..40))

entwine_11 = Entwine(
    Branch00=show_10,
    Branch01=anchor_10,
    Branch02=length_line_13,
    Branch03=length_line_14,
    Branch04=vertexloads_8,
    FlattenInputs=True)
solver_10 = Solver(GoalObjects=entwine_11, Reset=Button(), Threshold=1e-15, Tolerance=0.0001, On=Toggle(False))  # -> I, V, O

bang_12 = ExplodeTree(Data=solver_10.O)  # -> Branch0, Branch1, Branch2, Branch3, Branch4, Branch5
medges_11 = MeshEdges(Mesh=bang_12.Branch0)  # -> NakedEdges, InteriorEdges, NonManifoldEdges
mesh_14 = Mesh(bang_12.Branch0)
item_14 = ListItem(List=medges_11.InteriorEdges, Index=cp_4.CPIndex, Wrap=True)
join_17 = JoinCurves(Curves=item_14, Preserve=False)  # disabled
nv_16 = NakedVertices(Mesh=mesh_14)  # -> ClothedIndex, NakedIndex, ClothedPts, NakedPts; disabled
supp_6 = SupportKaramba3D(PosInd=nv_16.NakedPts, Ct_kN_m=Vector(0, 0, 0), Cr_kNm_rad=Vector(0, 0, 0), menu=[buttons(on, on, on, off, off, off)])  # disabled
loads_16 = LoadsKaramba3D(Vector=Z_2, Mesh=mesh_14, LCase="LC0", mode="MeshLoad -Const.", menu=[buttons(off, on, off), buttons(on, on)])  # disabled
lineelem = CreateLinearElementKaramba3D(
    Line=item_14,
    Identifier=panel_46,
    CrossSection=crosec,
    LimitDistance_m=0.005,
    BucklingLengthY_m=-1,
    BucklingLengthZ_m=-1,
    BucklingLengthLT_m=-1,
    Bending=False,
    ToPolylineMaxAngle=0.25,
    ToPolylineTolerance=0.1,
    ToPolylineMaxEdgeLength=0.25,
    New=True,
    Remove=True,
    mode="LineToTruss")  # -> Element, Points, Info; disabled
surfelem_6 = CreateSurfaceElementKaramba3D(Mesh=mesh_14, Identifier=panel_49, CrossSection=crosec_2, LimitDistance_m=0.005, Bending=False, mode="MeshToMembrane")  # -> Element, Points, Info; disabled
assemble_6 = AssembleModelKaramba3D(
    Elem=flatten([lineelem.Element, surfelem_6.Element]),
    Support=flatten(supp_6),
    Load=flatten([loads_2, loads, loads_16, loads_3]),
    LimitDistance_cm=0.005)  # -> Model, Info, Mass_kg, CentreOfGravity, LoadCaseNames; disabled
analysethii_6 = AnalyseThIIKaramba3D(
    Model=assemble_6.Model,
    UseInitialNII=True,
    NIIFromCombination=True,
    NoTensionalNII=False,
    RTolerance=1e-07,
    MaxIterations=50)  # -> AnalysedModel, MaximumDisplacement_cm, ResultingForce_kN, ChangeOfElasticEnergy_kNm; disabled
emodes = EigenModesKaramba3D(
    Model=analysethii_6.AnalysedModel,
    FromIndex=1,
    NumberOfModes=1,
    WithThIIEffects=True,
    MaximumNumberOfIterations=300,
    Epsilon=1e-07)  # -> ModelWithEigenModes, Eigenvalues; disabled
modelview_6 = ModelViewKaramba3D(Model=analysethii_6.AnalysedModel)  # -> Model, DeformedMesh, DeformedAxes, DeformedModel, MaximumDeformation; disabled
beamview = BeamViewKaramba3D(Model=modelview_6.Model)  # -> Model, MeshesOfRenderedBeams, DeformedBeamAxes, LegendColours, LegendTags; disabled
legend_6 = Legend(Colour=beamview.LegendColours, Tags=beamview.LegendTags, LegendType=1)  # disabled

srf_12 = Surface(reparameterize(<surface referenced from the Rhino model>))  # disabled
# Formfinding with inlays (Kangaroo)
input_mesh_10 = Mesh(qrmesh_5)  # disabled
crv_42 = Curve(srf_12)  # disabled
disc_9 = Discontinuity(Curve=crv_42, Level=1)  # -> Points, Parameters; disabled
number_slider_34 = Slider(40, range=0..40)  # disabled
shatter_10 = Shatter(Curve=crv_42, Parameters=disc_9.Parameters)  # disabled
divide_15 = DivideCurve(Curve=shatter_10, Count=number_slider_34, Kinks=False)  # -> Points, Tangents, Parameters; disabled
item_15 = ListItem(List=shatter_10, Index=[1, 3], Wrap=True)  # disabled
medges_12 = MeshEdges(Mesh=input_mesh_10)  # -> NakedEdges, InteriorEdges, NonManifoldEdges; disabled
number_slider_35 = Slider(0.36, range=0..1)  # disabled
number_slider_36 = Slider(27, range=0..40)  # disabled
number_slider_37 = Slider(0.73, range=0..1)  # disabled
inner_edges_11 = Curve(flatten(medges_12.InteriorEdges))  # disabled
number_slider_38 = Slider(8, range=1..10)  # disabled
nv_17 = NakedVertices(Mesh=input_mesh_10)  # -> ClothedIndex, NakedIndex, ClothedPts, NakedPts; disabled
len_18 = Length(Curve=inner_edges_11)  # disabled
multiplication_16 = Multiplication(A=len_18, B=number_slider_37)  # disabled
vertexloads_9 = VertexLoads(Mesh=input_mesh_10, Strength=-0.1)  # disabled
anchor_11 = Anchor(Point=nv_17.NakedPts, Strength=1e+10)  # disabled
length_line_15 = LengthLine(Line=inner_edges_11, Length=multiplication_16, Strength=number_slider_38)  # disabled
show_11 = Show(G=input_mesh_10)  # disabled
button_9 = Button()  # disabled
toggle_17 = BooleanToggle(True)  # disabled

multiplication_17 = Multiplication(A=len_17, B=number_slider_35)  # disabled
length_line_16 = LengthLine(Line=entwine_10, Length=multiplication_17, Strength=number_slider_36)  # disabled

entwine_12 = Entwine(
    Branch00=show_11,
    Branch01=anchor_11,
    Branch02=length_line_15,
    Branch03=length_line_16,
    Branch04=vertexloads_9,
    FlattenInputs=True)  # disabled
solver_11 = Solver(GoalObjects=entwine_12, Reset=button_9, Threshold=1e-15, Tolerance=0.0001, On=toggle_17)  # -> I, V, O; disabled

bang_13 = ExplodeTree(Data=solver_11.O)  # -> Branch0, Branch1, Branch2, Branch3, Branch4, Branch5; disabled
